# Grasshopper definition Physics.gh (Grasshopper 1.0.7)
# plug-ins: SpacePartition, Human, PTComponentLibrary, Kangaroo2 Components, TT Toolbox

# ---- group: CustomContour
c_script = CSharpScript()  # -> indexPattern; inputs curveTree: tree of Curve; disabled
# ---------- c_script: C# ----------
    double maxZ = 0.0, minZ = 0.0;

    List<int> indexes = new List<int>();

    int branches = curveTree.BranchCount;

    indexes.Add(0);

    for( int i = 0; i < branches - 1; ++i )
    {

      maxZ = AreaMassProperties.Compute(curveTree.Branch(i)[curveTree.Branch(i).Count - 1]).Centroid.Z;

      minZ = AreaMassProperties.Compute(curveTree.Branch(i + 1)[curveTree.Branch(i).Count - 1]).Centroid.Z;

      for( int j = 0; j < curveTree.Branch(i).Count; ++j )
      {

        double Z = AreaMassProperties.Compute(curveTree.Branch(i)[j]).Centroid.Z;

        if( Z <= maxZ && Z >= minZ || Z == maxZ || Z == minZ )
        {

          indexes.Add(j);

        }

      }

    }

    maxZ = AreaMassProperties.Compute(curveTree.Branch(branches - 1)[curveTree.Branch(branches - 1).Count - 1]).Centroid.Z;
    minZ = AreaMassProperties.Compute(curveTree.Branch(branches - 2)[curveTree.Branch(branches - 2).Count - 1]).Centroid.Z;

    for( int i = 0; i < curveTree.Branch(branches - 1).Count; ++i )
    {

      double Z = AreaMassProperties.Compute(curveTree.Branch(branches - 1)[i]).Centroid.Z;

      if( Z <= maxZ && Z >= minZ && i == curveTree.Branch(branches - 1).Count - 1 )
      {

        indexes.Add(i);

      }

    }

    int fromI = 0, toI = 1;

    DataTree<int> dataOut = new DataTree<int>();
    int pather = 0;

    int countIndexes = indexes.Count, tempoCount = 0;

    for( int i = 2; i < countIndexes; ++i )
    {

      tempoCount++;

    }


    countIndexes += tempoCount;

    indexPattern = countIndexes;

    for( int i = 0; i < countIndexes; ++i )
    {

      var path = new GH_Path(pather);

      if( i % 2 == 0 )
      {

        dataOut.Add(indexes[fromI], path);
        dataOut.Add(indexes[toI], path);
        fromI++;
        toI++;
        pather++;

      }

    }
/*
    for( int i = 0; i < dataOut.BranchCount; ++i )
    {

      for( int j = 0; j < 2; ++j )
      {

        if( i % 2 != 1 && j % 2 != 0 )
        {

          dataOut.Branch(i)[j]--;

        }

      }

    }*/

    indexPattern = dataOut;
# ---------- end c_script ----------
c_script_2 = CSharpScript(dataOut=c_script)  # -> sortedTree, sortedPlanes; inputs curveTree: tree of Curve, frameTree: tree of Plane, dataOut: tree of Int32; disabled
# ---------- c_script_2: C# ----------
    var treeOut = new DataTree<Curve>();
    var planes = new DataTree<Plane>();

    int branches = curveTree.BranchCount;

    int tracker = 0;

    var pathy = new GH_Path();

    int tempo = 0, tempoMax = 0, tempoPlane = 0;

    for( int i = 0; i < branches; ++i )
    {

      for( int k = 0; k < branches; ++k )
      {

        pathy = new GH_Path(k);

        tempo = dataOut.Branch(k)[0];

        tempoMax = dataOut.Branch(k)[1];
        
        //if( tempo != tempoMax ) 

        for( int j = tempo; j < tempoMax + 1; ++j )
        {

          if( k != 0 )
          {

            if( i > tracker )
            {

              treeOut.Add(curveTree.Branch(i)[j], pathy);

            }

          }

          else
          {

            treeOut.Add(curveTree.Branch(i)[j], pathy);

          }

          tracker = k - 1;

        }

      }

      tempoPlane = dataOut.Branch(i)[0];

      /*if( i != 0 )

        tempoPlane++;*/

      for( int j = tempoPlane; j < dataOut.Branch(i)[1] + 1; ++j )
      {

        planes.Add(frameTree.Branch(i)[j], new GH_Path(i));

      }

    }

    sortedTree = treeOut;
    sortedPlanes = planes;
# ---------- end c_script_2 ----------
number_slider = Slider(0, range=0..100)  # disabled
number_slider_2 = Slider(0, range=0..100)  # disabled
cull_i = CullIndex(List=c_script_2.sortedTree, Indices=number_slider_2, Wrap=True)  # -> simplify(List); disabled
cull_i_2 = CullIndex(List=c_script_2.sortedPlanes, Indices=number_slider_2, Wrap=True)  # -> simplify(List); disabled
runion = RegionUnion(Curves=cull_i, Plane=cull_i_2)  # disabled

# ---- group: CustomPointsOutsideCurve
number_slider_3 = Slider(58, range=0..100)  # disabled
sdivide = DivideSurface(UCount=number_slider_3, VCount=number_slider_3)  # -> simplify(Points), Normals, Parameters; disabled
flatten = FlattenTree(Tree=sdivide.Points, Path="{0}")  # disabled
inside = PointWithinCurve(pts=sdivide.Points)  # -> simplify(B); inputs pts: list of Point3d, crv: list of Polyline; disabled
# ---------- inside: C# usings ----------
using System.IO;
using System.Linq;
using System.Data;
using System.Drawing;
using System.Reflection;
using System.Windows.Forms;
using System.Xml;
using System.Xml.Linq;
using System.Runtime.InteropServices;

using Rhino.DocObjects;
using Rhino.Collections;
using GH_IO;
using GH_IO.Serialization;
# ---------- inside: C# ----------
    var outside = new DataTree<Point3d>(); //Outside(pts, crv);

    var temp = Outside( pts, crv[0] );
    
    foreach( var item in temp )
    {
      
      outside.Add( item, new GH_Path(0) );
    
    }
    /*
    temp = Outside(outside.Branch(0), crv[1]);
    
    foreach( var item in temp )
    {
      
      outside.Add( item, new GH_Path(1) );
    
    }
    
    temp = Outside(outside.Branch(1), crv[2]);*/
    
    for( int i = 1; i < crv.Count; ++i )
    {
   
      foreach( var item in temp )
      {
      
        outside.Add(item, new GH_Path(i));
    
      }
    
      temp = Outside( outside.Branch(i), crv[i] );
      
    }
    
    B = temp;
# ---------- inside: C# additional code ----------
  System.Collections.Concurrent.ConcurrentBag<Point3d> Outside(List<Point3d> pts, Polyline crv)
  {

    var outside = new System.Collections.Concurrent.ConcurrentBag<Point3d>();
    System.Threading.Tasks.Parallel.ForEach(pts, pt =>
      {
      if(!IsInside(pt, crv))
      {
        outside.Add(pt);
      }
      });

    return outside;

  }

  bool IsInside (Point3d pt, Polyline crv)
  {
    Point3d pt1, pt2;
    bool oddNodes = false;

    for (int i = 0; i < crv.SegmentCount; i++) //for each contour line
    {

      pt1 = crv.SegmentAt(i).From; //get start and end pt
      pt2 = crv.SegmentAt(i).To;

      if ( (pt1[1] < pt[1] && pt2[1] >= pt[1] || pt2[1] < pt[1] && pt1[1] >= pt[1]) && (pt1[0] <= pt[0] || pt2[0] <= pt[0]) ) //if pt is between pts in y, and either of pts is before pt in x
        oddNodes ^= ( pt2[0] + (pt[1] - pt2[1]) * (pt1[0] - pt2[0]) / (pt1[1] - pt2[1]) < pt[0] ); //^= is xor
      //end.X + (pt-end).Y   * (start-end).X  /(start-end).Y   <   pt.X
    }


    if (!oddNodes)
    {
      double minDist = 1e10;
      for (int i = 0; i < crv.SegmentCount; i++) {
        Point3d cp = crv.SegmentAt(i).ClosestPoint(pt, true);
        //Point3d cp = mvContour[i].closestPoint(pt);
        //minDist = min(minDist, cp.distance(pt));
        minDist = Math.Min(minDist, cp.DistanceTo(pt));
      }
      if (minDist < 1e-10)
        return true;
    }

    if(oddNodes) return true;

    return false;
  }
# ---------- end inside ----------

# ----
crv = Curve([<curve referenced from the Rhino model> x5])
area = Area(Geometry=crv, UseTasks=False)  # -> Area, Centroid
ma = MassAddition(Input=area.Area)  # -> Result, PartialResults
multiplication = Multiplication(A=ma.Result, B=Slider(1, range=1..23))
division = Division(A=Slider(2863.08, range=0..10000), B=5)
multiplication_2 = Multiplication()

# ---- group: AreaVentas
multiplication_3 = Multiplication(A=division, B=Slider(8, range=1..23))

# ----
division_2 = Division(A=Slider(22904.62, range=0..100000), B=multiplication_3)
multiplication_4 = Multiplication(B=8)
multiplication_5 = Multiplication(A=Slider(25, range=0..100), B=Slider(173, range=0..1000))
multiplication_6 = Multiplication(A=multiplication_5, B=0.5)
panel = Panel(multiplication_3)

# ---- group: NumberOfBuildings
number_slider_4 = Slider(5, range=0..10)

# ----
addition = Addition(A=Slider(2863.08, range=0..10000), B=multiplication_6)
panel_2 = Panel(division_2)
subtraction = Subtraction(A=Slider(9543.59, range=0..10000), B=addition)

# ---- group: SeedPoints
dom = ConstructDomain(DomainStart=0, DomainEnd=1)
txt = Text("X")
txt_2 = Text("Y")
genemodifier = GenePoolModifier(GeneList=txt, Count=number_slider_4, Domain=dom, Randomize=Button(), PercentageOfRandomization=Slider(1, range=0..1))
genemodifier_2 = GenePoolModifier(GeneList=txt_2, Count=number_slider_4, Domain=dom, Randomize=Button(), PercentageOfRandomization=Slider(1, range=0..1))
Y = GenePool(Decimals=2, Maximum=1, Minimum=0, Value=[0.18, 0.87, 0.66, 0.57, 0.78])
X = GenePool(Decimals=2, Maximum=1, Minimum=0, Value=[0.92, 0.2, 0.28, 0.83, 0.4])
crv_2 = Curve(<curve referenced from the Rhino model>)
pt = ConstructPoint(XCoordinate=X, YCoordinate=Y, ZCoordinate=0)
area_2 = Area(Geometry=crv_2, UseTasks=False)  # -> Area, Centroid
srf = Surface(crv_2)
scale = Scale(Geometry=srf, Center=area_2.Centroid, Factor=Slider(1, range=0..10))  # -> Geometry, Transform
evalsrf = EvaluateSurface(Surface=reparameterize(scale.Geometry), Point=pt)  # -> Point, Normal, UDirection, VDirection, Frame
srf_cp = SurfaceClosestPoint(Point=evalsrf.Point, Surface=scale.Geometry)  # -> Point, UVPoint, Distance
pt_2 = Point(srf_cp.Point)

# ---- group: DifferentialHeights
txt_3 = Text("Z")
dom_2 = ConstructDomain(DomainStart=Slider(5, range=0..10), DomainEnd=Slider(9, range=0..10))
genemodifier_3 = GenePoolModifier(GeneList=txt_3, Count=number_slider_4, Domain=dom_2, Randomize=Button(), PercentageOfRandomization=Slider(1, range=0..1))
Z = GenePool(Decimals=0, Maximum=9, Minimum=5, Value=[5, 8, 7, 7, 8])
number_slider_5 = Slider(2.4, range=0..10)
sort = SortList(Keys=Z, ValuesA=Z)  # -> Keys, ValuesA
series = Series(Start=0, Step=number_slider_5, Count=sort.ValuesA)
multiplication_7 = Multiplication(A=number_slider_5, B=sort.ValuesA)
Z_2 = UnitZ(Factor=series)
multiplication_8 = Multiplication(A=multiplication_7, B=Slider(0.1, range=0..1))
multiplication_9 = Multiplication(A=multiplication_7, B=Slider(0.3333, range=0..1))

# ----
number_slider_6 = Slider(0.3535, range=0..1)
number_slider_7 = Slider(0.9, range=0.8..1.2)
panel_3 = Panel(multiplication_8)
number_slider_8 = Slider(90, range=0..90)  # disabled
number_slider_9 = Slider(0.001, range=0..0.001)  # disabled
rad = Radians(Degrees=number_slider_8)  # disabled
toggle = BooleanToggle(True)  # disabled
button = Button()  # disabled
number_slider_10 = Slider(0, range=0..10)  # disabled
number_slider_11 = Slider(100, range=0..100)  # disabled
Y_2 = UnitY(Factor=number_slider_11)  # disabled
number_slider_12 = Slider(0, range=0..1)  # disabled
toggle_2 = BooleanToggle(False)  # disabled
button_2 = Button()  # disabled
number_slider_13 = Slider(33, range=0..100)  # disabled
number_slider_14 = Slider(9, range=0..100)  # disabled
path = ConstructPath(Indices=number_slider_14)  # disabled
number_slider_15 = Slider(0, range=0..100)  # disabled
number_slider_16 = Slider(1, range=0..100)  # disabled
pt_3 = Point(Point(3.976909937, -3.323878744, 0))  # disabled
pt_4 = Point(Point(18.39302838, -67.06960533, 0))  # disabled

# ---- group: AreaVendible / Circulacion
number_slider_17 = Slider(0.2, range=0..1)

# ---- group: SameAreaDifferentRatios
txt_4 = Text("Percentage")
number_slider_18 = Slider(573, range=0..1000)
dom_3 = ConstructDomain(DomainStart=Slider(0.9, range=0..1), DomainEnd=Slider(1.572, range=0..10))
genemodifier_4 = GenePoolModifier(GeneList=txt_4, Count=number_slider_4, Domain=dom_3, Randomize=Button(), PercentageOfRandomization=Slider(1, range=0..1))
multiplication_10 = Multiplication(A=number_slider_18, B=number_slider_17)
addition_2 = Addition(A=number_slider_18, B=multiplication_10)
percentage = GenePool(Decimals=2, Maximum=1.572, Minimum=0.9, Value=[1.572, 1.572, 1.572, 1.572, 1.572])
sqrt = SquareRoot(Value=addition_2)
multiplication_11 = Multiplication(A=sqrt, B=percentage)
division_3 = Division(A=addition_2, B=multiplication_11)
multiplication_12 = Multiplication(A=division_3, B=0.5)
multiplication_13 = Multiplication(A=multiplication_11, B=0.5)
num = Number(1.112732212)
pt_5 = Point(pt_2)
dom_4 = ConstructDomain(DomainStart=expr("-x", multiplication_12), DomainEnd=multiplication_12)
dom_5 = ConstructDomain(DomainStart=expr("-x", multiplication_13), DomainEnd=multiplication_13)
pln = Plane(pt_5)
rotate = Rotate(Geometry=pln, Angle=expr("x-0.5*pi", num), Plane=pt_5)  # -> Geometry, Transform
rectangle = Rectangle(Plane=rotate.Geometry, XSize=dom_5, YSize=dom_4, Radius=0)  # -> Rectangle, Length
area_3 = Area(Geometry=rectangle.Rectangle, UseTasks=False)  # -> Area, Centroid

# ----
sqrt_2 = SquareRoot(Value=multiplication_10)
multiplication_14 = Multiplication(A=sqrt_2, B=percentage)
division_4 = Division(A=multiplication_10, B=multiplication_14)
multiplication_15 = Multiplication(A=division_4, B=0.5)
multiplication_16 = Multiplication(A=multiplication_14, B=0.5)
dom_6 = ConstructDomain(DomainStart=expr("-x", multiplication_15), DomainEnd=multiplication_15)
dom_7 = ConstructDomain(DomainStart=expr("-x", multiplication_16), DomainEnd=multiplication_16)
rectangle_2 = Rectangle(Plane=rotate.Geometry, XSize=dom_7, YSize=dom_6, Radius=0)  # -> Rectangle, Length

# ---- group: Rotate
dom_8 = ConstructDomain(DomainStart=0, DomainEnd=Slider(1, range=0..1))
genemodifier_5 = GenePoolModifier(
    GeneList="Rotate",
    Count=number_slider_4,
    Domain=dom_8,
    Randomize=Button(),
    PercentageOfRandomization=Slider(1, range=0..1))
rotate_2 = GenePool(Decimals=0, Maximum=1, Minimum=0, Value=[0, 0, 0, 0, 0])
rad_2 = Radians(Degrees=rotate_2)
rotate_3 = Rotate(Geometry=rectangle.Rectangle, Angle=expr("x*90", rad_2), Plane=rotate.Geometry)  # -> Geometry, Transform
crv_3 = Curve(rotate_3.Geometry)
offset = OffsetCurve(Curve=crv_3, Distance=multiplication_8, Plane=PlaneXY(0, 0, 0), Corners=1)  # -> flatten(Curve)

# ----
pln_2 = Plane(rotate.Geometry)
_2personas = Panel("35")
_2personas_2 = Panel("50")
_3personas = Panel("65.7")
num_2 = Number(_3personas)
areaaptos1 = Panel("161884.8")
areaaptos2 = Panel("172480")
galapagos = Galapagos(
    fitness=ma_13,
    gene=[X, Y, rotate_2, number_slider_23, number_slider_22, number_slider_21, number_slider_27, number_slider_25, number_slider_26, number_slider_7, rotateone, Z, rotatebuildings, rotateparking])
num_3 = Number(areaaptos1)
division_5 = Division(A=num_3, B=num_2)
multiplication_17 = Multiplication(A=division_5, B=Slider(150, range=0..1000))
panel_4 = Panel(multiplication_17)
ma_2 = MassAddition()  # -> Result, PartialResults; disabled
ma_3 = MassAddition()  # -> Result, PartialResults; disabled
panel_5 = Panel("""Área util m2
Área total construida m2
I.O
I.C
Relación parqueaderos/aptos
Área puntos fijos m2
Área vendible m2
Área salones comunales
Área parqueaderos
Número de torres""")
panel_6 = Panel("D:\SSS\Salitre\Libro1.xlsx")  # disabled
panel_7 = Panel("""Pisos
Aislamientos m
Área total torre m2
Altura m""")
button_3 = Button()
wo = WriteOptions(
    FilePath=panel_6,
    ClearDataOverwrite=True,
    SaveAfterWrite=False,
    CloseAfterWrite=False,
    ColumnStartPosition=1,
    RowStartPosition=1)  # -> UserMessages, WriteOptions; disabled

# ---- group: Lote
crv_4 = Curve(<curve referenced from the Rhino model>)
crv_5 = Curve(<curve referenced from the Rhino model>)
area_4 = Area(Geometry=crv_4, UseTasks=False)  # -> Area, Centroid
area_5 = Area(Geometry=crv_5, UseTasks=False)  # -> Area, Centroid
panel_8 = Panel(area_4.Area)
panel_9 = Panel(area_5.Area)

# ---- group: Parqueaderos
addition_3 = Addition(A=Slider(5, range=0..10), B=Slider(4.5, range=0..10))
multiplication_18 = Multiplication(A=addition_3, B=Slider(2.3, range=0..10))
panel_10 = Panel(multiplication_18)
multiplication_19 = Multiplication(A=multiplication_18, B=Slider(173, range=0..1000))
multiplication_20 = Multiplication(A=multiplication_19, B=1)
panel_11 = Panel(multiplication_19)
panel_12 = Panel(multiplication_20)
division_6 = Division(A=multiplication_20, B=28)
panel_13 = Panel(division_6)
number_slider_19 = Slider(1, range=0..1)
number_slider_20 = Slider(1, range=0..10)
dom_9 = ConstructDomain(DomainStart=Slider(0, range=0..1), DomainEnd=Slider(1, range=0..1))
sqrt_3 = SquareRoot(Value=multiplication_20)
genemodifier_6 = GenePoolModifier(GeneList="ParkX", Count=number_slider_20, Domain=dom_9, Randomize=Button(), PercentageOfRandomization=number_slider_19)
genemodifier_7 = GenePoolModifier(GeneList="ParkY", Count=number_slider_20, Domain=dom_9, Randomize=Button(), PercentageOfRandomization=number_slider_19)
multiplication_21 = Multiplication(A=sqrt_3, B=Slider(1.88, range=0.6..2))
parkx = GenePool(Decimals=2, Maximum=1, Minimum=0, Value=0.7113606006)
number_slider_21 = Slider(0.2379, range=0..1)
number_slider_22 = Slider(0.1062, range=0..1)
parky = GenePool(Decimals=2, Maximum=1, Minimum=0, Value=0.7713441005)
division_7 = Division(A=multiplication_20, B=multiplication_21)
multiplication_22 = Multiplication(A=division_7, B=number_slider_6)
multiplication_23 = Multiplication(A=multiplication_21, B=number_slider_6)
dom_10 = ConstructDomain(DomainStart=Slider(0, range=0..1), DomainEnd=Slider(1, range=0..10))
panel_14 = Panel(multiplication_21)
pt_6 = ConstructPoint(XCoordinate=parkx, YCoordinate=parky, ZCoordinate=0)
panel_15 = Panel(division_7)
dom_11 = ConstructDomain(DomainStart=expr("-x", multiplication_22), DomainEnd=multiplication_22)
dom_12 = ConstructDomain(DomainStart=expr("-x", multiplication_23), DomainEnd=multiplication_23)
number_slider_23 = Slider(9.004, range=0..10)
genemodifier_8 = GenePoolModifier(
    GeneList="RotateOne",
    Count=number_slider_20,
    Domain=dom_10,
    Randomize=Button(),
    PercentageOfRandomization=Slider(1, range=0..1))
evalsrf_2 = EvaluateSurface(Surface=reparameterize(scale.Geometry), Point=pt_6)  # -> Point, Normal, UDirection, VDirection, Frame
pi = Pi(Factor=number_slider_23)
srf_cp_2 = SurfaceClosestPoint(Point=evalsrf_2.Point, Surface=scale.Geometry)  # -> Point, UVPoint, Distance
rotateone = GenePool(Decimals=0, Maximum=1, Minimum=0, Value=0)
pt_7 = Point(srf_cp_2.Point)
rectangle_3 = Rectangle(Plane=pt_7, XSize=dom_12, YSize=dom_11, Radius=0)  # -> Rectangle, Length
number_slider_24 = Slider(1, range=0..2)
area_6 = Area(Geometry=rectangle_3.Rectangle, UseTasks=False)  # -> Area, Centroid
ma_4 = MassAddition(Input=area_6.Area)  # -> Result, PartialResults
frgb = ColourRGBF(Alpha=Slider(1, range=0..1), Red=Slider(0.3, range=0..1), Green=Slider(0.3, range=0..1), Blue=Slider(0.3, range=0..1))

# ----
rad_3 = Radians(Degrees=expr("x*90", rotateone))

# ---- group: Comunal
number_slider_25 = Slider(0.133, range=0..1)
number_slider_26 = Slider(0.9259, range=0..1)
pt_8 = ConstructPoint(XCoordinate=number_slider_25, YCoordinate=number_slider_26, ZCoordinate=0)
evalsrf_3 = EvaluateSurface(Surface=reparameterize(scale.Geometry), Point=pt_8)  # -> Point, Normal, UDirection, VDirection, Frame
srf_cp_3 = SurfaceClosestPoint(Point=evalsrf_3.Point, Surface=scale.Geometry)  # -> Point, UVPoint, Distance
pt_9 = Point(srf_cp_3.Point)
crv_6 = Curve(<curve referenced from the Rhino model>)
area_7 = Area(Geometry=crv_6, UseTasks=False)  # -> Area, Centroid
sqrt_4 = SquareRoot(Value=area_7.Area)
multiplication_24 = Multiplication(A=sqrt_4, B=number_slider_7)
division_8 = Division(A=area_7.Area, B=multiplication_24)
multiplication_25 = Multiplication(A=division_8, B=0.5)
multiplication_26 = Multiplication(A=multiplication_24, B=0.5)
dom_13 = ConstructDomain(DomainStart=expr("-x", multiplication_25), DomainEnd=multiplication_25)
dom_14 = ConstructDomain(DomainStart=expr("-x", multiplication_26), DomainEnd=multiplication_26)
number_slider_27 = Slider(0.71, range=0..1)
rectangle_4 = Rectangle(Plane=pt_9, XSize=dom_14, YSize=dom_13, Radius=0)  # -> Rectangle, Length
rad_4 = Radians(Degrees=expr("x*90", number_slider_27))
number_slider_28 = Slider(1, range=0..5)
rotate_4 = Rotate(Geometry=rectangle_4.Rectangle, Angle=rad_4, Plane=pt_9)  # -> Geometry, Transform
offset_2 = OffsetCurve(Curve=rotate_4.Geometry, Distance=number_slider_28, Plane=PlaneXY(0, 0, 0), Corners=1)
Z_3 = UnitZ(Factor=Slider(0.01, range=0..0.01))
frgb_2 = ColourRGBF(Alpha=Slider(1, range=0..1), Red=Slider(0, range=0..1), Green=Slider(0, range=0..1), Blue=Slider(1, range=0..1))

# ---- group: FloorPlan
voronoi = Voronoi(Points=rotate.Geometry, BruteForceOverride=False)  # disabled
number_slider_29 = Slider(8, range=0..100)  # disabled
number_slider_30 = Slider(0.001, range=0..0.001)  # disabled
number_slider_31 = Slider(0.5, range=0..1)  # disabled
number_slider_32 = Slider(769, range=0..1000)  # disabled
number_slider_33 = Slider(1000, range=0..1000)  # disabled
number_slider_34 = Slider(178, range=0..1000)  # disabled

# ---- group: Parqueaderos (continued)
rotate_5 = Rotate(Geometry=rectangle_3.Rectangle, Angle=rad_3, Plane=pt_7)  # -> Geometry, Transform
offset_3 = OffsetCurve(Curve=rotate_5.Geometry, Distance=number_slider_24, Plane=PlaneXY(0, 0, 0), Corners=1)  # -> flatten(Curve)

# ---- group: Physics / EnclosingCurve
number_slider_35 = Slider(100, range=0..100)  # disabled
crv_7 = Curve(<curve referenced from the Rhino model>)
divide = DivideCurve(Curve=crv_7, Count=number_slider_35, Kinks=False, UseTasks=False)  # -> Points, Tangents, Parameters; disabled
disc = Discontinuity(Curve=crv_7, Level=2)  # -> Points, Parameters

# ---- group: FloorPlan (continued)
srf_2 = Surface(crv_7)  # disabled
sdivide_2 = DivideSurface(Surface=srf_2, UCount=number_slider_29, VCount=number_slider_29)  # -> Points, Normals, Parameters; disabled
ptborders = GenerateBorders(Grid=sdivide_2.Points, PanelShape=0, Surface=srf_2)  # disabled
flatten_2 = FlattenTree(Tree=ptborders, Path="{0}")  # disabled
item = ListItem(List=flatten_2, Index=0, Wrap=True)  # disabled
area_8 = Area(Geometry=item, UseTasks=False)  # -> Area, Centroid; disabled
multiplication_27 = Multiplication(A=area_8.Area, B=number_slider_31)  # disabled
sortxy = SortPointsXY(Grid=flatten(flatten_2))  # disabled

# ---- group: Physics
pline = PolyLine(Vertices=disc.Points, Closed=True)
pln_3 = Plane(pt_7)
pln_4 = Plane(pt_9)
relay = Relay([pln_2, pln_3, pln_4])
spctopo = SpaceTopology(Curves=offset)  # disabled
flatten_3 = FlattenTree(Tree=relay, Path="{0}")
linetopo = LineTopology(PointTree=graft(area_3.Centroid), Topology=spctopo)  # -> flatten(LineTopology); disabled
flatten_4 = FlattenTree(Tree=[offset, offset_3, offset_2], Path="{0}")
length_line = LengthLine(Line=linetopo, Strength=number_slider_12)  # disabled
show = Show(G=flatten_4)

# ----
crv_8 = Curve(flatten_4)
spctopo_2 = SpaceTopology(Curves=flatten(crv_8))  # disabled
area_9 = Area(Geometry=crv_8, UseTasks=False)  # -> Area, Centroid; disabled
linetopo_2 = LineTopology(PointTree=graft(area_9.Centroid), Topology=spctopo_2)  # -> flatten(LineTopology); disabled
shift = ShiftList(List=linetopo_2, Shift=1, Wrap=False)  # disabled
short = ShortestList(ListA=linetopo_2, ListB=shift, TrimMode=2)  # -> ListA, ListB; disabled
clampangle = ClampAngle(LineA=short.ListA, LineB=short.ListB, UpperLimit=rad, LowerLimit=rad, Strength=number_slider_10)  # disabled
length_line_2 = LengthLine(Line=linetopo_2, Strength=10)  # disabled

# ---- group: Physics / EnclosingCurve (continued)
offsettree = CSharpScript(tree=pline, distance=Slider(100, range=-20..100))  # -> out, A; inputs tree: tree of Curve, distance: Double
# ---------- offsettree: C# ----------
    /*var curves = x.Offset(Plane.WorldXY, -10, 1e-3, CurveOffsetCornerStyle.Sharp);

    var list = new List<Curve>();
    list.AddRange(curves);
    list.Add(x);

    Brep[] brep = Brep.CreateFromLoft(list, Point3d.Unset, Point3d.Unset, LoftType.Normal, false);

    A = brep;*/

    int branches = tree.BranchCount;

    DataTree<Curve> treeOut = new DataTree<Curve>();
    GH_Path path = new GH_Path();

    for( int i = 0; i < branches; ++i )
    {

      path = new GH_Path(i);

      //for( int j = 0; j < tree.Branch(i).Count; ++j )
      {

        treeOut.Add(tree.Branch(i)[0], path);
        treeOut.AddRange(tree.Branch(i)[0].Offset(Plane.WorldXY, distance, 1e-3, CurveOffsetCornerStyle.Sharp), path);

      }

    }

    A = treeOut;
# ---------- end offsettree ----------
loft = Loft(Curves=offsettree.A, Options={Adjust=False, Closed=False, LoftEnds=0, LoftSimp=0, LoftType=0, Rebuild=10, Refit=0.01})
debrep = DeconstructBrep(Brep=loft)  # -> simplify(Faces), Edges, Vertices
wires = BrepWireframe(Brep=debrep.Faces, Density=-1)
join = JoinCurves(Curves=wires, Preserve=False)  # -> flatten(Curves)

# ----
cc = CurveCollide(Curves=flatten(crv_8), Frames=flatten_3, PassiveCurves=join, BasePlane=PlaneXY(0, 0, 0), Strength=number_slider_9)  # -> Goal, Frames; disabled
solver = Solver(GoalObjects=flatten(cc.Goal), Reset=button, Threshold=1e-15, Tolerance=0.01, On=toggle)  # -> I, V, O; disabled
sdivide_3 = DivideSurface(Surface=pline, UCount=number_slider_13, VCount=number_slider_13)  # -> simplify(Points), Normals, Parameters; disabled
flatten_5 = FlattenTree(Tree=sdivide_3.Points, Path="{0}")  # disabled
branch = TreeBranch(Tree=sdivide_3.Points, Path=path, MaintainPaths=True)  # disabled

# ---- group: FloorPlan (continued)
rint = RegionIntersection(CurvesA=voronoi, CurvesB=pline)  # disabled
spacepartition = SpacePartition(VoronoiIn=rint, GridIn=flatten_2, AreaIn=multiplication_27, Tolerance=number_slider_30)  # disabled
sortxy_2 = SortPointsXY(Grid=flatten(spacepartition))  # disabled
pararunion = ParallelRegionUnion(Curves=spacepartition)  # disabled
missing = MissingGridCells(CulledGrid=sortxy_2, OriginalGrid=sortxy)  # disabled
mgtree = MergeTreeMissing(CulledGrid=simplify(pararunion), MissingGridCells=missing)  # disabled
pararunion_2 = ParallelRegionUnion(Curves=mgtree)  # disabled
lng = ListLength(List=flatten(pararunion_2))  # disabled
srf_3 = Surface(pararunion_2)  # disabled
random = Random(Range=Domain(0, 1), Number=lng, Seed=number_slider_32)  # disabled
random_2 = Random(Range=Domain(0, 1), Number=lng, Seed=number_slider_33)  # disabled
random_3 = Random(Range=Domain(0, 1), Number=lng, Seed=number_slider_34)  # disabled
frgb_3 = ColourRGBF(Alpha=1, Red=random_2, Green=random, Blue=random_3)  # disabled

# ----
move = Move(Geometry=srf_3, Motion=Y_2)  # -> Geometry, Transform; disabled

# ---- group: FloorPlan (continued)
preview = CustomPreview(Geometry=move.Geometry, Material=graft(frgb_3))  # disabled

# ---- group: Physics (continued)
cc_2 = CurveCollide(
    Curves=flatten(flatten_4),
    Frames=flatten_3,
    PassiveCurves=join,
    BasePlane=PlaneXY(0, 0, 0),
    Strength=Slider(1, range=0..10))  # -> Goal, Frames

# ----
data = Data(cc_2.Goal)

# ---- group: Physics (continued)
entwine = Entwine(Branch00=show, Branch01=data, FlattenInputs=True)
customkangaroo = CSharpScript(
    Goals=entwine,
    Reset=Toggle(True),
    Iter=Slider(15, range=0..100),
    Reference="C:\Program Files\Rhino 6\Plug-ins\Grasshopper\Components\KangarooSolver.dll")  # -> A; inputs Goals: list, Reset: Boolean, Iter: Int32
# ---------- customkangaroo: C# usings ----------
using System.IO;
using System.Linq;
using System.Data;
using System.Drawing;
using System.Reflection;
using System.Windows.Forms;
using System.Xml;
using System.Xml.Linq;
using System.Runtime.InteropServices;

using Rhino.DocObjects;
using Rhino.Collections;
using GH_IO;
using GH_IO.Serialization;
using KangarooSolver;
using KangarooSolver.Goals;
# ---------- customkangaroo: C# ----------
    if( Reset )
    {

      PS = new KangarooSolver.PhysicalSystem();

      GoalList.Clear();

      foreach( IGoal G in Goals ) //Assign indexes to the particles in each Goal:
        //System.Threading.Tasks.Parallel.ForEach(Goals, G =>
      {

        PS.AssignPIndex(G, 0.0001); // the second argument is the tolerance distance below which points combine into a single particle
        GoalList.Add(G);

      }
      //);

    }

    for( int i = 0; i < Iter; ++i )
      //System.Threading.Tasks.Parallel.For(0, Iter, i =>
    {

      PS.Step(GoalList, true, 1);

    }
    //);

    A = PS.GetOutput(GoalList);
# ---------- customkangaroo: C# additional code ----------
  KangarooSolver.PhysicalSystem PS = new KangarooSolver.PhysicalSystem();
  List<IGoal> GoalList = new List<IGoal>();
# ---------- end customkangaroo ----------
clean = CleanTree(RemoveNulls=True, RemoveInvalid=True, RemoveEmpty=False, Tree=customkangaroo)
bang = ExplodeTree(Data=customkangaroo)  # -> Branch0, Branch1
objecttocurves = CSharpScript(x=clean)  # -> A; inputs x: list; disabled
# ---------- objecttocurves: C# ----------
    var listOut = new DataTree<Curve>();
    var list = new object[x.Count];
    Curve temp = null;
    
    for( int i = 0; i < x.Count; ++i )
    {
      
      list = ( object[] ) x[i];
      
      for( int j = 0; j < list.Length; ++j )
      {
        
        GH_Convert.ToCurve(list[j], ref temp, GH_Conversion.Both);
        
        listOut.Add(temp, new GH_Path(i));
      
      }
        
    }
    
    A = listOut;
# ---------- end objecttocurves ----------
objecttocurves_2 = CSharpScript(x=bang.Branch1)  # -> A; inputs x: list
# ---------- objecttocurves_2: C# ----------
    /*
    var listOut = new DataTree<Curve>();
    var list = new object[x.Count];
    Curve temp = null;

    for( int i = 0; i < x.Count; ++i )
    {

      list = ( object[] ) x[i];

      for( int j = 0; j < list.Length; ++j )
      {

        GH_Convert.ToCurve(list[j], ref temp, GH_Conversion.Both);

        listOut.Add(temp, new GH_Path(i));

      }

    }
*/
    A = x[0];
# ---------- end objecttocurves_2 ----------

# ----
solver_2 = Solver(GoalObjects=entwine, Reset=button_2, Threshold=1e-15, Tolerance=0.01, On=toggle_2)  # -> I, V, O; disabled
bang_2 = ExplodeTree(Data=solver_2.O)  # -> Branch0, Branch1; disabled
crv_9 = Curve(bang_2.Branch1)  # disabled

# ---- group: PullToEnclosingCurve
area_10 = Area(Geometry=objecttocurves_2, UseTasks=False)  # -> Area, Centroid
item_2 = ListItem(List=offset_3, Index=0, Wrap=True)
sort_2 = SortList(Keys=area_10.Area, ValuesA=objecttocurves_2)  # -> Keys, ValuesA
area_11 = Area(Geometry=item_2, UseTasks=False)  # -> Area, Centroid
number_slider_36 = Slider(0, range=0..100)
number_slider_37 = Slider(2.088, range=0..6.283)  # disabled
int = Integer(sort_2.Keys)
int_2 = Integer(area_11.Area)
equals = Equality(FirstNumber=int, SecondNumber=int_2)  # -> Equality, Inequality
item_3 = ListItem(List=sort_2.ValuesA, Index=number_slider_36, Wrap=True)
cull = CullPattern(List=sort_2.ValuesA, CullPattern=equals.Equality)
cull_2 = CullPattern(List=sort_2.ValuesA, CullPattern=invert(equals.Equality))
area_12 = Area(Geometry=item_3, UseTasks=False)  # -> Area, Centroid
rotate_6 = Rotate(Geometry=item_3, Angle=number_slider_37, Plane=area_12.Centroid)  # -> Geometry, Transform; disabled
int_3 = Integer(number_slider_36)
crv_10 = Curve(cull)
offset_4 = OffsetCurve(Curve=item_3, Distance=expr("-x", number_slider_28), Plane=PlaneXY(0, 0, 0), Corners=1)
cull_i_3 = CullIndex(List=cull_2, Indices=int_3, Wrap=True)
offset_5 = OffsetCurve(Curve=cull_i_3, Distance=expr("-x", multiplication_8), Plane=PlaneXY(0, 0, 0), Corners=1)  # -> simplify(flatten(Curve))
area_13 = Area(Geometry=offset_4, UseTasks=False)  # -> Area, Centroid
offset_6 = OffsetCurve(Curve=crv_10, Distance=expr("-x", number_slider_24), Plane=PlaneXY(0, 0, 0), Corners=1)  # -> simplify(flatten(Curve))
crv_11 = Curve(<curve referenced from the Rhino model>)
crvprox = CurveProximity(CurveA=offset_5, CurveB=crv_11)  # -> PointA, PointB, Distance
area_14 = Area(Geometry=offset_6, UseTasks=False)  # -> Area, Centroid; disabled
vec2pt = Vector2Pt(PointA=crvprox.PointA, PointB=crvprox.PointB, Unitize=False)  # -> Vector, Length
move_2 = Move(Geometry=flatten(offset_5), Motion=vec2pt.Vector)  # -> Geometry, Transform
number_slider_38 = Slider(1, range=0..1)  # disabled
number_slider_39 = Slider(1, range=0..1)  # disabled
button_4 = Button()  # disabled
button_5 = Button()  # disabled
dom_15 = ConstructDomain(DomainStart=0, DomainEnd=6.283185307)  # disabled
lng_2 = ListLength(List=offset_6)  # disabled
dom_16 = ConstructDomain(DomainStart=0, DomainEnd=6.283185307)  # disabled
lng_3 = ListLength(List=move_2.Geometry)  # disabled
rotateparking = GenePool(Decimals=2, Maximum=6.283185307, Minimum=0, Value=[5.392733886, 1.07054272])  # disabled
genemodifier_9 = GenePoolModifier(GeneList="RotateParking", Count=lng_2, Domain=dom_15, Randomize=button_4, PercentageOfRandomization=number_slider_38)  # disabled
rotatebuildings = GenePool(Decimals=2, Maximum=6.283185307, Minimum=0, Value=[4.652358548, 2.901470922, 0.2001014429, 3.671861477, 6.183134586])  # disabled
genemodifier_10 = GenePoolModifier(GeneList="RotateBuildings", Count=lng_3, Domain=dom_16, Randomize=button_5, PercentageOfRandomization=number_slider_39)  # disabled
area_15 = Area(Geometry=offset_5, UseTasks=False)  # -> Area, Centroid; disabled
rotate_7 = Rotate(Geometry=offset_6, Angle=rotateparking, Plane=area_14.Centroid)  # -> Geometry, Transform; disabled
rotate_8 = Rotate(Geometry=move_2.Geometry, Angle=rotatebuildings, Plane=area_15.Centroid)  # -> Geometry, Transform; disabled

# ---- group: Lote (continued)
area_16 = Area(Geometry=offset_5, UseTasks=False)  # -> Area, Centroid
ma_5 = MassAddition(Input=flatten(area_16.Area))  # -> Result, PartialResults

# ---- group: Comunal (continued)
srf_4 = Surface(offset_4)
move_3 = Move(Geometry=srf_4, Motion=Z_3)  # -> Geometry, Transform
preview_2 = CustomPreview(Geometry=move_3.Geometry, Material=frgb_2)

# ----
item_4 = ListItem(List=offset_5, Index=0, Wrap=True)  # disabled
inside_2 = PointWithinCurve(pts=sdivide_3.Points, crv=offset_5)  # -> simplify(B); inputs pts: list of Point3d, crv: list of Polyline; disabled
# ---------- inside_2: C# ----------
    var outside = new DataTree<Point3d>(); //Outside(pts, crv);

    var temp = Outside(pts, crv[0]);

    foreach( var item in temp )
    {

      outside.Add(item, new GH_Path(0));

    }

    for( int i = 1; i < crv.Count; ++i )
    {

      foreach( var item in temp )
      {

        outside.Add(item, new GH_Path(i));

      }

      temp = Outside(outside.Branch(i), crv[i]);

    }

    B = temp;
# ---------- inside_2: C# additional code ----------
  System.Collections.Concurrent.ConcurrentBag<Point3d> Outside(List<Point3d> pts, Polyline crv)
  {

    var outside = new System.Collections.Concurrent.ConcurrentBag<Point3d>();
    //for( int i = 0; i < pts.BranchCount; ++i )
      System.Threading.Tasks.Parallel.ForEach(pts, pt =>
        {
        if(!IsInside(pt, crv))
        {
          outside.Add(pt);
        }
        });

    return outside;

  }

  bool IsInside (Point3d pt, Polyline crv)
  {
    Point3d pt1, pt2;
    bool oddNodes = false;

    for (int i = 0; i < crv.SegmentCount; i++) //for each contour line
    {

      pt1 = crv.SegmentAt(i).From; //get start and end pt
      pt2 = crv.SegmentAt(i).To;

      if ( (pt1[1] < pt[1] && pt2[1] >= pt[1] || pt2[1] < pt[1] && pt1[1] >= pt[1]) && (pt1[0] <= pt[0] || pt2[0] <= pt[0]) ) //if pt is between pts in y, and either of pts is before pt in x
        oddNodes ^= ( pt2[0] + (pt[1] - pt2[1]) * (pt1[0] - pt2[0]) / (pt1[1] - pt2[1]) < pt[0] ); //^= is xor
      //end.X + (pt-end).Y   * (start-end).X  /(start-end).Y   <   pt.X
    }


    if (!oddNodes)
    {
      double minDist = 1e10;
      for (int i = 0; i < crv.SegmentCount; i++) {
        Point3d cp = crv.SegmentAt(i).ClosestPoint(pt, true);
        //Point3d cp = mvContour[i].closestPoint(pt);
        //minDist = min(minDist, cp.distance(pt));
        minDist = Math.Min(minDist, cp.DistanceTo(pt));
      }
      if (minDist < 1e-10)
        return true;
    }

    if(oddNodes) return true;

    return false;
  }
# ---------- end inside_2 ----------
branch_2 = TreeBranch(Tree=inside_2, Path=path, MaintainPaths=True)  # disabled
cull_i_4 = CullIndex(List=branch_2, Indices=number_slider_15, Wrap=True)  # disabled
item_5 = ListItem(List=branch_2, Index=number_slider_15, Wrap=True)  # disabled
expression = Expression(x=inside_2, Expression="If( ( x.X = 0 ) and ( x.Y = 0 ), False, True )")  # disabled

# ---- group: PuntoFijo
number_slider_40 = Slider(0.4083, range=0..1)
area_17 = Area(Geometry=offset_5, UseTasks=False)  # -> Area, Centroid
scale_nu = ScaleNU(Geometry=offset_5, Plane=area_17.Centroid, ScaleX=number_slider_40, ScaleY=number_slider_40, ScaleZ=1)  # -> Geometry, Transform
addition_4 = Addition(A=sort.ValuesA, B=1)
series_2 = Series(Start=0, Step=number_slider_5, Count=addition_4)
Z_4 = UnitZ(Factor=series_2)
move_4 = Move(Geometry=graft(scale_nu.Geometry), Motion=Z_4)  # -> simplify(Geometry), Transform
crv_12 = Curve(move_4.Geometry)
flatten_6 = FlattenTree(Tree=crv_12, Path="{0}")
crv_13 = Curve(flatten_6)
frgb_4 = ColourRGBF(Alpha=Slider(1, range=0..1), Red=Slider(1, range=0..1), Green=Slider(1, range=0..1), Blue=Slider(1, range=0..1))
area_18 = Area(Geometry=crv_13, UseTasks=False)  # -> Area, Centroid
ma_6 = MassAddition(Input=area_18.Area)  # -> Result, PartialResults
panel_16 = Panel(ma_6.Result)
previewlw = CustomPreviewLineweights(Geometry=crv_13, Shader=frgb_4, Absolute=False)
item_6 = ListItem(List=area_18.Area, Index=0, Wrap=True)
multiplication_28 = Multiplication(A=item_6, B=number_slider_4)
subtraction_2 = Subtraction(A=ma_6.Result, B=multiplication_28)

# ----
crvprox_2 = CurveProximity(CurveA=offset_6, CurveB=crv_11)  # -> PointA, PointB, Distance
vec2pt_2 = Vector2Pt(PointA=crvprox_2.PointA, PointB=crvprox_2.PointB, Unitize=False)  # -> Vector, Length
move_5 = Move(Geometry=flatten(offset_6), Motion=vec2pt_2.Vector)  # -> Geometry, Transform
cull_3 = CullPattern(List=inside_2, CullPattern=expression)  # disabled
prune = PruneTree(Tree=cull_3, Minimum=number_slider_16, Maximum=0)  # disabled
path_mapper = PathMapper(prune, source="{A}", target="{path_index}")  # disabled
flip = FlipMatrix(Data=path_mapper)  # disabled
closestptgrid = ClosestPointInGrid(Grid=flip, Point=pt_3)  # -> ClosestPointInGrid, BranchOfGrid, LeafOfGrid; disabled
closestptgrid_2 = ClosestPointInGrid(Grid=flip, Point=pt_4)  # -> ClosestPointInGrid, BranchOfGrid, LeafOfGrid; disabled

# ---- group: OutsideOfArea
crv_14 = Curve(flatten([offset_5, offset_6, offset_4]))
disc_2 = Discontinuity(Curve=crv_14, Level=3)  # -> flatten(Points), Parameters
inside_3 = PointWithinCurve(pts=disc_2.Points, crv=pline)  # -> simplify(B); inputs pts: list of Point3d, crv: Polyline
# ---------- inside_3: C# ----------
    //int counter = 0;

    int count = pts.Count;

    //Polyline poly = new Polyline();

    //crv.TryGetPolyline(out poly);

    int[] array = new int[count];

    System.Threading.Tasks.Parallel.For(0, count, i => //for( int i = 0; i < count; ++i )
      {

      if( !IsInside(pts[i], crv) )

        array[i] = 1;

      });

    B = array;
# ---------- inside_3: C# additional code ----------
  System.Collections.Concurrent.ConcurrentBag<Point3d> Outside(List<Point3d> pts, Polyline crv)
  {

    var outside = new System.Collections.Concurrent.ConcurrentBag<Point3d>();
    //for( int i = 0; i < pts.BranchCount; ++i )
    System.Threading.Tasks.Parallel.ForEach(pts, pt =>
      {
      if(!IsInside(pt, crv))
      {
        outside.Add(pt);
      }
      });

    return outside;

  }

  bool IsInside (Point3d pt, Polyline crv)
  {
    Point3d pt1, pt2;
    bool oddNodes = false;

    for (int i = 0; i < crv.SegmentCount; i++) //for each contour line
    {

      pt1 = crv.SegmentAt(i).From; //get start and end pt
      pt2 = crv.SegmentAt(i).To;

      if ( (pt1[1] < pt[1] && pt2[1] >= pt[1] || pt2[1] < pt[1] && pt1[1] >= pt[1]) && (pt1[0] <= pt[0] || pt2[0] <= pt[0]) ) //if pt is between pts in y, and either of pts is before pt in x
        oddNodes ^= ( pt2[0] + (pt[1] - pt2[1]) * (pt1[0] - pt2[0]) / (pt1[1] - pt2[1]) < pt[0] ); //^= is xor
      //end.X + (pt-end).Y   * (start-end).X  /(start-end).Y   <   pt.X
    }


    if (!oddNodes)
    {
      double minDist = 1e10;
      for (int i = 0; i < crv.SegmentCount; i++) {
        Point3d cp = crv.SegmentAt(i).ClosestPoint(pt, true);
        //Point3d cp = mvContour[i].closestPoint(pt);
        //minDist = min(minDist, cp.distance(pt));
        minDist = Math.Min(minDist, cp.DistanceTo(pt));
      }
      if (minDist < 1e-10)
        return true;
    }

    if(oddNodes) return true;

    return false;
  }
# ---------- end inside_3 ----------
multiplication_29 = Multiplication(A=inside_3, B=Slider(1000, range=0..1000))

# ---- group: I.O
multiplication_30 = Multiplication(A=ma_5.Result, B=number_slider_17)
subtraction_3 = Subtraction(A=ma_5.Result, B=multiplication_30)
ma_7 = MassAddition(Input=[subtraction_3, area_7.Area])  # -> Result, PartialResults
division_9 = Division(A=ma_7.Result, B=area_4.Area)
panel_17 = Panel(division_9)
expression_2 = Expression(
    x=division_9,
    y=Slider(0.31, range=0..10),
    z=Slider(0.24, range=0..1),
    Expression="If( ( x ≤ y ) and ( x ≥ z ), 0, 10000 )")

# ----
pathfindingdiagonal = CSharpScript(
    grid=flip,
    idx=closestptgrid_2.BranchOfGrid,
    idj=closestptgrid_2.LeafOfGrid,
    fidx=closestptgrid.BranchOfGrid,
    fjdx=closestptgrid.LeafOfGrid)  # -> Shortest; inputs grid: tree of Point3d, idx: Int32, idj: Int32, fidx: Int32, fjdx: Int32; disabled
# ---------- pathfindingdiagonal: C# ----------
    int branchCount = grid.BranchCount;
    int maxTreeBranchCount = grid.Branch(branchCount - 1).Count;

    int x = idx % branchCount, y = idj % maxTreeBranchCount;

    Point3d tempPoint = new Point3d();
    Point3d point = grid.Branch(x)[y];
    Point3d finalPoint = grid.Branch(fidx % branchCount)[fjdx % maxTreeBranchCount];
    List<Point3d> tempList = new List<Point3d>();
    double minDistance = double.MaxValue;
    //var keyValuePair = new KeyValuePair<double, Point3d>();

    tempList.Add(point);

    CustomPair customPair;

    GH_Path path = new GH_Path();

    //while( tempPoint.CompareTo(finalPoint) != 0 )
    for( int i = 0; i < 300; ++i )
    {

      for( int xx = x - 1; xx < x + 2; ++xx )
        //System.Threading.Tasks.Parallel.For(x - 1, x + 2, xx =>
      {

        for( int yy = y - 1; yy < y + 2; ++yy )
          //System.Threading.Tasks.Parallel.For(y - 1, y + 2, yy =>
        {

          if( xx >= 0 && xx < branchCount && yy >= 0 && yy < maxTreeBranchCount )
          {

            double localDistance = finalPoint.DistanceTo(grid.Branch(xx)[yy]);

            customPair.Key = localDistance;
            customPair.Value = grid.Branch(xx)[yy];
            customPair.Path = new GH_Path(xx, yy);

            minDistance = Math.Min(minDistance, localDistance);

            if( ( customPair.Key - minDistance ) < 0.01 )
            {

              tempPoint = customPair.Value;
              path = customPair.Path;

            }

          }

        }

      }

      x = path.Indices[0];
      y = path.Indices[1];

      tempList.Add(tempPoint);

    }

    Shortest = new Polyline(tempList);
# ---------- pathfindingdiagonal: C# additional code ----------
  struct CustomPair
  {

    public double Key;
    public Point3d Value;
    public GH_Path Path;

  }
# ---------- end pathfindingdiagonal ----------
pathfindingsquare = CSharpScript(
    grid=flip,
    idx=closestptgrid_2.BranchOfGrid,
    idj=closestptgrid_2.LeafOfGrid,
    fidx=closestptgrid.BranchOfGrid,
    fjdx=closestptgrid.LeafOfGrid)  # -> Shortest; inputs grid: tree of Point3d, idx: Int32, idj: Int32, fidx: Int32, fjdx: Int32; disabled
# ---------- pathfindingsquare: C# ----------
    int branchCount = grid.BranchCount;
    int maxTreeBranchCount = grid.Branch(branchCount - 1).Count;

    int x = idx, y = idj;

    Point3d tempPoint = new Point3d();
    Point3d point = grid.Branch(x)[y];
    Point3d finalPoint = grid.Branch(fidx)[fjdx];
    List<Point3d> tempList = new List<Point3d>();
    double minDistance = double.MaxValue, minDistanceOne = double.MaxValue;

    tempList.Add(point);

    CustomPair customPair, customPairOne;

    GH_Path path = new GH_Path();

    //while( tempPoint.CompareTo(finalPoint) != 0 )
    for( int i = 0; i < 200; ++i )
    {

      for( int xx = -1; xx < 2; xx += 2 )
      {

        int dX = x + xx, dY = y + xx;

        if( dX >= 0 && dX < branchCount && dY >= 0 && dY < maxTreeBranchCount )
        {

          double localDistance = finalPoint.DistanceTo(grid.Branch(dX)[y]);

          customPair.Key = localDistance;
          customPair.Value = grid.Branch(dX)[y];
          customPair.Path = new GH_Path(dX, y);

          minDistance = Math.Min(minDistance, localDistance);

          double localDistanceOne = finalPoint.DistanceTo(grid.Branch(x)[dY]);

          customPairOne.Key = localDistanceOne;
          customPairOne.Value = grid.Branch(x)[dY];
          customPairOne.Path = new GH_Path(x, dY);

          minDistanceOne = Math.Min(minDistanceOne, localDistanceOne);

          if( minDistance < minDistanceOne )
          {

            if( ( customPair.Key - minDistance ) < 0.01 )
            {

              tempPoint = customPair.Value;
              path = customPair.Path;

            }

          }

          else
          {

            if( ( customPairOne.Key - minDistanceOne ) < 0.01 )
            {

              tempPoint = customPairOne.Value;
              path = customPairOne.Path;

            }

          }

        }

      }

      x = path.Indices[0];
      y = path.Indices[1];

      tempList.Add(tempPoint);

    }

    //Print("Path: " + path.ToString());

    Shortest = new Polyline(tempList);
# ---------- pathfindingsquare: C# additional code ----------
  struct CustomPair
  {

    public double Key;
    public Point3d Value;
    public GH_Path Path;

  }
# ---------- end pathfindingsquare ----------

# ---- group: Collisions
crv_15 = Curve(flatten([pline, crv_14]))
colmm = CollisionManyMany(Colliders=crv_15)  # -> Collision, Indices
multiplication_31 = Multiplication(A=colmm.Collision, B=1000)
ma_8 = MassAddition(Input=multiplication_31)  # -> Result, PartialResults

# ---- group: Aislamientos
crossref = CrossReference(ListA=offset_5, ListB=offset_5, CrossMode=5)  # -> ListA, ListB
crvprox_3 = CurveProximity(CurveA=crossref.ListA, CurveB=crossref.ListB)  # -> PointA, PointB, Distance
item_7 = ListItem(List=multiplication_9, Index=0, Wrap=True)
expression_3 = Expression(x=crvprox_3.Distance, y=item_7, Expression="If( x > y, 0, 10000 )")

# ---- group: AreaPlanta
item_8 = ListItem(List=offset_5, Index=0, Wrap=True)
area_19 = Area(Geometry=item_8, UseTasks=False)  # -> Area, Centroid
panel_18 = Panel(area_19.Area)

# ---- group: Volumes
loft_2 = Loft(Curves=crv_12, Options={Adjust=False, Closed=False, LoftEnds=0, LoftSimp=0, LoftType=0, Rebuild=10, Refit=0.01})
cap = CapHoles(Brep=loft_2)
frgb_5 = ColourRGBF(Alpha=Slider(0.359, range=0..1), Red=Slider(0, range=0..1), Green=Slider(0, range=0..1), Blue=Slider(1, range=0..1))
preview_3 = CustomPreview(Geometry=cap, Material=frgb_5)

# ----
hull = ConvexHull(Points=disc_2.Points, Plane=PlaneXY(0, 0, 0))  # -> Hull, HullZ, Indices
area_20 = Area(Geometry=hull.Hull, UseTasks=False)  # -> Area, Centroid
expression_4 = Expression(x=area_20.Area, y=Slider(8300, range=0..10000), Expression="If( x > y, 100000, 0 )")

division_10 = Division(A=ma_4.Result, B=subtraction_2)

# ---- group: Parqueaderos (continued)
srf_5 = Surface(offset_6)

# ----
move_6 = Move(Geometry=srf_5, Motion=Z_3)  # -> Geometry, Transform

# ---- group: Parqueaderos (continued)
preview_4 = CustomPreview(Geometry=move_6.Geometry, Material=frgb)

# ---- group: Floors
move_7 = Move(Geometry=graft(offset_5), Motion=Z_2)  # -> simplify(Geometry), Transform
crv_16 = Curve(move_7.Geometry)
area_21 = Area(Geometry=crv_16, UseTasks=False)  # -> Area, Centroid
flatten_7 = FlattenTree(Tree=crv_16, Path="{0}")
crv_17 = Curve(flatten_7)
frgb_6 = ColourRGBF(Alpha=Slider(1, range=0..1), Red=Slider(0, range=0..1), Green=Slider(0, range=0..1), Blue=Slider(0, range=0..1))
ma_9 = MassAddition(Input=flatten(area_21.Area))  # -> Result, PartialResults
panel_19 = Panel(ma_9.Result)
previewlw_2 = CustomPreviewLineweights(Geometry=crv_17, Shader=frgb_6, Absolute=False)
cull_i_5 = CullIndex(List=area_21.Area, Indices=Slider(0, range=0..100), Wrap=True)

# ---- group: Alturas
lng_4 = ListLength(List=move_7.Geometry)
item_9 = ListItem(List=move_7.Geometry, Index=expr("x-1", lng_4), Wrap=True)
item_10 = ListItem(List=move_7.Geometry, Index=0, Wrap=True)
area_22 = Area(Geometry=item_10, UseTasks=False)  # -> Area, Centroid
area_23 = Area(Geometry=item_9, UseTasks=False)  # -> Area, Centroid
vec2pt_3 = Vector2Pt(PointA=area_22.Centroid, PointB=area_23.Centroid, Unitize=False)  # -> Vector, Length
num_4 = Number(flatten(vec2pt_3.Length))
vdis = VectorDisplay(Anchor=area_22.Centroid, Vector=vec2pt_3.Vector)

# ---- group: Volumes
loft_3 = Loft(Curves=crv_16, Options={Adjust=False, Closed=False, LoftEnds=0, LoftSimp=0, LoftType=0, Rebuild=10, Refit=0.01})
cap_2 = CapHoles(Brep=loft_3)
frgb_7 = ColourRGBF(Alpha=Slider(0.359, range=0..1), Red=Slider(1, range=0..1), Green=Slider(1, range=0..1), Blue=Slider(1, range=0..1))
preview_5 = CustomPreview(Geometry=cap_2, Material=frgb_7)

# ---- group: Floors / ÁreaXTorre
ma_10 = MassAddition(Input=cull_i_5)  # -> simplify(flatten(Result)), PartialResults

# ---- group: Floors / ÁreaTotal
ma_11 = MassAddition(Input=flatten(cull_i_5))  # -> Result, PartialResults

# ---- group: AreaVendible
multiplication_32 = Multiplication(A=ma_11.Result, B=number_slider_17)
subtraction_4 = Subtraction(A=ma_11.Result, B=multiplication_32)
ma_12 = MassAddition(Input=flatten([subtraction_4, area_13.Area, area_14.Area]))  # -> Result, PartialResults
areatotalplantas = Panel(subtraction_4)
panel_20 = Panel(ma_12.Result)

# ---- group: I.C
division_11 = Division(A=ma_12.Result, B=area_4.Area)
panel_21 = Panel(division_11)
expression_5 = Expression(
    x=division_11,
    y=Slider(2.4, range=0..10),
    z=Slider(1.7, range=0..10),
    Expression="If( ( x ≤ y ) and ( x ≥ z ), 0, 100000 )")

# ----
data_2 = Data(flatten([expression_5, ma_8.Result, expression_2, expression_3, multiplication_29, expression_4]))
ma_13 = MassAddition(Input=data_2)  # -> Result, PartialResults
panel_22 = Panel(ma_13.Result)
expression_6 = Expression(x=subtraction_4, y=num_3, Expression="If( x < y, 1000, 0 )")
galaplist = GalapagosListener(
    Genomes=[Z, X, Y, rotateone, parkx, parky, number_slider_25, number_slider_26, number_slider_7, number_slider_27],
    Fitness=ma_13.Result,
    Reset=Toggle(True))  # -> Fitness, Iterations

# ---- group: Floors (continued)
panel_23 = Panel(ma_11.Result)

# ----
panel_24 = Panel(galaplist.Iterations)
panel_25 = Panel(galaplist.Fitness)
merge = Merge(
    Data1=area_4.Area,
    Data2=ma_12.Result,
    Data3=panel_17,
    Data4=panel_21,
    Data5=division_10,
    Data6=subtraction_2,
    Data7=subtraction_4,
    Data8=area_7.Area,
    Data9=ma_4.Result,
    Data10=number_slider_4)
data_3 = Data(merge)
lng_5 = ListLength(List=num_4)
c_script_3 = CSharpScript(x=data_3, y=sort.ValuesA, z=multiplication_9, u=ma_10.Result, v=num_4)  # -> out, A; inputs x: list, y: list, z: list, u: list, v: list
# ---------- c_script_3: C# ----------
    var treeOut = new DataTree<object>();

    treeOut.AddRange(x, new GH_Path(0));

    for( int i = 0; i < x.Count; ++i )
    {

      treeOut.Add(null, new GH_Path(1));
      treeOut.Add(null, new GH_Path(2));
      treeOut.Add(null, new GH_Path(3));
      treeOut.Add(null, new GH_Path(4));

    }

    treeOut.AddRange(y, new GH_Path(1));
    treeOut.AddRange(z, new GH_Path(2));
    treeOut.AddRange(u, new GH_Path(3));
    treeOut.AddRange(v, new GH_Path(4));

    A = treeOut;
# ---------- end c_script_3 ----------
c_script_4 = CSharpScript(x=panel_5, y=lng_5)  # -> out, A; inputs x: list, y: Int32
# ---------- c_script_4: C# ----------
    for( int i = 1; i <= y; ++i )
    {

      string str = "Torre " + i.ToString();

      x.Add(str);

    }

    A = x;
# ---------- end c_script_4 ----------
panel_26 = Panel(c_script_4.A)
writexl = WriteToExcel(
    Run=Toggle(True),
    ExcelWorksheet="1",
    ColumnNames=panel_7,
    RowNames=c_script_4.A,
    WriteOptions="None",
    ColumnnsOrRows=False,
    DataToWriteIntoColumns=c_script_3.A)
panel_27 = Panel(c_script_3.A)
