# Grasshopper definition ResearchAndDevelopment.gh (Grasshopper 1.0.7)
# plug-ins: SpacePartition, Human

# ---- group: SeedPoints
number_slider = Slider(5, range=0..10)
dom = ConstructDomain(DomainStart=Slider(0, range=0..100), DomainEnd=Slider(1, range=0..1))
genemodifier = GenePoolModifier(
    GeneList="XOriginal",
    Count=number_slider,
    Domain=dom,
    Randomize=Button(),
    PercentageOfRandomization=Slider(1, range=0..1))
genemodifier_2 = GenePoolModifier(
    GeneList="YOriginal",
    Count=number_slider,
    Domain=dom,
    Randomize=Button(),
    PercentageOfRandomization=Slider(1, range=0..1))
xoriginal = GenePool(Decimals=1, Maximum=1, Minimum=0, Value=[0.8558526839, 0.2169540665, 0.1168040489, 0.8, 0.6])
yoriginal = GenePool(Decimals=1, Maximum=1, Minimum=0, Value=[0.06198411624, 0.2954958162, 0.3608458808, 0.4504960926, 0.4165781198])
pt = ConstructPoint(XCoordinate=xoriginal, YCoordinate=yoriginal, ZCoordinate=0)
crv = Curve(<curve referenced from the Rhino model>)
evalsrf = EvaluateSurface(Surface=reparameterize(crv), Point=pt)  # -> Point, Normal, UDirection, VDirection, Frame
srf_cp = SurfaceClosestPoint(Point=evalsrf.Point, Surface=crv)  # -> Point, UVPoint, Distance
pln = Plane(srf_cp.Point)
num = Number(1.112732212)
rotate = Rotate(Geometry=pln, Angle=expr("x-0.5*pi", num), Plane=srf_cp.Point)  # -> Geometry, Transform

# ----
vec = Vector(Vector(29.5053242, 59.8436735, 0))
vec_2 = Vector(Vector(59.8436735, -29.5053242, 0))

# ---- group: PorcentajeCirculacion
number_slider_2 = Slider(0.2, range=0..1)

# ----
rev = Reverse(Vector=vec_2)
rev_2 = Reverse(Vector=vec)
area = Area(Geometry=crv, UseTasks=False)  # -> Area, Centroid
move = Move(Geometry=area.Centroid, Motion=[vec_2, rev])  # -> Geometry, Transform
move_2 = Move(Geometry=area.Centroid, Motion=[vec, rev_2])  # -> Geometry, Transform
amp = Amplitude(Vector=vec_2, Amplitude=Slider(-0.347, range=-50..50))
ln = Line(StartPoint=area.Centroid, EndPoint=move.Geometry)
ln_2 = Line(StartPoint=area.Centroid, EndPoint=move_2.Geometry)

# ---- group: SameAreaDifferentRatios
txt = Text("Percentage")
number_slider_3 = Slider(573, range=0..1000)
dom_2 = ConstructDomain(DomainStart=Slider(0.6, range=0..1), DomainEnd=Slider(1.572, range=0..10))
genemodifier_3 = GenePoolModifier(GeneList=txt, Count=number_slider, Domain=dom_2, Randomize=Button(), PercentageOfRandomization=Slider(1, range=0..1))
multiplication = Multiplication(A=number_slider_3, B=number_slider_2)
addition = Addition(A=number_slider_3, B=multiplication)
percentage = GenePool(Decimals=2, Maximum=1.572, Minimum=0.6, Value=[0.8185636489, 1.47369883, 1.328884711, 1.355019236, 0.7203080311])
sqrt = SquareRoot(Value=addition)
multiplication_2 = Multiplication(A=sqrt, B=percentage)
division = Division(A=addition, B=multiplication_2)
multiplication_3 = Multiplication(A=division, B=0.5)
multiplication_4 = Multiplication(A=multiplication_2, B=0.5)
dom_3 = ConstructDomain(DomainStart=expr("-x", multiplication_4), DomainEnd=multiplication_4)
dom_4 = ConstructDomain(DomainStart=expr("-x", multiplication_3), DomainEnd=multiplication_3)
rectangle = Rectangle(Plane=rotate.Geometry, XSize=dom_3, YSize=dom_4, Radius=0)  # -> Rectangle, Length

# ----
move_3 = Move(Geometry=ln_2, Motion=amp)  # -> Geometry, Transform
amp_2 = Amplitude(Vector=vec, Amplitude=Slider(-4.838, range=-50..50))
move_4 = Move(Geometry=ln, Motion=amp_2)  # -> Geometry, Transform
join = JoinCurves(Curves=[move_4.Geometry, move_3.Geometry], Preserve=False)
ccx = CurveCurve(CurveA=crv, CurveB=join)  # -> Points, ParamsA, ParamsB
item = ListItem(List=ccx.Points, Index=0, Wrap=True)  # -> Item, Item1
ln_3 = Line(StartPoint=item.Item, EndPoint=item.Item1)

# ---- group: Rotations
dom_5 = ConstructDomain(DomainStart=0, DomainEnd=1)
rotations = GenePool(Decimals=0, Maximum=1, Minimum=0, Value=[0.3558625888, 0.2777851109, 0, 0.3850133677, 0.05726511639])
genemodifier_4 = GenePoolModifier(
    GeneList="Rotations",
    Count=number_slider,
    Domain=dom_5,
    Randomize=Button(),
    PercentageOfRandomization=Slider(1, range=0..1))
rad = Radians(Degrees=expr("x*90", rotations))
crv_2 = Curve(<curve referenced from the Rhino model>)
rotate_2 = Rotate(Geometry=rectangle.Rectangle, Angle=rad, Plane=rotate.Geometry)  # -> Geometry, Transform
drec = DeconstuctRectangle(Rectangle=crv_2)  # -> BasePlane, XInterval, YInterval
rotate_3 = Rotate(Geometry=drec.BasePlane, Angle=expr("x-0.5*pi", num), Plane=drec.BasePlane)  # -> Geometry, Transform
rad_2 = Radians(Degrees=Slider(30.728, range=0..360))
rectangle_2 = Rectangle(Plane=rotate_3.Geometry, XSize=drec.XInterval, YSize=drec.YInterval, Radius=0)  # -> Rectangle, Length
rotate_4 = Rotate(Geometry=rectangle_2.Rectangle, Angle=rad_2, Plane=drec.BasePlane)  # -> Geometry, Transform
scale_nu = ScaleNU(
    Geometry=rotate_4.Geometry,
    Plane=drec.BasePlane,
    ScaleX=Slider(0.899, range=0..1),
    ScaleY=Slider(0.873, range=0..1),
    ScaleZ=1)  # -> Geometry, Transform
rint = RegionIntersection(CurvesA=rotate_2.Geometry, CurvesB=scale_nu.Geometry)

# ---- group: DifferentialHeights
txt_2 = Text("Z")
dom_6 = ConstructDomain(DomainStart=Slider(5, range=0..10), DomainEnd=Slider(10, range=0..10))
genemodifier_5 = GenePoolModifier(GeneList=txt_2, Count=number_slider, Domain=dom_6, Randomize=Button(), PercentageOfRandomization=Slider(1, range=0..1))
Z = GenePool(Decimals=0, Maximum=10, Minimum=5, Value=[6.457290294, 9.164174443, 5.320175169, 8.657019482, 5.503441817])
number_slider_4 = Slider(2.4, range=0..10)
sort = SortList(Keys=Z, ValuesA=Z)  # -> Keys, ValuesA
series = Series(Start=0, Step=number_slider_4, Count=sort.ValuesA)
multiplication_5 = Multiplication(A=number_slider_4, B=sort.ValuesA)
Z_2 = UnitZ(Factor=series)
multiplication_6 = Multiplication(A=multiplication_5, B=Slider(0.2, range=0..1))
multiplication_7 = Multiplication(A=multiplication_5, B=Slider(0.3333, range=0..1))
move_5 = Move(Geometry=graft(rint), Motion=Z_2)  # -> simplify(Geometry), Transform

# ----
crv_3 = Curve(move_5.Geometry)

# ---- group: CustomContour
c_script = CSharpScript(curveTree=crv_3)  # -> indexPattern; inputs curveTree: tree of Curve
# ---------- c_script: C# ----------
    double maxZ = 0.0, minZ = 0.0;

    List<int> indexes = new List<int>();

    int branches = curveTree.BranchCount;

    indexes.Add(0);

    for( int i = 0; i < branches - 1; ++i )
    {

      maxZ = AreaMassProperties.Compute(curveTree.Branch(i)[curveTree.Branch(i).Count - 1]).Centroid.Z;

      minZ = AreaMassProperties.Compute(curveTree.Branch(i + 1)[curveTree.Branch(i).Count - 1]).Centroid.Z;

      for( int j = 0; j < curveTree.Branch(i).Count; ++j )
      {

        double Z = AreaMassProperties.Compute(curveTree.Branch(i)[j]).Centroid.Z;

        if( Z <= maxZ && Z >= minZ || Z == maxZ || Z == minZ )
        {

          indexes.Add(j);

        }

      }

    }

    maxZ = AreaMassProperties.Compute(curveTree.Branch(branches - 1)[curveTree.Branch(branches - 1).Count - 1]).Centroid.Z;
    minZ = AreaMassProperties.Compute(curveTree.Branch(branches - 2)[curveTree.Branch(branches - 2).Count - 1]).Centroid.Z;

    for( int i = 0; i < curveTree.Branch(branches - 1).Count; ++i )
    {

      double Z = AreaMassProperties.Compute(curveTree.Branch(branches - 1)[i]).Centroid.Z;

      if( Z <= maxZ && Z >= minZ && i == curveTree.Branch(branches - 1).Count - 1 )
      {

        indexes.Add(i);

      }

    }

    int fromI = 0, toI = 1;

    DataTree<int> dataOut = new DataTree<int>();
    int pather = 0;

    int countIndexes = indexes.Count, tempoCount = 0;

    for( int i = 2; i < countIndexes; ++i )
    {

      tempoCount++;

    }


    countIndexes += tempoCount;

    indexPattern = countIndexes;

    for( int i = 0; i < countIndexes; ++i )
    {

      var path = new GH_Path(pather);

      if( i % 2 == 0 )
      {

        dataOut.Add(indexes[fromI], path);
        dataOut.Add(indexes[toI], path);
        fromI++;
        toI++;
        pather++;

      }

    }
/*
    for( int i = 0; i < dataOut.BranchCount; ++i )
    {

      for( int j = 0; j < 2; ++j )
      {

        if( i % 2 != 1 && j % 2 != 0 )
        {

          dataOut.Branch(i)[j]--;

        }

      }

    }
*/
    indexPattern = dataOut;
/*
    var finalTree = new DataTree<int>(); int pathF = 0;

    for( int i = 0; i < dataOut.BranchCount; ++i )
    {

      if( dataOut.Branch(i)[0] != dataOut.Branch(i)[1] )
      {

        //if( i != 0 ) dataOut.Branch(i)[0]++;

        //if( i != dataOut.BranchCount - 1 && i != 0  ) dataOut.Branch(i)[1]++;

        finalTree.AddRange(dataOut.Branch(i), new GH_Path(pathF));

        pathF++;

      }

    }

    laterProcessing = finalTree;*/
# ---------- end c_script ----------
c_script_2 = CSharpScript(curveTree=crv_3, frameTree=crv_3, indexes=c_script)  # -> A, B; inputs curveTree: tree of Curve, frameTree: tree of Plane, indexes: tree of Int32
# ---------- c_script_2: C# ----------
    var curvesOut = new DataTree<Curve>();
    var planesOut = new DataTree<Plane>();
    int tracker = 0;

    GH_Path pathy = new GH_Path();
    int minIndex = 0, maxIndex = 0;

    for( int i = 0; i < curveTree.BranchCount; ++i )
    {

      for( int k = 0; k < curveTree.BranchCount; ++k )
      {

        pathy = new GH_Path(k);

        minIndex = indexes.Branch(k)[0];

        maxIndex = indexes.Branch(k)[1];

        if( minIndex != maxIndex )
        {

          for( int j = minIndex; j < maxIndex + 1; ++j )
          {

            if( k != 0 )
            {

              if( i > tracker )
              {

                curvesOut.Add(curveTree.Branch(i)[j], pathy);

              }

            }

            else
            {

              curvesOut.Add(curveTree.Branch(i)[j], pathy);

            }

            tracker = k - 1;

          }

        }

      }

    }

    int initialIndex = 0, finalIndex = 0;

    for( int i = 0; i < indexes.BranchCount; ++i )
    {

      initialIndex = indexes.Branch(i)[0];
      finalIndex = indexes.Branch(i)[1];
      
      //if( indexes.Branch(i)[0] != null ) indexes.Branch(i)[0]++;

      if( initialIndex != finalIndex )
      {

        for( int j = initialIndex; j < finalIndex + 1; ++j )
        {

          planesOut.Add(frameTree.Branch(i)[j], new GH_Path(i));

        }
        
      }

    }

    A = curvesOut;
    B = planesOut;
# ---------- end c_script_2 ----------
cull_i = CullIndex(List=c_script_2.B, Indices=0, Wrap=True)
area_2 = Area(Geometry=c_script_2.A, UseTasks=False)  # -> Area, Centroid
pdecon = Deconstruct(Point=area_2.Centroid)  # -> XComponent, YComponent, ZComponent
item_2 = ListItem(List=pdecon.ZComponent, Index=0, Wrap=True)
expression = Expression(x=item_2, y=pdecon.ZComponent, Expression="If( ( y - x ) < 0.01, False, True )")
cull = CullPattern(List=c_script_2.A, CullPattern=expression)
runion = RegionUnion(Curves=cull, Plane=cull_i)  # -> simplify(Result)
runion_2 = RegionUnion(Curves=rint)
area_3 = Area(Geometry=runion_2, UseTasks=False)  # -> Area, Centroid
c_script_3 = CSharpScript(x=runion_2, y=runion)  # -> A; inputs x: list of Curve, y: tree of Curve
# ---------- c_script_3: C# ----------
    var treeOut = new DataTree<Curve>();

    for( int i = 0; i < x.Count; ++i )
    {

      treeOut.Add(x[i], new GH_Path(0, i));

    }

    GH_Path path = new GH_Path();

    for( int i = 0; i < y.BranchCount; ++i )
    {

      path = y.Path(i);
      
      path = new GH_Path(path.Indices[0]+1, path.Indices[1]);

      for( int j = 0; j < y.Branch(i).Count; ++j )
      {

        treeOut.Add(y.Branch(i)[j], path);

      }

    }

    A = treeOut;
# ---------- end c_script_3 ----------

# ----
multiplication_8 = Multiplication(A=sort.ValuesA, B=0.3333)
offset = OffsetCurve(Curve=rint, Distance=multiplication_7, Plane=PlaneXY(0, 0, 0), Corners=1)
c_script_4 = CSharpScript(x=c_script_3)  # -> out, A; inputs x: tree of Curve
# ---------- c_script_4: C# ----------
    var dataOut = new DataTree<Curve>();
    var path = new GH_Path();

    for( int i = 0; i < x.BranchCount; ++i )
    {

      path = new GH_Path(i);

      //dataOut.AddRange(x.Branch(i), path);

      for( int j = 0; j < x.Branch(i).Count; ++j )
      {
  
        dataOut.Add( x.Branch(i)[j], path );
  
      }

    }

    A = dataOut;
# ---------- end c_script_4 ----------
item_3 = ListItem(List=multiplication_5, Index=0, Wrap=True)
flatten = FlattenTree(Tree=runion, Path="{0}")
area_4 = Area(Geometry=flatten, UseTasks=False)  # -> Area, Centroid
bang = ExplodeTree(Data=c_script_3)  # -> Branch0, Branch1, Branch2, Branch3, Branch4, Branch5, Branch6, Branch7, Branch8, Branch9
crv_4 = Curve([bang.Branch0, bang.Branch1])
crv_5 = Curve([bang.Branch0, bang.Branch1])
c_script_5 = CSharpScript(u=item_3, pt=area_3.Centroid, ptO=area_4.Centroid, curves=flatten)  # -> out, A; inputs u: Double, pt: list of Point3d, ptO: list of Point3d, curves: list of Curve
# ---------- c_script_5: C# ----------
    var treeOut = new DataTree<Curve>();

    for( int i = 0; i < pt.Count; ++i )
    {

      for( int j = 0; j < ptO.Count; ++j )
      {

        /*if( ( ptO[j].X - pt[i].X ) < 0.001 && ( ptO[j].Y - pt[i].Y ) < 0.001  )
        {

          treeOut.Add(curves[j], new GH_Path(i));

        }

        else*/ if( ( ptO[j].X - pt[i].X ) < 0.001 && ( ptO[j].Y - pt[i].Y ) < 0.001 )
        {

          treeOut.Add(curves[j], new GH_Path(i));

        }

      }

    }

    A = treeOut;
# ---------- end c_script_5 ----------
bang_2 = ExplodeTree(Data=c_script_5.A)  # -> Branch0, Branch1
shift = ShiftList(List=runion_2, Shift=1, Wrap=True)
crv_6 = Curve(bang_2.Branch0)
crvprox = CurveProximity(CurveA=runion_2, CurveB=shift)  # -> PointA, PointB, Distance
panel = Panel(crvprox.Distance)
ln_4 = Line(StartPoint=crvprox.PointA, EndPoint=crvprox.PointB)

# ---- group: Volumes
loft = Loft(Curves=crv_3, Options={Adjust=False, Closed=False, LoftEnds=0, LoftSimp=0, LoftType=0, Rebuild=10, Refit=0.01})
cap = CapHoles(Brep=loft)  # -> flatten(Brep)
frgb = ColourRGBF(Alpha=Slider(0.359, range=0..1), Red=Slider(1, range=0..1), Green=Slider(1, range=0..1), Blue=Slider(1, range=0..1))
sunion = SolidUnion(Breps=cap)
preview = CustomPreview(Geometry=sunion, Material=frgb)

# ---- group: Alturas
debrep = DeconstructBrep(Brep=sunion)  # -> Faces, Edges, Vertices
area_5 = Area(Geometry=debrep.Faces)  # -> Area, Centroid
pdecon_2 = Deconstruct(Point=area_5.Centroid)  # -> XComponent, YComponent, ZComponent
sort_2 = SortList(Keys=pdecon_2.ZComponent, ValuesA=area_5.Centroid)  # -> Keys, ValuesA
lng = ListLength(List=sort_2.Keys)
item_4 = ListItem(List=sort_2.ValuesA, Index=expr("x-1", lng), Wrap=True)
pdecon_3 = Deconstruct(Point=item_4)  # -> XComponent, YComponent, ZComponent
pt_2 = ConstructPoint(XCoordinate=pdecon_3.XComponent, YCoordinate=pdecon_3.YComponent, ZCoordinate=0)
vec2pt = Vector2Pt(PointA=pt_2, PointB=item_4, Unitize=False)  # -> Vector, Length
num_2 = Number(flatten(vec2pt.Length))
vdis = VectorDisplay(Anchor=pt_2, Vector=vec2pt.Vector)

# ----
multiplication_9 = Multiplication(A=num_2, B=0.3333)
panel_2 = Panel(multiplication_9)

# ---- group: Lote
crv_7 = Curve(<curve referenced from the Rhino model>)
crv_8 = Curve(<curve referenced from the Rhino model>)
area_6 = Area(Geometry=runion_2, UseTasks=False)  # -> Area, Centroid
area_7 = Area(Geometry=crv_7, UseTasks=False)  # -> Area, Centroid
area_8 = Area(Geometry=crv_8, UseTasks=False)  # -> Area, Centroid
ma = MassAddition(Input=flatten(area_6.Area))  # -> Result, PartialResults
panel_3 = Panel(area_7.Area)
panel_4 = Panel(area_8.Area)

# ---- group: I.O
ma_2 = MassAddition(Input=area_3.Area)  # -> Result, PartialResults
multiplication_10 = Multiplication(A=ma_2.Result, B=number_slider_2)
subtraction = Subtraction(A=ma_2.Result, B=multiplication_10)
ma_3 = MassAddition(Input=subtraction)  # -> Result, PartialResults
division_2 = Division(A=ma_3.Result, B=area_7.Area)
panel_5 = Panel(division_2)
expression_2 = Expression(
    x=division_2,
    y=Slider(0.31, range=0..10),
    z=Slider(0.24, range=0..1),
    Expression="If( ( x ≤ y ) and ( x ≥ z ), 0, 10000 )")

# ---- group: AreaPlanta
area_9 = Area(Geometry=runion_2, UseTasks=False)  # -> Area, Centroid
panel_6 = Panel(area_9.Area)

# ---- group: Floors
area_10 = Area(Geometry=c_script_3, UseTasks=False)  # -> Area, Centroid
flatten_2 = FlattenTree(Tree=c_script_3, Path="{0}")
crv_9 = Curve(flatten_2)
frgb_2 = ColourRGBF(Alpha=Slider(1, range=0..1), Red=Slider(0, range=0..1), Green=Slider(0, range=0..1), Blue=Slider(0, range=0..1))
ma_4 = MassAddition(Input=flatten(area_10.Area))  # -> Result, PartialResults
previewlw = CustomPreviewLineweights(Geometry=crv_9, Shader=frgb_2, Thickness=Slider(5, range=0..10), Absolute=False)
panel_7 = Panel(ma_4.Result)
cull_i_2 = CullIndex(List=area_10.Area, Indices=Slider(0, range=0..100), Wrap=True)

# ---- group: Floors / ÁreaXTorre
ma_5 = MassAddition(Input=cull_i_2)  # -> simplify(flatten(Result)), PartialResults

# ---- group: Floors / ÁreaTotal
ma_6 = MassAddition(Input=flatten(cull_i_2))  # -> Result, PartialResults

# ---- group: Floors (continued)
panel_8 = Panel(ma_6.Result)

# ---- group: AreaVendible
multiplication_11 = Multiplication(A=ma_6.Result, B=number_slider_2)
subtraction_2 = Subtraction(A=ma_6.Result, B=multiplication_11)
panel_9 = Panel(subtraction_2)

# ---- group: I.C
division_3 = Division(A=subtraction_2, B=area_7.Area)
panel_10 = Panel(division_3)
expression_3 = Expression(
    x=division_3,
    y=Slider(2.4, range=0..10),
    z=Slider(1.7, range=0..10),
    Expression="If( ( x ≤ y ) and ( x ≥ z ), 0, 100000 )")
