# Grasshopper definition ResearchAndDevelopment[0].gh (Grasshopper 1.0.7)
# plug-ins: SpacePartition, Human, Kangaroo2 Components

number_slider = Slider(5, range=0..10)
number_slider_2 = Slider(1, range=0..1)
vec = Vector(Vector(59.8436735, -29.5053242, 0))
vec_2 = Vector(Vector(29.5053242, 59.8436735, 0))
rev = Reverse(Vector=vec)
rev_2 = Reverse(Vector=vec_2)
crv = Curve(<curve referenced from the Rhino model>)

# ---- group: PorcentajeCirculacion
number_slider_3 = Slider(0.2, range=0..1)

# ----
area = Area(Geometry=crv, UseTasks=False)  # -> Area, Centroid
move = Move(Geometry=area.Centroid, Motion=[vec, rev])  # -> Geometry, Transform
move_2 = Move(Geometry=area.Centroid, Motion=[vec_2, rev_2])  # -> Geometry, Transform
ln = Line(StartPoint=area.Centroid, EndPoint=move.Geometry)
ln_2 = Line(StartPoint=area.Centroid, EndPoint=move_2.Geometry)
amp = Amplitude(Vector=vec_2, Amplitude=Slider(9.739, range=-50..50))
amp_2 = Amplitude(Vector=vec, Amplitude=Slider(-20.516, range=-50..50))
move_3 = Move(Geometry=ln, Motion=amp)  # -> Geometry, Transform
move_4 = Move(Geometry=ln_2, Motion=amp_2)  # -> Geometry, Transform
join = JoinCurves(Curves=[move_3.Geometry, move_4.Geometry], Preserve=False)
ccx = CurveCurve(CurveA=crv, CurveB=join)  # -> Points, ParamsA, ParamsB
item = ListItem(List=ccx.Points, Index=0, Wrap=True)  # -> Item, Item1
dom = ConstructDomain(DomainStart=Slider(0, range=0..100), DomainEnd=Slider(1, range=0..1))
ln_3 = Line(StartPoint=item.Item, EndPoint=item.Item1)
genemodifier = GenePoolModifier(GeneList="tParam", Count=number_slider, Domain=dom, Randomize=Button(), PercentageOfRandomization=Slider(1, range=0..1))
tparam = GenePool(Decimals=1, Maximum=1, Minimum=0, Value=[0.6123925571, 0.1886710945, 0.7685470776, 0.282694263, 0.593597757])
num = Number(1.112732212)
eval = EvaluateCurve(Curve=flatten(ln_3), Parameter=tparam)  # -> Point, Tangent, Angle
pln = Plane(eval.Point)
pln_2 = Plane(eval.Point)
rotate = Rotate(Geometry=pln_2, Angle=expr("x-0.5*pi", num), Plane=pln)  # -> Geometry, Transform

# ---- group: SameAreaDifferentRatios
txt = Text("Percentage")
number_slider_4 = Slider(573, range=0..1000)
dom_2 = ConstructDomain(DomainStart=Slider(0.6, range=0..1), DomainEnd=Slider(1.572, range=0..10))
genemodifier_2 = GenePoolModifier(GeneList=txt, Count=number_slider, Domain=dom_2, Randomize=Button(), PercentageOfRandomization=Slider(1, range=0..1))
multiplication = Multiplication(A=number_slider_4, B=number_slider_3)
addition = Addition(A=number_slider_4, B=multiplication)
percentage = GenePool(Decimals=2, Maximum=1.572, Minimum=0.6, Value=[1.572, 1.572, 1.572, 1.572, 1.572])
sqrt = SquareRoot(Value=addition)
multiplication_2 = Multiplication(A=sqrt, B=percentage)
division = Division(A=addition, B=multiplication_2)
multiplication_3 = Multiplication(A=division, B=0.5)
multiplication_4 = Multiplication(A=multiplication_2, B=0.5)
dom_3 = ConstructDomain(DomainStart=expr("-x", multiplication_4), DomainEnd=multiplication_4)
dom_4 = ConstructDomain(DomainStart=expr("-x", multiplication_3), DomainEnd=multiplication_3)
rectangle = Rectangle(Plane=rotate.Geometry, XSize=dom_3, YSize=dom_4, Radius=0)  # -> Rectangle, Length

# ----
radii = Radii(0.2)
crv_2 = Curve([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])

# ---- group: Rotations
rotations = GenePool(Decimals=0, Maximum=1, Minimum=0, Value=[0, 0, 0.3293048285, 0.2813390597, 0.2005870935])
dom_5 = ConstructDomain(DomainStart=0, DomainEnd=1)
genemodifier_3 = GenePoolModifier(
    GeneList="Rotations",
    Count=number_slider,
    Domain=dom_5,
    Randomize=Button(),
    PercentageOfRandomization=Slider(1, range=0..1))
rad = Radians(Degrees=expr("x*90", rotations))
crv_3 = Curve(<curve referenced from the Rhino model>)
rotate_2 = Rotate(Geometry=rectangle.Rectangle, Angle=rad, Plane=rotate.Geometry)  # -> Geometry, Transform
drec = DeconstuctRectangle(Rectangle=crv_3)  # -> BasePlane, XInterval, YInterval
rotate_3 = Rotate(Geometry=drec.BasePlane, Angle=expr("x-0.5*pi", num), Plane=drec.BasePlane)  # -> Geometry, Transform
rad_2 = Radians(Degrees=Slider(30.728, range=0..360))
rectangle_2 = Rectangle(Plane=rotate_3.Geometry, XSize=drec.XInterval, YSize=drec.YInterval, Radius=0)  # -> Rectangle, Length
rotate_4 = Rotate(Geometry=rectangle_2.Rectangle, Angle=rad_2, Plane=drec.BasePlane)  # -> Geometry, Transform
rint = RegionIntersection(CurvesA=rotate_2.Geometry, CurvesB=rotate_4.Geometry)

# ----
rotate_5 = Rotate(Geometry=rectangle_2.Rectangle, Angle=rad_2, Plane=drec.BasePlane)  # -> Geometry, Transform
number_slider_5 = Slider(2, range=0..10)
number_slider_6 = Slider(0.897, range=0..10)
scale_nu = ScaleNU(Geometry=rotate_5.Geometry, Plane=drec.BasePlane, ScaleX=number_slider_6, ScaleY=number_slider_6, ScaleZ=1)  # -> Geometry, Transform

# ---- group: Allows dragging with Alt+LMB
grab = Grab(On=True, Strength=100, Range=3)  # -> Grab, Anchors

# ---- group: Physics / EnclosingCurve
number_slider_7 = Slider(100, range=0..100)  # disabled
crv_4 = Curve(<curve referenced from the Rhino model>)
divide = DivideCurve(Curve=crv_4, Count=number_slider_7, Kinks=False, UseTasks=False)  # -> Points, Tangents, Parameters; disabled
disc = Discontinuity(Curve=crv_4, Level=2)  # -> Points, Parameters
offsettree = CSharpScript(tree=scale_nu.Geometry, distance=Slider(50, range=-20..100))  # -> out, A; inputs tree: tree of Curve, distance: Double
# ---------- offsettree: C# ----------
    /*var curves = x.Offset(Plane.WorldXY, -10, 1e-3, CurveOffsetCornerStyle.Sharp);

    var list = new List<Curve>();
    list.AddRange(curves);
    list.Add(x);

    Brep[] brep = Brep.CreateFromLoft(list, Point3d.Unset, Point3d.Unset, LoftType.Normal, false);

    A = brep;*/

    int branches = tree.BranchCount;

    DataTree<Curve> treeOut = new DataTree<Curve>();
    GH_Path path = new GH_Path();

    for( int i = 0; i < branches; ++i )
    {

      path = new GH_Path(i);

      //for( int j = 0; j < tree.Branch(i).Count; ++j )
      {

        treeOut.Add(tree.Branch(i)[0], path);
        treeOut.AddRange(tree.Branch(i)[0].Offset(Plane.WorldXY, distance, 1e-3, CurveOffsetCornerStyle.Sharp), path);

      }

    }

    A = treeOut;
# ---------- end offsettree ----------
loft = Loft(Curves=offsettree.A, Options={Adjust=False, Closed=False, LoftEnds=0, LoftSimp=0, LoftType=0, Rebuild=10, Refit=0.01})
debrep = DeconstructBrep(Brep=loft)  # -> simplify(Faces), Edges, Vertices
wires = BrepWireframe(Brep=debrep.Faces, Density=-1)
join_2 = JoinCurves(Curves=wires, Preserve=False)  # -> flatten(Curves)

# ---- group: DifferentialHeights
txt_2 = Text("Z")
dom_6 = ConstructDomain(DomainStart=Slider(5, range=0..10), DomainEnd=Slider(10, range=0..10))
genemodifier_4 = GenePoolModifier(GeneList=txt_2, Count=number_slider, Domain=dom_6, Randomize=Button(), PercentageOfRandomization=Slider(1, range=0..1))
Z = GenePool(Decimals=0, Maximum=10, Minimum=5, Value=[6.457290294, 9.164174443, 5.320175169, 8.657019482, 5.503441817])
number_slider_8 = Slider(2.4, range=0..10)
sort = SortList(Keys=Z, ValuesA=Z)  # -> Keys, ValuesA
series = Series(Start=0, Step=number_slider_8, Count=sort.ValuesA)
multiplication_5 = Multiplication(A=number_slider_8, B=sort.ValuesA)
Z_2 = UnitZ(Factor=series)
multiplication_6 = Multiplication(A=multiplication_5, B=Slider(0.2, range=0..1))
multiplication_7 = Multiplication(A=multiplication_5, B=Slider(0.3333, range=0..1))
move_5 = Move(Geometry=graft(rint), Motion=Z_2)  # -> simplify(Geometry), Transform

# ----
area_2 = Area(Geometry=rint, UseTasks=False)  # -> Area, Centroid

on = BooleanToggle(False)
reset = Button()

inter = InterconnectPoints(Pts=area_2.Centroid)
length_line = LengthLine(Line=inter, Strength=10)
multiplication_8 = Multiplication(A=multiplication_5, B=Slider(0.3333, range=0..1))
neg = Negative(Value=multiplication_8)
offset = OffsetCurve(Curve=rotate_2.Geometry, Distance=multiplication_8, Plane=PlaneXY(0, 0, 0), Corners=1)
relay = Relay()
relay_2 = Relay()
multiplication_9 = Multiplication(B=0.3333)
relay_3 = Relay()
relay_4 = Relay()
crv_5 = Curve(move_5.Geometry)

# ---- group: CustomContour
c_script = CSharpScript(curveTree=crv_5)  # -> indexPattern; inputs curveTree: tree of Curve
# ---------- c_script: C# ----------
    double maxZ = 0.0, minZ = 0.0;

    List<int> indexes = new List<int>();

    int branches = curveTree.BranchCount;

    indexes.Add(0);

    for( int i = 0; i < branches - 1; ++i )
    {

      maxZ = AreaMassProperties.Compute(curveTree.Branch(i)[curveTree.Branch(i).Count - 1]).Centroid.Z;

      minZ = AreaMassProperties.Compute(curveTree.Branch(i + 1)[curveTree.Branch(i).Count - 1]).Centroid.Z;

      for( int j = 0; j < curveTree.Branch(i).Count; ++j )
      {

        double Z = AreaMassProperties.Compute(curveTree.Branch(i)[j]).Centroid.Z;

        if( Z <= maxZ && Z >= minZ || Z == maxZ || Z == minZ )
        {

          indexes.Add(j);

        }

      }

    }

    maxZ = AreaMassProperties.Compute(curveTree.Branch(branches - 1)[curveTree.Branch(branches - 1).Count - 1]).Centroid.Z;
    minZ = AreaMassProperties.Compute(curveTree.Branch(branches - 2)[curveTree.Branch(branches - 2).Count - 1]).Centroid.Z;

    for( int i = 0; i < curveTree.Branch(branches - 1).Count; ++i )
    {

      double Z = AreaMassProperties.Compute(curveTree.Branch(branches - 1)[i]).Centroid.Z;

      if( Z <= maxZ && Z >= minZ && i == curveTree.Branch(branches - 1).Count - 1 )
      {

        indexes.Add(i);

      }

    }

    int fromI = 0, toI = 1;

    DataTree<int> dataOut = new DataTree<int>();
    int pather = 0;

    int countIndexes = indexes.Count, tempoCount = 0;

    for( int i = 2; i < countIndexes; ++i )
    {

      tempoCount++;

    }


    countIndexes += tempoCount;

    indexPattern = countIndexes;

    for( int i = 0; i < countIndexes; ++i )
    {

      var path = new GH_Path(pather);

      if( i % 2 == 0 )
      {

        dataOut.Add(indexes[fromI], path);
        dataOut.Add(indexes[toI], path);
        fromI++;
        toI++;
        pather++;

      }

    }
/*
    for( int i = 0; i < dataOut.BranchCount; ++i )
    {

      for( int j = 0; j < 2; ++j )
      {

        if( i % 2 != 1 && j % 2 != 0 )
        {

          dataOut.Branch(i)[j]--;

        }

      }

    }
*/
    indexPattern = dataOut;
/*
    var finalTree = new DataTree<int>(); int pathF = 0;

    for( int i = 0; i < dataOut.BranchCount; ++i )
    {

      if( dataOut.Branch(i)[0] != dataOut.Branch(i)[1] )
      {

        //if( i != 0 ) dataOut.Branch(i)[0]++;

        //if( i != dataOut.BranchCount - 1 && i != 0  ) dataOut.Branch(i)[1]++;

        finalTree.AddRange(dataOut.Branch(i), new GH_Path(pathF));

        pathF++;

      }

    }

    laterProcessing = finalTree;*/
# ---------- end c_script ----------
c_script_2 = CSharpScript(curveTree=crv_5, frameTree=crv_5, indexes=c_script)  # -> A, B; inputs curveTree: tree of Curve, frameTree: tree of Plane, indexes: tree of Int32
# ---------- c_script_2: C# ----------
    var curvesOut = new DataTree<Curve>();
    var planesOut = new DataTree<Plane>();
    int tracker = 0;

    GH_Path pathy = new GH_Path();
    int minIndex = 0, maxIndex = 0;

    for( int i = 0; i < curveTree.BranchCount; ++i )
    {

      for( int k = 0; k < curveTree.BranchCount; ++k )
      {

        pathy = new GH_Path(k);

        minIndex = indexes.Branch(k)[0];

        maxIndex = indexes.Branch(k)[1];

        if( minIndex != maxIndex )
        {

          for( int j = minIndex; j < maxIndex + 1; ++j )
          {

            if( k != 0 )
            {

              if( i > tracker )
              {

                curvesOut.Add(curveTree.Branch(i)[j], pathy);

              }

            }

            else
            {

              curvesOut.Add(curveTree.Branch(i)[j], pathy);

            }

            tracker = k - 1;

          }

        }

      }

    }

    int initialIndex = 0, finalIndex = 0;

    for( int i = 0; i < indexes.BranchCount; ++i )
    {

      initialIndex = indexes.Branch(i)[0];
      finalIndex = indexes.Branch(i)[1];
      
      //if( indexes.Branch(i)[0] != null ) indexes.Branch(i)[0]++;

      if( initialIndex != finalIndex )
      {

        for( int j = initialIndex; j < finalIndex + 1; ++j )
        {

          planesOut.Add(frameTree.Branch(i)[j], new GH_Path(i));

        }
        
      }

    }

    A = curvesOut;
    B = planesOut;
# ---------- end c_script_2 ----------
cull_i = CullIndex(List=c_script_2.B, Indices=0, Wrap=True)
area_3 = Area(Geometry=c_script_2.A, UseTasks=False)  # -> Area, Centroid
pdecon = Deconstruct(Point=area_3.Centroid)  # -> XComponent, YComponent, ZComponent
item_2 = ListItem(List=pdecon.ZComponent, Index=0, Wrap=True)
expression = Expression(x=item_2, y=pdecon.ZComponent, Expression="If( ( y - x ) < 0.01, False, True )")
cull = CullPattern(List=c_script_2.A, CullPattern=expression)
runion = RegionUnion(Curves=cull, Plane=cull_i)  # -> simplify(Result)
runion_2 = RegionUnion(Curves=rint)
area_4 = Area(Geometry=runion_2, UseTasks=False)  # -> Area, Centroid
c_script_3 = CSharpScript(x=runion_2, y=runion)  # -> A; inputs x: list of Curve, y: tree of Curve
# ---------- c_script_3: C# ----------
    var treeOut = new DataTree<Curve>();

    for( int i = 0; i < x.Count; ++i )
    {

      treeOut.Add(x[i], new GH_Path(0, i));

    }

    GH_Path path = new GH_Path();

    for( int i = 0; i < y.BranchCount; ++i )
    {

      path = y.Path(i);
      
      path = new GH_Path(path.Indices[0]+1, path.Indices[1]);

      for( int j = 0; j < y.Branch(i).Count; ++j )
      {

        treeOut.Add(y.Branch(i)[j], path);

      }

    }

    A = treeOut;
# ---------- end c_script_3 ----------

# ----
multiplication_10 = Multiplication(A=sort.ValuesA, B=0.3333)
offset_2 = OffsetCurve(Curve=rint, Distance=multiplication_7, Plane=PlaneXY(0, 0, 0), Corners=1)
c_script_4 = CSharpScript(x=c_script_3)  # -> out, A; inputs x: tree of Curve
# ---------- c_script_4: C# ----------
    var dataOut = new DataTree<Curve>();
    var path = new GH_Path();

    for( int i = 0; i < x.BranchCount; ++i )
    {

      path = new GH_Path(i);

      //dataOut.AddRange(x.Branch(i), path);

      for( int j = 0; j < x.Branch(i).Count; ++j )
      {
  
        dataOut.Add( x.Branch(i)[j], path );
  
      }

    }

    A = dataOut;
# ---------- end c_script_4 ----------
item_3 = ListItem(List=multiplication_5, Index=0, Wrap=True)
flatten = FlattenTree(Tree=runion, Path="{0}")
area_5 = Area(Geometry=flatten, UseTasks=False)  # -> Area, Centroid
c_script_5 = CSharpScript(u=item_3, pt=area_4.Centroid, ptO=area_5.Centroid, curves=flatten)  # -> out, A; inputs u: Double, pt: list of Point3d, ptO: list of Point3d, curves: list of Curve
# ---------- c_script_5: C# ----------
    var treeOut = new DataTree<Curve>();

    for( int i = 0; i < pt.Count; ++i )
    {

      for( int j = 0; j < ptO.Count; ++j )
      {

        /*if( ( ptO[j].X - pt[i].X ) < 0.001 && ( ptO[j].Y - pt[i].Y ) < 0.001  )
        {

          treeOut.Add(curves[j], new GH_Path(i));

        }

        else*/ if( ( ptO[j].X - pt[i].X ) < 0.001 && ( ptO[j].Y - pt[i].Y ) < 0.001 )
        {

          treeOut.Add(curves[j], new GH_Path(i));

        }

      }

    }

    A = treeOut;
# ---------- end c_script_5 ----------
bang = ExplodeTree(Data=c_script_5.A)  # -> Branch0, Branch1
shift = ShiftList(List=runion_2, Shift=1, Wrap=True)
crv_6 = Curve(bang.Branch0)
crvprox = CurveProximity(CurveA=runion_2, CurveB=shift)  # -> PointA, PointB, Distance
panel = Panel(crvprox.Distance)
ln_4 = Line(StartPoint=crvprox.PointA, EndPoint=crvprox.PointB)

# ---- group: Volumes
loft_2 = Loft(Curves=crv_5, Options={Adjust=False, Closed=False, LoftEnds=0, LoftSimp=0, LoftType=0, Rebuild=10, Refit=0.01})
cap = CapHoles(Brep=loft_2)  # -> flatten(Brep)
frgb = ColourRGBF(Alpha=Slider(0.359, range=0..1), Red=Slider(1, range=0..1), Green=Slider(1, range=0..1), Blue=Slider(1, range=0..1))
sunion = SolidUnion(Breps=cap)
preview = CustomPreview(Geometry=sunion, Material=frgb)

# ---- group: Alturas
debrep_2 = DeconstructBrep(Brep=sunion)  # -> Faces, Edges, Vertices
area_6 = Area(Geometry=debrep_2.Faces)  # -> Area, Centroid
pdecon_2 = Deconstruct(Point=area_6.Centroid)  # -> XComponent, YComponent, ZComponent
sort_2 = SortList(Keys=pdecon_2.ZComponent, ValuesA=area_6.Centroid)  # -> Keys, ValuesA
lng = ListLength(List=sort_2.Keys)
item_4 = ListItem(List=sort_2.ValuesA, Index=expr("0", lng), Wrap=True)
item_5 = ListItem(List=sort_2.ValuesA, Index=expr("x-1", lng), Wrap=True)
vec2pt = Vector2Pt(PointA=item_4, PointB=item_5, Unitize=False)  # -> Vector, Length
num_2 = Number(flatten(vec2pt.Length))
vdis = VectorDisplay(Anchor=item_4, Vector=vec2pt.Vector)

# ----
multiplication_11 = Multiplication(A=num_2, B=0.3333)
panel_2 = Panel(multiplication_11)

# ---- group: Lote
crv_7 = Curve(<curve referenced from the Rhino model>)
crv_8 = Curve(<curve referenced from the Rhino model>)
area_7 = Area(Geometry=runion_2, UseTasks=False)  # -> Area, Centroid
area_8 = Area(Geometry=crv_7, UseTasks=False)  # -> Area, Centroid
area_9 = Area(Geometry=crv_8, UseTasks=False)  # -> Area, Centroid
ma = MassAddition(Input=flatten(area_7.Area))  # -> Result, PartialResults
panel_3 = Panel(area_8.Area)
panel_4 = Panel(area_9.Area)

# ---- group: I.O
ma_2 = MassAddition(Input=area_4.Area)  # -> Result, PartialResults
multiplication_12 = Multiplication(A=ma_2.Result, B=number_slider_3)
subtraction = Subtraction(A=ma_2.Result, B=multiplication_12)
ma_3 = MassAddition(Input=subtraction)  # -> Result, PartialResults
division_2 = Division(A=ma_3.Result, B=area_8.Area)
panel_5 = Panel(division_2)
expression_2 = Expression(
    x=division_2,
    y=Slider(0.31, range=0..10),
    z=Slider(0.24, range=0..1),
    Expression="If( ( x ≤ y ) and ( x ≥ z ), 0, 10000 )")

# ---- group: AreaPlanta
area_10 = Area(Geometry=runion_2, UseTasks=False)  # -> Area, Centroid
panel_6 = Panel(area_10.Area)

# ---- group: Physics
pline = PolyLine(Vertices=disc.Points, Closed=True)
relay_5 = Relay()
pln_3 = Plane(relay)
pln_4 = Plane(relay_2)
relay_6 = Relay()
flatten_2 = FlattenTree(Tree=rotate.Geometry, Path="{0}")
flatten_3 = FlattenTree(Tree=offset, Path="{0}")
cc = CurveCollide(
    Curves=flatten(flatten_3),
    Frames=flatten_2,
    PassiveCurves=join_2,
    BasePlane=PlaneXY(0, 0, 0),
    Strength=Slider(1, range=0..10))  # -> Goal, Frames

# ----
crv_9 = Curve(flatten_3)
area_11 = Area(Geometry=crv_9)  # -> Area, Centroid
offset_3 = Offset(Curve=crv_9, Distance=multiplication_8, Plane=PlaneXY(0, 0, 0), Corners=1)
spctopo = SpaceTopology(Curves=crv_9)
ma_4 = MassAddition(Input=area_11.Area)  # -> Result, PartialResults
explode = Explode(Curve=offset_3, Recursive=True)  # -> Segments, Vertices
pcen = PolygonCenter(Polyline=graft(offset_3))  # -> CenterV, CenterE, CenterA
disc_2 = Discontinuity(Curve=offset_3, Level=1)  # -> Points, Parameters
linetopo = LineTopology(PointTree=pcen.CenterV, Topology=spctopo)
pt = Point([disc_2.Points, pcen.CenterV])
line = Line(explode.Segments)
pt_2 = Point(flatten(pcen.CenterV))

# ---- group: keep everything on the plane
cullpt = CullDuplicates(Points=flatten(explode.Vertices), Tolerance=0.1, CullMode=3)  # -> Points, Indices, Valence
anchorxyz = AnchorXYZ(Point=cullpt.Points, X=False, Y=False, Z=True, Strength=1000)

# ----
show = Show(G=offset_3)
crossref = CrossReference(ListA=pt, ListB=pt, CrossMode=5)  # -> ListA, ListB
item_6 = ListItem(List=pt_2, Index=0, Wrap=True)  # -> Item, Item1, Item2, Item3, Item4, Item5
collider = Collider(Objects=flatten(line), Radii=multiplication_8, Strength=1000)
ln_5 = Line(StartPoint=crossref.ListA, EndPoint=crossref.ListB)
length_line_2 = LengthLine(Line=ln_5, Strength=1000)

# ---- group: choosing which pairs to attract
ln_6 = Line(StartPoint=item_6.Item, EndPoint=item_6.Item1)
ln_7 = Line(StartPoint=item_6.Item, EndPoint=item_6.Item2)
ln_8 = Line(StartPoint=item_6.Item, EndPoint=item_6.Item3)
ln_9 = Line(StartPoint=item_6.Item3, EndPoint=item_6.Item4)
ln_10 = Line(StartPoint=item_6.Item4, EndPoint=item_6.Item5)
ln_11 = Line(StartPoint=item_6.Item1, EndPoint=item_6.Item2)
ln_12 = Line(StartPoint=item_6.Item1, EndPoint=item_6.Item5)
ln_13 = Line(StartPoint=item_6.Item3, EndPoint=item_6.Item5)

# ----
length_line_3 = LengthLine(Line=flatten(linetopo), Length=0, Strength=0.05)
data = Data([length_line_3, collider, anchorxyz, length_line_2])
entwine = Entwine(Branch00=show, Branch01=data, FlattenInputs=True)
zombiesolver = ZombieSolver(GoalObjects=flatten(entwine), Threshold=1e-10, Tolerance=0.01, MaxIterations=Slider(0, range=0..100))  # -> I, V, O
solver = Solver(GoalObjects=entwine, Reset=reset, Threshold=1e-10, Tolerance=0.01, On=on)  # -> I, V, O
crv_10 = Curve(zombiesolver.O)
bang_2 = ExplodeTree(Data=solver.O)  # -> Branch0, Branch1
bang_3 = ExplodeTree(Data=zombiesolver.O)  # -> Branch0, Branch1
cls = Closed(Curve=crv_10)  # -> Closed, Periodic
customkangaroo = CSharpScript(
    Goals=entwine,
    Reset=Toggle(True),
    Iter=Slider(92, range=0..100),
    Reference="C:\Program Files\Rhino 6\Plug-ins\Grasshopper\Components\KangarooSolver.dll")  # -> A; inputs Goals: list, Reset: Boolean, Iter: Int32
# ---------- customkangaroo: C# usings ----------
using System.IO;
using System.Linq;
using System.Data;
using System.Drawing;
using System.Reflection;
using System.Windows.Forms;
using System.Xml;
using System.Xml.Linq;
using System.Runtime.InteropServices;

using Rhino.DocObjects;
using Rhino.Collections;
using GH_IO;
using GH_IO.Serialization;
using KangarooSolver;
using KangarooSolver.Goals;
# ---------- customkangaroo: C# ----------
    if( Reset )
    {

      PS = new KangarooSolver.PhysicalSystem();

      GoalList.Clear();

      foreach( IGoal G in Goals ) //Assign indexes to the particles in each Goal:
        //System.Threading.Tasks.Parallel.ForEach(Goals, G =>
      {

        PS.AssignPIndex(G, 0.0001); // the second argument is the tolerance distance below which points combine into a single particle
        GoalList.Add(G);

      }
      //);

    }

    for( int i = 0; i < Iter; ++i )
      //System.Threading.Tasks.Parallel.For(0, Iter, i =>
    {

      PS.Step(GoalList, true, 1);

    }
    //);

    A = PS.GetOutput(GoalList);
# ---------- customkangaroo: C# additional code ----------
  KangarooSolver.PhysicalSystem PS = new KangarooSolver.PhysicalSystem();
  List<IGoal> GoalList = new List<IGoal>();
# ---------- end customkangaroo ----------
cull_2 = CullPattern(List=crv_10, CullPattern=cls.Closed)
offset_4 = Offset(Curve=bang_2.Branch0, Distance=expr("-x", multiplication_8), Plane=PlaneXY(0, 0, 0), Corners=1)
clean = CleanTree(RemoveNulls=True, RemoveInvalid=True, RemoveEmpty=False, Tree=customkangaroo)
offset_5 = Offset(Curve=cull_2, Distance=expr("-x", multiplication_8), Plane=PlaneXY(0, 0, 0), Corners=1)
objecttocurves = CSharpScript(x=clean)  # -> A; inputs x: list
# ---------- objecttocurves: C# ----------
    /*
    var listOut = new DataTree<Curve>();
    var list = new object[x.Count];
    Curve temp = null;

    for( int i = 0; i < x.Count; ++i )
    {

      list = ( object[] ) x[i];

      for( int j = 0; j < list.Length; ++j )
      {

        GH_Convert.ToCurve(list[j], ref temp, GH_Conversion.Both);

        listOut.Add(temp, new GH_Path(i));

      }

    }
*/
    A = x[0];
# ---------- end objecttocurves ----------
pln_5 = Plane(relay_5)
data_2 = Data(flatten(cc.Goal))
solver_2 = Solver(GoalObjects=data_2, Reset=Button(), Threshold=1e-15, Tolerance=0.01, On=Toggle(False))  # -> I, V, O

# ---- group: Physics (continued)
customkangaroo_2 = CSharpScript(
    Goals=data_2,
    Reset=Toggle(True),
    Iter=Slider(20, range=0..100),
    Reference="C:\Program Files\Rhino 6\Plug-ins\Grasshopper\Components\KangarooSolver.dll")  # -> A; inputs Goals: list, Reset: Boolean, Iter: Int32; same code as customkangaroo
clean_2 = CleanTree(RemoveNulls=True, RemoveInvalid=True, RemoveEmpty=False, Tree=customkangaroo_2)
objecttocurves_2 = CSharpScript(x=clean_2)  # -> A; inputs x: list; disabled
# ---------- objecttocurves_2: C# ----------
    var listOut = new DataTree<Curve>();
    var list = new object[x.Count];
    Curve temp = null;
    
    for( int i = 0; i < x.Count; ++i )
    {
      
      list = ( object[] ) x[i];
      
      for( int j = 0; j < list.Length; ++j )
      {
        
        GH_Convert.ToCurve(list[j], ref temp, GH_Conversion.Both);
        
        listOut.Add(temp, new GH_Path(i));
      
      }
        
    }
    
    A = listOut;
# ---------- end objecttocurves_2 ----------

# ----
objecttocurves_3 = CSharpScript(x=clean_2)  # -> A; inputs x: list; same code as objecttocurves

# ---- group: Floors
area_12 = Area(Geometry=c_script_3, UseTasks=False)  # -> Area, Centroid
flatten_4 = FlattenTree(Tree=c_script_3, Path="{0}")
crv_11 = Curve(flatten_4)
frgb_2 = ColourRGBF(Alpha=Slider(1, range=0..1), Red=Slider(0, range=0..1), Green=Slider(0, range=0..1), Blue=Slider(0, range=0..1))
ma_5 = MassAddition(Input=flatten(area_12.Area))  # -> Result, PartialResults
previewlw = CustomPreviewLineweights(Geometry=crv_11, Shader=frgb_2, Thickness=Slider(5, range=0..10), Absolute=False)
panel_7 = Panel(ma_5.Result)
cull_i_2 = CullIndex(List=area_12.Area, Indices=Slider(0, range=0..100), Wrap=True)

# ---- group: Floors / ÁreaXTorre
ma_6 = MassAddition(Input=cull_i_2)  # -> simplify(flatten(Result)), PartialResults

# ---- group: Floors / ÁreaTotal
ma_7 = MassAddition(Input=flatten(cull_i_2))  # -> Result, PartialResults

# ---- group: Floors (continued)
panel_8 = Panel(ma_7.Result)

# ---- group: AreaVendible
multiplication_13 = Multiplication(A=ma_7.Result, B=number_slider_3)
subtraction_2 = Subtraction(A=ma_7.Result, B=multiplication_13)
panel_9 = Panel(subtraction_2)

# ---- group: I.C
division_3 = Division(A=subtraction_2, B=area_8.Area)
panel_10 = Panel(division_3)
expression_3 = Expression(
    x=division_3,
    y=Slider(2.4, range=0..10),
    z=Slider(1.7, range=0..10),
    Expression="If( ( x ≤ y ) and ( x ≥ z ), 0, 100000 )")
