# Grasshopper definition ResearchAndDevelopment[1].gh (Grasshopper 1.0.7)
# plug-ins: SpacePartition, Human, PTComponentLibrary

vec = Vector(Vector(29.5053242, 59.8436735, 0))
vec_2 = Vector(Vector(59.8436735, -29.5053242, 0))
crv = Curve(<curve referenced from the Rhino model>)
number_slider = Slider(5, range=0..10)
number_slider_2 = Slider(20, range=0..100)
number_slider_3 = Slider(5, range=0..10)
number_slider_4 = Slider(7, range=0..100)
area = Area(Geometry=crv, UseTasks=False)  # -> Area, Centroid
srf = Surface(crv)
ptsrfdomchord = SurfaceDomainChordDistance(Surface=crv, UDistance=Slider(3, range=0..10), VDistance=Slider(3, range=0..10))
disc = Discontinuity(Curve=crv, Level=2)  # -> Points, Parameters
ptplanar = PlanarGrid(
    BasePoint=area.Centroid,
    IDir=Vector(1, 0, 0),
    JDir=Vector(0, 1, 0),
    IDistance=number_slider,
    JDistance=number_slider,
    INumber=number_slider_2,
    JNumber=number_slider_2)
number_slider_5 = Slider(1, range=0..1)
sdivide = DivideSurface(Surface=srf, UCount=number_slider_2, VCount=number_slider_2)  # -> Points, Normals, Parameters
dom = ConstructDomain(DomainStart=Slider(1, range=0..1), DomainEnd=Slider(3, range=0..100))
pline = PolyLine(Vertices=disc.Points, Closed=True)
ptborders = GenerateBorders(Grid=ptsrfdomchord, PanelShape=0)

# ---- group: Comunal
number_slider_6 = Slider(1, range=0..10)
matrixsize = CSharpScript(grid=ptborders)  # -> A, B; inputs grid: tree of Curve
# ---------- matrixsize: C# ----------
    A = grid.BranchCount;
    B = grid.Branch(0).Count;
# ---------- end matrixsize ----------
dom_2 = ConstructDomain(DomainStart=Slider(1, range=0..1), DomainEnd=Slider(3, range=0..100))
genemodifier = GenePoolModifier(
    GeneList="horT",
    Count=number_slider_6,
    Domain=dom_2,
    Randomize=Button(),
    PercentageOfRandomization=Slider(1, range=0..1))
idxt = GenePool(Decimals=0, Maximum=32, Minimum=3, Value=24)
idyt = GenePool(Decimals=0, Maximum=31, Minimum=3, Value=22)
hort = GenePool(Decimals=0, Maximum=3, Minimum=1, Value=2)
number_slider_7 = Slider(3, range=0..10)
subtraction = Subtraction(A=matrixsize.B, B=number_slider_7)
subtraction_2 = Subtraction(A=matrixsize.A, B=number_slider_7)
dom_3 = ConstructDomain(DomainStart=number_slider_7, DomainEnd=subtraction)
dom_4 = ConstructDomain(DomainStart=number_slider_7, DomainEnd=subtraction_2)
genemodifier_2 = GenePoolModifier(
    GeneList="idyT",
    Count=number_slider_6,
    Domain=dom_3,
    Randomize=Button(),
    PercentageOfRandomization=Slider(1, range=0..1))
genemodifier_3 = GenePoolModifier(
    GeneList="idxT",
    Count=number_slider_6,
    Domain=dom_4,
    Randomize=Button(),
    PercentageOfRandomization=Slider(1, range=0..1))
inversegenepool = CSharpScript(genePool=hort, min=Slider(1, range=0..10), max=number_slider_7)  # -> A, B; inputs genePool: list of Int32, min: Int32, max: Int32
# ---------- inversegenepool: C# ----------
    int size = genePool.Count;

    int temp = 0;

    double[] array = new double[size], arrayOne = new double[size];

    for( int i = 0; i < size; ++i )
    {

      temp = genePool[i];

      if( temp % 2 != 1 )
      {

        array[i] = min;
        arrayOne[i] = max;

      }

      else//( temp == 2 )
      {

        array[i] = max;
        arrayOne[i] = min;

      }

    }

    A = array;
    B = arrayOne;
# ---------- end inversegenepool ----------
pickgeometries = CSharpScript(grid=ptborders, idx=idxt, idy=idyt, hor=inversegenepool.A, ver=inversegenepool.B)  # -> simplify(A); inputs grid: tree of Curve, idx: Int32, idy: Int32, hor: Int32, ver: Int32
# ---------- pickgeometries: C# ----------
    int branchCount = grid.BranchCount;
    int maxTreeBranchCount = grid.Branch(branchCount - 1).Count;

    int x = idx % branchCount, y = idy % maxTreeBranchCount;

    List<Curve> array = new List<Curve>();

    int vertical = ver, horizontal = hor;

    for( int xx = x - vertical; xx <= x + vertical; ++xx )
    {

      for( int yy = y - horizontal; yy <= y + horizontal; ++yy )
      {

        if( xx >= 0 && xx < branchCount && yy >= 0 && yy < maxTreeBranchCount )

          array.Add(grid.Branch(xx)[yy]);

      }

    }

    A = array;
# ---------- end pickgeometries ----------
runion = RegionUnion(Curves=pickgeometries)  # -> simplify(Result)
area_2 = Area(Geometry=runion)  # -> Area, Centroid
panel = Panel(area_2.Area)
srf_2 = Surface(runion)
Z = UnitZ(Factor=Slider(0.01, range=0..0.01))
frgb = ColourRGBF(Alpha=Slider(1, range=0..1), Red=Slider(0, range=0..1), Green=Slider(0, range=0..1), Blue=Slider(1, range=0..1))
move = Move(Geometry=srf_2, Motion=Z)  # -> Geometry, Transform
preview = CustomPreview(Geometry=move.Geometry, Material=frgb)

# ----
matrixsize_2 = CSharpScript(grid=ptborders)  # -> A, B; inputs grid: tree of Curve; same code as matrixsize
inside = PointWithinCurve(pts=ptsrfdomchord, crv=pline)  # -> simplify(B); inputs pts: list of Point3d, crv: list of Polyline
# ---------- inside: C# usings ----------
using System.IO;
using System.Linq;
using System.Data;
using System.Drawing;
using System.Reflection;
using System.Windows.Forms;
using System.Xml;
using System.Xml.Linq;
using System.Runtime.InteropServices;

using Rhino.DocObjects;
using Rhino.Collections;
using GH_IO;
using GH_IO.Serialization;
# ---------- inside: C# ----------
    var outside = new DataTree<Point3d>(); //Outside(pts, crv);

    var temp = Outside(pts, crv[0]);

    foreach( var item in temp )
    {

      outside.Add(item, new GH_Path(0));

    }
    /*
    temp = Outside(outside.Branch(0), crv[1]);

    foreach( var item in temp )
    {

      outside.Add( item, new GH_Path(1) );

    }

    temp = Outside(outside.Branch(1), crv[2]);*/

    for( int i = 1; i < crv.Count; ++i )
    {

      foreach( var item in temp )
      {

        outside.Add(item, new GH_Path(i));

      }

      temp = Outside(outside.Branch(i), crv[i]);

    }

    B = temp;
# ---------- inside: C# additional code ----------
  System.Collections.Concurrent.ConcurrentBag<Point3d> Outside(List<Point3d> pts, Polyline crv)
  {

    var inside = new System.Collections.Concurrent.ConcurrentBag<Point3d>();
    System.Threading.Tasks.Parallel.ForEach(pts, pt =>
      {
      if(IsInside(pt, crv))
      {
        inside.Add(pt);
      }
      });

    return inside;

  }

  bool IsInside (Point3d pt, Polyline crv)
  {
    Point3d pt1, pt2;
    bool oddNodes = false;

    for (int i = 0; i < crv.SegmentCount; i++) //for each contour line
    {

      pt1 = crv.SegmentAt(i).From; //get start and end pt
      pt2 = crv.SegmentAt(i).To;

      if ( (pt1[1] < pt[1] && pt2[1] >= pt[1] || pt2[1] < pt[1] && pt1[1] >= pt[1]) && (pt1[0] <= pt[0] || pt2[0] <= pt[0]) ) //if pt is between pts in y, and either of pts is before pt in x
        oddNodes ^= ( pt2[0] + (pt[1] - pt2[1]) * (pt1[0] - pt2[0]) / (pt1[1] - pt2[1]) < pt[0] ); //^= is xor
      //end.X + (pt-end).Y   * (start-end).X  /(start-end).Y   <   pt.X
    }


    if (!oddNodes)
    {
      double minDist = 1e10;
      for (int i = 0; i < crv.SegmentCount; i++) {
        Point3d cp = crv.SegmentAt(i).ClosestPoint(pt, true);
        //Point3d cp = mvContour[i].closestPoint(pt);
        //minDist = min(minDist, cp.distance(pt));
        minDist = Math.Min(minDist, cp.DistanceTo(pt));
      }
      if (minDist < 1e-10)
        return true;
    }

    if(oddNodes) return true;

    return false;
  }
# ---------- end inside ----------
prune = PruneTree(Tree=inside, Minimum=Slider(1, range=0..100), Maximum=0)
flip = FlipMatrix(Data=ptborders)
genemodifier_4 = GenePoolModifier(GeneList="hor", Count=number_slider_3, Domain=dom, Randomize=Button(), PercentageOfRandomization=Slider(1, range=0..1))
clean = CleanTree(RemoveNulls=True, RemoveInvalid=True, RemoveEmpty=False, Tree=inside)

# ---- group: Parqueaderos
number_slider_8 = Slider(9, range=0..10)
number_slider_9 = Slider(5, range=0..10)

# ----
flatten = FlattenTree(Tree=flip, Path="{0}")  # disabled
idx = GenePool(Decimals=0, Maximum=30, Minimum=5, Value=[5, 5, 6, 13, 9])
idy = GenePool(Decimals=0, Maximum=29, Minimum=5, Value=[16, 10, 8, 22, 18])
hor = GenePool(Decimals=0, Maximum=3, Minimum=1, Value=[1, 1, 1, 2, 1])
ptborders_2 = GenerateBorders(Grid=inside, PanelShape=0)

number_slider_10 = Slider(5, range=0..10)

subtraction_3 = Subtraction(A=matrixsize_2.B, B=number_slider_10)
subtraction_4 = Subtraction(A=matrixsize_2.A, B=number_slider_10)
dom_5 = ConstructDomain(DomainStart=number_slider_10, DomainEnd=subtraction_3)
dom_6 = ConstructDomain(DomainStart=number_slider_10, DomainEnd=subtraction_4)
genemodifier_5 = GenePoolModifier(GeneList="idy", Count=number_slider_3, Domain=dom_5, Randomize=Button(), PercentageOfRandomization=Slider(1, range=0..1))
genemodifier_6 = GenePoolModifier(GeneList="idx", Count=number_slider_3, Domain=dom_6, Randomize=Button(), PercentageOfRandomization=Slider(1, range=0..1))
pline_2 = PolyLine(Vertices=prune, Closed=False)
flip_2 = FlipMatrix(Data=prune)
pline_3 = PolyLine(Vertices=flip_2, Closed=False)
number_slider_11 = Slider(0, range=0..1)
dom_7 = ConstructDomain(DomainStart=Slider(5, range=0..100), DomainEnd=Slider(15, range=0..100))

# ---- group: Algo
inversegenepool_2 = CSharpScript(genePool=hor, min=Slider(2, range=0..10), max=number_slider_10)  # -> A, B; inputs genePool: list of Int32, min: Int32, max: Int32; same code as inversegenepool
pickgeometries_2 = CSharpScript(grid=ptborders, idx=idx, idy=idy, hor=inversegenepool_2.A, ver=inversegenepool_2.B)  # -> simplify(A); inputs grid: tree of Curve, idx: Int32, idy: Int32, hor: Int32, ver: Int32; same code as pickgeometries

# ----
genemodifier_7 = GenePoolModifier(GeneList="hei", Count=number_slider_3, Domain=dom_7, Randomize=Button(), PercentageOfRandomization=Slider(1, range=0..1))
hei = GenePool(Decimals=0, Maximum=15, Minimum=5, Value=[10, 7, 6, 10, 12])
frgb_2 = ColourRGBF(Alpha=1, Red=number_slider_11, Green=number_slider_11, Blue=number_slider_11)
runion_2 = RegionUnion(Curves=pickgeometries_2)  # -> simplify(Result)
previewlw = CustomPreviewLineweights(Geometry=ptborders, Shader=frgb_2, Thickness=Slider(1, range=0..1), Absolute=False)
area_3 = Area(Geometry=runion_2)  # -> Area, Centroid
sort = SortList(Keys=hei, ValuesA=hei)  # -> Keys, ValuesA
srf_3 = Surface(runion_2)
panel_2 = Panel(area_3.Area)
series = Series(Start=0, Step=Slider(2.4, range=0..10), Count=sort.ValuesA)
lng = ListLength(List=series)  # disabled
subtraction_5 = Subtraction(A=lng, B=1)  # disabled
item = ListItem(List=series, Index=subtraction_5, Wrap=True)  # disabled
shatter = Shatter(Curve=crv, Parameters=disc.Parameters)
number_slider_12 = Slider(1, range=0..1)  # disabled
number_slider_13 = Slider(5, range=0..10)  # disabled
item_2 = ListItem(List=shatter, Index=0, Wrap=True)  # -> Item, Item1
division = Division(A=number_slider_12, B=number_slider_13)  # disabled
multiplication = Multiplication(A=item, B=division)  # disabled
join = JoinCurves(Curves=[item_2.Item, item_2.Item1], Preserve=False)
offset = OffsetCurve(Curve=runion_2, Distance=multiplication, Plane=PlaneXY(0, 0, 0), Corners=1)  # -> simplify(Curve); disabled
flatten_2 = FlattenTree(Tree=runion_2, Path="{0}")  # disabled
crv_2 = Curve(flatten(offset))  # disabled
crv_3 = Curve(flatten([flatten_2, crv]))  # disabled
crossref = CrossReference(ListA=crv_3, ListB=crv_3, CrossMode=5)  # -> graft(ListA), graft(ListB); disabled
area_4 = Area(Geometry=crv_3, UseTasks=False)  # -> Area, Centroid; disabled
crv_4 = Curve([crossref.ListA, crossref.ListB])  # disabled
item_3 = ListItem(List=crv_4, Index=0, Wrap=True)  # -> Item, Item1; disabled
crvprox = CurveProximity(CurveA=item_3.Item, CurveB=item_3.Item1)  # -> PointA, PointB, Distance; disabled
ivist = IsoVist(Plane=area_4.Centroid, Count=10, Radius=100, Obstacles=crv_3)  # -> Points, Distance, Index; disabled
ln = Line(StartPoint=crvprox.PointA, EndPoint=crvprox.PointB)  # disabled
pline_4 = PolyLine(Vertices=ivist.Points, Closed=True)  # disabled
srf_4 = Surface(pline_4)  # disabled
division_2 = Division(A=Slider(1, range=0..1), B=Slider(5, range=0..10))

# ---- group: Lote
crv_5 = Curve(<curve referenced from the Rhino model>)
crv_6 = Curve(<curve referenced from the Rhino model>)
area_5 = Area(Geometry=crv, UseTasks=False)  # -> Area, Centroid
area_6 = Area(Geometry=crv_5, UseTasks=False)  # -> Area, Centroid
area_7 = Area(Geometry=crv_6, UseTasks=False)  # -> Area, Centroid
ma = MassAddition(Input=flatten(area_5.Area))  # -> Result, PartialResults
panel_3 = Panel(area_6.Area)
panel_4 = Panel(area_7.Area)

# ---- group: I.O
ma_2 = MassAddition(Input=flatten(area_3.Area))  # -> Result, PartialResults
division_3 = Division(A=ma_2.Result, B=area_6.Area)
panel_5 = Panel(division_3)
expression = Expression(
    x=division_3,
    y=Slider(0.31, range=0..10),
    z=Slider(0.24, range=0..1),
    Expression="If( ( x ≤ y ) and ( x ≥ z ), 0, 10000 )")

# ----
galapagos = Galapagos(fitness=ma_6, gene=[idy, idx, hei, hor, idxo, idyo, horo, idxt, idyt, hort])

# ---- group: Parqueaderos
number_slider_14 = Slider(1, range=0..10)
matrixsize_3 = CSharpScript(grid=ptborders)  # -> A, B; inputs grid: tree of Curve; same code as matrixsize
subtraction_6 = Subtraction(A=matrixsize_3.B, B=number_slider_8)
subtraction_7 = Subtraction(A=matrixsize_3.A, B=number_slider_8)
dom_8 = ConstructDomain(DomainStart=Slider(1, range=0..1), DomainEnd=Slider(3, range=0..100))
dom_9 = ConstructDomain(DomainStart=number_slider_8, DomainEnd=subtraction_6)
dom_10 = ConstructDomain(DomainStart=number_slider_8, DomainEnd=subtraction_7)
genemodifier_8 = GenePoolModifier(
    GeneList="idyO",
    Count=number_slider_14,
    Domain=dom_9,
    Randomize=Button(),
    PercentageOfRandomization=Slider(1, range=0..1))
genemodifier_9 = GenePoolModifier(
    GeneList="idxO",
    Count=number_slider_14,
    Domain=dom_10,
    Randomize=Button(),
    PercentageOfRandomization=Slider(1, range=0..1))
genemodifier_10 = GenePoolModifier(
    GeneList="horO",
    Count=number_slider_14,
    Domain=dom_8,
    Randomize=Button(),
    PercentageOfRandomization=Slider(1, range=0..1))
idxo = GenePool(Decimals=0, Maximum=26, Minimum=9, Value=23)
idyo = GenePool(Decimals=0, Maximum=25, Minimum=9, Value=12)
horo = GenePool(Decimals=0, Maximum=3, Minimum=1, Value=2)
frgb_3 = ColourRGBF(Alpha=Slider(1, range=0..1), Red=Slider(0.3, range=0..1), Green=Slider(0.3, range=0..1), Blue=Slider(0.3, range=0..1))

# ---- group: Parqueaderos / Algo
inversegenepool_3 = CSharpScript(genePool=horo, min=number_slider_9, max=number_slider_8)  # -> A, B; inputs genePool: list of Int32, min: Int32, max: Int32; same code as inversegenepool
pickgeometries_3 = CSharpScript(grid=ptborders, idx=idxo, idy=idyo, hor=inversegenepool_3.A, ver=inversegenepool_3.B)  # -> simplify(A); inputs grid: tree of Curve, idx: Int32, idy: Int32, hor: Int32, ver: Int32; same code as pickgeometries

# ---- group: Parqueaderos (continued)
runion_3 = RegionUnion(Curves=pickgeometries_3)  # -> simplify(Result)
area_8 = Area(Geometry=runion_3)  # -> Area, Centroid
panel_6 = Panel(area_8.Area)
srf_5 = Surface(runion_3)
move_2 = Move(Geometry=srf_5, Motion=expr("x*1.01", Z))  # -> Geometry, Transform
preview_2 = CustomPreview(Geometry=move_2.Geometry, Material=frgb_3)

# ----
crvprox_2 = CurveProximity(CurveA=join, CurveB=runion_3)  # -> PointA, PointB, Distance; disabled
ln_2 = Line(StartPoint=crvprox_2.PointA, EndPoint=crvprox_2.PointB)  # disabled

# ---- group: Floors
Z_2 = UnitZ(Factor=series)
move_3 = Move(Geometry=runion_2, Motion=Z_2)  # -> Geometry, Transform
frgb_4 = ColourRGBF(Alpha=Slider(1, range=0..1), Red=Slider(0, range=0..1), Green=Slider(0, range=0..1), Blue=Slider(0, range=0..1))
number_slider_15 = Slider(0, range=0..100)

# ---- group: CustomContour
lng_2 = ListLength(List=move_3.Geometry)
subtraction_8 = Subtraction(A=lng_2, B=1)
cull_i = CullIndex(List=move_3.Geometry, Indices=subtraction_8, Wrap=True)
crv_7 = Curve(simplify(cull_i))
c_script = CSharpScript(curveTree=crv_7)  # -> indexPattern; inputs curveTree: tree of Curve
# ---------- c_script: C# ----------
    double maxZ = 0.0, minZ = 0.0;

    List<int> indexes = new List<int>();

    int branches = curveTree.BranchCount;

    indexes.Add(0);

    for( int i = 0; i < branches - 1; ++i )
    {

      maxZ = AreaMassProperties.Compute(curveTree.Branch(i)[curveTree.Branch(i).Count - 1]).Centroid.Z;

      minZ = AreaMassProperties.Compute(curveTree.Branch(i + 1)[curveTree.Branch(i).Count - 1]).Centroid.Z;

      for( int j = 0; j < curveTree.Branch(i).Count; ++j )
      {

        double Z = AreaMassProperties.Compute(curveTree.Branch(i)[j]).Centroid.Z;

        if( Z <= maxZ && Z >= minZ || Z == maxZ || Z == minZ )
        {

          indexes.Add(j);

        }

      }

    }

    maxZ = AreaMassProperties.Compute(curveTree.Branch(branches - 1)[curveTree.Branch(branches - 1).Count - 1]).Centroid.Z;
    minZ = AreaMassProperties.Compute(curveTree.Branch(branches - 2)[curveTree.Branch(branches - 2).Count - 1]).Centroid.Z;

    for( int i = 0; i < curveTree.Branch(branches - 1).Count; ++i )
    {

      double Z = AreaMassProperties.Compute(curveTree.Branch(branches - 1)[i]).Centroid.Z;

      if( Z <= maxZ && Z >= minZ && i == curveTree.Branch(branches - 1).Count - 1 )
      {

        indexes.Add(i);

      }

    }

    int fromI = 0, toI = 1;

    DataTree<int> dataOut = new DataTree<int>();
    int pather = 0;

    int countIndexes = indexes.Count, tempoCount = 0;

    for( int i = 2; i < countIndexes; ++i )
    {

      tempoCount++;

    }


    countIndexes += tempoCount;

    indexPattern = countIndexes;

    for( int i = 0; i < countIndexes; ++i )
    {

      var path = new GH_Path(pather);

      if( i % 2 == 0 )
      {

        dataOut.Add(indexes[fromI], path);
        dataOut.Add(indexes[toI], path);
        fromI++;
        toI++;
        pather++;

      }

    }
/*
    for( int i = 0; i < dataOut.BranchCount; ++i )
    {

      for( int j = 0; j < 2; ++j )
      {

        if( i % 2 != 1 && j % 2 != 0 )
        {

          dataOut.Branch(i)[j]--;

        }

      }

    }
*/
    indexPattern = dataOut;
/*
    var finalTree = new DataTree<int>(); int pathF = 0;

    for( int i = 0; i < dataOut.BranchCount; ++i )
    {

      if( dataOut.Branch(i)[0] != dataOut.Branch(i)[1] )
      {

        //if( i != 0 ) dataOut.Branch(i)[0]++;

        //if( i != dataOut.BranchCount - 1 && i != 0  ) dataOut.Branch(i)[1]++;

        finalTree.AddRange(dataOut.Branch(i), new GH_Path(pathF));

        pathF++;

      }

    }

    laterProcessing = finalTree;*/
# ---------- end c_script ----------
c_script_2 = CSharpScript(curveTree=crv_7, frameTree=crv_7, indexes=c_script)  # -> A, B; inputs curveTree: tree of Curve, frameTree: tree of Plane, indexes: tree of Int32
# ---------- c_script_2: C# ----------
    var curvesOut = new DataTree<Curve>();
    var planesOut = new DataTree<Plane>();
    int tracker = 0;

    GH_Path pathy = new GH_Path();
    int minIndex = 0, maxIndex = 0;

    for( int i = 0; i < curveTree.BranchCount; ++i )
    {

      for( int k = 0; k < curveTree.BranchCount; ++k )
      {

        pathy = new GH_Path(k);

        minIndex = indexes.Branch(k)[0];

        maxIndex = indexes.Branch(k)[1];

        if( minIndex != maxIndex )
        {

          for( int j = minIndex; j < maxIndex + 1; ++j )
          {

            if( k != 0 )
            {

              if( i > tracker )
              {

                curvesOut.Add(curveTree.Branch(i)[j], pathy);

              }

            }

            else
            {

              curvesOut.Add(curveTree.Branch(i)[j], pathy);

            }

            tracker = k - 1;

          }

        }

      }

    }

    int initialIndex = 0, finalIndex = 0;

    for( int i = 0; i < indexes.BranchCount; ++i )
    {

      initialIndex = indexes.Branch(i)[0];
      finalIndex = indexes.Branch(i)[1];
      
      //if( indexes.Branch(i)[0] != null ) indexes.Branch(i)[0]++;

      if( initialIndex != finalIndex )
      {

        for( int j = initialIndex; j < finalIndex + 1; ++j )
        {

          planesOut.Add(frameTree.Branch(i)[j], new GH_Path(i));

        }
        
      }

    }

    A = curvesOut;
    B = planesOut;
# ---------- end c_script_2 ----------
cull_i_2 = CullIndex(List=c_script_2.B, Indices=0, Wrap=True)
area_9 = Area(Geometry=c_script_2.A, UseTasks=False)  # -> Area, Centroid
pdecon = Deconstruct(Point=area_9.Centroid)  # -> XComponent, YComponent, ZComponent
item_4 = ListItem(List=pdecon.ZComponent, Index=0, Wrap=True)
expression_2 = Expression(x=item_4, y=pdecon.ZComponent, Expression="If( ( y - x ) < 0.01, False, True )")
cull = CullPattern(List=c_script_2.A, CullPattern=expression_2)
runion_4 = RegionUnion(Curves=flatten(runion_2))
runion_5 = RegionUnion(Curves=cull, Plane=cull_i_2)  # -> simplify(Result)
c_script_3 = CSharpScript(x=runion_4, y=runion_5)  # -> A; inputs x: list of Curve, y: tree of Curve
# ---------- c_script_3: C# ----------
    var treeOut = new DataTree<Curve>();

    for( int i = 0; i < x.Count; ++i )
    {

      treeOut.Add(x[i], new GH_Path(0, i));

    }

    GH_Path path = new GH_Path();

    for( int i = 0; i < y.BranchCount; ++i )
    {

      path = y.Path(i);
      
      path = new GH_Path(path.Indices[0]+1, path.Indices[1]);

      for( int j = 0; j < y.Branch(i).Count; ++j )
      {

        treeOut.Add(y.Branch(i)[j], path);

      }

    }

    A = treeOut;
# ---------- end c_script_3 ----------

# ----
crv_8 = Curve(flatten([runion_4, runion_3, runion]))  # disabled
ivray = IsoVistRay(Sample=ln_2, Radius=100, Obstacles=crv_8)  # -> Point, Distance, Index; disabled
flatten_3 = FlattenTree(Tree=runion_4, Path="{0}")

# ---- group: Volumes
loft = Loft(Curves=move_3.Geometry, Options={Adjust=False, Closed=False, LoftEnds=0, LoftSimp=0, LoftType=0, Rebuild=10, Refit=0.01})
cap = CapHoles(Brep=loft)  # -> flatten(Brep)
frgb_5 = ColourRGBF(Alpha=Slider(0.359, range=0..1), Red=Slider(1, range=0..1), Green=Slider(1, range=0..1), Blue=Slider(1, range=0..1))
sunion = SolidUnion(Breps=cap)
preview_3 = CustomPreview(Geometry=sunion, Material=frgb_5)

# ---- group: Alturas
debrep = DeconstructBrep(Brep=sunion)  # -> Faces, Edges, Vertices
area_10 = Area(Geometry=debrep.Faces)  # -> Area, Centroid
pdecon_2 = Deconstruct(Point=area_10.Centroid)  # -> XComponent, YComponent, ZComponent
sort_2 = SortList(Keys=pdecon_2.ZComponent, ValuesA=area_10.Centroid)  # -> Keys, ValuesA
lng_3 = ListLength(List=sort_2.Keys)
item_5 = ListItem(List=sort_2.ValuesA, Index=expr("x-1", lng_3), Wrap=True)
pdecon_3 = Deconstruct(Point=item_5)  # -> XComponent, YComponent, ZComponent
pt = ConstructPoint(XCoordinate=pdecon_3.XComponent, YCoordinate=pdecon_3.YComponent, ZCoordinate=0)
vec2pt = Vector2Pt(PointA=pt, PointB=item_5, Unitize=False)  # -> Vector, Length
num = Number(flatten(vec2pt.Length))
vdis = VectorDisplay(Anchor=pt, Vector=vec2pt.Vector)

# ----
multiplication_2 = Multiplication(A=num, B=division_2)
offset_2 = OffsetCurve(Curve=flatten_3, Distance=multiplication_2, Plane=flatten_3, Corners=1)  # -> flatten(Curve)
crv_9 = Curve([offset_2, crv, runion, runion_3])
crossref_2 = CrossReference(ListA=crv_9, ListB=crv_9, CrossMode=5)  # -> graft(ListA), graft(ListB)
disc_2 = Discontinuity(Curve=crv_9, Level=1)  # -> Points, Parameters
colmm = CollisionManyMany(Colliders=flatten(crv_9))  # -> Collision, Indices
crv_10 = Curve([crossref_2.ListA, crossref_2.ListB])
hull = ConvexHull(Points=flatten(disc_2.Points), Plane=PlaneXY(0, 0, 0))  # -> Hull, HullZ, Indices
multiplication_3 = Multiplication(A=colmm.Collision, B=Slider(1000, range=0..10000))
item_6 = ListItem(List=crv_10, Index=0, Wrap=True)  # -> Item, Item1
area_11 = Area(Geometry=hull.Hull, UseTasks=False)  # -> Area, Centroid
ccx = CurveCurve(CurveA=item_6.Item, CurveB=item_6.Item1, UseTasks=False)  # -> Points, ParamsA, ParamsB
ccx_2 = CurveCurve(CurveA=hull.Hull, CurveB=crv)  # -> Points, ParamsA, ParamsB
expression_3 = Expression(x=area_11.Area, y=area.Area, Expression="If( x > y, 1000, 0 )")
lng_4 = ListLength(List=ccx.ParamsA)
lng_5 = ListLength(List=ccx_2.Points)
multiplication_4 = Multiplication(A=lng_4, B=Slider(1000, range=0..10000))  # -> flatten(Result)
multiplication_5 = Multiplication(A=lng_5, B=1000)

# ---- group: Aislamientos
crossref_3 = CrossReference(ListA=runion_4, ListB=runion_4, CrossMode=5)  # -> ListA, ListB
crvprox_3 = CurveProximity(CurveA=crossref_3.ListA, CurveB=crossref_3.ListB)  # -> PointA, PointB, Distance
null = NullItem(Item=crvprox_3.Distance)  # -> NullFlags, InvalidFlags, Description
item_7 = ListItem(List=multiplication_2, Index=0, Wrap=True)
expression_4 = Expression(x=null.NullFlags, y=crvprox_3.Distance, z=item_7, Expression="If( x = True, z, y )")
expression_5 = Expression(x=expression_4, y=item_7, Expression="If( x ≥ y, 0, 10000 )")

# ---- group: Floors (continued)
crv_11 = Curve(simplify(c_script_3))
area_12 = Area(Geometry=crv_11, UseTasks=False)  # -> Area, Centroid
flatten_4 = FlattenTree(Tree=crv_11, Path="{0}")
crv_12 = Curve(flatten_4)
ma_3 = MassAddition(Input=flatten(area_12.Area))  # -> Result, PartialResults
previewlw_2 = CustomPreviewLineweights(Geometry=crv_12, Shader=frgb_4, Absolute=False)
panel_7 = Panel(ma_3.Result)

# ---- group: Floors / ÁreaXTorre
ma_4 = MassAddition(Input=area_12.Area)  # -> simplify(flatten(Result)), PartialResults

# ---- group: Floors / ÁreaTotal
ma_5 = MassAddition(Input=flatten(area_12.Area))  # -> Result, PartialResults

# ---- group: I.C
division_4 = Division(A=ma_5.Result, B=area_7.Area)
panel_8 = Panel(division_4)
expression_6 = Expression(
    x=division_4,
    y=Slider(2.4, range=0..10),
    z=Slider(1.7, range=0..10),
    Expression="If( ( x ≤ y ) and ( x ≥ z ), 0, 100000 )")

# ----
ma_6 = MassAddition(Input=flatten([multiplication_3, multiplication_5, expression_3, expression, expression_6, multiplication_4, expression_5]))  # -> Result, PartialResults
panel_9 = Panel(ma_6.Result)

# ---- group: Floors (continued)
panel_10 = Panel(ma_5.Result)
