# Grasshopper definition StressTest[0].gh (Grasshopper 1.0.7)
# plug-ins: SpacePartition, ClipperComponents, Human, PTComponentLibrary, MetaHopper, Kangaroo2 Components, TT Toolbox

# ---- group: NumberOfBuildings
number_slider = Slider(5, range=0..10)

# ---- group: ÁreaUtil
crv = Curve(<curve referenced from the Rhino model>)

# ---- group: ÁreaBruta
crv_2 = Curve(<curve referenced from the Rhino model>)

# ---- group: CustomContour
c_script = CSharpScript()  # -> indexPattern; inputs curveTree: tree of Curve; disabled
# ---------- c_script: C# ----------
    double maxZ = 0.0, minZ = 0.0;

    List<int> indexes = new List<int>();

    int branches = curveTree.BranchCount;

    indexes.Add(0);

    for( int i = 0; i < branches - 1; ++i )
    {

      maxZ = AreaMassProperties.Compute(curveTree.Branch(i)[curveTree.Branch(i).Count - 1]).Centroid.Z;

      minZ = AreaMassProperties.Compute(curveTree.Branch(i + 1)[curveTree.Branch(i).Count - 1]).Centroid.Z;

      for( int j = 0; j < curveTree.Branch(i).Count; ++j )
      {

        double Z = AreaMassProperties.Compute(curveTree.Branch(i)[j]).Centroid.Z;

        if( Z <= maxZ && Z >= minZ || Z == maxZ || Z == minZ )
        {

          indexes.Add(j);

        }

      }

    }

    maxZ = AreaMassProperties.Compute(curveTree.Branch(branches - 1)[curveTree.Branch(branches - 1).Count - 1]).Centroid.Z;
    minZ = AreaMassProperties.Compute(curveTree.Branch(branches - 2)[curveTree.Branch(branches - 2).Count - 1]).Centroid.Z;

    for( int i = 0; i < curveTree.Branch(branches - 1).Count; ++i )
    {

      double Z = AreaMassProperties.Compute(curveTree.Branch(branches - 1)[i]).Centroid.Z;

      if( Z <= maxZ && Z >= minZ && i == curveTree.Branch(branches - 1).Count - 1 )
      {

        indexes.Add(i);

      }

    }

    int fromI = 0, toI = 1;

    DataTree<int> dataOut = new DataTree<int>();
    int pather = 0;

    int countIndexes = indexes.Count, tempoCount = 0;

    for( int i = 2; i < countIndexes; ++i )
    {

      tempoCount++;

    }


    countIndexes += tempoCount;

    indexPattern = countIndexes;

    for( int i = 0; i < countIndexes; ++i )
    {

      var path = new GH_Path(pather);

      if( i % 2 == 0 )
      {

        dataOut.Add(indexes[fromI], path);
        dataOut.Add(indexes[toI], path);
        fromI++;
        toI++;
        pather++;

      }

    }
/*
    for( int i = 0; i < dataOut.BranchCount; ++i )
    {

      for( int j = 0; j < 2; ++j )
      {

        if( i % 2 != 1 && j % 2 != 0 )
        {

          dataOut.Branch(i)[j]--;

        }

      }

    }*/

    indexPattern = dataOut;
# ---------- end c_script ----------
c_script_2 = CSharpScript(dataOut=c_script)  # -> sortedTree, sortedPlanes; inputs curveTree: tree of Curve, frameTree: tree of Plane, dataOut: tree of Int32; disabled
# ---------- c_script_2: C# ----------
    var treeOut = new DataTree<Curve>();
    var planes = new DataTree<Plane>();

    int branches = curveTree.BranchCount;

    int tracker = 0;

    var pathy = new GH_Path();

    int tempo = 0, tempoMax = 0, tempoPlane = 0;

    for( int i = 0; i < branches; ++i )
    {

      for( int k = 0; k < branches; ++k )
      {

        pathy = new GH_Path(k);

        tempo = dataOut.Branch(k)[0];

        tempoMax = dataOut.Branch(k)[1];
        
        //if( tempo != tempoMax ) 

        for( int j = tempo; j < tempoMax + 1; ++j )
        {

          if( k != 0 )
          {

            if( i > tracker )
            {

              treeOut.Add(curveTree.Branch(i)[j], pathy);

            }

          }

          else
          {

            treeOut.Add(curveTree.Branch(i)[j], pathy);

          }

          tracker = k - 1;

        }

      }

      tempoPlane = dataOut.Branch(i)[0];

      /*if( i != 0 )

        tempoPlane++;*/

      for( int j = tempoPlane; j < dataOut.Branch(i)[1] + 1; ++j )
      {

        planes.Add(frameTree.Branch(i)[j], new GH_Path(i));

      }

    }

    sortedTree = treeOut;
    sortedPlanes = planes;
# ---------- end c_script_2 ----------
number_slider_2 = Slider(0, range=0..100)  # disabled
number_slider_3 = Slider(0, range=0..100)  # disabled
cull_i = CullIndex(List=c_script_2.sortedTree, Indices=number_slider_3, Wrap=True)  # -> simplify(List); disabled
cull_i_2 = CullIndex(List=c_script_2.sortedPlanes, Indices=number_slider_3, Wrap=True)  # -> simplify(List); disabled
runion = RegionUnion(Curves=cull_i, Plane=cull_i_2)  # disabled

# ---- group: CustomPointsOutsideCurve
number_slider_4 = Slider(58, range=0..100)  # disabled
sdivide = DivideSurface(UCount=number_slider_4, VCount=number_slider_4)  # -> simplify(Points), Normals, Parameters; disabled
flatten = FlattenTree(Tree=sdivide.Points, Path="{0}")  # disabled
inside = PointWithinCurve(pts=sdivide.Points)  # -> simplify(B); inputs pts: list of Point3d, crv: list of Polyline; disabled
# ---------- inside: C# usings ----------
using System.IO;
using System.Linq;
using System.Data;
using System.Drawing;
using System.Reflection;
using System.Windows.Forms;
using System.Xml;
using System.Xml.Linq;
using System.Runtime.InteropServices;

using Rhino.DocObjects;
using Rhino.Collections;
using GH_IO;
using GH_IO.Serialization;
# ---------- inside: C# ----------
    var outside = new DataTree<Point3d>(); //Outside(pts, crv);

    var temp = Outside( pts, crv[0] );
    
    foreach( var item in temp )
    {
      
      outside.Add( item, new GH_Path(0) );
    
    }
    /*
    temp = Outside(outside.Branch(0), crv[1]);
    
    foreach( var item in temp )
    {
      
      outside.Add( item, new GH_Path(1) );
    
    }
    
    temp = Outside(outside.Branch(1), crv[2]);*/
    
    for( int i = 1; i < crv.Count; ++i )
    {
   
      foreach( var item in temp )
      {
      
        outside.Add(item, new GH_Path(i));
    
      }
    
      temp = Outside( outside.Branch(i), crv[i] );
      
    }
    
    B = temp;
# ---------- inside: C# additional code ----------
  System.Collections.Concurrent.ConcurrentBag<Point3d> Outside(List<Point3d> pts, Polyline crv)
  {

    var outside = new System.Collections.Concurrent.ConcurrentBag<Point3d>();
    System.Threading.Tasks.Parallel.ForEach(pts, pt =>
      {
      if(!IsInside(pt, crv))
      {
        outside.Add(pt);
      }
      });

    return outside;

  }

  bool IsInside (Point3d pt, Polyline crv)
  {
    Point3d pt1, pt2;
    bool oddNodes = false;

    for (int i = 0; i < crv.SegmentCount; i++) //for each contour line
    {

      pt1 = crv.SegmentAt(i).From; //get start and end pt
      pt2 = crv.SegmentAt(i).To;

      if ( (pt1[1] < pt[1] && pt2[1] >= pt[1] || pt2[1] < pt[1] && pt1[1] >= pt[1]) && (pt1[0] <= pt[0] || pt2[0] <= pt[0]) ) //if pt is between pts in y, and either of pts is before pt in x
        oddNodes ^= ( pt2[0] + (pt[1] - pt2[1]) * (pt1[0] - pt2[0]) / (pt1[1] - pt2[1]) < pt[0] ); //^= is xor
      //end.X + (pt-end).Y   * (start-end).X  /(start-end).Y   <   pt.X
    }


    if (!oddNodes)
    {
      double minDist = 1e10;
      for (int i = 0; i < crv.SegmentCount; i++) {
        Point3d cp = crv.SegmentAt(i).ClosestPoint(pt, true);
        //Point3d cp = mvContour[i].closestPoint(pt);
        //minDist = min(minDist, cp.distance(pt));
        minDist = Math.Min(minDist, cp.DistanceTo(pt));
      }
      if (minDist < 1e-10)
        return true;
    }

    if(oddNodes) return true;

    return false;
  }
# ---------- end inside ----------

# ---- group: Lote
area = Area(Geometry=crv_2, UseTasks=False)  # -> Area, Centroid
area_2 = Area(Geometry=crv, UseTasks=False)  # -> Area, Centroid
panel = Panel(area.Area)
panel_2 = Panel(area_2.Area)

# ---- group: SeedPoints
dom = ConstructDomain(DomainStart=0, DomainEnd=1)
txt = Text("EdificiosXCoord")
txt_2 = Text("EdificiosYCoord")
genemodifier = GenePoolModifier(GeneList=txt, Count=number_slider, Domain=dom, Randomize=Button(), PercentageOfRandomization=Slider(1, range=0..1))
genemodifier_2 = GenePoolModifier(GeneList=txt_2, Count=number_slider, Domain=dom, Randomize=Button(), PercentageOfRandomization=Slider(1, range=0..1))
edificiosycoord = GenePool(Decimals=3, Maximum=1, Minimum=0, Value=[0.234, 0.473, 0.598, 0.431, 0.303])
edificiosxcoord = GenePool(Decimals=3, Maximum=1, Minimum=0, Value=[0.662, 0.453, 0.487, 0.538, 0.248])
pt = ConstructPoint(XCoordinate=edificiosxcoord, YCoordinate=edificiosycoord, ZCoordinate=0)
area_3 = Area(Geometry=crv, UseTasks=False)  # -> Area, Centroid
srf = Surface(crv)
scale = Scale(Geometry=srf, Center=area_3.Centroid, Factor=Slider(1, range=0..10))  # -> Geometry, Transform
evalsrf = EvaluateSurface(Surface=reparameterize(scale.Geometry), Point=pt)  # -> Point, Normal, UDirection, VDirection, Frame
srf_cp = SurfaceClosestPoint(Point=evalsrf.Point, Surface=scale.Geometry)  # -> Point, UVPoint, Distance
pt_2 = Point(srf_cp.Point)

# ---- group: Parqueaderos / calculoParqueaderos
anchoparqueo = Slider(2.3, range=0..2.5)
largoparqueo = Slider(4.3, range=0..10)
circulacion = Slider(5, range=0..10)

# ---- group: AlturaEntrePisos
number_slider_5 = Slider(2.4, range=0..10)

# ---- group: FillThemUp / alturaEntrepiso
number = Number(number_slider_5)

# ---- group: Physics / Parqueadero
relay = Relay()

# ----
number_slider_6 = Slider(100, range=0..100)  # disabled
Y = UnitY(Factor=number_slider_6)  # disabled

# ---- group: Ortho / OrthoDontForget!
toggle = BooleanToggle(True)

# ---- group: PassThrough / RoundToDecimal
number_slider_7 = Slider(2, range=0..10)

# ---- group: AreaVendible / Circulacion
number_slider_8 = Slider(0.18, range=0..1)

# ---- group: indicadores / áreaÚtilLote
number_2 = Number(area.Area)

# ---- group: indicadores / áreaCirculación
number_3 = Number()

# ----
galapagos = Galapagos(
    fitness=ma_22,
    gene=[edificiosxcoord, edificiosycoord, comunalycoord, comunalxcoord, comunalwidthheightratio, numberofparkinglots])
crv_3 = Curve(<curve referenced from the Rhino model>)

# ---- group: indicadores / InitialPoint
pt_3 = Point(<point referenced from the Rhino model>)

# ---- group: Excel / ParqueaderosSotano
panel_3 = Panel(" ")  # disabled

# ----
panel_4 = Panel("CaliIsoNoOrtho")

# ---- group: Reinstate / NoOrtho
iterations = Number(Tree({0}: [0.125, 0.818, 0.489, 0.137, 0.138, 0.434, 0.498, 0.769, 0.507, 0.955, 0.3944, 0.7347, 0.9, 0.563], {1}: [0.125, 0.818, 0.489, 0.137, 0.138, 0.434, 0.498, 0.769, 0.507, 0.955, 0.3944, 0.7347, 0.9, 0.563], {2}: [0.825, 0.728, 0.404, 0.286, 0.638, 0.187, 0.372, 0.078, 0.283, 0.58, 0.4135, 0.128, 1, 0.568], {3}: [0.768, 0.117, 0.263, 0.951, 0.035, 0.172, 0.383, 0.807, 0.095, 0.938, 0.969, 0.3522, 0.8, 0.578], {4}: [0.447, 0.973, 0.93, 0.557, 0.149, 0.84, 0.419, 0.058, 0.87, 0.921, 0.4232, 0.4454, 0.9, 0.543], {5}: [0.624, 0.522, 0.365, 0.902, 0.845, 0.008, 0.483, 0.481, 0.44, 0.758, 0.8636, 0.9317, 1.1, 0.503]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))
fitness = Number(Tree({0}: [2.1], {1}: [2.1], {2}: [10.27664176], {3}: [19.2694938], {4}: [16.19464717], {5}: [51.58240811]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))

# ---- group: Reinstate / Ortho
iterations_2 = Number(Tree({0}: [0.662, 0.453, 0.487, 0.538, 0.248, 0.234, 0.473, 0.598, 0.431, 0.303, 0.3558, 0.6873, 0.8, 0.616], {1}: [0.662, 0.453, 0.487, 0.538, 0.248, 0.234, 0.473, 0.598, 0.431, 0.303, 0.3558, 0.6873, 0.8, 0.616], {2}: [0.662, 0.453, 0.487, 0.538, 0.248, 0.234, 0.473, 0.598, 0.431, 0.303, 0.3558, 0.6873, 0.8, 0.616], {3}: [0.662, 0.453, 0.487, 0.538, 0.248, 0.234, 0.473, 0.598, 0.431, 0.303, 0.3558, 0.6873, 0.8, 0.616], {4}: [0.662, 0.453, 0.487, 0.538, 0.248, 0.234, 0.473, 0.598, 0.431, 0.303, 0.3558, 0.6873, 0.8, 0.616], {5}: [0.662, 0.453, 0.487, 0.538, 0.248, 0.234, 0.473, 0.598, 0.431, 0.303, 0.3558, 0.6873, 0.8, 0.616]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))
fitness_2 = Number(Tree({0}: [0.7187203347], {1}: [0.7187203347], {2}: [56.58018575], {3}: [1.354941834], {4}: [55.48622189], {5}: [3.576014013]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))

# ---- group: ExcelWriterOne / NúmeroPisosParqueadero
number_slider_9 = Slider(1, range=0..1)  # disabled
int = Integer(number_slider_9)  # disabled

# ---- group: ExcelWriterOne / ÁreaBruta
num = Number(area.Area)  # disabled

# ---- group: ExcelWriterOne / ÁreaNetaUrbanizable
num_2 = Number(area_2.Area)  # disabled

# ---- group: CálculosIniciales
number_slider_10 = Slider(1.925, range=1.8..2.4)
multiplication = Multiplication(A=area.Area, B=number_slider_10)
panel_5 = Panel(multiplication)
multiplication_2 = Multiplication(A=multiplication, B=number_slider_8)
addition = Addition(A=multiplication, B=multiplication_2)
division = Division(A=addition, B=number_slider)
panel_6 = Panel(division)
panel_7 = Panel(addition)
addition_2 = Addition(A=division, B=addition)

# ---- group: FillThemUp / areaTotalVendible
number_4 = Number(addition_2)

# ---- group: Parqueaderos
curve = Curve(<curve referenced from the Rhino model>)
len = Length(Curve=curve)
division_2 = Division(A=len, B=anchoparqueo)
Z = UnitZ(Factor=1)  # -> expr("-x", UnitVector)
divide = DivideCurve(Curve=curve, Count=division_2, Kinks=False, UseTasks=False)  # -> Points, Tangents, Parameters
xprod = CrossProduct(VectorA=divide.Tangents, VectorB=Z, Unitize=False)  # -> Vector, Length
multiplication_3 = Multiplication(A=largoparqueo, B=xprod.Vector)
move = Move(Geometry=divide.Points, Motion=multiplication_3)  # -> Geometry, Transform
pline = PolyLine(Vertices=divide.Points, Closed=False)
pline_2 = PolyLine(Vertices=move.Geometry, Closed=False)
ln = Line(StartPoint=divide.Points, EndPoint=move.Geometry)
lng = ListLength(List=ln)
item = ListItem(List=ln, Index=expr("x-1", lng), Wrap=True)
item_2 = ListItem(List=ln, Index=0, Wrap=True)
join = JoinCurves(Curves=flatten([pline, pline_2, item_2, item]), Preserve=False)
panel_8 = Panel("NumberOfParkingLots")
srfsplit = SurfaceSplit(Surface=join, Curves=ln)
numberofparkinglots = Slider(0.616, range=0.5..0.7)
lng_2 = ListLength(List=srfsplit)
startat = Slider(26.977, range=0..500)
panel_9 = Panel(lng_2)
crv_4 = Curve(crv)
len_2 = Length(Curve=crv_4)
addition_3 = Addition(A=lng_2)
ramp = Slider(7.5, range=0..10)
mod = Modulus(A=startat, B=len_2)
panel_10 = Panel(addition_3)
Z_2 = UnitZ(Factor=1)  # -> expr("-x", UnitVector)
number_slider_11 = Slider(0.952, range=0..1)
eval = EvaluateCurve(Curve=crv_4, Parameter=ramp)  # -> Point, Tangent, Angle
number_slider_12 = Slider(4, range=-5..5)
number_slider_13 = Slider(1, range=0..1)

# ---- group: SameAreaDifferentRatios
txt_3 = Text("Percentage")
addition_4 = Addition(A=number_slider_8, B=Slider(0.01, range=0..1))
dom_2 = ConstructDomain(DomainStart=Slider(0.9, range=0..1), DomainEnd=Slider(1.572, range=0..10))
genemodifier_3 = GenePoolModifier(GeneList=txt_3, Count=number_slider, Domain=dom_2, Randomize=Button(), PercentageOfRandomization=Slider(1, range=0..1))
percentage = GenePool(Decimals=2, Maximum=1.572, Minimum=0.9, Value=[1.572, 1.572, 1.572, 1.572, 1.572])
num_3 = Number(1.112732212)
pt_4 = Point(pt_2)
pln = Plane(pt_4)
rotate = Rotate(Geometry=pln, Angle=expr("x-0.5*pi", num_3), Plane=pt_4)  # -> Geometry, Transform

# ---- group: FillThemUp / planeIniciales
plane = Plane(rotate.Geometry)

# ---- group: FillThemUp
difstor = Slider(0, range=0..10)
number_slider_14 = Slider(8, range=0..33)
areaapto = Slider(55.5, range=35..65.7)

# ---- group: CálculosIniciales (continued)
division_3 = Division(A=division, B=number_slider_14)
panel_11 = Panel(division_3)

# ---- group: SameAreaDifferentRatios / PuntosFijos
multiplication_4 = Multiplication(A=division_3, B=addition_4)
sqrt = SquareRoot(Value=multiplication_4)
multiplication_5 = Multiplication(A=sqrt, B=percentage)
division_4 = Division(A=multiplication_4, B=multiplication_5)
multiplication_6 = Multiplication(A=division_4, B=0.5)  # -> graft(Result)
multiplication_7 = Multiplication(A=multiplication_5, B=0.5)  # -> graft(Result)

# ---- group: SameAreaDifferentRatios (continued)
sqrt_2 = SquareRoot(Value=division_3)
multiplication_8 = Multiplication(A=sqrt_2, B=percentage)
division_5 = Division(A=division_3, B=multiplication_8)
multiplication_9 = Multiplication(A=division_5, B=0.5)
multiplication_10 = Multiplication(A=multiplication_8, B=0.5)
dom_3 = ConstructDomain(DomainStart=expr("-x", multiplication_9), DomainEnd=multiplication_9)
dom_4 = ConstructDomain(DomainStart=expr("-x", multiplication_10), DomainEnd=multiplication_10)
sort = SortList(Keys=[multiplication_7, multiplication_6], ValuesA=[multiplication_7, multiplication_6])  # -> Keys, ValuesA

# ---- group: FillThemUp (continued)
domain = Domain(dom_4)
domain_2 = Domain(dom_3)
customgeoplacement = CSharpScript(diff=difstor, f=number, w=domain_2, h=domain, maxIter=number_slider_14, areaTotal=number_4, planes=flatten(plane))  # -> A, B; inputs diff: Int32, f: Double, w: list, h: list, maxIter: Int32, areaTotal: Double, planes: list of Plane
# ---------- customgeoplacement: C# ----------
    var listaRect = new DataTree<Rectangle3d>();
    double move = 0.0;
    var vectorList = new DataTree<Vector3d>();
    int size = planes.Count;
    Rectangle3d rectTemp = new Rectangle3d();
    double areaR = 0, temp = 0;

    for (int i = 0; i < size; ++i)
    {

      rectTemp = new Rectangle3d(planes[i], w[i], h[i]);

      var path = new GH_Path(i);

      for (int j = 0; j <= maxIter; ++j)
      {

        if( j != 0 )

          temp += f;

        areaR += AreaMassProperties.Compute(rectTemp.ToNurbsCurve()).Area;

        //vector = new Vector3d(0, 0, temp);


        rectTemp.Transform(Rhino.Geometry.Transform.Translation(0, 0, temp));
        listaRect.Add(rectTemp, path);
        move += temp;
        vectorList.Add(new Vector3d(0, 0, move), path);
        temp = 0;

        if (areaR * 1.025 >= areaTotal && areaR * 0.975 <= areaTotal) break;

      }

      maxIter -= diff;

      move = 0;

      if (areaR * 1.025 >= areaTotal && areaR * 0.975 <= areaTotal) break;

    }

    A = listaRect;
    B = vectorList;
    //Print(areaR.ToString());
# ---------- end customgeoplacement ----------
lng_3 = ListLength(List=customgeoplacement.A)
subtraction = Subtraction(A=lng_3, B=1)
cull_i_3 = CullIndex(List=customgeoplacement.A, Indices=subtraction, Wrap=True)
lng_4 = ListLength(List=customgeoplacement.B)
area_4 = Area(Geometry=cull_i_3)  # -> flatten(Area), Centroid
subtraction_2 = Subtraction(A=lng_4, B=1)
item_3 = ListItem(List=customgeoplacement.A, Index=0, Wrap=True)
ma = MassAddition(Input=area_4.Area)  # -> Result, PartialResults
item_4 = ListItem(List=customgeoplacement.B, Index=subtraction_2, Wrap=True)
multiplication_11 = Multiplication(A=item_4, B=Slider(0.333, range=0..1))
panel_12 = Panel(ma.Result)
devec = DeconstructVector(Vector=flatten(multiplication_11))  # -> XComponent, YComponent, ZComponent

# ----
multiplication_12 = Multiplication(A=multiplication_8, B=division_5)
panel_13 = Panel(multiplication_12)

# ---- group: ScaleNUAislamientos
num_4 = Number(graft(multiplication_10))
num_5 = Number(graft(multiplication_9))
num_6 = Number([num_4, num_5])
aislamientos = Slider(7, range=0..10)
sort_2 = SortList(Keys=num_6, ValuesA=num_6)  # -> Keys, ValuesA
multiplication_13 = Multiplication(A=devec.ZComponent, B=Slider(0.5, range=0..1))
item_5 = ListItem(List=sort_2.ValuesA, Index=0, Wrap=True)  # -> Item, Item1
multiplication_14 = Multiplication(A=aislamientos, B=0.5)
division_6 = Division(A=flatten(multiplication_14), B=flatten(item_5.Item))
division_7 = Division(A=flatten(Slider(2, range=0..10)), B=flatten(item_5.Item1))
number_slider_15 = Slider(1, range=0..1)
addition_5 = Addition(A=number_slider_15, B=division_6)
addition_6 = Addition(A=number_slider_15, B=division_7)
crv_5 = Curve(item_3)
scale_nu = ScaleNU(Geometry=crv_5, Plane=graft(rotate.Geometry), ScaleX=graft(addition_5), ScaleY=graft(addition_6), ScaleZ=1)  # -> Geometry, Transform

# ---- group: RescaleNU / Smallest
num_7 = Number(flatten(item_5.Item))

# ---- group: RescaleNU / Biggest
num_8 = Number(flatten(item_5.Item1))

# ----
lng_5 = ListLength(List=customgeoplacement.B)

# ---- group: indicadores / áreaApto
number_5 = Number(areaapto)

# ---- group: ExcelWriterOne / PisosXTorre
int_2 = Integer(customgeoplacement.B)  # disabled
lng_6 = ListLength(List=int_2)  # disabled

# ---- group: ExcelWriterOne / AislamientoMinimoEntreTorres
num_9 = Number(devec.ZComponent)  # disabled

# ---- group: FillThemUp / NumeroAptos
area_5 = Area(Geometry=cull_i_3)  # -> Area, Centroid

# ----
multiplication_15 = Multiplication(A=area_5.Area, B=number_slider_8)
subtraction_3 = Subtraction(A=area_5.Area, B=multiplication_15)
panel_14 = Panel(subtraction_3)

# ---- group: Comunal
comunalxcoord = Slider(0.3558, range=0..1)
comunalycoord = Slider(0.6873, range=0..1)
panel_15 = Panel("ComunalXCoord")
panel_16 = Panel("ComunalYCoord")
pt_5 = ConstructPoint(XCoordinate=comunalxcoord, YCoordinate=comunalycoord, ZCoordinate=0)
evalsrf_2 = EvaluateSurface(Surface=reparameterize(scale.Geometry), Point=pt_5)  # -> Point, Normal, UDirection, VDirection, Frame
srf_cp_2 = SurfaceClosestPoint(Point=evalsrf_2.Point, Surface=scale.Geometry)  # -> Point, UVPoint, Distance
pt_6 = Point(srf_cp_2.Point)
crv_6 = Curve(<curve referenced from the Rhino model>)
area_6 = Area(Geometry=crv_6, UseTasks=False)  # -> Area, Centroid
multiplication_16 = Multiplication(A=area_6.Area, B=0.5)
comunalwidthheightratio = Slider(0.8, range=0.8..1.2)
sqrt_3 = SquareRoot(Value=multiplication_16)
panel_17 = Panel("ComunalWidthHeightRatio")
multiplication_17 = Multiplication(A=sqrt_3, B=comunalwidthheightratio)
division_8 = Division(A=multiplication_16, B=multiplication_17)
multiplication_18 = Multiplication(A=division_8, B=0.5)
multiplication_19 = Multiplication(A=multiplication_17, B=0.5)
dom_5 = ConstructDomain(DomainStart=expr("-x", multiplication_18), DomainEnd=multiplication_18)
dom_6 = ConstructDomain(DomainStart=expr("-x", multiplication_19), DomainEnd=multiplication_19)
rectangle = Rectangle(Plane=pt_6, XSize=dom_6, YSize=dom_5, Radius=0)  # -> Rectangle, Length
number_slider_16 = Slider(2, range=0..5)
number_slider_17 = Slider(0.716, range=0..1)
number_slider_18 = Slider(0.336, range=0..1)
number_slider_19 = Slider(1, range=0..1)
offset = OffsetCurve(Curve=rectangle.Rectangle, Distance=number_slider_16, Plane=PlaneXY(0, 0, 0), Corners=1)
Z_3 = UnitZ(Factor=number_slider_5)
frgb = ColourRGBF(Alpha=Slider(0.276, range=0..1), Red=number_slider_18, Green=number_slider_18, Blue=number_slider_18)
Z_4 = UnitZ(Factor=number_slider_5)  # -> expr("x*2", UnitVector)

# ---- group: indicadores / áreaEquipComunal
number_6 = Number(area_6.Area)

# ---- group: Excel / AislamientoEnCulata
multiplication_20 = Multiplication(A=number_slider_16, B=2)  # disabled

# ---- group: FillThemUp / NumeroAptos (continued)
ma_2 = MassAddition(Input=subtraction_3)  # -> Result, PartialResults
panel_18 = Panel(ma_2.Result)
division_9 = Division(A=ma_2.Result, B=areaapto)

# ---- group: FillThemUp / AptosXTorre
round = Round(Number=division_9)  # -> Nearest, Floor, Ceiling

# ---- group: FillThemUp / AptosTotal
ma_3 = MassAddition(Input=flatten(round.Nearest))  # -> Result, PartialResults

# ---- group: calculoParqueaderos
division_10 = Division(A=ma_3.Result, B=Slider(2, range=0..10))
division_11 = Division(A=ma_3.Result, B=Slider(30, range=0..30))
division_12 = Division(A=ma_3.Result, B=Slider(10, range=0..10))
round_2 = Round(Number=division_11)  # -> Nearest, Floor, Ceiling
round_3 = Round(Number=division_12)  # -> Nearest, Floor, Ceiling
round_4 = Round(Number=division_10)  # -> Nearest, Floor, Ceiling
parqvisitantes = Panel(round_3.Nearest)
parqprivados = Panel(round_4.Nearest)
parqmovreducida = Panel(round_2.Nearest)
mass_addition = MassAddition(Input=[round_4.Nearest, round_3.Nearest, parqmovreducida])  # -> Result, PartialResults
round_5 = Round(Number=mass_addition.Result)  # -> Nearest, Floor, Ceiling
totalparqueaderos = Panel(round_5.Nearest)

# ---- group: FillThemUp / NumeroAptos (continued)
panel_19 = Panel(round.Nearest)
panel_20 = Panel(ma_3.Result)

# ---- group: Parqueaderos (continued)
subtraction_4 = Subtraction(A=round_5.Nearest, B=lng_2)
multiplication_21 = Multiplication(A=subtraction_4, B=numberofparkinglots)
placeparkinglots = CSharpScript(InputCurve=crv_4, ParkingSize=anchoparqueo, ParkLots=multiplication_21, StartAt=mod)  # -> PointsOut, TangentsOut; inputs InputCurve: Curve, ParkingSize: Double, ParkLots: Int32, StartAt: Double
# ---------- placeparkinglots: C# ----------
    int size = ParkLots / 2;

    Point3d[] evaluatedPoints = new Point3d[size];
    Vector3d[] tangents = new Vector3d[size];

    double evaluateAt = StartAt;
    
    double length = InputCurve.GetLength(1e-3);
    
    for( int i = 0; i < size; ++i )
    {

      evaluatedPoints[i] = InputCurve.PointAt(evaluateAt);
      tangents[i] = InputCurve.TangentAt(evaluateAt);

      evaluateAt += ParkingSize;
      evaluateAt %= length;

    }

    PointsOut = evaluatedPoints;
    TangentsOut = tangents;
# ---------- end placeparkinglots ----------
xprod_2 = CrossProduct(VectorA=placeparkinglots.TangentsOut, VectorB=Z_2, Unitize=True)  # -> Vector, Length
amp = Amplitude(Vector=xprod_2.Vector, Amplitude=largoparqueo)
amp_2 = Amplitude(Vector=xprod_2.Vector, Amplitude=circulacion)
move_2 = Move(Geometry=placeparkinglots.PointsOut, Motion=amp)  # -> Geometry, Transform
move_3 = Move(Geometry=move_2.Geometry, Motion=amp_2)  # -> Geometry, Transform
ln_2 = Line(StartPoint=placeparkinglots.PointsOut, EndPoint=move_2.Geometry)
shift = ShiftList(List=move_3.Geometry, Shift=1, Wrap=False)
shift_2 = ShiftList(List=move_2.Geometry, Shift=1, Wrap=False)
ln_3 = Line(StartPoint=move_3.Geometry, EndPoint=shift)
ln_4 = Line(StartPoint=move_2.Geometry, EndPoint=shift_2)
pline_3 = PolyLine(Vertices=move_2.Geometry, Closed=False)
pline_4 = PolyLine(Vertices=placeparkinglots.PointsOut, Closed=False)
len_3 = Length(Curve=ln_3)
len_4 = Length(Curve=ln_4)
end = EndPoints(Curve=pline_3)  # -> Start, End
end_2 = EndPoints(Curve=pline_4)  # -> Start, End
expression = Expression(x=len_3, y=anchoparqueo, z=number_slider_11, Expression="If( x < ( y * z ), False, True )")
expression_2 = Expression(x=len_4, y=anchoparqueo, z=number_slider_11, Expression="If( x < ( y * z ), False, True )")
ln_5 = Line(StartPoint=end.Start, EndPoint=end_2.Start)
ln_6 = Line(StartPoint=end.End, EndPoint=end_2.End)
join_2 = JoinCurves(Curves=flatten([ln_5, ln_6, pline_3, pline_4]), Preserve=False)
cull = CullPattern(List=ln_3, CullPattern=expression)
cull_2 = CullPattern(List=ln_2, CullPattern=expression_2)
join_3 = JoinCurves(Curves=cull, Preserve=False)
end_3 = EndPoints(Curve=pline_4)  # -> Start, End
flatten_2 = FlattenTree(Tree=join_3, Path="{0}")
c_script_3 = CSharpScript(Curves=join_3)  # -> B; inputs Curves: list of Curve
# ---------- c_script_3: C# ----------
    //var pointsOut = new List<Point3d>();
    var paramsOut = new List<double>();

    int size = Curves.Count;

    for( int i = 0; i < size - 1; ++i )
    {

      //      Curves[i].

      var events = Rhino.Geometry.Intersect.Intersection.CurveCurve(Curves[i], Curves[i + 1], 1e-3, 0);

      for( int j = 0; j < events.Count; ++j )
      {

        var eve = events[j];

        /*pointsOut.Add(eve.PointA);
        pointsOut.Add(eve.PointB);*/

        paramsOut.Add(eve.ParameterA);
        paramsOut.Add(eve.ParameterB);

        //Rhino.Geometry.Curve.

      }

    }

    //A = pointsOut;
    B = paramsOut;
# ---------- end c_script_3 ----------
len_5 = Length(Curve=flatten_2)
shatter = Shatter(Curve=join_3, Parameters=c_script_3)
sort_3 = SortList(Keys=len_5, ValuesA=len_5)  # -> Keys, ValuesA
len_6 = Length(Curve=shatter)
vec2pt = Vector2Pt(PointA=end_3.Start, PointB=eval.Point, Unitize=Toggle(True))  # -> Vector, Length
item_6 = ListItem(List=sort_3.ValuesA, Index=0, Wrap=True)
expression_3 = Expression(x=len_6, y=item_6, z=Slider(3.73, range=0..10), Expression="If( x < (z), False, True )")
len_7 = Length(Curve=shatter)
multiplication_22 = Multiplication(A=vec2pt.Vector, B=Slider(5, range=0..10))
sort_4 = SortList(Keys=len_7, ValuesA=shatter)  # -> Keys, ValuesA
multiplication_23 = Multiplication(A=vec2pt.Vector, B=ramp)
srfsplit_2 = SurfaceSplit(Surface=join_2, Curves=cull_2)
cull_3 = CullPattern(List=shatter, CullPattern=expression_3)  # -> flatten(List)
item_7 = ListItem(List=reverse(sort_4.ValuesA), Index=Slider(0, range=0..10), Wrap=True)  # -> flatten(Item)
divide_2 = DivideCurve(Curve=cull_3, Count=10, Kinks=False)  # -> Points, Tangents, Parameters
flatten_3 = FlattenTree(Tree=divide_2.Points, Path="{0}")
duppt = RemoveDuplicatePts(Points=flatten_3, Tolerance=0.01)
pline_5 = PolyLine(Vertices=flatten(duppt), Closed=False)
fillet = Fillet(Curve=pline_5, Radius=Slider(1, range=0..10))
len_8 = Length(Curve=fillet)
division_13 = Division(A=len_8, B=anchoparqueo)
series = Series(Start=0, Step=anchoparqueo, Count=division_13)
eval_2 = EvaluateCurve(Curve=fillet, Parameter=series)  # -> Point, Tangent, Angle
shift_3 = ShiftList(List=eval_2.Point, Shift=1, Wrap=False)
ln_7 = Line(StartPoint=eval_2.Point, EndPoint=shift_3)
join_4 = JoinCurves(Curves=ln_7, Preserve=False)
fillet_2 = Fillet(Curve=join_4, Radius=Slider(1, range=0..10))
end_4 = EndPoints(Curve=fillet_2)  # -> Start, End
offset_2 = OffsetCurve(Curve=fillet_2, Distance=expr("-x", circulacion), Plane=PlaneXY(0, 0, 0), Corners=2)
crv_7 = Curve(flatten([pline_4, offset_2]))
end_5 = EndPoints(Curve=offset_2)  # -> Start, End
ln_8 = Line(StartPoint=end_5.End, EndPoint=end_3.End)
ln_9 = Line(StartPoint=end_5.Start, EndPoint=end_3.Start)
join_5 = JoinCurves(Curves=flatten([ln_9, ln_8, crv_7]), Preserve=False)
move_4 = Move(Geometry=ln_9, Motion=multiplication_22)  # -> Geometry, Transform
move_5 = Move(Geometry=move_4.Geometry, Motion=multiplication_23)  # -> Geometry, Transform
end_6 = EndPoints(Curve=move_5.Geometry)  # -> Start, End
ln_10 = Line(StartPoint=[end_5.Start, end_6.End], EndPoint=[end_6.Start, end_3.Start])  # -> flatten(Line)
area_7 = Area(Geometry=join_5, UseTasks=False)  # -> Area, Centroid
join_6 = JoinCurves(Curves=ln_10, Preserve=False)
multiplication_24 = Multiplication(A=area_7.Area, B=2)
area_8 = Area(Geometry=join_6, UseTasks=False)  # -> Area, Centroid
runion_2 = RegionUnion(Curves=flatten([join_6, join_5]))
ma_4 = MassAddition(Input=[area_8.Area, multiplication_24])  # -> Result, PartialResults
end_7 = EndPoints(Curve=offset_2)  # -> Start, End
ln_11 = Line(StartPoint=end_4.Start, EndPoint=end_7.Start)
crv_cp = CurveClosestPoint(Point=eval_2.Point, Curve=offset_2)  # -> Point, Parameter, Distance
ln_12 = Line(StartPoint=crv_cp.Point, EndPoint=eval_2.Point)
ln_13 = Line(StartPoint=end_4.End, EndPoint=end_7.End)
join_7 = JoinCurves(Curves=flatten([ln_13, ln_11, offset_2, fillet_2]), Preserve=False)
shift_4 = ShiftList(List=crv_cp.Point, Shift=1, Wrap=False)
dist = Distance(PointA=crv_cp.Point, PointB=shift_4)
expression_4 = Expression(x=dist, y=anchoparqueo, z=Slider(0.106, range=0..1), Expression="If( x > ( y * z ), True, False )")
lng_7 = ListLength(List=srfsplit_2)
cull_4 = CullPattern(List=ln_12, CullPattern=expression_4)
srfsplit_3 = SurfaceSplit(Surface=join_7, Curves=cull_4)
lng_8 = ListLength(List=srfsplit_3)
ma_5 = MassAddition(Input=flatten([lng_8, lng_7]))  # -> Result, PartialResults
multiplication_25 = Multiplication(A=ma_5.Result, B=Slider(2, range=0..10))
addition_7 = Addition(A=multiplication_25, B=lng_2)
panel_21 = Panel(addition_7)
srf_2 = Surface(flatten([srfsplit_2, srfsplit_3, join_6]))

# ---- group: Parqueaderos / ParqueaderosVisual
number_slider_20 = Slider(0.065, range=0..1)
number_slider_21 = Slider(0.3, range=0..1)
number_slider_22 = Slider(0.3, range=0..1)
Z_5 = UnitZ(Factor=Slider(0.01, range=0..0.01))
frgb_2 = ColourRGBF(Alpha=Slider(0.453, range=0..1), Red=number_slider_20, Green=number_slider_20, Blue=number_slider_20)
move_6 = Move(Geometry=srf_2, Motion=Z_5)  # -> Geometry, Transform
preview = CustomPreview(Geometry=flatten([move_6.Geometry, srfsplit]), Material=frgb_2)

# ---- group: MáximoAptos
expression_5 = Expression(x=ma_3.Result, z=Slider(320, range=0..1000), Expression="Abs( x - z )")
panel_22 = Panel(expression_5)

# ---- group: ParkingFitness
expression_6 = Expression(x=addition_7, z=round_5.Nearest, Expression="Abs( x - z ) * 0.1")
panel_23 = Panel(expression_6)

# ---- group: indicadores / totalParqueaderos
integer = Integer(round_5.Nearest)

# ---- group: indicadores / totalUNViv
integer_2 = Integer(ma_3.Result)

# ---- group: indicadores
# NUMERO DE VIV/Ha UTIL = (No. TOTAL DE APARTAMENTOS/AREA UTIL LOTE) 	257, 	170, 	344
number_slider_23 = Slider(10000, range=0..10000)
division_14 = Division(A=number_2, B=number_slider_23)
division_15 = Division(A=integer_2, B=division_14)
roundto = CSharpScript(Number=division_15, DecimalPlace=number_slider_7)  # -> Rounded; inputs Number: Double, DecimalPlace: Int32
# ---------- roundto: C# ----------
    Rounded = Math.Round(Number, DecimalPlace);
# ---------- end roundto ----------
panel_24 = Panel(roundto)

# M2 DOTACION COMUNAL POR UNIDAD DE VIVIENDA (No Incluye Espacios Tecnicos)	2.09, 	1.36, 	2.82
division_16 = Division(A=number_6, B=integer_2)
roundto_2 = CSharpScript(Number=division_16, DecimalPlace=number_slider_7)  # -> Rounded; inputs Number: Double, DecimalPlace: Int32; same code as roundto
panel_25 = Panel(roundto_2)

# ---- group: RelacionParqueaderos/UViviendas
# RELACION PARQUEADEROS POR VIVIENDA=(TOTAL PARQUEADEROS / No. TOTAL DE VIVIENDAS, Incl visit)	0.43, 	0.36, 	0.50
division_17 = Division(A=round_5.Nearest, B=ma_3.Result)
roundto_3 = CSharpScript(Number=division_17, DecimalPlace=number_slider_7)  # -> Rounded; inputs Number: Double, DecimalPlace: Int32; same code as roundto
panel_26 = Panel(roundto_3)

# ---- group: Parqueaderos / ParqueaderosPrivados
division_18 = Division(A=round_4.Nearest, B=round_5.Nearest)
multiplication_26 = Multiplication(A=addition_7, B=division_18)
round_6 = Round(Number=multiplication_26)  # -> Nearest, Floor, Ceiling
panel_27 = Panel(round_6.Nearest)
path_mapper = PathMapper(round_6.Nearest, source="{A;B;C}", target="{A}")

# ---- group: Parqueaderos / ParqueaderosVisitantes
division_19 = Division(A=round_3.Nearest, B=round_5.Nearest)
multiplication_27 = Multiplication(A=addition_7, B=division_19)
round_7 = Round(Number=multiplication_27)  # -> Nearest, Floor, Ceiling
panel_28 = Panel(round_7.Nearest)
path_mapper_2 = PathMapper(round_7.Nearest, source="{A;B;C}", target="{A}")

# ---- group: Parqueaderos / ParqueaderosMovilidadReducida
division_20 = Division(A=round_2.Nearest, B=round_5.Nearest)
multiplication_28 = Multiplication(A=addition_7, B=division_20)
round_8 = Round(Number=multiplication_28)  # -> Nearest, Floor, Ceiling
panel_29 = Panel(round_8.Nearest)
path_mapper_3 = PathMapper(round_8.Nearest, source="{A;B;C}", target="{A}")

# ---- group: ExcelWriterOne / RelaciónParqueaderos/Visitantes
ma_6 = MassAddition(Input=flatten(round.Nearest))  # -> Result, PartialResults; disabled
division_21 = Division(A=round_3.Nearest, B=ma_6.Result)  # disabled

# ---- group: ExcelWriterOne / NúmeroTotalAptos
int_3 = Integer(ma_3.Result)  # disabled

# ---- group: ExcelWriterOne / ParqueaderosPrivados
int_4 = Integer(round_5.Nearest)  # disabled

# ---- group: ExcelWriterOne / RelaciónParqueaderos/Aptos
ma_7 = MassAddition(Input=flatten(round.Nearest))  # -> Result, PartialResults; disabled
division_22 = Division(A=int_4, B=ma_7.Result)  # disabled

# ---- group: Physics / EnclosingCurve
crv_8 = Curve(crv)
crv_9 = Curve(runion_2)
area_9 = Area(Geometry=crv_8, UseTasks=False)  # -> Area, Centroid
scale_2 = Scale(Geometry=crv_9, Center=area_9.Centroid, Factor=Slider(1.01, range=0..10))  # -> Geometry, Transform
crv_10 = Curve(scale_2.Geometry)
rdiff = RegionDifference(CurvesA=crv_8, CurvesB=crv_10)
crv_11 = Curve(rdiff)
divide_3 = DivideCurve(Curve=crv_11, Count=Slider(100, range=0..100), Kinks=False, UseTasks=True)  # -> Points, Tangents, Parameters
disc = Discontinuity(Curve=crv_11, Level=2)  # -> Points, Parameters; disabled

# ---- group: FloorPlan
voronoi = Voronoi(Points=rotate.Geometry, BruteForceOverride=False)  # disabled
number_slider_24 = Slider(8, range=0..100)  # disabled
srf_3 = Surface(crv_11)  # disabled
sdivide_2 = DivideSurface(Surface=srf_3, UCount=number_slider_24, VCount=number_slider_24)  # -> Points, Normals, Parameters; disabled
ptborders = GenerateBorders(Grid=sdivide_2.Points, PanelShape=0, Surface=srf_3)  # disabled
number_slider_25 = Slider(0.001, range=0..0.001)  # disabled
flatten_4 = FlattenTree(Tree=ptborders, Path="{0}")  # disabled
item_8 = ListItem(List=flatten_4, Index=0, Wrap=True)  # disabled
area_10 = Area(Geometry=item_8, UseTasks=False)  # -> Area, Centroid; disabled
number_slider_26 = Slider(0.5, range=0..1)  # disabled
multiplication_29 = Multiplication(A=area_10.Area, B=number_slider_26)  # disabled
sortxy = SortPointsXY(Grid=flatten(flatten_4))  # disabled
number_slider_27 = Slider(769, range=0..1000)  # disabled
number_slider_28 = Slider(1000, range=0..1000)  # disabled
number_slider_29 = Slider(178, range=0..1000)  # disabled

# ---- group: Physics
pline_6 = PolyLine(Vertices=divide_3.Points, Closed=True)
merge = Merge(Data1=offset, Data3=scale_nu.Geometry)
flatten_5 = FlattenTree(Tree=merge, Path="{0}")

# ---- group: Physics / EnclosingCurve (continued)
offsettree = CSharpScript(tree=pline_6, distance=Slider(50, range=-100..100))  # -> out, A; inputs tree: tree of Curve, distance: Double
# ---------- offsettree: C# ----------
    /*var curves = x.Offset(Plane.WorldXY, -10, 1e-3, CurveOffsetCornerStyle.Sharp);

    var list = new List<Curve>();
    list.AddRange(curves);
    list.Add(x);

    Brep[] brep = Brep.CreateFromLoft(list, Point3d.Unset, Point3d.Unset, LoftType.Normal, false);

    A = brep;*/

    int branches = tree.BranchCount;

    DataTree<Curve> treeOut = new DataTree<Curve>();
    GH_Path path = new GH_Path();

    for( int i = 0; i < branches; ++i )
    {

      path = new GH_Path(i);

      //for( int j = 0; j < tree.Branch(i).Count; ++j )
      {

        treeOut.Add(tree.Branch(i)[0], path);
        treeOut.AddRange(tree.Branch(i)[0].Offset(Plane.WorldXY, distance, 1e-3, CurveOffsetCornerStyle.Sharp), path);

      }

    }

    A = treeOut;
# ---------- end offsettree ----------
loft = Loft(Curves=offsettree.A, Options={Adjust=True, Closed=False, LoftEnds=0, LoftSimp=0, LoftType=3, Rebuild=100, Refit=0.01})
debrep = DeconstructBrep(Brep=loft)  # -> simplify(Faces), Edges, Vertices
wires = BrepWireframe(Brep=debrep.Faces, Density=-1)
join_8 = JoinCurves(Curves=wires, Preserve=False)  # -> flatten(Curves)

# ---- group: Physics (continued)
cc = CurveCollide(Curves=flatten(flatten_5), PassiveCurves=join_8, BasePlane=PlaneXY(0, 0, 0), Strength=Slider(0.469, range=0..10))  # -> Goal, Frames
data = Data(flatten(cc.Goal))
customkangaroo = CSharpScript(
    Goals=data,
    Reset=Toggle(True),
    Iter=Slider(15, range=0..100),
    Reference="C:\Program Files\Rhino 6\Plug-ins\Grasshopper\Components\KangarooSolver.dll")  # -> A; inputs Goals: list, Reset: Boolean, Iter: Int32
# ---------- customkangaroo: C# usings ----------
using System.IO;
using System.Linq;
using System.Data;
using System.Drawing;
using System.Reflection;
using System.Windows.Forms;
using System.Xml;
using System.Xml.Linq;
using System.Runtime.InteropServices;

using Rhino.DocObjects;
using Rhino.Collections;
using GH_IO;
using GH_IO.Serialization;
using KangarooSolver;
using KangarooSolver.Goals;
# ---------- customkangaroo: C# ----------
    if( Reset )
    {

      PS = new KangarooSolver.PhysicalSystem();

      GoalList.Clear();

      foreach( IGoal G in Goals ) //Assign indexes to the particles in each Goal:
        //System.Threading.Tasks.Parallel.ForEach(Goals, G =>
      {

        PS.AssignPIndex(G, 0.0001); // the second argument is the tolerance distance below which points combine into a single particle
        GoalList.Add(G);

      }
      //);

    }

    for( int i = 0; i < Iter; ++i )
      //System.Threading.Tasks.Parallel.For(0, Iter, i =>
    {

      PS.Step(GoalList, true, 1);

    }
    //);

    A = PS.GetOutput(GoalList);
# ---------- customkangaroo: C# additional code ----------
  KangarooSolver.PhysicalSystem PS = new KangarooSolver.PhysicalSystem();
  List<IGoal> GoalList = new List<IGoal>();
# ---------- end customkangaroo ----------
objecttocurves = CSharpScript(x=customkangaroo)  # -> A; inputs x: list
# ---------- objecttocurves: C# ----------
    /*
    var listOut = new DataTree<Curve>();
    var list = new object[x.Count];
    Curve temp = null;

    for( int i = 0; i < x.Count; ++i )
    {

      list = ( object[] ) x[i];

      for( int j = 0; j < list.Length; ++j )
      {

        GH_Convert.ToCurve(list[j], ref temp, GH_Conversion.Both);

        listOut.Add(temp, new GH_Path(i));

      }

    }
*/
    A = x[0];
# ---------- end objecttocurves ----------

# ---- group: FloorPlan (continued)
rint = RegionIntersection(CurvesA=voronoi, CurvesB=pline_6)  # disabled
spacepartition = SpacePartition(VoronoiIn=rint, GridIn=flatten_4, AreaIn=multiplication_29, Tolerance=number_slider_25)  # disabled
sortxy_2 = SortPointsXY(Grid=flatten(spacepartition))  # disabled
pararunion = ParallelRegionUnion(Curves=spacepartition)  # disabled
missing = MissingGridCells(CulledGrid=sortxy_2, OriginalGrid=sortxy)  # disabled
mgtree = MergeTreeMissing(CulledGrid=simplify(pararunion), MissingGridCells=missing)  # disabled
pararunion_2 = ParallelRegionUnion(Curves=mgtree)  # disabled
lng_9 = ListLength(List=flatten(pararunion_2))  # disabled
srf_4 = Surface(pararunion_2)  # disabled
random = Random(Range=Domain(0, 1), Number=lng_9, Seed=number_slider_27)  # disabled
random_2 = Random(Range=Domain(0, 1), Number=lng_9, Seed=number_slider_28)  # disabled
random_3 = Random(Range=Domain(0, 1), Number=lng_9, Seed=number_slider_29)  # disabled
frgb_3 = ColourRGBF(Alpha=1, Red=random_2, Green=random, Blue=random_3)  # disabled

# ----
move_7 = Move(Geometry=srf_4, Motion=Y)  # -> Geometry, Transform; disabled

# ---- group: FloorPlan (continued)
preview_2 = CustomPreview(Geometry=move_7.Geometry, Material=graft(frgb_3))  # disabled

# ---- group: Ortho
D = Direction(Vector(87.27427758, -44.28019983, 0))
Z_6 = UnitZ(Factor=1)
xprod_3 = CrossProduct(VectorA=D, VectorB=Z_6, Unitize=False)  # -> Vector, Length

# ---- group: PullToBoundary
debrep_2 = DeconstructBrep(Brep=objecttocurves)  # -> Faces, Edges, Vertices
eval_3 = EvaluateCurve(Curve=reparameterize(debrep_2.Edges), Parameter=0.5)  # -> Point, Tangent, Angle
area_11 = Area(Geometry=objecttocurves, UseTasks=False)  # -> Area, graft(Centroid)
number_slider_30 = Slider(1, range=0..1)
number_slider_31 = Slider(0, range=0..100)

# ---- group: Ortho (continued)
addition_8 = Addition(A=eval_3.Point, B=xprod_3.Vector)
addition_9 = Addition(A=eval_3.Point, B=xprod_3.Vector)
pdecon = Deconstruct(Point=addition_8)  # -> XComponent, YComponent, ZComponent
pdecon_2 = Deconstruct(Point=addition_9)  # -> XComponent, YComponent, ZComponent
multiplication_30 = Multiplication(A=pdecon.XComponent, B=Slider(1000, range=0..1000))
sort_5 = SortList(Keys=multiplication_30, ValuesA=eval_3.Point)  # -> Keys, ValuesA
sort_6 = SortList(Keys=pdecon_2.XComponent, ValuesA=eval_3.Point)  # -> Keys, ValuesA
points = PointList(Points=sort_5.ValuesA, Size=Slider(4.95, range=0..10))
points_2 = PointList(Points=sort_6.ValuesA, Size=Slider(4.95, range=0..10))
pt_7 = Point(area_11.Centroid)
item_9 = ListItem(List=sort_6.ValuesA, Index=Slider(3, range=0..10), Wrap=True)
item_10 = ListItem(List=sort_5.ValuesA, Index=Slider(1, range=0..10), Wrap=True)
item_11 = ListItem(List=sort_5.ValuesA, Index=Slider(2, range=0..2), Wrap=True)
expression_7 = Expression(x=item_10, y=item_11, Expression="If( x.Y > y.Y, x, y )")
ln_14 = Line(StartPoint=pt_7, EndPoint=item_9)
ln_15 = Line(StartPoint=pt_7, EndPoint=expression_7)
lnln = LineLine(LineA=flatten(ln_14), LineB=flatten(ln_15))
align = AlignPlane(Plane=lnln, Direction=D)  # -> Plane, Angle
ortho = CSharpScript(Ortho=toggle, Angles=align.Angle)  # -> AnglesOut; inputs Ortho: Boolean, Angles: list of Double
# ---------- ortho: C# ----------
    double temp = 0.0;

    int size = Angles.Count;

    double[] anglesOut = new double[size];

    if( Ortho == true )
    {

      for( int i = 0; i < size; ++i )
      {

        temp = Angles[i];

        if( temp < 0 )
        {

          if( temp < -( Math.PI * 0.25 ) )
          {

            temp -= Math.PI * 0.5;

          }

        }

        anglesOut[i] = temp;

      }

    }

    else
    {

      for( int i = 0; i < size; ++i )
        
        anglesOut[i] = 0;

    }

    AnglesOut = anglesOut;
# ---------- end ortho ----------
rotate_2 = Rotate(Geometry=objecttocurves, Angle=ortho, Plane=lnln)  # -> Geometry, Transform

# ---- group: RescaleNU
len_9 = Length(Curve=ln_14)
len_10 = Length(Curve=ln_15)
number_slider_32 = Slider(2, range=0..10)

# ---- group: PullToBoundary (continued)
sort_7 = SortList(Keys=area_11.Area, ValuesA=rotate_2.Geometry)  # -> Keys, ValuesA

# ---- group: PullToBoundary / Edificios
cull_i_4 = CullIndex(List=sort_7.ValuesA, Indices=number_slider_31, Wrap=True)

# ---- group: RescaleNU (continued)
crv_12 = Curve(cull_i_4)
debrep_3 = DeconstructBrep(Brep=crv_12)  # -> Faces, Edges, Vertices
area_12 = Area(Geometry=crv_12, UseTasks=False)  # -> Area, graft(Centroid)
eval_4 = EvaluateCurve(Curve=reparameterize(debrep_3.Edges), Parameter=0.5)  # -> Point, Tangent, Angle
disc_2 = Discontinuity(Curve=crv_12, Level=1)  # -> Points, Parameters
rectangle_2 = Rectangle(Plane=area_12.Centroid, XSize=Domain(-1, 1), YSize=Domain(-2, 2), Radius=0)  # -> Rectangle, Length
pln_2 = Plane(area_12.Centroid)
align_2 = AlignPlane(Plane=pln_2, Direction=xprod_3.Vector)  # -> Plane, Angle
addition_10 = Addition(A=eval_4.Point, B=xprod_3.Vector)
pdecon_3 = Deconstruct(Point=addition_10)  # -> XComponent, YComponent, ZComponent
sort_8 = SortList(Keys=pdecon_3.XComponent, ValuesA=eval_4.Point)  # -> Keys, ValuesA
points_3 = PointList(Points=sort_8.ValuesA, Size=Slider(4.95, range=0..10))
item_12 = ListItem(List=eval_4.Point, Index=Slider(2, range=0..10), Wrap=True)
item_13 = ListItem(List=eval_4.Point, Index=Slider(3, range=0..10), Wrap=True)
ln_16 = Line(StartPoint=area_12.Centroid, EndPoint=item_13)
ln_17 = Line(StartPoint=area_12.Centroid, EndPoint=item_12)
lnln_2 = LineLine(LineA=flatten(ln_16), LineB=flatten(ln_17))
anchoslargos = CSharpScript(plantas=crv_12)  # -> graft(ancho), graft(largo); inputs plantas: tree of Rectangle3d
# ---------- anchoslargos: C# ----------
    DataTree<double> anchosOut = new DataTree<double>(), largosOut = new DataTree<double>();

    Rectangle3d temp = new Rectangle3d();

    GH_Path path = new GH_Path();

    for( int i = 0; i < plantas.BranchCount; ++i )
    {

      path = plantas.Path(i);

      for( int j = 0; j < plantas.Branch(i).Count; ++j )
      {

        temp = plantas.Branch(i)[j];
        
        anchosOut.Add(temp.Width, path);
        largosOut.Add(temp.Height, path);

      }

    }

    ancho = anchosOut;
    largo = largosOut;
# ---------- end anchoslargos ----------
sort_9 = SortList(Keys=[anchoslargos.ancho, anchoslargos.largo], ValuesA=[anchoslargos.ancho, anchoslargos.largo])  # -> Keys, ValuesA
item_14 = ListItem(List=sort_9.ValuesA, Index=0, Wrap=True)  # -> Item, Item1
division_23 = Division(A=flatten(num_8), B=flatten(item_14.Item1))
division_24 = Division(A=flatten(num_7), B=flatten(item_14.Item))
multiplication_31 = Multiplication(A=number_slider_32, B=division_24)
multiplication_32 = Multiplication(A=division_23, B=number_slider_32)
crv_13 = Curve(crv_12)
scale_nu_2 = ScaleNU(Geometry=crv_13, Plane=lnln_2, ScaleX=multiplication_31, ScaleY=multiplication_32, ScaleZ=1)  # -> Geometry, Transform

# ---- group: AreaPrimerPiso
crv_14 = Curve(scale_nu_2.Geometry)
area_13 = Area(Geometry=crv_14, UseTasks=False)  # -> Area, Centroid
ma_8 = MassAddition(Input=flatten(area_13.Area))  # -> Result, PartialResults

# ---- group: PullToBoundary / Comunal
item_15 = ListItem(List=sort_7.ValuesA, Index=number_slider_31, Wrap=True)

# ---- group: PuntoFijoFloors
num_10 = Number(sort.ValuesA)
item_16 = ListItem(List=num_10, Index=0, Wrap=True)  # -> Item, Item1
num_11 = Number(flatten(item_16.Item))
num_12 = Number(flatten(item_16.Item1))
division_25 = Division(A=flatten(num_12), B=flatten(item_14.Item1))
division_26 = Division(A=flatten(num_11), B=flatten(item_14.Item))
number_slider_33 = Slider(2, range=0..10)
multiplication_33 = Multiplication(A=number_slider_33, B=division_26)
multiplication_34 = Multiplication(A=division_25, B=number_slider_33)
crv_15 = Curve(crv_12)
scale_nu_3 = ScaleNU(Geometry=crv_15, Plane=lnln_2, ScaleX=multiplication_33, ScaleY=multiplication_34, ScaleZ=1)  # -> Geometry, Transform
addition_11 = Addition(A=lng_5, B=1)
series_2 = Series(Start=0, Step=number_slider_5, Count=addition_11)
Z_7 = UnitZ(Factor=series_2)
move_8 = Move(Geometry=graft(scale_nu_3.Geometry), Motion=Z_7)  # -> simplify(Geometry), Transform
crv_16 = Curve(move_8.Geometry)
flatten_6 = FlattenTree(Tree=crv_16, Path="{0}")
crv_17 = Curve(flatten_6)
frgb_4 = ColourRGBF(Alpha=Slider(1, range=0..1), Red=Slider(0, range=0..1), Green=Slider(0, range=0..1), Blue=Slider(0, range=0..1))
area_14 = Area(Geometry=crv_16, UseTasks=False)  # -> Area, Centroid
ma_9 = MassAddition(Input=flatten(area_14.Area))  # -> Result, PartialResults
panel_30 = Panel(ma_9.Result)
number_slider_34 = Slider(2.2241, range=0..10)
previewlw = CustomPreviewLineweights(Geometry=crv_17, Shader=frgb_4, Thickness=number_slider_34, Absolute=False)

# ---- group: PullToBoundary (continued)
offset_3 = OffsetCurve(Curve=item_15, Distance=expr("-x", number_slider_16), Plane=PlaneXY(0, 0, 0), Corners=1)
area_15 = Area(Geometry=offset_3, UseTasks=False)  # -> Area, Centroid

# ---- group: Comunal (continued)
srf_5 = Surface(offset_3)
crv_18 = Curve(srf_5)
move_9 = Move(Geometry=crv_18, Motion=Z_3)  # -> Geometry, Transform
extr = Extrude(Base=srf_5, Direction=Z_4)
move_10 = Move(Geometry=move_9.Geometry, Motion=Z_3)  # -> Geometry, Transform
preview_3 = CustomPreview(Geometry=extr, Material=frgb)

# ---- group: PassThrough
area_16 = Area(Geometry=runion_2, UseTasks=False)  # -> Area, Centroid
merge_2 = Merge(Data1=ma_8.Result, Data2=multiplication_16, Data3=area_16.Area)  # -> flatten(Result)
num_13 = Number(ma_4.Result)
ma_10 = MassAddition(Input=flatten(merge_2))  # -> Result, PartialResults
addition_12 = Addition(A=area_6.Area, B=ma_8.Result)

# ---- group: CollisionsWithBorder
crv_19 = Curve(flatten([scale_nu_2.Geometry, offset_3]))
crv_20 = Curve(flatten(crv_19))
crv_21 = Curve(pline_6)
relay_2 = Relay([crv_21, crv_20])
area_17 = Area(Geometry=crv_21, UseTasks=False)  # -> Area, Centroid
runion_3 = RegionUnion(Curves=flatten(relay_2))
ma_11 = MassAddition(Input=flatten(area_17.Area))  # -> Result, PartialResults
area_18 = Area(Geometry=runion_3, UseTasks=False)  # -> Area, Centroid
ma_12 = MassAddition(Input=flatten(area_18.Area))  # -> Result, PartialResults
expression_8 = Expression(x=ma_12.Result, y=ma_11.Result, Expression="Abs( x - y ) * 0.1")
panel_31 = Panel(expression_8)

# ---- group: CollisionsBetweenThem
relay_3 = Relay([item_15, crv_12])
crv_22 = Curve(flatten(relay_3))
runion_4 = RegionUnion(Curves=crv_22)
area_19 = Area(Geometry=crv_22, UseTasks=False)  # -> Area, Centroid
area_20 = Area(Geometry=runion_4, UseTasks=False)  # -> Area, Centroid
ma_13 = MassAddition(Input=flatten(area_19.Area))  # -> Result, PartialResults
ma_14 = MassAddition(Input=flatten(area_20.Area))  # -> Result, PartialResults
expression_9 = Expression(x=ma_14.Result, y=ma_13.Result, Expression="Abs( x - y ) * 0.1")
panel_32 = Panel(expression_9)

# ---- group: ParkingCollisions
relay_4 = Relay([runion_2, crv_22])
runion_5 = RegionUnion(Curves=flatten(relay_4))
area_21 = Area(Geometry=relay_4, UseTasks=False)  # -> Area, Centroid
ma_15 = MassAddition(Input=flatten(area_21.Area))  # -> Result, PartialResults
area_22 = Area(Geometry=runion_5, UseTasks=False)  # -> Area, Centroid
ma_16 = MassAddition(Input=flatten(area_22.Area))  # -> Result, PartialResults
expression_10 = Expression(x=ma_16.Result, y=ma_15.Result, Expression="Abs( x - y ) * 0.1")
panel_33 = Panel(expression_10)

# ---- group: VolumesPuntoFijo
loft_2 = Loft(Curves=crv_16, Options={Adjust=False, Closed=False, LoftEnds=0, LoftSimp=0, LoftType=0, Rebuild=10, Refit=0.01})
number_slider_35 = Slider(0, range=0..1)
number_slider_36 = Slider(0, range=0..1)
number_slider_37 = Slider(0.429, range=0..1)
cap = CapHoles(Brep=loft_2)
frgb_5 = ColourRGBF(Alpha=Slider(1, range=0..1), Red=number_slider_37, Green=number_slider_37, Blue=number_slider_37)
preview_4 = CustomPreview(Geometry=cap, Material=frgb_5)

# ---- group: AreaPlanta
item_17 = ListItem(List=scale_nu_2.Geometry, Index=0, Wrap=True)
area_23 = Area(Geometry=item_17, UseTasks=False)  # -> Area, Centroid
panel_34 = Panel(area_23.Area)

# ----
lng_10 = ListLength(List=crv_16)
cull_i_5 = CullIndex(List=crv_16, Indices=expr("x-1", lng_10), Wrap=True)

# ---- group: indicadores / áreaPuntoFijo
number_7 = Number(ma_9.Result)

# ---- group: indicadores / áreaPrimerPiso
number_8 = Number(ma_8.Result)

# ---- group: indicadores / áreaParqueable
number_9 = Number(num_13)

# ---- group: I.O
# INDICE DE OCUPACION (AREA CONSTRUIDA EN PRIMER PISO/AREA UTIL LOTE)	0.39, 	0.21, 	0.57
division_27 = Division(A=addition_12, B=area.Area)
roundto_4 = CSharpScript(Number=division_27, DecimalPlace=number_slider_7)  # -> Rounded; inputs Number: Double, DecimalPlace: Int32; same code as roundto
panel_35 = Panel(roundto_4)

expression_11 = Expression(
    x=roundto_4,
    y=Slider(0.3, range=0..10),
    z=Slider(0.24, range=0..1),
    Expression="If( ( x ≤ y ) and ( x ≥ z ), 0, Abs( x - z ) * 30 )")
panel_36 = Panel(expression_11)

# ---- group: indicadores
# AREA PROMEDIO PARQUEADERO (AREA PARQUEABLE/TOTAL PARQUEADEROS)	23.53, 	20.18, 	26.88
division_28 = Division(A=number_9, B=integer)
roundto_5 = CSharpScript(Number=division_28, DecimalPlace=number_slider_7)  # -> Rounded; inputs Number: Double, DecimalPlace: Int32; same code as roundto
panel_37 = Panel(roundto_5)

# M2 PUNTO FIJO POR  UNIDAD DE VIVIENDA = (AREA PUNTOS FIJOS/No. TOTAL DE APARTAMENTOS)	5.41, 	4.69, 	6.13
division_29 = Division(A=number_7, B=integer_2)
roundto_6 = CSharpScript(Number=division_29, DecimalPlace=number_slider_7)  # -> Rounded; inputs Number: Double, DecimalPlace: Int32; same code as roundto
panel_38 = Panel(roundto_6)

# % DE OCUPACION TOTAL (AREA TOTAL OCUPADA/AREA UTIL LOTE)	53.7%, 	38.7%, 	68.7%
division_30 = Division(A=ma_10.Result, B=number_2)
multiplication_35 = Multiplication(A=division_30, B=100)
roundto_7 = CSharpScript(Number=multiplication_35, DecimalPlace=number_slider_7)  # -> Rounded; inputs Number: Double, DecimalPlace: Int32; same code as roundto
panel_39 = Panel(roundto_7)

# % DE AREA LIBRE = (AREA UTIL LOTE - AREA DE OCUPACION TOTAL / AREA UTIL LOTE)	46.3%, 	31.3%, 	61.3%
subtraction_5 = Subtraction(A=number_2, B=ma_10.Result)
division_31 = Division(A=subtraction_5, B=number_2)
multiplication_36 = Multiplication(A=division_31, B=100)  # disabled
roundto_8 = CSharpScript(Number=multiplication_36, DecimalPlace=number_slider_7)  # -> Rounded; inputs Number: Double, DecimalPlace: Int32; same code as roundto
panel_40 = Panel(roundto_8)

# ---- group: ExcelWriterOne / I.O.
num_14 = Number(roundto_4)  # disabled

# ---- group: Floors
move_11 = Move(Geometry=graft(scale_nu_2.Geometry), Motion=customgeoplacement.B)  # -> simplify(Geometry), Transform
crv_23 = Curve(move_11.Geometry)
area_24 = Area(Geometry=crv_23, UseTasks=False)  # -> Area, Centroid
flatten_7 = FlattenTree(Tree=crv_23, Path="{0}")
crv_24 = Curve(flatten_7)
frgb_6 = ColourRGBF(Alpha=Slider(1, range=0..1), Red=Slider(0, range=0..1), Green=Slider(0, range=0..1), Blue=Slider(0, range=0..1))
ma_17 = MassAddition(Input=flatten(area_24.Area))  # -> Result, PartialResults
panel_41 = Panel(ma_17.Result)
cull_i_6 = CullIndex(List=area_24.Area, Indices=Slider(0, range=0..100), Wrap=True)
previewlw_2 = CustomPreviewLineweights(Geometry=crv_24, Shader=frgb_6, Thickness=number_slider_34, Absolute=False)

# ----
previewlw_3 = CustomPreviewLineweights(Geometry=[move_10.Geometry, move_9.Geometry, crv_18], Shader=frgb_6, Thickness=number_slider_34, Absolute=False)

# ---- group: Volumes
loft_3 = Loft(Curves=crv_23, Options={Adjust=False, Closed=False, LoftEnds=0, LoftSimp=0, LoftType=0, Rebuild=10, Refit=0.01})
number_slider_38 = Slider(0.719, range=0..1)
number_slider_39 = Slider(1, range=0..1)
number_slider_40 = Slider(1, range=0..1)
cap_2 = CapHoles(Brep=loft_3)
frgb_7 = ColourRGBF(Alpha=Slider(0.904, range=0..1), Red=number_slider_38, Green=number_slider_38, Blue=number_slider_38)
preview_5 = CustomPreview(Geometry=cap_2, Material=frgb_7)

# ---- group: Alturas
lng_11 = ListLength(List=move_11.Geometry)
item_18 = ListItem(List=move_11.Geometry, Index=expr("x-1", lng_11), Wrap=True)
item_19 = ListItem(List=move_11.Geometry, Index=0, Wrap=True)
area_25 = Area(Geometry=item_19, UseTasks=False)  # -> Area, Centroid
area_26 = Area(Geometry=item_18, UseTasks=False)  # -> Area, Centroid
vec2pt_2 = Vector2Pt(PointA=area_25.Centroid, PointB=area_26.Centroid, Unitize=False)  # -> Vector, Length
num_15 = Number(flatten(vec2pt_2.Length))
vdis = VectorDisplay(Anchor=area_25.Centroid, Vector=vec2pt_2.Vector)  # disabled

# ---- group: Floors / ÁreaTotal
ma_18 = MassAddition(Input=flatten(cull_i_6))  # -> Result, PartialResults

# ---- group: AreaVendible
multiplication_37 = Multiplication(A=ma_18.Result, B=number_slider_8)
subtraction_6 = Subtraction(A=ma_18.Result, B=multiplication_37)
areatotalplantas = Panel(subtraction_6)
ma_19 = MassAddition(Input=flatten([subtraction_6, area_15.Area]))  # -> Result, PartialResults
ma_20 = MassAddition(Input=flatten(subtraction_6))  # -> Result, PartialResults
panel_42 = Panel(ma_20.Result)

# ---- group: Floors (continued)
panel_43 = Panel(ma_18.Result)

# ---- group: Floors / ÁreaXTorre
ma_21 = MassAddition(Input=cull_i_6)  # -> simplify(flatten(Result)), PartialResults

# ---- group: indicadores / áreaTotalConstruida
number_10 = Number(ma_18.Result)

# ---- group: indicadores / áreaVendible
number_11 = Number(ma_19.Result)

# ---- group: I.C
# INDICE DE CONSTRUCCION (AREA CONSTRUIDA VENDIBLE/AREA UTIL)	1.58, 	1.08, 	2.08
division_32 = Division(A=ma_19.Result, B=area.Area)
roundto_9 = CSharpScript(Number=division_32, DecimalPlace=number_slider_7)  # -> Rounded; inputs Number: Double, DecimalPlace: Int32; same code as roundto
panel_44 = Panel(roundto_9)

division_33 = Division(A=ma_19.Result, B=area.Area)
panel_45 = Panel(division_33)
expression_12 = Expression(
    x=roundto_9,
    y=Slider(2.4, range=0..10),
    z=Slider(1.9, range=0..10),
    Expression="If( ( x ≤ y ) and ( x ≥ z ), 0, Abs( x - z ) * 20 )")
panel_46 = Panel(expression_12)

# ----
data_2 = Data(flatten([expression_12, expression_11, expression_5, expression_9, expression_8, expression_10, expression_6]))
ma_22 = MassAddition(Input=data_2)  # -> Result, PartialResults
panel_47 = Panel(ma_22.Result)

# ---- group: indicadores
# RELACION M2 VENDIBLES /M2 CONSTRUIDOS = (AREA TOTAL VENDIBLE/AREA CONSTRUIDA )	80%, 	76%, 	84%
division_34 = Division(A=number_11, B=number_10)
multiplication_38 = Multiplication(A=division_34, B=100)
roundto_10 = CSharpScript(Number=multiplication_38, DecimalPlace=number_slider_7)  # -> Rounded; inputs Number: Double, DecimalPlace: Int32; same code as roundto
panel_48 = Panel(roundto_10)

# RELACION M2 DE PUNTO FIJO/AREA VENDIBLE=(AREA PUNTOS FIJOS/AREA VENDIBLE)	9.2%, 	8.2%, 	10.2%
division_35 = Division(A=number_7, B=number_11)
multiplication_39 = Multiplication(A=division_35, B=100)
roundto_11 = CSharpScript(Number=multiplication_39, DecimalPlace=number_slider_7)  # -> Rounded; inputs Number: Double, DecimalPlace: Int32; same code as roundto
panel_49 = Panel(roundto_11)

# ---- group: Excel
toggle_2 = GroupToggle(ToggleActive=True, ToggleVisible=False)  # disabled
panel_50 = Panel("EN SERVIDUMBRE VISUAL m")  # disabled
panel_51 = Panel("CONTRA TORRES DE VIVIENDA")  # disabled
panel_52 = Panel("SÓTANO")  # disabled
merge_3 = Merge(
    Data1=area.Area,
    Data2=area_2.Area,
    Data3=subtraction_6,
    Data4=addition_12,
    Data5=roundto_9,
    Data6=roundto_4,
    Data7=panel_50,
    Data8=aislamientos,
    Data9=number_slider_14,
    Data10=panel_52,
    Data11=panel_3,
    Data12=path_mapper,
    Data13=path_mapper_2,
    Data14=path_mapper_3,
    Data15=roundto_3,
    Data16=area_6.Area,
    Data17=panel_51,
    Data18=multiplication_20)  # disabled
panel_53 = Panel("C:\Users\Paula\Desktop\Felipe\Prodesa\Felipe\Excel\Test.xlsx")  # disabled
panel_54 = Panel("D:\SSS\Prodesa\Felipe\Excel\Test.xlsx")  # disabled
number_slider_41 = Slider(3, range=0..10)  # disabled
number_slider_42 = Slider(4, range=0..10)  # disabled
toggle_3 = BooleanToggle(False)  # disabled
toggle_4 = BooleanToggle(False)  # disabled
toggle_5 = BooleanToggle(False)  # disabled
c_script_4 = CSharpScript(
    x=merge_3,
    y=flatten(ma_5.Result),
    z=flatten(multiplication_20),
    u=flatten(ma_5.Result),
    v=flatten(ma_3.Result),
    w=flatten(multiplication_20))  # -> out, A; inputs x: list, y: list; disabled
# ---------- c_script_4: C# ----------
    var treeOut = new DataTree<object>();

    treeOut.AddRange(x, new GH_Path(0));

    GH_Path path = new GH_Path(1);

    for( int i = 0; i < 9; ++i )
    {

      treeOut.Add(null, path);

    }

    treeOut.Add("SEMISÓTANO", path);
    treeOut.AddRange(y, path);

    GH_Path pathO = new GH_Path(2);

    for( int i = 0; i < 4; ++i )
    {

      treeOut.Add("m2", pathO);

    }

    /*for( int i = 0; i < 2; ++i )
    {

      treeOut.Add("m2", pathO);

    }*/

    for( int i = 0; i < 2; ++i )
    {

      treeOut.Add(null, pathO);

    }

    treeOut.Add("EN CULATA m", pathO);
    treeOut.Add(z, pathO);
    treeOut.Add("PISOS", pathO);
    treeOut.Add("EN SUPERFICIE", pathO);
    treeOut.Add(u, pathO);

    for( int i = 0; i < 3; ++i )
    {

      treeOut.Add(null, pathO);

    }

    treeOut.Add(v, pathO);
    treeOut.Add("m", pathO);
    treeOut.Add("CONTRA PARQUEADEROS", pathO);
    treeOut.Add(w, pathO);

    A = treeOut;
# ---------- end c_script_4 ----------
wo = WriteOptions(
    FilePath=panel_54,
    ClearDataOverwrite=toggle_3,
    SaveAfterWrite=toggle_4,
    CloseAfterWrite=toggle_5,
    ColumnStartPosition=number_slider_41,
    RowStartPosition=number_slider_42)  # -> UserMessages, WriteOptions; disabled
toggle_6 = BooleanToggle(True)  # disabled
toggle_7 = BooleanToggle(False)  # disabled
writexl = WriteToExcel(
    Run=toggle_6,
    ExcelWorksheet="1",
    WriteOptions=wo.WriteOptions,
    ColumnnsOrRows=toggle_7,
    DataToWriteIntoColumns=c_script_4.A)  # disabled

# ---- group: Reinstate
# Note that when changing Ortho to NoOrtho
# you must change the boolean in the group
# Ortho in the subgrup OrthoDontForget!
branchdata = CSharpScript(
    EdificiosXCoord=edificiosxcoord,
    EdificiosYCoord=edificiosycoord,
    ComunalXCoord=comunalxcoord,
    ComunalYCoord=comunalycoord,
    ComunalWidthHeightRatio=comunalwidthheightratio,
    NumberOfParkingLots=numberofparkinglots)  # -> BranchedData, Names; inputs EdificiosXCoord: list of Double, EdificiosYCoord: list of Double, ComunalXCoord: Double, ComunalYCoord: Double, ComunalWidthHeightRatio: Double, NumberOfParkingLots: Double
# ---------- branchdata: C# ----------
    int size = Component.Params.Input.Count;

    DataTree<double> treeOut = new DataTree<double>();
    DataTree<string> namesOut = new DataTree<string>();

    GH_Path path = new GH_Path();

    double temp = 0.0;

    for( int i = 0; i < size; ++i )
    {

      path = new GH_Path(i);

      var iter = Component.Params.Input[i];

      namesOut.Add(iter.NickName, path);

      for( int j = 0; j < iter.VolatileDataCount; ++j )
      {

        GH_Convert.ToDouble(Component.Params.Input[i].VolatileData.get_Branch(0)[j], out temp, GH_Conversion.Both);

        treeOut.Add(temp, path);

      }

    }

    BranchedData = treeOut;
    
    Names = namesOut;
# ---------- end branchdata ----------
toggle_8 = GroupToggle(ToggleActive=True, ToggleVisible=False)  # disabled
num_16 = Number(flatten([0.662, 0.453, 0.487, 0.538, 0.248, 0.234, 0.473, 0.598, 0.431, 0.303, 0.3558, 0.6873, 0.8, 0.616]))
galaplist = GalapagosListener(Genomes=num_16, Fitness=ma_22.Result, Reset=Toggle(False))  # -> Fitness, Iterations
path = ConstructPath(Indices=Slider(0, range=0..1000))
pickthebest = CSharpScript(Iter=fitness_2)  # -> out, A; inputs Iter: tree of Double
# ---------- pickthebest: C# ----------
    List<KeyValuePair<double, int>> treeOut = new List<KeyValuePair<double, int>>();
    
    //GH_Path path = new GH_Path();
    
    for( int i = 0; i < Iter.BranchCount; ++i )
    {
    
      //path = Iter.Path(i);
      
      //for( int j = 0; j < Iter.Branch(i).Count; ++j )
      {
      
        treeOut.Add( new KeyValuePair<double, int>(Iter.Branch(i)[0], i ) );
      
      }
    
    }
    
    treeOut.Sort(Compare1);
    
    A = treeOut;
# ---------- pickthebest: C# additional code ----------
  static int Compare1(KeyValuePair<double, int> a, KeyValuePair<double, int> b)
  {
    return a.Key.CompareTo(b.Key);
  }
# ---------- end pickthebest ----------
txt_4 = Text(flatten(branchdata.Names))
branch = TreeBranch(Tree=iterations_2, Path=path, MaintainPaths=True)
panel_55 = Panel(iterations_2)
panel_56 = Panel(pickthebest.A)
reinstatevalues = CSharpScript(
    Names=txt_4,
    Values=branch,
    Run=Button(),
    Reference="C:\Program Files\Rhino 6\Plug-ins\Grasshopper\Components\GalapagosComponents.gha")  # inputs Names: list of String, Values: list of Double, Run: Boolean
# ---------- reinstatevalues: C# ----------
    GalapagosComponents.GalapagosGeneListObject GComp = null;
    Grasshopper.Kernel.Special.GH_NumberSlider slider = null;

    int counter = 0;

    var ghDocument = Component.OnPingDocument();

    if( ghDocument != null && Run == true )

      for( int i = 0; i < Names.Count; ++i )
      {

        foreach( IGH_DocumentObject obj in ghDocument.Objects )
        {

          if( obj.ToString() == "GalapagosComponents.GalapagosGeneListObject" )
          {

            GComp = (GalapagosComponents.GalapagosGeneListObject) obj;

            if( GComp.NickName == Names[i] )
            {

              for( int g = 0; g < GComp.Count; ++g )
              {

                GComp.set_NormalisedValue(g, Convert.ToDecimal(Values[counter]));

                counter++;

              }

              GComp.ExpireSolution(true);

            }

          }

          if( obj.ToString() == "Grasshopper.Kernel.Special.GH_NumberSlider" )
          {

            slider = (Grasshopper.Kernel.Special.GH_NumberSlider) obj;

            if( slider.NickName == Names[i] )
            {

              slider.SetSliderValue(Convert.ToDecimal(Values[counter]));

              counter++;

              slider.ExpireSolution(true);

            }

          }

        }

      }
# ---------- end reinstatevalues ----------

# ---- group: TakeScreenShotIterations
toggle_9 = GroupToggle(ToggleActive=True, ToggleVisible=False)  # disabled
panel_57 = Panel("Cali0")
takescreenshot = CSharpScript(
    Run=Toggle(False),
    Reset=Button(),
    Fitness=ma_22.Result,
    Expected=Slider(2, range=0..5),
    Min=Slider(0, range=0..1),
    Max=Slider(2, range=0..10),
    GalapagosSliders=flatten(fitness_2),
    Path="D:\SSS\Prodesa\Felipe\Fotos\Final",
    ImageName="Cali000RayTraced")  # -> out; inputs Run: Boolean, Reset: Boolean, Fitness: Double, Expected: Double, Min: Double, Max: Double, GalapagosSliders: list of Double, Path: String, ImageName: String
# ---------- takescreenshot: C# ----------
    string pather = Path + ImageName;// + counter.ToString();

    GH_Document ghDocument = Component.OnPingDocument();

    double min = Expected * Min, max = Expected * Max;

    if(ghDocument.IsModified && Run == true )
    {

      if( Fitness >= min && Fitness <= max  )
      {

        Rhino.RhinoApp.RunScript("_-ScreenCaptureToFile " + pather, true);

      }

      counter++;

    }

    if(Reset == true) counter = 0;

    Print(pather);
# ---------- takescreenshot: C# additional code ----------
  int counter = 0;
# ---------- end takescreenshot ----------
panel_58 = Panel(takescreenshot)

# ---- group: ExcelWriterOne / I.C.
num_17 = Number(roundto_9)  # disabled

# ---- group: ExcelWriterOne
toggle_10 = GroupToggle(ToggleActive=True, ToggleVisible=False)  # disabled
merge_4 = Merge(
    Data1=num,
    Data2=num_2,
    Data3=number_11,
    Data4=num_17,
    Data5=num_14,
    Data6=int_3,
    Data7=int_4,
    Data8=round_3.Nearest,
    Data9=round_2.Nearest,
    Data10=int,
    Data11=division_22,
    Data12=division_21,
    Data13=number_6,
    Data14=number_slider_16)  # disabled
panel_59 = Panel("""Área bruta m2
Área neta urbanizable m2
Área vendible
I.C.
I.O.
Número total aptos.
Parqueaderos privados
Parqueaderos visitantes
Parqueaderos movilidad reducida
Número pisos parqueadero
Relación parqueadero/aptos.
Relación parqueadero/visitantes
Área equipamiento comunal m2
Aislamientos comunal m""")  # disabled
panel_60 = Panel(item_3)  # disabled
anchoslargos_2 = CSharpScript(plantas=item_3)  # -> ancho, largo; inputs plantas: tree of Rectangle3d; disabled; same code as anchoslargos
data_3 = Data(merge_4)  # disabled
panel_61 = Panel("""Ancho m
Largo m
Pisos
Aislamientos m
Aptos
Altura m""")  # disabled
button = Button()  # disabled
c_script_5 = CSharpScript(
    x=data_3,
    y=flatten(anchoslargos_2.ancho),
    z=flatten(anchoslargos_2.largo),
    u=flatten(lng_6),
    v=flatten(num_9),
    w=flatten(round.Nearest),
    xx=flatten(num_15))  # -> out, A; inputs x: list, y: list, z: list, u: list, v: list, w: list, xx: list; disabled
# ---------- c_script_5: C# ----------
    var treeOut = new DataTree<object>();

    treeOut.AddRange(x, new GH_Path(0));

    for( int i = 0; i < x.Count; ++i )
    {

      treeOut.Add(null, new GH_Path(1));
      treeOut.Add(null, new GH_Path(2));
      treeOut.Add(null, new GH_Path(3));
      treeOut.Add(null, new GH_Path(4));
      treeOut.Add(null, new GH_Path(5));
      treeOut.Add(null, new GH_Path(6));

    }

    treeOut.AddRange(y, new GH_Path(1));
    treeOut.AddRange(z, new GH_Path(2));
    treeOut.AddRange(u, new GH_Path(3));
    treeOut.AddRange(v, new GH_Path(4));
    treeOut.AddRange(w, new GH_Path(5));
    treeOut.AddRange(xx, new GH_Path(6));

    A = treeOut;
# ---------- end c_script_5 ----------
toggle_11 = BooleanToggle(False)  # disabled
lng_12 = ListLength(List=flatten(num_9))  # disabled
c_script_6 = CSharpScript(x=panel_59, y=lng_12)  # -> out, A; inputs x: list, y: Int32; disabled
# ---------- c_script_6: C# ----------
    for( int i = 1; i <= y; ++i )
    {

      string str = "Torre " + i.ToString();

      x.Add(str);

    }

    A = x;
# ---------- end c_script_6 ----------
writexl_2 = WriteToExcel(
    Run=toggle_11,
    ExcelWorksheet="1",
    ColumnNames=panel_61,
    RowNames=c_script_6.A,
    WriteOptions="None",
    ColumnnsOrRows=False,
    DataToWriteIntoColumns=c_script_5.A)  # disabled
panel_62 = Panel(c_script_6.A)  # disabled
panel_63 = Panel(c_script_5.A)  # disabled

# ---- group: indicadores
toggle_12 = GroupToggle(ToggleActive=True, ToggleVisible=False)  # disabled
division_36 = Division(A=ma_10.Result, B=area.Area)
panel_64 = Panel(number_10)
panel_65 = Panel(number_11)
panel_66 = Panel(number_5)
panel_67 = Panel(integer)
panel_68 = Panel(number_2)
panel_69 = Panel(integer_2)
panel_70 = Panel(number_9)
panel_71 = Panel(number_6)
panel_72 = Panel(number_7)
panel_73 = Panel(number_8)
concat = Concatenate(FragmentA="A2/PARQ: ", FragmentB=roundto_5)
concat_2 = Concatenate(FragmentA="A2VEND/A2CONST: ", FragmentB=roundto_10)
concat_3 = Concatenate(FragmentA="COM2/VIV: ", FragmentB=roundto_2)
concat_4 = Concatenate(FragmentA="A2PF/A2VEND: ", FragmentB=roundto_11)
concat_5 = Concatenate(FragmentA="A2PF/VIV: ", FragmentB=roundto_6)
concat_6 = Concatenate(FragmentA="%AL1er: ", FragmentB=roundto_8)
concat_7 = Concatenate(FragmentA="Fitness: ", FragmentB=ma_22.Result)
concat_8 = Concatenate(FragmentA="VIV/Ha: ", FragmentB=roundto)
concat_9 = Concatenate(FragmentA="PARQ/VIV: ", FragmentB=roundto_3)
concat_10 = Concatenate(FragmentA="%OCUPTOT: ", FragmentB=roundto_7)
concat_11 = Concatenate(FragmentA="I.O: ", FragmentB=roundto_4)
concat_12 = Concatenate(FragmentA="I.C: ", FragmentB=roundto_9)
concat_13 = Concatenate(FragmentA=concat_6, FragmentB="%")
concat_14 = Concatenate(FragmentA=concat_10, FragmentB="%")
concat_15 = Concatenate(FragmentA=concat_2, FragmentB="%")
concat_16 = Concatenate(FragmentA=concat_4, FragmentB="%")
merge_5 = Merge(Data1=concat_16, Data2=concat_5, Data3=concat_11, Data4=concat_12, Data5=concat_14, Data6=concat_13, Data7=concat_7)  # -> flatten(Result)
merge_6 = Merge(Data1=concat_8, Data2=concat_9, Data3=concat, Data4=concat_3, Data5=concat_15)  # -> flatten(Result)
merge_7 = Merge(Data1=merge_6, Data2=merge_5)  # -> flatten(Result)
vec = Vector(Vector(-15.81929114, -31.567482, 0))
lng_13 = ListLength(List=merge_7)
unit = UnitVector(Vector=vec)
multiplication_40 = Multiplication(A=unit, B=Slider(4.43, range=0..10))
series_3 = Series(Start=0, Step=1, Count=lng_13)
multiplication_41 = Multiplication(A=multiplication_40, B=series_3)
move_12 = Move(Geometry=pt_3, Motion=multiplication_41)  # -> Geometry, Transform
screentext = ScreenOrientedText(
    Text=merge_7,
    Font="Interstate bold",
    Justification=7,
    Location=move_12.Geometry,
    SizeFactor=Slider(7, range=0..10),
    Depth=0,
    Absolute=False)

# ---- group: indicadores / ocupaciónTotal
number_12 = Number(division_36)

# ---- group: indicadores (continued)
panel_74 = Panel(number_12)

# ---- group: MedialAxis
# http://www.grasshopper3d.com/forum/topics/tween-curve-in-between-polygons
# 
# Laurent Delrieu
# 30/03/2017
flatten_8 = FlattenTree(Tree=crv_19, Path="{0}")  # disabled
toggle_13 = GroupToggle(ToggleActive=True, ToggleVisible=False)  # disabled
crv_25 = Curve(flatten_8)  # disabled
number_slider_43 = Slider(100, range=0..100)  # disabled
item_20 = ListItem(List=lnln_2, Index=0, Wrap=True)  # disabled
panel_75 = Panel("5")  # disabled
number_slider_44 = Slider(1.2, range=0..10)  # disabled
panel_76 = Panel("1.02")  # disabled
number_slider_45 = Slider(100, range=1..100)  # disabled
Z_8 = UnitZ(Factor=number_slider_45)  # disabled
panel_77 = Panel("0.0001")  # disabled
swatch = ColourSwatch(SwatchColor=RGB(255, 0, 62))  # disabled
number_slider_46 = Slider(0, range=0..100)  # disabled
number_slider_47 = Slider(1, range=0..10)  # disabled

# ---- group: MedialAxis / Suppress non closed and duplicate curves
cls = Closed(Curve=crv_25)  # -> Closed, Periodic; disabled
dispatch = Dispatch(List=crv_25, DispatchPattern=cls.Closed)  # -> ListA, ListB; disabled
area_27 = Area(Geometry=dispatch.ListA)  # -> Area, Centroid; disabled
cullpt = CullDuplicates(Points=area_27.Centroid, Tolerance=0.1, CullMode=1)  # -> Points, Indices, Valence; disabled
item_21 = ListItem(List=dispatch.ListA, Index=cullpt.Indices, Wrap=True)  # disabled

# ---- group: MedialAxis (continued)
crv_26 = Curve(item_21)  # disabled
divide_4 = DivideCurve(Curve=crv_26, Count=number_slider_43, Kinks=False)  # -> flatten(Points), Tangents, Parameters; disabled
bbox = BoundingBox(Content=crv_26, Plane=item_20, UnionBox=True)  # -> Box, Box_2; disabled
boxprop = BoxProperties(Box=bbox.Box)  # -> Center, Diagonal, Area, Volume, Degeneracy; disabled
cullpt_2 = CullDuplicates(Points=divide_4.Points, Tolerance=0.1, CullMode=1)  # -> Points, Indices, Valence; disabled
scale_3 = Scale(Geometry=bbox.Box, Center=boxprop.Center, Factor=number_slider_44)  # -> Geometry, Transform; disabled
voronoi_2 = Voronoi(Points=cullpt_2.Points, Boundary=scale_3.Geometry, BruteForceOverride=False)  # disabled
rec = Rectangle(scale_3.Geometry)  # disabled
boundary = BoundarySurfaces(Edges=flatten([rec, crv_26]), UseTasks=True)  # disabled
parallelregionintersection = ParallelRegionIntersection(CurvesA=crv, CurvesB=voronoi_2)  # disabled
explode = Explode(Curve=parallelregionintersection, Recursive=True)  # -> flatten(Segments), Vertices; disabled

# ---- group: MedialAxis / Suppress little surfaces
area_28 = Area(Geometry=boundary, UseTasks=False)  # -> Area, Centroid; disabled
sort_10 = SortList(Keys=area_28.Area, ValuesA=boundary)  # -> Keys, ValuesA; disabled
panel_78 = Panel("0")  # disabled
rev = ReverseList(List=sort_10.ValuesA)  # disabled
item_22 = ListItem(List=rev, Index=panel_78, Wrap=True)  # disabled

# ---- group: MedialAxis / cull duplicate lines
curvepoint = PointOnCurve(explode.Segments, parameter=0.5)  # disabled
tolerance = Panel("0.01")  # disabled
cullpt_3 = CullDuplicates(Points=curvepoint, Tolerance=tolerance, CullMode=1)  # -> Points, Indices, Valence; disabled
item_23 = ListItem(List=explode.Segments, Index=cullpt_3.Indices, Wrap=True)  # disabled

# ---- group: MedialAxis (continued)
end_8 = EndPoints(Curve=item_23)  # -> Start, End; disabled
line = LineSDL(Start=end_8.Start, Direction=Z_8, Length=number_slider_45)  # disabled
line_2 = LineSDL(Start=end_8.End, Direction=Z_8, Length=number_slider_45)  # disabled
move_13 = Move(Geometry=line, Motion=expr("-1/2*x", Z_8))  # -> Geometry, Transform; disabled
move_14 = Move(Geometry=line_2, Motion=expr("-1/2*x", Z_8))  # -> Geometry, Transform; disabled
blx = BrepLine(Brep=item_22, Line=move_14.Geometry, LimitToFirst=False)  # -> Curves, Points; disabled
blx_2 = BrepLine(Brep=item_22, Line=move_13.Geometry, LimitToFirst=False)  # -> Curves, Points; disabled
lng_14 = ListLength(List=blx.Points)  # -> flatten(Length); disabled
lng_15 = ListLength(List=blx_2.Points)  # -> flatten(Length); disabled
multiplication_42 = Multiplication(A=lng_15, B=lng_14)  # disabled
larger = LargerThan(FirstNumber=multiplication_42, SecondNumber=panel_77)  # -> LargerThan, OrEqualTo; disabled
dispatch_2 = Dispatch(List=item_23, DispatchPattern=larger.LargerThan)  # -> ListA, ListB; disabled
crv_27 = Curve(dispatch_2.ListA)  # disabled
join_9 = JoinCurves(Curves=crv_27, Preserve=False)  # disabled
previewlw_4 = CustomPreviewLineweights(Geometry=crv_27, Shader=swatch, Thickness=5, Absolute=False)  # disabled
srfsplit_4 = SurfaceSplit(Surface=pline_6, Curves=join_9)  # disabled
crv_28 = Curve(srfsplit_4)  # disabled
polyoffset = PolylineOffset(
    Polylines=crv_28,
    Distance=number_slider_47,
    Plane=Plane(origin=(0, 0, 0), x=(0, 0, 0), y=(0, 0, 0)),
    Tolerance=0.01,
    ClosedFillet=number_slider_46,
    OpenFillet=number_slider_46,
    Miter=2)  # -> Contour, Holes; disabled
boundary_2 = BoundarySurfaces(Edges=flatten([polyoffset.Contour, polyoffset.Holes]), UseTasks=True)  # disabled
