# Grasshopper definition 19.06.23_Setting_001.gh (Grasshopper 1.0.7)
# plug-ins: Kangaroo2 Components

# ---- group: manzanas / manzana1
geometry = Geometry(<curve referenced from the Rhino model>)

# ---- group: manzanas / manzana3
geometry_2 = Geometry(<curve referenced from the Rhino model>)

# ---- group: manzanas / manzana4
geometry_3 = Geometry(<curve referenced from the Rhino model>)

# ---- group: manzanas / manzana2
geometry_4 = Geometry(<curve referenced from the Rhino model>)

# ---- group: manzanas
area = Area(Geometry=geometry)  # -> Area, Centroid
area_2 = Area(Geometry=geometry_4)  # -> Area, Centroid
area_3 = Area(Geometry=geometry_2)  # -> Area, Centroid
area_4 = Area(Geometry=geometry_3)  # -> Area, Centroid
panel = Panel(area.Area)
panel_2 = Panel(area_3.Area)
panel_3 = Panel(area_4.Area)
panel_4 = Panel(area_2.Area)

# ----
deconstuct_rectangle = DeconstuctRectangle(Rectangle=geometry)  # -> BasePlane, XInterval, YInterval

# ---- group: lote / loteBruto
geometry_5 = Geometry(<curve referenced from the Rhino model>)

# ---- group: lote
scale = Scale(Geometry=geometry_5, Center=Point(0, 0, 0), Factor=Slider(3.74701, range=0..30))  # -> Geometry, Transform
area_5 = Area(Geometry=scale.Geometry)  # -> Area, Centroid
discontinuity = Discontinuity(Curve=scale.Geometry, Level=1)  # -> Points, Parameters
list_item = ListItem(List=discontinuity.Points, Index=Slider(2, range=0..10), Wrap=True)
point = Point(list_item)
áreabruta = Panel(area_5.Area)

# ----
rectangle = Rectangle(
    Plane=deconstuct_rectangle.BasePlane,
    XSize=deconstuct_rectangle.XInterval,
    YSize=deconstuct_rectangle.YInterval,
    Radius=0)  # -> Rectangle, Length

# ---- group: àrea_apto
numviviendas = Slider(616, range=0..1000)
number_slider = Slider(64, range=60..70)
numviviendas_2 = Slider(572, range=0..1000)
number_slider_2 = Slider(60, range=60..70)
numviviendas_3 = Slider(660, range=0..1000)
number_slider_3 = Slider(60, range=60..70)
numviviendas_4 = Slider(616, range=0..1000)
number_slider_4 = Slider(60, range=60..70)
division = Division(A=numviviendas, B=number_slider)
division_2 = Division(A=numviviendas_2, B=number_slider_2)
division_3 = Division(A=numviviendas_3, B=number_slider_3)
division_4 = Division(A=numviviendas_4, B=number_slider_4)
integer = Integer(division)
integer_2 = Integer(division_2)
integer_3 = Integer(division_3)
integer_4 = Integer(division_4)
panel_5 = Panel(integer_2)
panel_6 = Panel(integer_4)
numaptospiso = Panel(integer)
panel_7 = Panel(integer_3)
multiplication = Multiplication(A=number_slider_4, B=integer_4)
multiplication_2 = Multiplication(A=integer, B=number_slider)
multiplication_3 = Multiplication(A=number_slider_2, B=integer_2)
multiplication_4 = Multiplication(A=number_slider_3, B=integer_3)
panel_8 = Panel(multiplication)
àrea_piso = Panel(multiplication_2)
panel_9 = Panel(multiplication_3)
panel_10 = Panel(multiplication_4)

# ----
collision_many_many = CollisionManyMany()  # -> Collision, Indices

# ---- group: towerPopulation
expression = Expression(area=multiplication_2, Expression="sqrt(area/2)")
integer_5 = Integer(expression)
multiplication_5 = Multiplication(A=integer_5, B=2)
panel_11 = Panel(integer_5)
rectangle_2 = Rectangle(Plane=PlaneXY(0, 0, 0), XSize=multiplication_5, YSize=integer_5, Radius=0)  # -> Rectangle, Length
numtowers = Slider(5, range=0..10)
numaptos = Slider(10, range=10..12)
area_6 = Area(Geometry=geometry)  # -> Area, Centroid
area_7 = Area(Geometry=rectangle_2.Rectangle)  # -> Area, Centroid
construct_point = ConstructPoint(XCoordinate=0, YCoordinate=0, ZCoordinate=0)
division_5 = Division(A=multiplication_2, B=numtowers)
vector_2pt = Vector2Pt(PointA=area_7.Centroid, PointB=construct_point, Unitize=False)  # -> Vector, Length
division_6 = Division(A=division_5, B=numaptos)
vector_display = VectorDisplay(Anchor=area_7.Centroid, Vector=vector_2pt.Vector)
scale_2 = Scale(Geometry=geometry, Center=area_6.Centroid, Factor=Slider(0.5, range=0..1))  # -> Geometry, Transform
list_item_2 = ListItem(List=vector_2pt.Vector, Index=1, Wrap=True)
integer_6 = Integer(division_6)
panel_12 = Panel(integer_6)
move = Move(Geometry=rectangle_2.Rectangle, Motion=list_item_2)  # -> Geometry, Transform
area_8 = Area(Geometry=move.Geometry)  # -> Area, Centroid
populate_2d = Populate2D(Region=scale_2.Geometry, Count=numtowers, Seed=1)
vector_2pt_2 = Vector2Pt(PointA=area_8.Centroid, PointB=populate_2d, Unitize=False)  # -> Vector, Length
move_2 = Move(Geometry=move.Geometry, Motion=vector_2pt_2.Vector)  # -> graft(Geometry), Transform
vector_display_2 = VectorDisplay(Anchor=area_8.Centroid, Vector=vector_2pt_2.Vector)

# ---- group: vectors
discontinuity_2 = Discontinuity(Curve=move_2.Geometry, Level=1)  # -> Points, Parameters
shatter = Shatter(Curve=move_2.Geometry, Parameters=discontinuity_2.Parameters)
point_on_curve = PointOnCurve(shatter, parameter=0.5)
tree_branch = TreeBranch(Tree=shatter, Path="{0;0;0;0}", MaintainPaths=True)
tree_branch_2 = TreeBranch(Tree=move_2.Geometry, Path="{0;0;0}", MaintainPaths=True)
area_9 = Area(Geometry=tree_branch_2)  # -> Area, Centroid
tree_branch_3 = TreeBranch(Tree=point_on_curve, Path="{0;0;0;0}", MaintainPaths=True)
panel_13 = Panel(tree_branch)
panel_14 = Panel(tree_branch_2)
vector_2pt_3 = Vector2Pt(PointA=area_9.Centroid, PointB=tree_branch_3, Unitize=False)  # -> Vector, Length

# ---- group: northOrientation / centroid
point_2 = Point(area.Centroid)

# ---- group: northOrientation
number_slider_5 = Slider(100, range=-100..100)
number_slider_6 = Slider(-100, range=-100..100)
unit_x = UnitX(Factor=[number_slider_5, number_slider_6])
unit_y = UnitY(Factor=[number_slider_5, number_slider_6])
move_3 = Move(Geometry=point_2, Motion=unit_y)  # -> Geometry, Transform
move_4 = Move(Geometry=point_2, Motion=unit_x)  # -> Geometry, Transform
list_item_3 = ListItem(List=move_4.Geometry, Index=0, Wrap=True)
list_item_4 = ListItem(List=move_3.Geometry, Index=0, Wrap=True)
vector_2pt_4 = Vector2Pt(PointA=point_2, PointB=list_item_3, Unitize=False)  # -> Vector, Length
vector_2pt_5 = Vector2Pt(PointA=point_2, PointB=list_item_4, Unitize=False)  # -> Vector, Length
vector_display_3 = VectorDisplay(Anchor=point_2, Vector=vector_2pt_4.Vector)
vector_display_4 = VectorDisplay(Anchor=point_2, Vector=vector_2pt_5.Vector)

# ---- group: towerOrientVector
flatten_tree = FlattenTree(Tree=tree_branch_3, Path="{0}")
list_item_5 = ListItem(List=flatten_tree, Index="2", Wrap=True)
list_item_6 = ListItem(List=flatten_tree, Index="1", Wrap=True)
vector_2pt_6 = Vector2Pt(PointA=area_9.Centroid, PointB=list_item_6, Unitize=False)  # -> Vector, Length
vector_2pt_7 = Vector2Pt(PointA=area_9.Centroid, PointB=list_item_5, Unitize=False)  # -> Vector, Length
vector_display_5 = VectorDisplay(Anchor=area_9.Centroid, Vector=vector_2pt_7.Vector)
vector_display_6 = VectorDisplay(Anchor=area_9.Centroid, Vector=vector_2pt_6.Vector)

# ---- group: áreaTotalIdeal
multiplication_6 = Multiplication(A=numviviendas, B=number_slider)
panel_15 = Panel(multiplication_6)

# ---- group: pisosTorre
multiplication_7 = Multiplication(A=numtowers, B=integer_6)
panel_16 = Panel(multiplication_7)

# ---- group: alignGeometry
number_slider_7 = Slider(42, range=0..100)  # disabled
number_slider_8 = Slider(0.141, range=0..1)  # disabled
plane_origin = PlaneOrigin(Base=tree_branch_2, Origin=area_9.Centroid)  # disabled
circle = Circle(Plane=point_2, Radius=number_slider_7)  # disabled
evaluate_curve = EvaluateCurve(Curve=reparameterize(circle), Parameter=number_slider_8)  # -> Point, Tangent, Angle; disabled
vector_2pt_8 = Vector2Pt(PointA=point_2, PointB=evaluate_curve.Point, Unitize=False)  # -> Vector, Length; disabled
align_plane = AlignPlane(Plane=plane_origin, Direction=vector_2pt_8.Vector)  # -> Plane, Angle; disabled
rotate = Rotate(Geometry=tree_branch_2, Angle=align_plane.Angle, Plane=align_plane.Plane)  # -> Geometry, Transform; disabled
vector_display_7 = VectorDisplay(Anchor=point_2, Vector=vector_2pt_8.Vector)  # disabled

# ----
gene_pool = GenePool(Decimals=0, Maximum=100, Minimum=0, Value=[50, 50, 50, 50, 50])
gene_pool_2 = GenePool(Decimals=0, Maximum=33, Minimum=0, Value=[16.5, 16.5, 16.5, 16.5, 16.5])
gene_pool_3 = GenePool(Decimals=2, Maximum=1, Minimum=0, Value=[0.89, 0.66, 0, 0.9856042988, 0.0528886081])
gene_pool_4 = GenePool(Decimals=2, Maximum=1, Minimum=0, Value=[0.8731952677, 0.754138204, 0.09507669094, 0.8915067183, 0.1042730438])

# ---- group: alignAllGeometry
area_10 = Area(Geometry=move_2.Geometry)  # -> Area, Centroid
plane_origin_2 = PlaneOrigin(Base=move_2.Geometry, Origin=area_10.Centroid)
circle_2 = Circle(Plane=point_2, Radius=Slider(47, range=0..100))
evaluate_curve_2 = EvaluateCurve(Curve=reparameterize(circle_2), Parameter=gene_pool_4)  # -> graft(Point), Tangent, Angle
vector_2pt_9 = Vector2Pt(PointA=point_2, PointB=evaluate_curve_2.Point, Unitize=False)  # -> Vector, Length
align_plane_2 = AlignPlane(Plane=plane_origin_2, Direction=vector_2pt_9.Vector)  # -> Plane, Angle
rotate_2 = Rotate(Geometry=move_2.Geometry, Angle=align_plane_2.Angle, Plane=align_plane_2.Plane)  # -> Geometry, Transform
vector_display_8 = VectorDisplay(Anchor=point_2, Vector=vector_2pt_9.Vector)

# ---- group: tensiónCentro
area_11 = Area(Geometry=rotate_2.Geometry)  # -> Area, Centroid
point_3 = Point(area_6.Centroid)
vector_2pt_10 = Vector2Pt(PointA=point_3, PointB=area_11.Centroid, Unitize=False)  # -> Vector, Length
gene_pool_5 = GenePool(Decimals=1, Maximum=1, Minimum=0, Value=[0.7635239245, 0.2722199779, 0.9454943333, 0.251404659, 0.498593284])
reverse = Reverse(Vector=vector_2pt_10.Vector)
multiplication_8 = Multiplication(A=flatten(vector_2pt_10.Vector), B=gene_pool_5)
amplitude = Amplitude(Vector=flatten(reverse), Amplitude=multiplication_8)
panel_17 = Panel(multiplication_8)
vector_display_9 = VectorDisplay(Anchor=flatten(area_11.Centroid), Vector=amplitude)

# ---- group: colisiones
deconstuct_rectangle_2 = DeconstuctRectangle(Rectangle=geometry)  # -> BasePlane, XInterval, YInterval
geometry_6 = Geometry(rotate_2.Geometry)
rectangle_3 = Rectangle(
    Plane=deconstuct_rectangle_2.BasePlane,
    XSize=deconstuct_rectangle_2.XInterval,
    YSize=deconstuct_rectangle_2.YInterval,
    Radius=0)  # -> Rectangle, Length
merge = Merge(Data1=flatten(geometry_6))
curvecollide = CurveCollide(Curves=merge, PassiveCurves=rectangle_3.Rectangle, BasePlane=deconstuct_rectangle_2.BasePlane, Strength=1)  # -> Goal, Frames
panel_18 = Panel(merge)
solver = Solver(GoalObjects=curvecollide.Goal, Reset=Toggle(False), Threshold=1e-15, Tolerance=0.01, On=Toggle(False))  # -> I, V, O

# ----
c_script = CSharpScript(torres=gene_pool, maxPisos=gene_pool_2, ánguloRotación=gene_pool_3)  # -> out, torresPisos; inputs torres: list of Int32, maxPisos: list of Int32
# ---------- c_script: C# ----------
    for (i = 0; i < torres; i++) {
      
    }
# ---------- end c_script ----------

# ---- group: variationFirstTower
integer_7 = Integer(integer_6)
duplicate_data = DuplicateData(Data=Slider(2.4, range=0..10), Number=integer_7, Order=True)
explode_tree = ExplodeTree(Data=rotate_2.Geometry)  # -> Branch0, Branch1, Branch2, Branch3, Branch4
merge_2 = Merge(Data1=flatten(Slider(0, range=0..100)), Data2=flatten(duplicate_data))
mass_addition = MassAddition(Input=merge_2)  # -> Result, PartialResults
panel_19 = Panel(mass_addition.Result)
panel_20 = Panel(mass_addition.PartialResults)
reverse_list = ReverseList(List=mass_addition.PartialResults)
list_item_7 = ListItem(List=reverse_list, Index=0, Wrap=True)

# ----
geometry_7 = Geometry(explode_tree.Branch0)

# ---- group: variationFirstTower (continued)
area_12 = Area(Geometry=geometry_7)  # -> Area, Centroid
deconstruct = Deconstruct(Point=area_12.Centroid)  # -> XComponent, YComponent, ZComponent
construct_point_2 = ConstructPoint(XCoordinate=deconstruct.XComponent, YCoordinate=deconstruct.YComponent, ZCoordinate=mass_addition.PartialResults)
xy_plane = XYPlane(Origin=construct_point_2)
panel_21 = Panel(xy_plane)

# ---- group: volumetrías / volumetríaGenérica
unit_z = UnitZ(Factor=list_item_7)
torre1 = Extrude(Base=explode_tree.Branch0, Direction=unit_z)

# ---- group: pisosAlturaMáxima
number_slider_9 = Slider(2.4, range=0..10)

# ---- group: pisosAlturaMáxima / alturaTotal
division_7 = Division(A=Slider(80, range=0..80), B=number_slider_9)
integer_8 = Integer(division_7)
panel_22 = Panel(integer_8)

# ---- group: pisosAlturaMáxima (continued)
integer_9 = Integer(integer_8)
duplicate_data_2 = DuplicateData(Data=number_slider_9, Number=integer_9, Order=True)
merge_3 = Merge(Data1=flatten(Slider(0, range=0..100)), Data2=flatten(duplicate_data_2))
mass_addition_2 = MassAddition(Input=merge_3)  # -> Result, PartialResults
panel_23 = Panel(mass_addition_2.PartialResults)
panel_24 = Panel(mass_addition_2.Result)
construct_point_3 = ConstructPoint(XCoordinate=0, YCoordinate=0, ZCoordinate=mass_addition_2.PartialResults)
xy_plane_2 = XYPlane(Origin=construct_point_3)  # -> graft(Plane)
panel_25 = Panel(xy_plane_2)

# ---- group: volumetrías
brep_plane = BrepPlane(Brep=torre1, Plane=xy_plane)  # -> Curves, Points
area_13 = Area(Geometry=brep_plane.Curves)  # -> flatten(Area), Centroid
mass_addition_3 = MassAddition(Input=area_13.Area)  # -> Result, PartialResults
division_8 = Division(A=mass_addition_3.Result, B=number_slider)
integer_10 = Integer(division_8)
integer_11 = Integer(numviviendas)
torre1_2 = Panel(integer_10)
subtraction = Subtraction(A=integer_11, B=integer_10)
torre2 = Panel(subtraction)
division_9 = Division(A=subtraction, B=integer)
panel_26 = Panel(division_9)
integer_12 = Integer(division_9)
list_length = ListLength(List=integer_12)
addition = Addition(A=Slider(0, range=0..100), B=list_length)
multiplication_9 = Multiplication(A=integer_12, B=number_slider_9)
unit_z_2 = UnitZ(Factor=multiplication_9)
list_item_8 = ListItem(Index=addition, Wrap=True)
extrude = Extrude(Base=list_item_8, Direction=unit_z_2)
path_mapper = PathMapper(xy_plane_2, source="{A;B}", target="{B}")
brep_plane_2 = BrepPlane(Brep=extrude, Plane=path_mapper)  # -> Curves, Points
panel_27 = Panel(brep_plane_2.Curves)

# ----
àreatotalproducto = Panel(mass_addition_3.Result)
