# Grasshopper definition 19.06.24_Setting_001.gh (Grasshopper 1.0.7)
# plug-ins: SpacePartition, Kangaroo2 Components

# ---- group: manzanas / manzana1
geometry = Geometry(<curve referenced from the Rhino model>)

# ---- group: manzanas / manzana2
geometry_2 = Geometry(<curve referenced from the Rhino model>)

# ---- group: manzanas / manzana4
geometry_3 = Geometry(<curve referenced from the Rhino model>)

# ---- group: manzanas / manzana3
geometry_4 = Geometry(<curve referenced from the Rhino model>)

# ---- group: manzanas
area = Area(Geometry=geometry)  # -> Area, Centroid
area_2 = Area(Geometry=geometry_2)  # -> Area, Centroid
area_3 = Area(Geometry=geometry_3)  # -> Area, Centroid
area_4 = Area(Geometry=geometry_4)  # -> Area, Centroid
áreavendiblevivienda = Panel("37863.3")
áreavendiblevivienda_2 = Panel("43094.9")
áreavendiblevivienda_3 = Panel("40479.1")
panel = Panel(area_3.Area)
panel_2 = Panel(area_2.Area)
panel_3 = Panel(area_4.Area)
àreamanzana = Panel(area.Area)
áreavendiblevivienda_4 = Panel("40479.1")
division = Division(A=áreavendiblevivienda_4, B=àreamanzana)
division_2 = Division(A=áreavendiblevivienda, B=panel_2)
division_3 = Division(A=áreavendiblevivienda_2, B=panel_3)
division_4 = Division(A=áreavendiblevivienda_3, B=panel)
i_c = Panel(division)
i_c_2 = Panel(division_2)
i_c_3 = Panel(division_3)
i_c_4 = Panel(division_4)

# ---- group: lote / loteBruto
geometry_5 = Geometry(<curve referenced from the Rhino model>)

# ---- group: lote
scale = Scale(Geometry=geometry_5, Center=Point(0, 0, 0), Factor=Slider(3.74701, range=0..30))  # -> Geometry, Transform
discontinuity = Discontinuity(Curve=scale.Geometry, Level=1)  # -> Points, Parameters
list_item = ListItem(List=discontinuity.Points, Index=Slider(2, range=0..10), Wrap=True)
area_5 = Area(Geometry=scale.Geometry)  # -> Area, Centroid
point = Point(list_item)
áreabruta = Panel(area_5.Area)

# ---- group: àrea_apto
numviviendas = Slider(616, range=0..1000)
number_slider = Slider(64, range=60..70)
numviviendas_2 = Slider(572, range=0..1000)
number_slider_2 = Slider(60, range=60..70)
numviviendas_3 = Slider(660, range=0..1000)
number_slider_3 = Slider(60, range=60..70)
numviviendas_4 = Slider(616, range=0..1000)
number_slider_4 = Slider(60, range=60..70)
division_5 = Division(A=numviviendas, B=number_slider)
division_6 = Division(A=numviviendas_2, B=number_slider_2)
division_7 = Division(A=numviviendas_3, B=number_slider_3)
division_8 = Division(A=numviviendas_4, B=number_slider_4)
integer = Integer(division_5)
integer_2 = Integer(division_6)
integer_3 = Integer(division_7)
integer_4 = Integer(division_8)
panel_4 = Panel(integer_2)
numaptospiso = Panel(integer)
panel_5 = Panel(integer_4)
panel_6 = Panel(integer_3)
multiplication = Multiplication(A=integer, B=number_slider)
multiplication_2 = Multiplication(A=number_slider_4, B=integer_4)
multiplication_3 = Multiplication(A=number_slider_2, B=integer_2)
multiplication_4 = Multiplication(A=number_slider_3, B=integer_3)
panel_7 = Panel(multiplication_2)
àrea_piso = Panel(multiplication)
panel_8 = Panel(multiplication_3)
panel_9 = Panel(multiplication_4)

# ---- group: áreaTotalIdeal
multiplication_5 = Multiplication(A=numviviendas, B=number_slider)
panel_10 = Panel(multiplication_5)

# ----
numpisos = Slider(32, range=0..100)

# ---- group: towerNumber
expression = Expression(area=multiplication, Expression="sqrt(area/2)")
integer_5 = Integer(expression)
multiplication_6 = Multiplication(A=integer_5, B=2)
panel_11 = Panel(integer_5)
rectangle = Rectangle(Plane=PlaneXY(0, 0, 0), XSize=multiplication_6, YSize=integer_5, Radius=0)  # -> Rectangle, Length
area_6 = Area(Geometry=geometry)  # -> Area, Centroid
area_7 = Area(Geometry=rectangle.Rectangle)  # -> Area, Centroid
construct_point = ConstructPoint(XCoordinate=0, YCoordinate=0, ZCoordinate=0)
vector_2pt = Vector2Pt(PointA=area_7.Centroid, PointB=construct_point, Unitize=False)  # -> Vector, Length
vector_display = VectorDisplay(Anchor=area_7.Centroid, Vector=vector_2pt.Vector)
numtowers = Slider(5, range=1..5)
scale_2 = Scale(Geometry=geometry, Center=area_6.Centroid, Factor=Slider(0.5, range=0..1))  # -> Geometry, Transform
list_item_2 = ListItem(List=vector_2pt.Vector, Index=1, Wrap=True)
move = Move(Geometry=rectangle.Rectangle, Motion=list_item_2)  # -> Geometry, Transform
area_8 = Area(Geometry=move.Geometry)  # -> Area, Centroid
populate_2d = Populate2D(Region=scale_2.Geometry, Count=numtowers, Seed=numpisos)
vector_2pt_2 = Vector2Pt(PointA=area_8.Centroid, PointB=populate_2d, Unitize=False)  # -> Vector, Length
move_2 = Move(Geometry=move.Geometry, Motion=vector_2pt_2.Vector)  # -> graft(Geometry), Transform
vector_display_2 = VectorDisplay(Anchor=area_8.Centroid, Vector=vector_2pt_2.Vector)

# ---- group: align / northOrientation / centroid
point_2 = Point(area.Centroid)

# ---- group: align / northOrientation
number_slider_5 = Slider(100, range=-100..100)
number_slider_6 = Slider(-100, range=-100..100)
unit_x = UnitX(Factor=[number_slider_5, number_slider_6])
unit_y = UnitY(Factor=[number_slider_5, number_slider_6])
move_3 = Move(Geometry=point_2, Motion=unit_y)  # -> Geometry, Transform
move_4 = Move(Geometry=point_2, Motion=unit_x)  # -> Geometry, Transform
list_item_3 = ListItem(List=move_4.Geometry, Index=0, Wrap=True)
list_item_4 = ListItem(List=move_3.Geometry, Index=0, Wrap=True)
vector_2pt_3 = Vector2Pt(PointA=point_2, PointB=list_item_3, Unitize=False)  # -> Vector, Length
vector_2pt_4 = Vector2Pt(PointA=point_2, PointB=list_item_4, Unitize=False)  # -> Vector, Length
vector_display_3 = VectorDisplay(Anchor=point_2, Vector=vector_2pt_3.Vector)
vector_display_4 = VectorDisplay(Anchor=point_2, Vector=vector_2pt_4.Vector)

# ---- group: align / alignAllGeometry
area_9 = Area(Geometry=move_2.Geometry)  # -> Area, Centroid
construct_domain = ConstructDomain(DomainStart=0.1, DomainEnd=1)
gene_pool01 = GenePool(Decimals=2, Maximum=1, Minimum=0.1, Value=[0.4531356346, 0.4275066815, 0.150791897, 0.8352580341, 0.3527638579])
genepoolmodifier = GenePoolModifier(
    GeneList="Gene Pool01",
    Count=numtowers,
    Domain=construct_domain,
    Randomize=Toggle(True),
    PercentageOfRandomization=Slider(65, range=0..100))
plane_origin = PlaneOrigin(Base=move_2.Geometry, Origin=area_9.Centroid)
circle = Circle(Plane=point_2, Radius=Slider(59, range=0..100))
evaluate_curve = EvaluateCurve(Curve=reparameterize(circle), Parameter=gene_pool01)  # -> graft(Point), Tangent, Angle
panel_12 = Panel(genepoolmodifier)
vector_2pt_5 = Vector2Pt(PointA=point_2, PointB=evaluate_curve.Point, Unitize=False)  # -> Vector, Length
align_plane = AlignPlane(Plane=plane_origin, Direction=vector_2pt_5.Vector)  # -> Plane, Angle
rotate = Rotate(Geometry=move_2.Geometry, Angle=align_plane.Angle, Plane=align_plane.Plane)  # -> Geometry, Transform
vector_display_5 = VectorDisplay(Anchor=point_2, Vector=vector_2pt_5.Vector)

# ----
panel_13 = Panel(rotate.Geometry)
galapagos = Galapagos(fitness=mass_addition_6, gene=[gene_pool01, gene_pool02, numtowers, gene_pool03, numpisos])

# ---- group: planosPlantas
number_slider_7 = Slider(0, range=0..100)
gene_pool03 = GenePool(Decimals=1, Maximum=33, Minimum=1, Value=[30.01674208, 11.36019713, 9.535129968, 6.867177474, 19])
construct_domain_2 = ConstructDomain(DomainStart=1, DomainEnd=33)
genepoolmodifier_2 = GenePoolModifier(
    GeneList="Gene Pool03",
    Count=numtowers,
    Domain=construct_domain_2,
    Randomize=Toggle(True),
    PercentageOfRandomization=Slider(65, range=0..100))
panel_14 = Panel(genepoolmodifier_2)

# ----
graft_tree = GraftTree(Tree=gene_pool03, IncludeEmptyLists=True, IncludeNullItems=True)
duplicate_data = DuplicateData(Data=number_slider_7, Number=numtowers, Order=True)
graft_tree_2 = GraftTree(Tree=duplicate_data, IncludeEmptyLists=True, IncludeNullItems=True)  # -> simplify(Tree)

# ---- group: planosPlantas (continued)
duplicate_data_2 = DuplicateData(Data=Slider(2.4, range=0..10), Number=graft_tree, Order=True)  # -> simplify(Data)
merge = Merge(Data1=graft_tree_2, Data2=duplicate_data_2)
mass_addition = MassAddition(Input=merge)  # -> TotalHeightTower, PartialResults
panel_15 = Panel(mass_addition.TotalHeightTower)
panel_16 = Panel(mass_addition.PartialResults)

# ----
panel_17 = Panel(merge)

# ---- group: aislamiento
number = Number(mass_addition.TotalHeightTower)
division_9 = Division(A=number, B=Slider(5, range=0..5))
offset_curve = OffsetCurve(Curve=rotate.Geometry, Distance=division_9, Plane=PlaneXY(0, 0, 0), Corners=1)  # -> flatten(Curve)
geometry_6 = Geometry(geometry)
merge_2 = Merge(Data1=offset_curve, Data2=geometry_6)  # -> flatten(Result)
curve_curve = CurveCurve(CurveA=merge_2, CurveB=graft(merge_2))  # -> flatten(Points), ParamsA, ParamsB
list_length = ListLength(List=curve_curve.Points)

# ---- group: tensiónCentro
area_10 = Area(Geometry=rotate.Geometry)  # -> Area, Centroid
construct_domain_3 = ConstructDomain(DomainStart=0.1, DomainEnd=1)
point_3 = Point(area_6.Centroid)
vector_2pt_6 = Vector2Pt(PointA=point_3, PointB=area_10.Centroid, Unitize=False)  # -> Vector, Length
genepoolmodifier_3 = GenePoolModifier(
    GeneList="Gene Pool02",
    Count=numtowers,
    Domain=construct_domain_3,
    Randomize=Toggle(True),
    PercentageOfRandomization=Slider(65, range=0..100))
gene_pool02 = GenePool(Decimals=2, Maximum=1, Minimum=0.1, Value=[0.916095871, 0.3913805443, 0.3400505304, 0.2650143665, 0.5670490381])
multiplication_7 = Multiplication(A=flatten(vector_2pt_6.Length), B=gene_pool02)
reverse = Reverse(Vector=vector_2pt_6.Vector)
panel_18 = Panel(genepoolmodifier_3)
amplitude = Amplitude(Vector=flatten(vector_2pt_6.Vector), Amplitude=multiplication_7)
panel_19 = Panel(multiplication_7)
vector_display_6 = VectorDisplay(Anchor=flatten(area_10.Centroid), Vector=flatten(amplitude))
move_5 = Move(Geometry=offset_curve, Motion=amplitude)  # -> Geometry, Transform

# ---- group: colisiones
deconstuct_rectangle = DeconstuctRectangle(Rectangle=geometry)  # -> BasePlane, XInterval, YInterval
geometry_7 = Geometry(offset_curve)
rectangle_2 = Rectangle(
    Plane=deconstuct_rectangle.BasePlane,
    XSize=deconstuct_rectangle.XInterval,
    YSize=deconstuct_rectangle.YInterval,
    Radius=0)  # -> Rectangle, Length
line = Line(StartPoint=point_3, EndPoint=area_10.Centroid)
merge_3 = Merge(Data1=flatten(geometry_7))
panel_20 = Panel(merge_3)
curvecollide = CurveCollide(Curves=merge_3, PassiveCurves=rectangle_2.Rectangle, BasePlane=deconstuct_rectangle.BasePlane, Strength=1)  # -> Goal, Frames
length_line = LengthLine(Line=flatten(line), Length=multiplication_7, Strength=Slider(88, range=0..100))
solver = Solver(GoalObjects=[curvecollide.Goal, length_line], Reset=Toggle(False), Threshold=1e-15, Tolerance=0.01, On=Toggle(False))  # -> I, V, O
panel_21 = Panel(solver.O)

# ----
move_6 = Move(Geometry=flatten(rotate.Geometry), Motion=amplitude)  # -> Geometry, Transform

# ---- group: planosPlantas (continued)
geometry_8 = Geometry(move_6.Geometry)
area_11 = Area(Geometry=graft(geometry_8))  # -> Area, Centroid
deconstruct = Deconstruct(Point=area_11.Centroid)  # -> XComponent, YComponent, ZComponent
construct_point_2 = ConstructPoint(XCoordinate=deconstruct.XComponent, YCoordinate=deconstruct.YComponent, ZCoordinate=mass_addition.PartialResults)
xy_plane = XYPlane(Origin=construct_point_2)
panel_22 = Panel(xy_plane)

# ----
panel_23 = Panel(move_6.Geometry)

# ---- group: volumetrías / volumetríaGenérica
unit_z = UnitZ(Factor=mass_addition.TotalHeightTower)
torre1 = Extrude(Base=move_6.Geometry, Direction=flatten(unit_z))

# ---- group: volumetrías
brep_plane = BrepPlane(Brep=graft(torre1), Plane=xy_plane)  # -> simplify(Curves), Points
addition = Addition(A=gene_pool03, B=1)
partition_list = PartitionList(List=flatten(brep_plane.Curves), Size=addition)
area_12 = Area(Geometry=partition_list)  # -> Area, Centroid
mass_addition_2 = MassAddition(Input=flatten(area_12.Area))  # -> Result, PartialResults
division_10 = Division(A=area_12.Area, B=number_slider)
numapartamentostorre = Integer(division_10)
mass_addition_3 = MassAddition(Input=flatten(numapartamentostorre))  # -> Result, PartialResults
totalaptos = Panel(mass_addition_3.Result)
totaláreaconstruida = Panel(mass_addition_2.Result)

# ----
panel_25 = Panel(numapartamentostorre)

# ---- group: fitnessFunction
# ángulos entre edificios
mass_addition_4 = MassAddition(Input=gene_pool01)  # -> Result, PartialResults
# totalÁreaConstruida
mass_addition_5 = MassAddition(TotalÁreaConstruida=mass_addition_2.Result)  # -> Result, PartialResults
# colisiones
integer_6 = Integer(list_length)
expression_2 = Expression(x=mass_addition_5.Result, y=áreavendiblevivienda_4, Expression="x/y")
panel_26 = Panel(integer_6)
panel_27 = Panel(mass_addition_4.Result)
panel_28 = Panel(expression_2)

# ----
mass_addition_6 = MassAddition(Input=[integer_6, mass_addition_4.Result, expression_2])  # -> Result, PartialResults

# ---- group: pisosAlturaMáxima / alturaTotal
mtstotal = Slider(80, range=0..80)

# ---- group: pisosAlturaMáxima
number_slider_8 = Slider(2.4, range=0..10)

# ---- group: pisosAlturaMáxima / alturaTotal (continued)
division_11 = Division(A=mtstotal, B=number_slider_8)
integer_7 = Integer(division_11)
panel_29 = Panel(integer_7)

# ---- group: pisosAlturaMáxima (continued)
integer_8 = Integer(integer_7)
duplicate_data_3 = DuplicateData(Data=number_slider_8, Number=integer_8, Order=True)
merge_4 = Merge(Data1=flatten(Slider(0, range=0..100)), Data2=flatten(duplicate_data_3))
mass_addition_7 = MassAddition(Input=merge_4)  # -> Result, PartialResults
panel_30 = Panel(mass_addition_7.PartialResults)
panel_31 = Panel(mass_addition_7.Result)
construct_point_3 = ConstructPoint(XCoordinate=0, YCoordinate=0, ZCoordinate=mass_addition_7.PartialResults)
xy_plane_2 = XYPlane(Origin=construct_point_3)  # -> graft(Plane)
panel_32 = Panel(xy_plane_2)
