# Grasshopper definition 19.06.26_Setting_001.gh (Grasshopper 1.0.7)
# plug-ins: SpacePartition, Kangaroo2 Components

# ---- group: manzanas / manzana1
geometry = Geometry(<curve referenced from the Rhino model>)

# ---- group: manzanas / manzana2
geometry_2 = Geometry(<curve referenced from the Rhino model>)

# ---- group: manzanas / manzana4
geometry_3 = Geometry(<curve referenced from the Rhino model>)

# ----
discontinuity = Discontinuity(Curve=geometry, Level=1)  # -> Points, Parameters

# ---- group: manzanas / manzana3
geometry_4 = Geometry(<curve referenced from the Rhino model>)

# ----
panel = Panel(discontinuity.Points)

# ---- group: manzanas
area = Area(Geometry=geometry)  # -> Area, Centroid
area_2 = Area(Geometry=geometry_2)  # -> Area, Centroid
area_3 = Area(Geometry=geometry_3)  # -> Area, Centroid
area_4 = Area(Geometry=geometry_4)  # -> Area, Centroid
áreavendiblevivienda = Panel("37863.3")
áreavendiblevivienda_2 = Panel("43094.9")
áreavendiblevivienda_3 = Panel("40479.1")
panel_2 = Panel(area_3.Area)
panel_3 = Panel(area_2.Area)
panel_4 = Panel(area_4.Area)
àreamanzana = Panel(area.Area)
áreavendiblevivienda_4 = Panel("40479.1")
division = Division(A=áreavendiblevivienda_4, B=àreamanzana)
division_2 = Division(A=áreavendiblevivienda, B=panel_3)
division_3 = Division(A=áreavendiblevivienda_2, B=panel_4)
division_4 = Division(A=áreavendiblevivienda_3, B=panel_2)
i_c = Panel(division_2)
i_c_2 = Panel(division_3)
i_c_3 = Panel(division)
i_c_4 = Panel(division_4)

# ----
shift_list = ShiftList(List=discontinuity.Points, Shift=Slider(10, range=0..10), Wrap=True)
list_item = ListItem(List=shift_list, Index=Slider(1, range=0..1), Wrap=True)
list_item_2 = ListItem(List=shift_list, Index=Slider(0, range=0..100), Wrap=True)
list_item_3 = ListItem(List=shift_list, Index=Slider(11, range=0..100), Wrap=True)
point_list = PointList(Points=shift_list, Size=Slider(10, range=0..10))
line = Line(StartPoint=list_item_2, EndPoint=list_item)

# ---- group: lote / loteBruto
geometry_5 = Geometry(<curve referenced from the Rhino model>)

# ---- group: lote
scale = Scale(Geometry=geometry_5, Center=Point(0, 0, 0), Factor=Slider(3.74701, range=0..30))  # -> Geometry, Transform
discontinuity_2 = Discontinuity(Curve=scale.Geometry, Level=1)  # -> Points, Parameters
list_item_4 = ListItem(List=discontinuity_2.Points, Index=Slider(2, range=0..10), Wrap=True)
area_5 = Area(Geometry=scale.Geometry)  # -> Area, Centroid
point = Point(list_item_4)
áreabruta = Panel(area_5.Area)

# ---- group: àrea_apto
numviviendas = Slider(616, range=0..1000)
number_slider = Slider(64, range=60..70)
numviviendas_2 = Slider(572, range=0..1000)
number_slider_2 = Slider(60, range=60..70)
numviviendas_3 = Slider(660, range=0..1000)
number_slider_3 = Slider(60, range=60..70)
numviviendas_4 = Slider(616, range=0..1000)
number_slider_4 = Slider(60, range=60..70)
division_5 = Division(A=numviviendas, B=number_slider)
division_6 = Division(A=numviviendas_2, B=number_slider_2)
division_7 = Division(A=numviviendas_3, B=number_slider_3)
division_8 = Division(A=numviviendas_4, B=number_slider_4)
integer = Integer(division_5)
integer_2 = Integer(division_6)
integer_3 = Integer(division_7)
integer_4 = Integer(division_8)
panel_5 = Panel(integer_2)
panel_6 = Panel(integer_4)
numaptospiso = Panel(integer)
panel_7 = Panel(integer_3)
multiplication = Multiplication(A=integer, B=number_slider)
multiplication_2 = Multiplication(A=number_slider_4, B=integer_4)
multiplication_3 = Multiplication(A=number_slider_2, B=integer_2)
multiplication_4 = Multiplication(A=number_slider_3, B=integer_3)
panel_8 = Panel(multiplication_2)
àrea_piso = Panel(multiplication)
panel_9 = Panel(multiplication_3)
panel_10 = Panel(multiplication_4)

# ---- group: áreaTotalIdeal
multiplication_5 = Multiplication(A=numviviendas, B=number_slider)
panel_11 = Panel(multiplication_5)

# ----
circle = Circle(Plane=PlaneXY(0, 0, 0), Radius=1)
curve = Curve(circle)
number_slider_5 = Slider(2.4, range=0..10)
number = Number(áreavendiblevivienda_4)
series = Series(Start=0, Step=number_slider_5, Count=Slider(23, range=0..100))
c_script = CSharpScript(x=Slider(10, range=0..10), y=number_slider_5)  # -> out, A; inputs x: Int32, y: Double
# ---------- c_script: C# ----------
    var listOut = new List<Rectangle3d>();

    double temp = 0;
    
    var rect = new Rectangle3d(Plane.WorldXY, 8, 8);listOut.Add(rect);
    /*var rectO = rect;

    
    
    temp += y;
    
    rect.Transform( Transform.Translation( 0, 0, temp ) );
    listOut.Add(rect);
    
    temp = 0;
    
    temp += y;
    
    rect.Transform(Transform.Translation(0, 0, temp));
    listOut.Add(rect);*/

    for( int i = 0; i < x; ++i )
    {

      temp += y;
      
      var vect = new Vector3d( 0, 0, temp );
      
      var xform = Transform.Translation(0, 0, temp);
      
      rect.Transform(xform);

      listOut.Add(rect);
      
      temp = 0;
      
      //xform = Transform.ZeroTransformation;
      
      Print( vect.ToString() );

    }

    A = listOut;
# ---------- end c_script ----------
panel_12 = Panel(c_script.out)
panel_13 = Panel(c_script.A)
panel_14 = Panel(number)
line_pt = LinePt(Line=line, Point=list_item_3)

# ---- group: align / northOrientation / centroid
point_2 = Point(area.Centroid)

# ---- group: align / northOrientation
number_slider_6 = Slider(100, range=-100..100)
number_slider_7 = Slider(-100, range=-100..100)
unit_x = UnitX(Factor=[number_slider_6, number_slider_7])
unit_y = UnitY(Factor=[number_slider_6, number_slider_7])
move = Move(Geometry=point_2, Motion=unit_y)  # -> Geometry, Transform
move_2 = Move(Geometry=point_2, Motion=unit_x)  # -> Geometry, Transform
list_item_5 = ListItem(List=move_2.Geometry, Index=0, Wrap=True)
list_item_6 = ListItem(List=move.Geometry, Index=0, Wrap=True)
vector_2pt = Vector2Pt(PointA=point_2, PointB=list_item_5, Unitize=False)  # -> Vector, Length
vector_2pt_2 = Vector2Pt(PointA=point_2, PointB=list_item_6, Unitize=False)  # -> Vector, Length
vector_display = VectorDisplay(Anchor=point_2, Vector=vector_2pt.Vector)
vector_display_2 = VectorDisplay(Anchor=point_2, Vector=vector_2pt_2.Vector)

# ----
vector_2pt_3 = Vector2Pt(PointA=line_pt, PointB=point_2, Unitize=False)  # -> Vector, Length
button = Button()  # disabled
galapagos = Galapagos(fitness=mass_addition_8, gene=[gene_pool02, gene_pool03])

# ---- group: planosPlantas
number_slider_8 = Slider(0, range=0..100)
gene_pool03 = GenePool(
    Decimals=0,
    Maximum=33,
    Minimum=1,
    Value=[18.97801136, 10.53188214, 32.23120564, 12.16532429, 10.74397105, 31.25338483, 19.34872344, 16.58528378, 17.74492801, 6.688803884])
construct_domain = ConstructDomain(DomainStart=1, DomainEnd=33)

# ----
graft_tree = GraftTree(Tree=gene_pool03, IncludeEmptyLists=True, IncludeNullItems=True)
list_item_7 = ListItem(List=gene_pool03, Index=0, Wrap=True)
panel_15 = Panel(list_item_7)

# ---- group: planosPlantas (continued)
duplicate_data = DuplicateData(Data=Slider(2.4, range=0..10), Number=graft_tree, Order=True)  # -> simplify(Data)

# ---- group: towerNumber
expression = Expression(area=multiplication, Expression="sqrt(area/2)")
integer_5 = Integer(expression)
multiplication_6 = Multiplication(A=integer_5, B=2)
panel_16 = Panel(integer_5)
rectangle = Rectangle(Plane=PlaneXY(0, 0, 0), XSize=multiplication_6, YSize=integer_5, Radius=0)  # -> Rectangle, Length
area_6 = Area(Geometry=geometry)  # -> Area, Centroid
area_7 = Area(Geometry=rectangle.Rectangle)  # -> Area, Centroid
construct_point = ConstructPoint(XCoordinate=0, YCoordinate=0, ZCoordinate=0)
vector_2pt_4 = Vector2Pt(PointA=area_7.Centroid, PointB=construct_point, Unitize=False)  # -> Vector, Length
vector_display_3 = VectorDisplay(Anchor=area_7.Centroid, Vector=vector_2pt_4.Vector)
scale_2 = Scale(Geometry=geometry, Center=area_6.Centroid, Factor=Slider(2, range=0..2))  # -> Geometry, Transform
pointpopulation = Slider(100, range=1..100)
numpisos = Slider(87, range=0..100)
list_item_8 = ListItem(List=vector_2pt_4.Vector, Index=1, Wrap=True)
move_3 = Move(Geometry=rectangle.Rectangle, Motion=list_item_8)  # -> Geometry, Transform
geometry_6 = Geometry(geometry)
area_8 = Area(Geometry=move_3.Geometry)  # -> Area, Centroid
populate_2d = Populate2D(Region=scale_2.Geometry, Count=pointpopulation, Seed=numpisos)

# ----
area_9 = Area(Geometry=geometry_6)  # -> Area, Centroid
scale_3 = Scale(Geometry=geometry_6, Center=area_9.Centroid, Factor=Slider(0.6, range=0..2))  # -> Geometry, Transform

# ---- group: towerNumber (continued)
point_in_curve = PointInCurve(Point=populate_2d, Curve=scale_3.Geometry)  # -> Relationship, Point
expression_2 = Expression(x=point_in_curve.Relationship, Expression="if(x=2, True, False)")
cull_pattern = CullPattern(List=populate_2d, CullPattern=expression_2)
vector_2pt_5 = Vector2Pt(PointA=area_8.Centroid, PointB=cull_pattern, Unitize=False)  # -> Vector, Length
move_4 = Move(Geometry=move_3.Geometry, Motion=vector_2pt_5.Vector)  # -> graft(Geometry), Transform
panel_17 = Panel(cull_pattern)
vector_display_4 = VectorDisplay(Anchor=area_8.Centroid, Vector=vector_2pt_5.Vector)

# ----
geometry_7 = Geometry(flatten(move_4.Geometry))
list_length = ListLength(List=geometry_7)
panel_18 = Panel(list_length)
duplicate_data_2 = DuplicateData(Data=number_slider_8, Number=list_length, Order=True)
graft_tree_2 = GraftTree(Tree=duplicate_data_2, IncludeEmptyLists=True, IncludeNullItems=True)  # -> simplify(Tree)

# ---- group: planosPlantas (continued)
genepoolmodifier = GenePoolModifier(
    GeneList="Gene Pool03",
    Count=list_length,
    Domain=construct_domain,
    Randomize=Toggle(True),
    PercentageOfRandomization=Slider(65, range=0..100))
panel_19 = Panel(genepoolmodifier)
merge = Merge(Data1=graft_tree_2, Data2=duplicate_data)
area_10 = Area(Geometry=graft(geometry_7))  # -> Area, Centroid
mass_addition = MassAddition(Input=merge)  # -> TotalHeightTower, PartialResults
panel_20 = Panel(mass_addition.TotalHeightTower)
deconstruct = Deconstruct(Point=area_10.Centroid)  # -> XComponent, YComponent, ZComponent
construct_point_2 = ConstructPoint(XCoordinate=deconstruct.XComponent, YCoordinate=deconstruct.YComponent, ZCoordinate=mass_addition.PartialResults)
panel_21 = Panel(mass_addition.PartialResults)
xy_plane = XYPlane(Origin=construct_point_2)
panel_22 = Panel(xy_plane)

# ----
panel_23 = Panel(merge)
number_2 = Number(integer_5)
number_3 = Number(multiplication_6)
multiplication_7 = Multiplication(A=number_3, B=0.5)
multiplication_8 = Multiplication(A=number_2, B=0.5)
construct_domain_2 = ConstructDomain(DomainStart=expr("-x", multiplication_8), DomainEnd=multiplication_8)
construct_domain_3 = ConstructDomain(DomainStart=expr("-x", multiplication_7), DomainEnd=multiplication_7)

# ---- group: volumetrías / volumetríaGenérica
unit_z = UnitZ(Factor=mass_addition.TotalHeightTower)

# ---- group: pisosAlturaMáxima / alturaTotal
mtstotal = Slider(80, range=0..80)

# ---- group: volumetrías
addition = Addition(A=gene_pool03, B=1)

# ---- group: pisosAlturaMáxima
number_slider_9 = Slider(2.4, range=0..10)

# ---- group: pisosAlturaMáxima / alturaTotal (continued)
division_9 = Division(A=mtstotal, B=number_slider_9)
integer_6 = Integer(division_9)
panel_24 = Panel(integer_6)

# ---- group: pisosAlturaMáxima (continued)
integer_7 = Integer(integer_6)
duplicate_data_3 = DuplicateData(Data=number_slider_9, Number=integer_7, Order=True)
merge_2 = Merge(Data1=flatten(Slider(0, range=0..100)), Data2=flatten(duplicate_data_3))
mass_addition_2 = MassAddition(Input=merge_2)  # -> Result, PartialResults
panel_25 = Panel(mass_addition_2.PartialResults)
panel_26 = Panel(mass_addition_2.Result)
construct_point_3 = ConstructPoint(XCoordinate=0, YCoordinate=0, ZCoordinate=mass_addition_2.PartialResults)
xy_plane_2 = XYPlane(Origin=construct_point_3)  # -> graft(Plane)
panel_27 = Panel(xy_plane_2)

# ----
number_4 = Number(number_slider_9)

# ---- group: colisiones
deconstuct_rectangle = DeconstuctRectangle(Rectangle=geometry)  # -> BasePlane, XInterval, YInterval; disabled
rectangle_2 = Rectangle(
    Plane=deconstuct_rectangle.BasePlane,
    XSize=deconstuct_rectangle.XInterval,
    YSize=deconstuct_rectangle.YInterval,
    Radius=0)  # -> Rectangle, Length; disabled
number_slider_10 = Slider(88, range=0..100)  # disabled
boolean_toggle = BooleanToggle(False)  # disabled
boolean_toggle_2 = BooleanToggle(False)  # disabled

# ----
offset_curve = OffsetCurve(Curve=rectangle_2.Rectangle, Distance=Slider(43, range=0..100), Plane=deconstuct_rectangle.BasePlane, Corners=1)  # disabled
panel_28 = Panel(rectangle_2.Rectangle)
loft = Loft(
    Curves=flatten([offset_curve, rectangle_2.Rectangle]),
    Options={Adjust=False, Closed=False, LoftEnds=0, LoftSimp=0, LoftType=0, Rebuild=10, Refit=0.01})  # disabled
deconstruct_brep = DeconstructBrep(Brep=loft)  # -> Faces, Edges, Vertices; disabled
brep_wireframe = BrepWireframe(Brep=deconstruct_brep.Faces, Density=-1)  # disabled

# ---- group: tensiónCentro
construct_domain_4 = ConstructDomain(DomainStart=0.1, DomainEnd=1)
point_3 = Point(area_6.Centroid)
genepoolmodifier_2 = GenePoolModifier(
    GeneList="Gene Pool02",
    Count=pointpopulation,
    Domain=construct_domain_4,
    Randomize=Toggle(True),
    PercentageOfRandomization=Slider(65, range=0..100))
gene_pool02 = GenePool(
    Decimals=2,
    Maximum=1,
    Minimum=0.1,
    Value=[0.4068065876, 0.4437180836, 0.8817268422, 0.8784832451, 0.661894215, 0.8689839098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])
panel_29 = Panel(genepoolmodifier_2)

# ---- group: aislamiento
number_5 = Number(mass_addition.TotalHeightTower)
division_10 = Division(A=number_5, B=Slider(5, range=0..5))
geometry_8 = Geometry(geometry)

# ---- group: align / alignAllGeometry
panel_30 = Panel("""0.0
0.5
1.0
1.5
2""")
area_11 = Area(Geometry=move_4.Geometry)  # -> Area, Centroid
expression_3 = Expression(x=panel_30, Expression="x*pi")
circle_2 = Circle(Plane=line_pt, Radius=Slider(59, range=0..100))
plane_origin = PlaneOrigin(Base=move_4.Geometry, Origin=area_11.Centroid)

# ----
bounds = Bounds(Numbers=expression_3)
move_5 = Move(Geometry=circle_2, Motion=vector_2pt_3.Vector)  # -> Geometry, Transform
remap_numbers = RemapNumbers(Value=expression_3, Source=bounds, Target=Domain(0, 1))  # -> Mapped, Clipped

# ---- group: align / alignAllGeometry (continued)
evaluate_curve = EvaluateCurve(Curve=reparameterize(move_5.Geometry), Parameter=remap_numbers.Mapped)  # -> graft(Point), Tangent, Angle
vector_2pt_6 = Vector2Pt(PointA=point_2, PointB=evaluate_curve.Point, Unitize=False)  # -> Vector, Length
align_plane = AlignPlane(Plane=plane_origin, Direction=vector_2pt_6.Vector)  # -> Plane, Angle
rotate = Rotate(Geometry=move_4.Geometry, Angle=align_plane.Angle, Plane=align_plane.Plane)  # -> simplify(Geometry), Transform
vector_display_5 = VectorDisplay(Anchor=point_2, Vector=vector_2pt_6.Vector)

# ---- group: aislamiento (continued)
offset_curve_2 = OffsetCurve(Curve=rotate.Geometry, Distance=division_10, Plane=PlaneXY(0, 0, 0), Corners=1)  # -> flatten(Curve)
merge_3 = Merge(Data1=offset_curve_2, Data2=geometry_8)  # -> flatten(Result)
curve_curve = CurveCurve(CurveA=merge_3, CurveB=graft(merge_3))  # -> flatten(Points), ParamsA, ParamsB
list_length_2 = ListLength(List=curve_curve.Points)

# ---- group: tensiónCentro (continued)
area_12 = Area(Geometry=rotate.Geometry)  # -> Area, Centroid
vector_2pt_7 = Vector2Pt(PointA=point_3, PointB=area_12.Centroid, Unitize=False)  # -> Vector, Length
multiplication_9 = Multiplication(A=flatten(vector_2pt_7.Length), B=gene_pool02)
reverse = Reverse(Vector=vector_2pt_7.Vector)
amplitude = Amplitude(Vector=flatten(vector_2pt_7.Vector), Amplitude=multiplication_9)
panel_31 = Panel(multiplication_9)
vector_display_6 = VectorDisplay(Anchor=flatten(area_12.Centroid), Vector=flatten(amplitude))
move_6 = Move(Geometry=offset_curve_2, Motion=amplitude)  # -> Geometry, Transform

# ---- group: colisiones (continued)
geometry_9 = Geometry(offset_curve_2)  # disabled
line_2 = Line(StartPoint=point_3, EndPoint=area_12.Centroid)  # disabled
merge_4 = Merge(Data1=flatten(geometry_9))  # disabled
length_line = LengthLine(Line=flatten(line_2), Length=multiplication_9, Strength=number_slider_10)  # disabled
curvecollide = CurveCollide(Curves=merge_4, PassiveCurves=flatten(brep_wireframe), BasePlane=deconstuct_rectangle.BasePlane, Strength=1)  # -> Goal, Frames; disabled
panel_32 = Panel(merge_4)  # disabled
solver = Solver(GoalObjects=curvecollide.Goal, Reset=button, Threshold=1e-15, Tolerance=0.01, On=boolean_toggle_2)  # -> I, V, O; disabled
panel_33 = Panel(solver.O)  # disabled

# ----
panel_34 = Panel(remap_numbers.Mapped)
plane = Plane(plane_origin)
geometry_10 = Geometry(solver.O)  # disabled
rotate_2 = Rotate(Geometry=plane, Angle=align_plane.Angle, Plane=align_plane.Plane)  # -> simplify(Geometry), Transform
plane_2 = Plane(rotate_2.Geometry)
c_script_2 = CSharpScript(f=number_4, w=construct_domain_3, h=construct_domain_2, maxIter=list_item_7, areaTotal=number, planes=flatten(plane_2))  # -> out, A; inputs f: Double, maxIter: Int32, areaTotal: Double, planes: list of Plane
# ---------- c_script_2: C# ----------
    var listaRect = new DataTree<Rectangle3d>();
    int size = planes.Count;
    Rectangle3d rectTemp = new Rectangle3d();
    double areaR = 0, temp = 0;

    for (int i = 0; i < size; ++i)
    {

      rectTemp = new Rectangle3d(planes[i], w, h);
      temp = 0;

      var path = new GH_Path(i);

      for (int j = 0; j < maxIter; ++j)
      {

        temp += f;
        areaR += AreaMassProperties.Compute(rectTemp.ToNurbsCurve()).Area;
        rectTemp.Transform(Rhino.Geometry.Transform.Translation(0, 0, temp));
        listaRect.Add(rectTemp, path);
        temp = 0;

        if (areaR * 1.05 >= areaTotal && areaR * 0.95 <= areaTotal) break;

      }

      if (areaR * 1.05 >= areaTotal && areaR * 0.95 <= areaTotal) break;

    }
    A = listaRect;
    Print(areaR.ToString());
# ---------- end c_script_2 ----------
geometry_11 = Geometry(c_script_2.A)
area_13 = Area(Geometry=c_script_2.A)  # -> Area, Centroid
list_item_9 = ListItem(List=geometry_11, Index=0, Wrap=True)
list_item_10 = ListItem(List=area_13.Centroid, Index=0, Wrap=True)
deconstruct_brep_2 = DeconstructBrep(Brep=list_item_9)  # -> Faces, Edges, Vertices
mass_addition_3 = MassAddition(Input=flatten(area_13.Area))  # -> Result, PartialResults
loft_2 = Loft(Curves=c_script_2.A, Options={Adjust=False, Closed=False, LoftEnds=0, LoftSimp=0, LoftType=0, Rebuild=10, Refit=0.01})
panel_35 = Panel(mass_addition_3.Result)
list_item_11 = ListItem(List=deconstruct_brep_2.Vertices, Index=0, Wrap=True)
vector_2pt_8 = Vector2Pt(PointA=list_item_10, PointB=list_item_11, Unitize=False)  # -> Vector, Length
panel_36 = Panel(deconstruct_brep_2.Vertices)
explode_tree = ExplodeTree(Data=c_script_2.A)  # -> Branch0, Branch1, Branch2, Branch3, Branch4, Branch5, Branch6, Branch7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
move_7 = Move(Geometry=geometry_11, Motion=vector_2pt_8.Vector)  # -> Geometry, Transform
curve_2 = Curve(explode_tree.Branch0)
move_8 = Move(Geometry=flatten(rotate.Geometry), Motion=amplitude)  # -> Geometry, Transform

# ---- group: volumetrías / volumetríaGenérica (continued)
torre1 = Extrude(Base=move_8.Geometry, Direction=flatten(unit_z))

# ---- group: volumetrías (continued)
panel_37 = Panel(move_8.Geometry)
brep_plane = BrepPlane(Brep=graft(torre1), Plane=xy_plane)  # -> simplify(Curves), Points
partition_list = PartitionList(List=flatten(brep_plane.Curves), Size=addition)
area_14 = Area(Geometry=partition_list)  # -> Area, Centroid
mass_addition_4 = MassAddition(Input=flatten(area_14.Area))  # -> Result, PartialResults
division_11 = Division(A=area_14.Area, B=number_slider)
numapartamentostorre = Integer(division_11)
mass_addition_5 = MassAddition(Input=flatten(numapartamentostorre))  # -> Result, PartialResults
panel_39 = Panel(numapartamentostorre)
totalaptos = Panel(mass_addition_5.Result)
totaláreaconstruida = Panel(mass_addition_4.Result)

# ----
panel_40 = Panel(rotate.Geometry)

# ---- group: fitnessFunction
# ángulos entre edificios
mass_addition_6 = MassAddition()  # -> Result, PartialResults
# totalÁreaConstruida
mass_addition_7 = MassAddition(TotalÁreaConstruida=mass_addition_4.Result)  # -> Result, PartialResults
# colisiones
integer_8 = Integer(list_length_2)
expression_4 = Expression(x=mass_addition_7.Result, y=áreavendiblevivienda_4, Expression="x/y")
panel_42 = Panel(integer_8)
panel_43 = Panel(mass_addition_6.Result)
panel_44 = Panel(expression_4)

# ----
mass_addition_8 = MassAddition(Input=[integer_8, mass_addition_6.Result, expression_4])  # -> Result, PartialResults
