# Grasshopper definition 19.06.30_Setting_004.gh (Grasshopper 1.0.7)
# plug-ins: SpacePartition, Human, TT Toolbox

# ---- group: base / manzanas / manzana2
geometry = Geometry(<curve referenced from the Rhino model>)

# ---- group: base / manzanas / manzana1
geometry_2 = Geometry(<curve referenced from the Rhino model>)

# ---- group: base / manzanas / manzana4
geometry_3 = Geometry(<curve referenced from the Rhino model>)

# ---- group: base / manzanas / manzana3
geometry_4 = Geometry(<curve referenced from the Rhino model>)

# ---- group: base / manzanas
area = Area(Geometry=geometry_2)  # -> Area, Centroid
area_2 = Area(Geometry=geometry_2)  # -> Area, Centroid
area_3 = Area(Geometry=geometry_3)  # -> Area, Centroid
area_4 = Area(Geometry=geometry_4)  # -> Area, Centroid
áreavendiblevivienda = Panel("37863.3")
áreavendiblevivienda_2 = Panel("43094.9")
áreavendiblevivienda_3 = Panel("40479.1")
panel = Panel(area_3.Area)
panel_2 = Panel(area_2.Area)
panel_3 = Panel(area_4.Area)
àreamanzana = Panel(area.Area)
áreavendiblevivienda_4 = Panel("40479.1")
division = Division(A=áreavendiblevivienda_4, B=àreamanzana)
division_2 = Division(A=áreavendiblevivienda, B=panel_2)
division_3 = Division(A=áreavendiblevivienda_2, B=panel_3)
division_4 = Division(A=áreavendiblevivienda_3, B=panel)
i_c = Panel(division)
i_c_2 = Panel(division_2)
i_c_3 = Panel(division_3)
i_c_4 = Panel(division_4)

# ---- group: loteAreaBruta / loteBruto
geometry_5 = Geometry(<curve referenced from the Rhino model>)

# ---- group: loteAreaBruta
scale = Scale(Geometry=geometry_5, Center=Point(0, 0, 0), Factor=Slider(3.74701, range=0..30))  # -> Geometry, Transform
discontinuity = Discontinuity(Curve=scale.Geometry, Level=1)  # -> Points, Parameters
list_item = ListItem(List=discontinuity.Points, Index=Slider(2, range=0..10), Wrap=True)
area_5 = Area(Geometry=scale.Geometry)  # -> Area, Centroid
point = Point(list_item)
áreabruta = Panel(area_5.Area)

# ---- group: planosPlantas
minpisos = Slider(5, range=0..100)
maxpisos = Slider(33, range=0..33)
gene_pool03 = GenePool(Decimals=0, Maximum=33, Minimum=5, Value=33)
construct_domain = ConstructDomain(DomainStart=minpisos, DomainEnd=maxpisos)
genepoolmodifier = GenePoolModifier(
    GeneList="Gene Pool03",
    Count=Slider(1, range=0..6),
    Domain=construct_domain,
    Randomize=Button(),
    PercentageOfRandomization=Slider(87.936, range=0..100))
panel_4 = Panel(genepoolmodifier)

# ---- group: base / àrea_apto
numviviendas = Slider(616, range=0..1000)
number_slider = Slider(65.5, range=60..70)
numviviendas_2 = Slider(572, range=0..1000)
number_slider_2 = Slider(60, range=60..70)
numviviendas_3 = Slider(660, range=0..1000)
number_slider_3 = Slider(60, range=60..70)
numviviendas_4 = Slider(616, range=0..1000)
number_slider_4 = Slider(60, range=60..70)
division_5 = Division(A=numviviendas, B=number_slider)
division_6 = Division(A=numviviendas_2, B=number_slider_2)
division_7 = Division(A=numviviendas_3, B=number_slider_3)
division_8 = Division(A=numviviendas_4, B=number_slider_4)
integer = Integer(division_5)
integer_2 = Integer(division_6)
integer_3 = Integer(division_7)
integer_4 = Integer(division_8)
panel_5 = Panel(integer_2)
panel_6 = Panel(integer_4)
numaptospiso = Panel(integer)
panel_7 = Panel(integer_3)
multiplication = Multiplication(A=integer, B=number_slider)
multiplication_2 = Multiplication(A=number_slider_4, B=integer_4)
multiplication_3 = Multiplication(A=number_slider_2, B=integer_2)
multiplication_4 = Multiplication(A=number_slider_3, B=integer_3)
panel_8 = Panel(multiplication_2)
àrea_piso = Panel(multiplication)
panel_9 = Panel(multiplication_3)
panel_10 = Panel(multiplication_4)

# ---- group: áreaTotalIdeal
multiplication_5 = Multiplication(A=numviviendas, B=number_slider)
panel_11 = Panel(multiplication_5)

# ----
difstor = Slider(10, range=0..10)

# ---- group: definicionTorres / altura1eraTorre
list_item_2 = ListItem(List=gene_pool03, Index=0, Wrap=True)

# ---- group: definicionTorres / areaTotalVendible
number = Number(áreavendiblevivienda_4)

# ----
multiplication_6 = Multiplication(A=number, B=1.05)
number_slider_5 = Slider(3, range=0..500)
number_slider_6 = Slider(2, range=0..10)
curve = Curve(geometry_2)

# ---- group: align / northOrientation / centroid
point_2 = Point(area.Centroid)

# ---- group: align / northOrientation
number_slider_7 = Slider(100, range=-100..100)
number_slider_8 = Slider(-100, range=-100..100)
unit_x = UnitX(Factor=[number_slider_7, number_slider_8])
unit_y = UnitY(Factor=[number_slider_7, number_slider_8])
move = Move(Geometry=point_2, Motion=unit_y)  # -> Geometry, Transform
move_2 = Move(Geometry=point_2, Motion=unit_x)  # -> Geometry, Transform
list_item_3 = ListItem(List=move_2.Geometry, Index=0, Wrap=True)
list_item_4 = ListItem(List=move.Geometry, Index=0, Wrap=True)
vector_2pt = Vector2Pt(PointA=point_2, PointB=list_item_3, Unitize=False)  # -> Vector, Length
vector_2pt_2 = Vector2Pt(PointA=point_2, PointB=list_item_4, Unitize=False)  # -> Vector, Length
vector_display = VectorDisplay(Anchor=point_2, Vector=vector_2pt.Vector)
vector_display_2 = VectorDisplay(Anchor=point_2, Vector=vector_2pt_2.Vector)

# ---- group: align / orientacionLote
discontinuity_2 = Discontinuity(Curve=geometry_2, Level=1)  # -> Points, Parameters
panel_12 = Panel(discontinuity_2.Points)
shift_list = ShiftList(List=discontinuity_2.Points, Shift=Slider(10, range=0..10), Wrap=True)
list_item_5 = ListItem(List=shift_list, Index=Slider(1, range=0..1), Wrap=True)
list_item_6 = ListItem(List=shift_list, Index=Slider(0, range=0..100), Wrap=True)
list_item_7 = ListItem(List=shift_list, Index=Slider(11, range=0..100), Wrap=True)
point_list = PointList(Points=shift_list, Size=Slider(10, range=0..10))
line = Line(StartPoint=list_item_6, EndPoint=list_item_5)

# ---- group: referenciaViaAcceso
# manzana 1
curve_2 = Curve(<curve referenced from the Rhino model>)

# ---- group: estudioParqueadero / unidadParqueo
number_slider_9 = Slider(2.3, range=0..10)
addition = Addition(A=Slider(4.3, range=0..10), B=Slider(2.5, range=0..10))
rectangle = Rectangle(Plane=PlaneXY(0, 0, 0), XSize=addition, YSize=number_slider_9, Radius=0)  # -> Rectangle, Length
area_6 = Area(Geometry=rectangle.Rectangle)  # -> Area, Centroid
mirror = Mirror(Geometry=rectangle.Rectangle, Plane=PlaneYZ(0, 0, 0))  # -> Geometry, Transform
areatotalparqueo_circl = Panel(area_6.Area)
merge = Merge(Data1=rectangle.Rectangle, Data2=mirror.Geometry)

# ----
radians = Radians(Degrees=expr("x*90", Slider(0, range=0..3)))
number_slider_10 = Slider(2, range=0..3)
c_script = CSharpScript(rotations=number_slider_10)  # -> A; inputs rotations: Int32
# ---------- c_script: C# ----------
    if( rotations % 2 != 1 )
    {
    
      A = -0.711002;
    
    }
    
    else
    {
    
      A = 0.859795;
    
    }
# ---------- end c_script ----------

# ---- group: areaTotalOcupacion / manzana
curve_3 = Curve(geometry_2)

# ----
number_slider_11 = Slider(1000, range=0..10000)
galapagos = Galapagos(
    fitness=mass_addition_8,
    gene=[gene_pool04, number_slider_15, number_slider_14, alturaedificio, number_slider_10, pointx, pointy])

# ---- group: ExcelWriter / ÁreaBruta
num = Number(area_5.Area)  # disabled

# ---- group: ExcelWriter / ÁreaNetaUrbanizable
num_2 = Number(area.Area)  # disabled

# ---- group: definicionTorres
panel_13 = Panel(list_item_2)

# ---- group: towerNumber
construct_domain_2 = ConstructDomain(DomainStart=0, DomainEnd=1)
expression = Expression(area=multiplication, Expression="sqrt(area/2)")
integer_5 = Integer(expression)
genepoolmodifier_2 = GenePoolModifier(
    GeneList="PointX",
    Count=number_slider_5,
    Domain=construct_domain_2,
    Randomize=Button(),
    PercentageOfRandomization=Slider(85, range=0..100))
genepoolmodifier_3 = GenePoolModifier(
    GeneList="PointY",
    Count=number_slider_5,
    Domain=construct_domain_2,
    Randomize=Button(),
    PercentageOfRandomization=Slider(85, range=0..100))
panel_14 = Panel(integer_5)
pointx = GenePool(Decimals=2, Maximum=1, Minimum=0, Value=[0.12, 0.76, 0.18])
pointy = GenePool(Decimals=2, Maximum=1, Minimum=0, Value=[0.81, 0.53, 0.02])
curve_4 = Curve(geometry_2)
boundary_surfaces = BoundarySurfaces(Edges=curve_4)
construct_point = ConstructPoint(XCoordinate=pointx, YCoordinate=pointy, ZCoordinate=0)
custom_preview = CustomPreview(Geometry=boundary_surfaces, Material=ColourSwatch(SwatchColor=RGBA(241, 232, 210, 193)))

# ----
area_7 = Area(Geometry=boundary_surfaces)  # -> Area, Centroid
scale_2 = Scale(Geometry=boundary_surfaces, Center=area_7.Centroid, Factor=Slider(0.7, range=0..1))  # -> Geometry, Transform

# ---- group: towerNumber (continued)
evaluate_surface = EvaluateSurface(Surface=reparameterize(scale_2.Geometry), Point=construct_point)  # -> Point, Normal, UDirection, VDirection, Frame
surface_closest_point = SurfaceClosestPoint(Point=evaluate_surface.Point, Surface=scale_2.Geometry)  # -> Point, UVPoint, Distance

# ---- group: definicionTorres (continued)
multiplication_7 = Multiplication(A=integer_5, B=2)
division_9 = Division(A=integer_5, B=2)
division_10 = Division(A=multiplication_7, B=2)
multiplication_8 = Multiplication(A=division_9, B=-1)
multiplication_9 = Multiplication(A=division_10, B=-1)
construct_domain_3 = ConstructDomain(DomainStart=multiplication_8, DomainEnd=division_9)
construct_domain_4 = ConstructDomain(DomainStart=multiplication_9, DomainEnd=division_10)

# ----
domain = Domain(construct_domain_4)
domain_2 = Domain(construct_domain_3)

# ---- group: pisosAlturaMáxima / alturaTotal
mtstotal = Slider(80, range=0..80)

# ---- group: pisosAlturaMáxima
number_slider_12 = Slider(2.4, range=0..10)

# ---- group: definicionTorres / alturaEntrepiso
number_2 = Number(number_slider_12)

# ---- group: pisosAlturaMáxima / alturaTotal (continued)
division_11 = Division(A=mtstotal, B=number_slider_12)
integer_6 = Integer(division_11)
panel_15 = Panel(integer_6)

# ---- group: pisosAlturaMáxima (continued)
integer_7 = Integer(integer_6)
duplicate_data = DuplicateData(Data=number_slider_12, Number=integer_7, Order=True)
merge_2 = Merge(Data1=flatten(Slider(0, range=0..100)), Data2=flatten(duplicate_data))
mass_addition = MassAddition(Input=merge_2)  # -> Result, PartialResults
panel_16 = Panel(mass_addition.PartialResults)
panel_17 = Panel(mass_addition.Result)
construct_point_2 = ConstructPoint(XCoordinate=0, YCoordinate=0, ZCoordinate=mass_addition.PartialResults)
xy_plane = XYPlane(Origin=construct_point_2)  # -> graft(Plane)
panel_18 = Panel(xy_plane)

# ---- group: align / alignAllGeometry / orientacionPlanos
gene_pool04 = GenePool(Decimals=0, Maximum=3, Minimum=0, Value=[1, 0, 0])
construct_domain_5 = ConstructDomain(DomainStart=0, DomainEnd=3)

# ---- group: align / alignAllGeometry
line_pt = LinePt(Line=line, Point=list_item_7)
panel_19 = Panel("""0.0
0.5
1.0
1.5
2""")
expression_2 = Expression(x=panel_19, Expression="x*pi")
bounds = Bounds(Numbers=expression_2)
vector_2pt_3 = Vector2Pt(PointA=line_pt, PointB=point_2, Unitize=False)  # -> Vector, Length
remap_numbers = RemapNumbers(Value=expression_2, Source=bounds, Target=Domain(0, 1))  # -> Mapped, Clipped
panel_20 = Panel(remap_numbers.Mapped)
plane = Plane(surface_closest_point.Point)

# ----
vector_display_3 = VectorDisplay(Anchor=point_2, Vector=vector_2pt_3.Vector)
list_length = ListLength(List=flatten(plane))

# ---- group: align / alignAllGeometry / orientacionPlanos (continued)
genepoolmodifier_4 = GenePoolModifier(
    GeneList="Gene Pool04",
    Count=list_length,
    Domain=construct_domain_5,
    Randomize=Button(),
    PercentageOfRandomization=Slider(80.059, range=0..100))
panel_21 = Panel(genepoolmodifier_4)

# ---- group: align
circle = Circle(Plane=line_pt, Radius=Slider(47, range=0..100))

# ---- group: calculoParqueaderos / numUnidades
number_3 = Number(number_slider)

# ---- group: align / alignAllGeometry (continued)
move_3 = Move(Geometry=circle, Motion=vector_2pt_3.Vector)  # -> Geometry, Transform

# ---- group: align (continued)
evaluate_curve = EvaluateCurve(Curve=reparameterize(move_3.Geometry), Parameter=remap_numbers.Mapped)  # -> Point, Tangent, Angle

# ----
list_item_8 = ListItem(List=evaluate_curve.Point, Index=gene_pool04, Wrap=True)  # -> graft(Item)

# ---- group: align (continued)
vector_2pt_4 = Vector2Pt(PointA=point_2, PointB=list_item_8, Unitize=False)  # -> Vector, Length
align_plane = AlignPlane(Plane=plane, Direction=flatten(vector_2pt_4.Vector))  # -> Plane, Angle
vector_display_4 = VectorDisplay(Anchor=point_2, Vector=vector_2pt_4.Vector)

# ---- group: align / alignAllGeometry (continued)
rotate = Rotate(Geometry=plane, Angle=align_plane.Angle, Plane=align_plane.Plane)  # -> simplify(Geometry), Transform
panel_22 = Panel(vector_2pt_4.Vector)

# ---- group: definicionTorres / planeIniciales
plane_2 = Plane(rotate.Geometry)

# ----
list_item_9 = ListItem(List=flatten(vector_2pt_4.Vector), Index=0, Wrap=True)  # -> Item, Item1, Item2
vector_display_5 = VectorDisplay(Anchor=point_2, Vector=list_item_9.Item)
vector_display_6 = VectorDisplay(Anchor=point_2, Vector=list_item_9.Item2)

# ---- group: definicionTorres (continued)
customgeoplacement = CSharpScript(diff=difstor, f=number_2, w=domain, h=domain_2, maxIter=list_item_2, areaTotal=multiplication_6, planes=flatten(plane_2))  # -> A, B; inputs diff: Int32, f: Double, maxIter: Int32, areaTotal: Double, planes: list of Plane
# ---------- customgeoplacement: C# ----------
    var listaRect = new DataTree<Rectangle3d>();
    double move = 0.0;
    var vectorList = new DataTree<Vector3d>();
    int size = planes.Count;
    Rectangle3d rectTemp = new Rectangle3d();
    double areaR = 0, temp = 0;

    for (int i = 0; i < size; ++i)
    {

      rectTemp = new Rectangle3d(planes[i], w, h);

      var path = new GH_Path(i);

      for (int j = 0; j <= maxIter; ++j)
      {

        if( j != 0 )

          temp += f;

        areaR += AreaMassProperties.Compute(rectTemp.ToNurbsCurve()).Area;

        //vector = new Vector3d(0, 0, temp);


        rectTemp.Transform(Rhino.Geometry.Transform.Translation(0, 0, temp));
        listaRect.Add(rectTemp, path);
        move += temp;
        vectorList.Add(new Vector3d(0, 0, move), path);
        temp = 0;

        if (areaR * 1.025 >= areaTotal && areaR * 0.975 <= areaTotal) break;

      }

      maxIter -= diff;

      move = 0;

      if (areaR * 1.025 >= areaTotal && areaR * 0.975 <= areaTotal) break;

    }

    A = listaRect;
    B = vectorList;
    //Print(areaR.ToString());
# ---------- end customgeoplacement ----------
area_8 = Area(Geometry=customgeoplacement.A)  # -> Area, Centroid
reverse_list = ReverseList(List=area_8.Centroid)
list_item_10 = ListItem(List=reverse_list, Index=0, Wrap=True)
deconstruct = Deconstruct(Point=list_item_10)  # -> XComponent, YComponent, ZComponent

# ---- group: definicionTorres / aislamiento
number_4 = Number(deconstruct.ZComponent)
division_12 = Division(A=number_4, B=Slider(5, range=0..5))

# ---- group: ExcelWriter / PisosXTorre
int = Integer(customgeoplacement.B)  # disabled
lng = ListLength(List=int)  # disabled

# ---- group: ExcelWriter / AislamientoMinimoEntreTorres
num_3 = Number(division_12)  # disabled

# ---- group: outputBase
list_item_11 = ListItem(List=customgeoplacement.A, Index=0, Wrap=True)
geometry_6 = Geometry(customgeoplacement.A)

# ---- group: definicionTorres (continued)
offset_curve = OffsetCurve(Curve=list_item_11, Distance=division_12, Plane=PlaneXY(0, 0, 0), Corners=1)
panel_24 = Panel(division_12)
cross_reference = CrossReference(ListListA=flatten(offset_curve), ListListB=flatten(offset_curve), CrossMode=5)  # -> ListListA, ListListB
geometry_7 = Geometry(graft(cross_reference.ListListA))
geometry_8 = Geometry(graft(cross_reference.ListListB))
geometry_9 = Geometry([geometry_7, geometry_8])
list_item_12 = ListItem(List=geometry_9, Index=0, Wrap=True)  # -> Item, Item1
region_intersection = RegionIntersection(CurvesA=list_item_12.Item, CurvesB=list_item_12.Item1)
curve_curve = CurveCurve(CurveA=list_item_12.Item, CurveB=list_item_12.Item1)  # -> Points, ParamsA, ParamsB

# ----
area_9 = Area(Geometry=list_item_11)  # -> Area, Centroid
offset_curve_2 = OffsetCurve(Curve=list_item_11, Distance=division_12, Plane=PlaneXY(0, 0, 0), Corners=1)

# ---- group: intersections
surface = Surface(region_intersection)

# ---- group: topology
cross_reference_2 = CrossReference(ListListA=flatten(list_item_11), ListListB=flatten(list_item_11), CrossMode=2)  # -> ListListA, ListListB
geometry_10 = Geometry(graft(cross_reference_2.ListListB))
geometry_11 = Geometry(graft(cross_reference_2.ListListA))
geometry_12 = Geometry([geometry_11, geometry_10])
area_10 = Area(Geometry=geometry_12)  # -> Area, Centroid
list_item_13 = ListItem(List=area_10.Centroid, Index=0, Wrap=True)  # -> Item, Item1
line_2 = Line(StartPoint=list_item_13.Item, EndPoint=list_item_13.Item1)

# ----
brep_edges = BrepEdges(Brep=list_item_11)  # -> Naked, Interior, NonManifold
brep_edges_2 = BrepEdges(Brep=offset_curve_2)  # -> Naked, Interior, NonManifold

# ---- group: areaTotalConstruida
move_4 = Move(Geometry=list_item_11, Motion=customgeoplacement.B)  # -> Geometry, Transform
list_length_2 = ListLength(List=move_4.Geometry)
subtraction = Subtraction(A=list_length_2, B=1)
cull_index = CullIndex(List=move_4.Geometry, Indices=subtraction, Wrap=True)
area_11 = Area(Geometry=cull_index)  # -> Area, Centroid
mass_addition_2 = MassAddition(Input=flatten(area_11.Area))  # -> Result, PartialResults
areatotalvendible = Panel(mass_addition_2.Result)

# ---- group: outputBase (continued)
loft = Loft(Curves=move_4.Geometry, Options={Adjust=False, Closed=False, LoftEnds=0, LoftSimp=0, LoftType=0, Rebuild=10, Refit=0.01})

# ----
cap_holes = CapHoles(Brep=loft)
custom_preview_2 = CustomPreview(Geometry=cap_holes, Material=ColourSwatch(SwatchColor=RGBA(49, 101, 158, 103)))
point_on_curve = PointOnCurve(brep_edges.Naked, parameter=0.5)
point_on_curve_2 = PointOnCurve(brep_edges_2.Naked, parameter=0.5)
point_3 = Point(point_on_curve)
point_4 = Point(point_on_curve_2)

# ---- group: Heights
lng_2 = ListLength(List=move_4.Geometry)
subtraction_2 = Subtraction(A=lng_2, B=1)
item = ListItem(List=move_4.Geometry, Index=subtraction_2, Wrap=True)
area_12 = Area(Geometry=item, UseTasks=False)  # -> Area, Centroid
pdecon = Deconstruct(Point=area_12.Centroid)  # -> XComponent, YComponent, ZComponent
pt = ConstructPoint(XCoordinate=pdecon.XComponent, YCoordinate=pdecon.YComponent, ZCoordinate=0)
vec2pt = Vector2Pt(PointA=pt, PointB=area_12.Centroid, Unitize=False)  # -> Vector, Length
vdis = VectorDisplay(Anchor=pt, Vector=vec2pt.Vector)

# ----
list_item_14 = ListItem(List=point_3, Index=0, Wrap=True)  # -> Item, Item1, Item2, Item3
point_list_2 = PointList(Points=point_4, Size=Slider(1, range=0..1))
list_item_15 = ListItem(List=point_4, Index=0, Wrap=True)  # -> Item, Item1, Item2, Item3
line_3 = Line(StartPoint=list_item_14.Item1, EndPoint=list_item_14.Item3)

# ---- group: prueba2Perimetro
discontinuity_3 = Discontinuity(Curve=list_item_11, Level=1)  # -> Points, Parameters
point_in_curve = PointInCurve(Point=discontinuity_3.Points, Curve=curve)  # -> Relationship, Point
expression_3 = Expression(x=point_in_curve.Relationship, Expression="If(x=2, True, False)")
dispatch = Dispatch(List=point_in_curve.Point, DispatchPattern=expression_3)  # -> ListA, ListB
curve_5 = Curve(list_item_11)
point_5 = Point(dispatch.ListB)
list_item_16 = ListItem(List=flatten(point_5), Index=0, Wrap=True)
curve_closest_point = CurveClosestPoint(Point=list_item_16, Curve=curve)  # -> Point, Parameter, Distance
collision_one_many = CollisionOneMany(Collider=curve, Obstacles=curve_5)  # -> Collision, Index
expression_4 = Expression(x=collision_one_many.Collision, Expression="If(x=True, False, True)")
vector_2pt_5 = Vector2Pt(PointA=list_item_16, PointB=curve_closest_point.Point, Unitize=False)  # -> Vector, Length
dispatch_2 = Dispatch(List=flatten(list_item_11), DispatchPattern=flatten(collision_one_many.Collision))  # -> ListA, ListB
dispatch_3 = Dispatch(List=flatten(list_item_11), DispatchPattern=flatten(expression_4))  # -> ListA, ListB
move_5 = Move(Geometry=dispatch_2.ListA, Motion=vector_2pt_5.Vector)  # -> Geometry, Transform
merge_3 = Merge(Data1=move_5.Geometry, Data2=dispatch_3.ListA)  # -> graft(Result)

# ----
line_4 = Line(StartPoint=list_item_14.Item, EndPoint=list_item_14.Item2)
line_line = LineLine(LineA=line_3, LineB=line_4)
vector_2pt_6 = Vector2Pt(PointA=line_line, PointB=area_9.Centroid, Unitize=False)  # -> Vector, Length
move_6 = Move(Geometry=line_line, Motion=vector_2pt_6.Vector)  # -> Geometry, Transform
line_5 = Line(StartPoint=list_item_15.Item1, EndPoint=list_item_15.Item3)
line_6 = Line(StartPoint=list_item_15.Item, EndPoint=list_item_15.Item2)
discontinuity_4 = Discontinuity(Curve=merge_3, Level=1)  # -> flatten(Points), Parameters
length = Length(Curve=line_4)
length_2 = Length(Curve=line_3)
length_3 = Length(Curve=line_5)
length_4 = Length(Curve=line_6)
# ladosLargos porcentaje escala
expression_5 = Expression(a=length_2, b=length_3, Expression="(1.5/b)+1")
# ladosCortos porcentaje escala
expression_6 = Expression(a=length, b=length_4, Expression="((100*b)/a)*0.01")
scale_nu = ScaleNU(Geometry=list_item_11, Plane=move_6.Geometry, ScaleX=expression_5, ScaleY=expression_6, ScaleZ=1)  # -> Geometry, Transform
panel_25 = Panel(expression_6)
panel_26 = Panel(expression_5)

# ---- group: calculoParqueaderos / numUnidades (continued)
number_5 = Number(mass_addition_2.Result)
division_13 = Division(A=number_5, B=number_3)
round = Round(Number=division_13)  # -> Nearest, Floor, Ceiling

# ---- group: calculoParqueaderos
alturaedificio = Slider(6, range=4..8)
division_14 = Division(A=round.Nearest, B=Slider(2, range=0..10))
division_15 = Division(A=round.Nearest, B=Slider(30, range=0..30))
division_16 = Division(A=round.Nearest, B=Slider(10, range=0..10))
parqprivados = Panel(division_14)
parqvisitantes = Panel(division_16)
parqmovreducida = Panel(division_15)
division_17 = Division(A=parqprivados, B=alturaedificio)
division_18 = Division(A=parqvisitantes, B=alturaedificio)
division_19 = Division(A=parqmovreducida, B=alturaedificio)
mass_addition_3 = MassAddition(Input=[division_14, division_16, parqmovreducida])  # -> Result, PartialResults
round_2 = Round(Number=division_17)  # -> Nearest, Floor, Ceiling
round_3 = Round(Number=division_18)  # -> Nearest, Floor, Ceiling
round_4 = Round(Number=division_19)  # -> Nearest, Floor, Ceiling
panel_27 = Panel(round_3.Floor)
panel_28 = Panel(round_2.Floor)
panel_29 = Panel(round_4.Floor)
round_5 = Round(Number=mass_addition_3.Result)  # -> Nearest, Floor, Ceiling
anchomovilidadreducida = Slider(3.1, range=0..3.1)
number_slider_13 = Slider(4, range=0..10)
anchoparqueo = Slider(2.3, range=0..2.5)
mass_addition_4 = MassAddition(Input=[round_2.Nearest, round_3.Nearest])  # -> Result, PartialResults
panel_30 = Panel(mass_addition_4.Result)
division_20 = Division(A=mass_addition_4.Result, B=number_slider_13)
division_21 = Division(A=round_4.Nearest, B=number_slider_13)
multiplication_10 = Multiplication(A=division_20, B=anchoparqueo)
multiplication_11 = Multiplication(A=division_21, B=anchomovilidadreducida)
addition_2 = Addition(A=multiplication_10, B=multiplication_11)
multiplication_12 = Multiplication(A=Slider(4.3, range=0..10), B=number_slider_13)
multiplication_13 = Multiplication(A=Slider(5, range=0..10), B=number_slider_13)
addition_3 = Addition(A=multiplication_12, B=multiplication_13)

# ---- group: bloqueParqueaderos
rectangle_2 = Rectangle(Plane=area.Centroid, XSize=addition_2, YSize=addition_3, Radius=0)  # -> Rectangle, Length

# input: módulo parqueaderos x piso, doble crujía, doble circulación paralela
number_slider_14 = Slider(0.56, range=0..0.7)
curve_6 = Curve(rectangle_2.Rectangle)
evaluate_curve_2 = EvaluateCurve(Curve=reparameterize(curve_2), Parameter=number_slider_14)  # -> Point, Tangent, Angle
plane_3 = Plane(curve_6)
rotate_2 = Rotate(Geometry=curve_6, Angle=c_script, Plane=plane_3)  # -> Geometry, Transform
area_13 = Area(Geometry=geometry_2)  # -> Area, Centroid
area_14 = Area(Geometry=rotate_2.Geometry)  # -> Area, Centroid
subtraction_3 = Subtraction(A=area_13.Centroid, B=area_14.Centroid)
move_7 = Move(Geometry=rotate_2.Geometry, Motion=subtraction_3)  # -> Geometry, Transform
panel_31 = Panel(move_7.Geometry)
discontinuity_5 = Discontinuity(Curve=move_7.Geometry, Level=1)  # -> Points, Parameters
deconstruct_2 = Deconstruct(Point=discontinuity_5.Points)  # -> XComponent, YComponent, ZComponent
multiplication_14 = Multiplication(A=deconstruct_2.XComponent, B=10000)
addition_4 = Addition(A=deconstruct_2.YComponent, B=multiplication_14)
sort_list = SortList(Keys=addition_4, ValuesValuesA=discontinuity_5.Points)  # -> Keys, ValuesValuesA
list_item_17 = ListItem(List=sort_list.ValuesValuesA, Index=Slider(3, range=0..3), Wrap=True)
vector_2pt_7 = Vector2Pt(PointA=list_item_17, PointB=evaluate_curve_2.Point, Unitize=False)  # -> flatten(Vector), Length
multiplication_15 = Multiplication(A=vector_2pt_7.Vector, B=Slider(0.95, range=0..1))
move_8 = Move(Geometry=move_7.Geometry, Motion=multiplication_15)  # -> Geometry, Transform

# ---- group: estudioParqueadero
vector_length = VectorLength(Vector=list_item_9.Item2)
discontinuity_6 = Discontinuity(Curve=rectangle.Rectangle, Level=1)  # -> Points, Parameters
multiplication_16 = Multiplication(A=vector_length, B=2)
division_22 = Division(A=multiplication_16, B=number_slider_9)
list_item_18 = ListItem(List=discontinuity_6.Points, Index=0, Wrap=True)  # -> Item, Item1, Item2, Item3
round_6 = Round(Number=division_22)  # -> Nearest, Floor, Ceiling
vector_2pt_8 = Vector2Pt(PointA=list_item_18.Item, PointB=list_item_18.Item3, Unitize=False)  # -> Vector, Length
moduloparqueos = Slider(60, range=0..100)
vector_display_7 = VectorDisplay(Anchor=list_item_18.Item, Vector=vector_2pt_8.Vector)
linear_array = LinearArray(Geometry=merge, Direction=vector_2pt_8.Vector, Count=round_6.Nearest)  # -> Geometry, Transform
division_23 = Division(A=round_5.Nearest, B=moduloparqueos)
bounding_box = BoundingBox(Content=flatten(linear_array.Geometry), Plane=PlaneXY(0, 0, 0), UnionBox=True)  # -> Box, Box_2
panel_32 = Panel(division_23)
brep_wireframe = BrepWireframe(Brep=bounding_box.Box, Density=-1)
curve_7 = Curve(brep_wireframe)

# ---- group: selectorGeometríaParqueo
multiplication_17 = Multiplication(A=number_slider_13, B=number_slider_12)
unit_z = UnitZ(Factor=multiplication_17)
item_selector = ItemSelector(move_8.Geometry, {"Polyline Curve"}, selected="Polyline Curve")
move_9 = Move(Geometry=item_selector, Motion=unit_z)  # -> Geometry, Transform
loft_2 = Loft(
    Curves=[move_9.Geometry, item_selector],
    Options={Adjust=False, Closed=False, LoftEnds=0, LoftSimp=0, LoftType=0, Rebuild=10, Refit=0.01})
cap_holes_2 = CapHoles(Brep=loft_2)
custom_preview_3 = CustomPreview(Geometry=cap_holes_2, Material=ColourSwatch(SwatchColor=RGBA(228, 95, 57, 154)))

# ----
discontinuity_7 = Discontinuity(Curve=item_selector, Level=1)  # -> flatten(Points), Parameters

# ---- group: equipamientoComunal
brep_edges_3 = BrepEdges(Brep=item_selector)  # -> graft(Naked), Interior, NonManifold
evaluate_curve_3 = EvaluateCurve(Curve=reparameterize(item_selector), Parameter=Slider(0.15, range=0..1))  # -> Point, Tangent, Angle
area_15 = Area(Geometry=item_selector)  # -> Area, Centroid
porcentaje = Slider(0.15, range=0..1)
radians_2 = Radians(Degrees=Slider(90, range=0..100))
multiplication_18 = Multiplication(A=mass_addition_2.Result, B=porcentaje)
line_pt_2 = LinePt(Line=brep_edges_3.Naked, Point=area_15.Centroid)
m2 = Slider(80, range=0..150)
m2_2 = Slider(15, range=0..100)
rotate_plane = RotatePlane(Plane=line_pt_2, Angle=radians_2)  # -> flatten(Plane)
division_24 = Division(A=multiplication_18, B=m2)
numpisos = Slider(2, range=0..2)
number_slider_15 = Slider(1, range=0..3)
multiplication_19 = Multiplication(A=division_24, B=m2_2)
division_25 = Division(A=multiplication_19, B=3)
division_26 = Division(A=division_25, B=numpisos)
square_root = SquareRoot(Value=division_26)
rectangle_3 = Rectangle(Plane=rotate_plane, XSize=square_root, YSize=square_root, Radius=0)  # -> Rectangle, Length
curve_8 = Curve(rectangle_3.Rectangle)
panel_33 = Panel(division_25)
list_item_19 = ListItem(List=curve_8, Index=number_slider_15, Wrap=True)
multiplication_20 = Multiplication(A=numpisos, B=number_slider_12)
panel_34 = Panel(list_item_19)
unit_z_2 = UnitZ(Factor=multiplication_20)
move_10 = Move(Geometry=list_item_19, Motion=unit_z_2)  # -> Geometry, Transform
loft_3 = Loft(
    Curves=[list_item_19, move_10.Geometry],
    Options={Adjust=False, Closed=False, LoftEnds=0, LoftSimp=0, LoftType=0, Rebuild=10, Refit=0.01})
cap_holes_3 = CapHoles(Brep=loft_3)
custom_preview_4 = CustomPreview(Geometry=cap_holes_3, Material=ColourSwatch(SwatchColor=RGBA(107, 80, 162, 138)))

# ----
discontinuity_8 = Discontinuity(Curve=list_item_19, Level=1)  # -> flatten(Points), Parameters
convex_hull = ConvexHull(Points=[discontinuity_4.Points, discontinuity_7.Points, discontinuity_8.Points], Plane=PlaneXY(0, 0, 0))  # -> Hull, HullZ, Indices
area_16 = Area(Geometry=convex_hull.Hull, UseTasks=False)  # -> Area, Centroid
region_union = RegionUnion(Curves=[move_8.Geometry, list_item_19])

# ---- group: areaTotalOcupacion / parqueaderos
# índice de ocupación
curve_9 = Curve(item_selector)

# ---- group: areaTotalOcupacion / equipamientoComunal
curve_10 = Curve(list_item_19)

# ---- group: areaTotalOcupacion / edificios
curve_11 = Curve(merge_3)

# ----
multiplication_21 = Multiplication(A=multiplication_17, B=Slider(0.2, range=0..1))
curve_12 = Curve(flatten([list_item_11, region_union]))

# ---- group: fitnessFunction
# Índice de Construcción
mass_addition_5 = MassAddition(TotalÁreaConstruida=mass_addition_2.Result)  # -> Result, PartialResults
max = Slider(5.36, range=0..6)
min = Slider(5, range=0..10)
expression_7 = Expression(x=mass_addition_5.Result, y=area.Area, Expression="x/y")
expression_8 = Expression(x=expression_7, y=max, z=min, Expression="If( ( x ≤ y ) and ( x ≥ z ), 0, 10000 )")
panel_35 = Panel(expression_7)

# ---- group: convexHull
expression_9 = Expression(x=area.Area, y=area_16.Area, Expression="If( x > y, 0, 10000 )")  # disabled
panel_36 = Panel(expression_9)  # disabled

# ----
offset = OffsetCurve(Curve=region_union, Distance=multiplication_21, Plane=PlaneXY(0, 0, 0), Corners=1)
discontinuity_9 = Discontinuity(Curve=curve_12, Level=1)  # -> flatten(Points), Parameters
convex_hull_2 = ConvexHull(Points=discontinuity_9.Points, Plane=PlaneXY(0, 0, 0))  # -> Hull, HullZ, Indices
region_difference = RegionDifference(CurvesA=convex_hull_2.Hull, CurvesB=geometry_2)
list_length_3 = ListLength(List=region_difference)
panel_37 = Panel(expression_8)
expression_10 = Expression(x=list_length_3, Expression="If( x ≠ 0, 10000, 0 )")

# ---- group: ExcelWriter / ParqueaderosVisitantes
round_7 = Round(Number=division_16)  # -> Nearest, Floor, Ceiling; disabled

# ---- group: ExcelWriter / ParqueaderosMovilidadReducida
round_8 = Round(Number=division_15)  # -> Nearest, Floor, Ceiling; disabled

# ---- group: ExcelWriter / ÁreaComunal
area_17 = Area(Geometry=list_item_19, UseTasks=False)  # -> Area, Centroid; disabled

# ---- group: ExcelWriter / I.C.
num_4 = Number(expression_7)  # disabled

# ---- group: ExcelWriter / ParqueaderosPrivados
int_2 = Integer(round_2.Nearest)  # disabled

# ---- group: ExcelWriter / NúmeroPisosParqueadero
int_3 = Integer(number_slider_13)  # disabled

# ---- group: ExcelWriter / AptosXTorre
ma = MassAddition(Input=area_11.Area)  # -> Result, PartialResults; disabled
division_27 = Division(A=ma.Result, B=number_slider)  # disabled
round_9 = Round(Number=division_27)  # -> Nearest, Floor, Ceiling; disabled

# ---- group: ExcelWriter / RelaciónParqueaderos/Aptos
ma_2 = MassAddition(Input=flatten(round_9.Nearest))  # -> Result, PartialResults; disabled
division_28 = Division(A=int_2, B=ma_2.Result)  # disabled

# ---- group: ExcelWriter / RelaciónParqueaderos/Visitantes
ma_3 = MassAddition(Input=flatten(round_9.Nearest))  # -> Result, PartialResults; disabled
division_29 = Division(A=round_7.Nearest, B=ma_3.Result)  # disabled

# ---- group: ExcelWriter / NúmeroTotalAptos
int_4 = Integer(ma_3.Result)  # disabled

# ----
# colisiones
data = Data(flatten(merge_3))  # disabled
curve_13 = Curve(flatten([scale_nu.Geometry, offset]))
curve_14 = Curve([curve_12, geometry_2])
curve_15 = Curve(curve_12)  # disabled
collision_many_many = CollisionManyMany(Colliders=curve_13)  # -> Collision, Indices; disabled
collision_many_many_2 = CollisionManyMany(Colliders=curve_14)  # -> Collision, Indices
pararunion = ParallelRegionUnion(Curves=curve_15)  # -> flatten(Result); disabled
number_slider_16 = Slider(1000, range=0..1000)  # disabled
lng_3 = ListLength(List=pararunion)  # disabled
area_18 = Area(Geometry=curve_15, UseTasks=False)  # -> Area, Centroid; disabled
area_19 = Area(Geometry=pararunion, UseTasks=False)  # -> Area, Centroid; disabled
lng_4 = ListLength(List=curve_15)  # disabled
expression_11 = Expression(x=lng_4, y=lng_3, Expression="If( x ≠ y, y, 0 )")  # disabled
ma_4 = MassAddition(Input=area_18.Area)  # -> Result, PartialResults; disabled
ma_5 = MassAddition(Input=area_19.Area)  # -> Result, PartialResults; disabled
number_slider_17 = Slider(1000, range=0..1000)  # disabled
expression_12 = Expression(x=ma_4.Result, y=ma_5.Result, Expression="If( ( x - y ) > 1.0, 10000, 0 ) ")  # disabled
multiplication_22 = Multiplication(A=expression_11, B=number_slider_17)  # disabled

area_20 = Area(Geometry=curve_13)  # -> Area, Centroid
spctopo = SpaceTopology(Curves=curve_13)
linetopo = LineTopology(PointTree=graft(area_20.Centroid), Topology=spctopo)
crossref = CrossReference(ListA=curve_15, ListB=curve_15, CrossMode=7)  # -> graft(ListA), graft(ListB); disabled
len = Length(Curve=linetopo)
crvprox = CurveProximity(CurveA=crossref.ListA, CurveB=crossref.ListB)  # -> PointA, PointB, Distance; disabled
panel_38 = Panel(len)
lng_5 = ListLength(List=flatten(len))
multiplication_23 = Multiplication(A=collision_many_many.Collision, B=number_slider_11)  # disabled
panel_39 = Panel(crvprox.Distance)  # disabled
multiplication_24 = Multiplication(A=collision_many_many_2.Collision, B=number_slider_11)
ln = Line(StartPoint=crvprox.PointA, EndPoint=crvprox.PointB)  # disabled
panel_40 = Panel(lng_5)
multiplication_25 = Multiplication(A=lng_5, B=Slider(3000, range=0..10000))

mass_addition_6 = MassAddition(Input=flatten([multiplication_23, multiplication_24]))  # -> Result, PartialResults
panel_41 = Panel(mass_addition_6.Result)  # disabled

# ---- group: areaTotalOcupacion
area_21 = Area(Geometry=curve_9)  # -> Area, Centroid
area_22 = Area(Geometry=curve_10)  # -> Area, Centroid
area_23 = Area(Geometry=curve_11)  # -> Area, Centroid
area_24 = Area(Geometry=curve_3)  # -> Area, Centroid
merge_4 = Merge(Data1=area_21.Area, Data2=area_22.Area, Data3=flatten(area_23.Area))
area_25 = Area(Geometry=curve_3)  # -> Area, Centroid
replace_nulls = ReplaceNulls(Items=merge_4, Replacements=Slider(0, range=0..100))  # -> Items, Count
mass_addition_7 = MassAddition(Input=replace_nulls.Items)  # -> Result, PartialResults
panel_42 = Panel(area_25.Area)
panel_43 = Panel(mass_addition_7.Result)
i_o_norma = Slider(0.65, range=0..1)
i_o_norma_2 = Slider(0.7, range=0..1)

# ----
division_30 = Division(A=mass_addition_7.Result, B=area_25.Area)

# ---- group: areaTotalOcupacion (continued)
i_o = Panel(division_30)
expression_13 = Expression(x=division_30, y=i_o_norma, z=i_o_norma_2, Expression="If( ( x ≥ y ) and ( x ≤ z ), 0, 1000 )")

# ----
panel_44 = Panel(expression_13)
data_2 = Data(flatten([expression_8, expression_9, mass_addition_6.Result, expression_13, expression_10, multiplication_22, multiplication_25]))
mass_addition_8 = MassAddition(Input=data_2)  # -> Result, PartialResults
panel_45 = Panel(mass_addition_8.Result)

# ---- group: ExcelWriter / I.O.
num_5 = Number(division_30)  # disabled

# ---- group: ExcelWriter
merge_5 = Merge(
    Data1=num,
    Data2=num_2,
    Data3=num_4,
    Data4=num_5,
    Data5=int_4,
    Data6=int_2,
    Data7=round_7.Nearest,
    Data8=round_8.Nearest,
    Data9=int_3,
    Data10=division_28,
    Data11=division_29,
    Data12=area_17.Area,
    Data13=multiplication_21)  # disabled
panel_46 = Panel("""Área bruta m2
Área neta urbanizable m2
I.C.
I.O.
Número total aptos.
Parqueaderos privados
Parqueaderos visitantes
Parqueaderos movilidad reducida
Número pisos parqueadero
Relación parqueadero/aptos.
Relación parqueadero/visitantes
Área equipamiento comunal m2
Aislamientos comunal m""")  # disabled
panel_47 = Panel(list_item_11)  # disabled
anchoslargos = CSharpScript(plantas=list_item_11)  # -> ancho, largo; inputs plantas: tree of Rectangle3d; disabled
# ---------- anchoslargos: C# ----------
    DataTree<double> anchosOut = new DataTree<double>(), largosOut = new DataTree<double>();

    Rectangle3d temp = new Rectangle3d();

    GH_Path path = new GH_Path();

    for( int i = 0; i < plantas.BranchCount; ++i )
    {

      path = plantas.Path(i);

      for( int j = 0; j < plantas.Branch(i).Count; ++j )
      {

        temp = plantas.Branch(i)[j];
        
        anchosOut.Add(temp.Width, path);
        largosOut.Add(temp.Height, path);

      }

    }

    ancho = anchosOut;
    largo = largosOut;
# ---------- end anchoslargos ----------
panel_48 = Panel(anchoslargos.largo)  # disabled
data_3 = Data(merge_5)  # disabled
panel_49 = Panel("""Ancho m
Largo m
Pisos
Aislamientos m
Aptos
Altura m""")  # disabled
button = Button()  # disabled
c_script_2 = CSharpScript(
    x=data_3,
    y=flatten(anchoslargos.ancho),
    z=flatten(anchoslargos.largo),
    u=flatten(lng),
    v=flatten(num_3),
    w=flatten(round_9.Nearest),
    xx=flatten(vec2pt.Length))  # -> out, A; inputs x: list, y: list, z: list, u: list, v: list, w: list, xx: list; disabled
# ---------- c_script_2: C# ----------
    var treeOut = new DataTree<object>();

    treeOut.AddRange(x, new GH_Path(0));

    for( int i = 0; i < x.Count; ++i )
    {

      treeOut.Add(null, new GH_Path(1));
      treeOut.Add(null, new GH_Path(2));
      treeOut.Add(null, new GH_Path(3));
      treeOut.Add(null, new GH_Path(4));
      treeOut.Add(null, new GH_Path(5));
      treeOut.Add(null, new GH_Path(6));

    }

    treeOut.AddRange(y, new GH_Path(1));
    treeOut.AddRange(z, new GH_Path(2));
    treeOut.AddRange(u, new GH_Path(3));
    treeOut.AddRange(v, new GH_Path(4));
    treeOut.AddRange(w, new GH_Path(5));
    treeOut.AddRange(xx, new GH_Path(6));

    A = treeOut;
# ---------- end c_script_2 ----------
toggle = BooleanToggle(False)  # disabled
lng_6 = ListLength(List=flatten(num_3))  # disabled
c_script_3 = CSharpScript(x=panel_46, y=lng_6)  # -> out, A; inputs x: list, y: Int32; disabled
# ---------- c_script_3: C# ----------
    for( int i = 1; i <= y; ++i )
    {

      string str = "Torre " + i.ToString();

      x.Add(str);

    }

    A = x;
# ---------- end c_script_3 ----------
writexl = WriteToExcel(
    Run=toggle,
    ExcelWorksheet="1",
    ColumnNames=panel_49,
    RowNames=c_script_3.A,
    WriteOptions="None",
    ColumnnsOrRows=False,
    DataToWriteIntoColumns=c_script_2.A)  # disabled
panel_50 = Panel(c_script_3.A)  # disabled
panel_51 = Panel(c_script_2.A)  # disabled
