# Grasshopper definition 19.07.03_Setting_005.gh (Grasshopper 1.0.7)
# plug-ins: SpacePartition, CORE.GH, Human, HAL [Data Utilities]

# ---- group: base / manzanas / manzana2
geometry = Geometry(<curve referenced from the Rhino model>)

# ---- group: base / manzanas / manzana1
geometry_2 = Geometry(<curve referenced from the Rhino model>)

# ---- group: base / manzanas / manzana3
geometry_3 = Geometry(<curve referenced from the Rhino model>)

# ---- group: base / manzanas / manzana4
geometry_4 = Geometry(<curve referenced from the Rhino model>)

# ---- group: loteUrbanizable
curve = Curve(geometry_4)

# ---- group: base / manzanas
area = Area(Geometry=geometry_2)  # -> Area, Centroid
area_2 = Area(Geometry=geometry)  # -> Area, Centroid
area_3 = Area(Geometry=geometry_3)  # -> Area, Centroid
area_4 = Area(Geometry=geometry_4)  # -> Area, Centroid
áreavendiblevivienda = Panel("37863.3")
áreavendiblevivienda_2 = Panel("43094.9")
áreavendiblevivienda_3 = Panel("40479.1")
panel = Panel(area_4.Area)
panel_2 = Panel(area_2.Area)
panel_3 = Panel(area_3.Area)
àreamanzana = Panel(area.Area)
áreavendiblevivienda_4 = Panel("40479.1")
division = Division(A=áreavendiblevivienda_4, B=àreamanzana)
division_2 = Division(A=áreavendiblevivienda, B=panel_2)
division_3 = Division(A=áreavendiblevivienda_2, B=panel_3)
division_4 = Division(A=áreavendiblevivienda_3, B=panel)
i_c = Panel(division)
i_c_2 = Panel(division_2)
i_c_3 = Panel(division_3)
i_c_4 = Panel(division_4)

# ---- group: loteAreaBruta / loteBruto
geometry_5 = Geometry(<curve referenced from the Rhino model>)

# ---- group: loteAreaBruta
scale = Scale(Geometry=geometry_5, Center=Point(0, 0, 0), Factor=Slider(3.74701, range=0..30))  # -> Geometry, Transform
discontinuity = Discontinuity(Curve=scale.Geometry, Level=1)  # -> Points, Parameters
list_item = ListItem(List=discontinuity.Points, Index=Slider(2, range=0..10), Wrap=True)
area_5 = Area(Geometry=scale.Geometry)  # -> Area, Centroid
point = Point(list_item)
áreabruta = Panel(area_5.Area)

# ---- group: planosPlantas
minpisos = Slider(5, range=0..100)
maxpisos = Slider(33, range=0..33)
gene_pool03 = GenePool(Decimals=0, Maximum=33, Minimum=5, Value=25)
construct_domain = ConstructDomain(DomainStart=minpisos, DomainEnd=maxpisos)
genepoolmodifier = GenePoolModifier(
    GeneList="Gene Pool03",
    Count=Slider(1, range=0..6),
    Domain=construct_domain,
    Randomize=Button(),
    PercentageOfRandomization=Slider(87.936, range=0..100))
panel_4 = Panel(genepoolmodifier)

# ----
number_slider = Slider(1.2, range=1..2)

# ---- group: manzana1
number = Number(áreavendiblevivienda_4)

# ---- group: manzana2
number_2 = Number(áreavendiblevivienda)

# ---- group: manzana3
number_3 = Number(áreavendiblevivienda_2)

# ---- group: manzana4
number_4 = Number(áreavendiblevivienda_3)

# ----
difstor = Slider(10, range=0..10)

# ---- group: definicionTorres / altura1eraTorre
list_item_2 = ListItem(List=gene_pool03, Index=0, Wrap=True)

# ---- group: definicionTorres / areaTotalVendible
number_5 = Number(number_4)

# ----
multiplication = Multiplication(A=number_5, B=1.05)
number_slider_2 = Slider(3, range=0..500)
number_slider_3 = Slider(2, range=0..10)

# ---- group: puntoReferenciaLote
number_slider_4 = Slider(12, range=0..20)

# ---- group: align / northOrientation / centroid
point_2 = Point(area.Centroid)

# ---- group: align / northOrientation
number_slider_5 = Slider(100, range=-100..100)
number_slider_6 = Slider(-100, range=-100..100)
unit_x = UnitX(Factor=[number_slider_5, number_slider_6])
unit_y = UnitY(Factor=[number_slider_5, number_slider_6])
move = Move(Geometry=point_2, Motion=unit_y)  # -> Geometry, Transform
move_2 = Move(Geometry=point_2, Motion=unit_x)  # -> Geometry, Transform
list_item_3 = ListItem(List=move_2.Geometry, Index=0, Wrap=True)
list_item_4 = ListItem(List=move.Geometry, Index=0, Wrap=True)
vector_2pt = Vector2Pt(PointA=point_2, PointB=list_item_3, Unitize=False)  # -> Vector, Length
vector_2pt_2 = Vector2Pt(PointA=point_2, PointB=list_item_4, Unitize=False)  # -> Vector, Length
vector_display = VectorDisplay(Anchor=point_2, Vector=vector_2pt.Vector)
vector_display_2 = VectorDisplay(Anchor=point_2, Vector=vector_2pt_2.Vector)

# ---- group: align
discontinuity_2 = Discontinuity(Curve=curve, Level=1)  # -> Points, Parameters
panel_5 = Panel(discontinuity_2.Points)
shift_list = ShiftList(List=discontinuity_2.Points, Shift=number_slider_4, Wrap=True)
list_item_5 = ListItem(List=shift_list, Index=Slider(1, range=0..1), Wrap=True)
list_item_6 = ListItem(List=shift_list, Index=Slider(0, range=0..100), Wrap=True)
list_item_7 = ListItem(List=shift_list, Index=Slider(6, range=0..100), Wrap=True)
point_list = PointList(Points=shift_list, Size=Slider(10, range=0..10))
line = Line(StartPoint=list_item_6, EndPoint=list_item_5)

# ---- group: manzana1
curve_2 = Curve(<curve referenced from the Rhino model>)

# ---- group: manzana2
curve_3 = Curve(<curve referenced from the Rhino model>)

# ---- group: manzana3
curve_4 = Curve(<curve referenced from the Rhino model>)

# ---- group: manzana4
curve_5 = Curve(<curve referenced from the Rhino model>)

# ---- group: referenciaViaAcceso
# curvaParqueadero
curve_6 = Curve(curve_5)

# ----
panel_6 = Panel(curve_6)

# ---- group: estudioParqueadero / unidadParqueo
number_slider_7 = Slider(2.3, range=0..10)
addition = Addition(A=Slider(4.3, range=0..10), B=Slider(2.5, range=0..10))
rectangle = Rectangle(Plane=PlaneXY(0, 0, 0), XSize=addition, YSize=number_slider_7, Radius=0)  # -> Rectangle, Length
area_6 = Area(Geometry=rectangle.Rectangle)  # -> Area, Centroid
mirror = Mirror(Geometry=rectangle.Rectangle, Plane=PlaneYZ(0, 0, 0))  # -> Geometry, Transform
areatotalparqueo_circl = Panel(area_6.Area)
merge = Merge(Data1=rectangle.Rectangle, Data2=mirror.Geometry)

# ----
radians = Radians(Degrees=expr("x*90", Slider(0, range=0..3)))

# ---- group: areaTotalOcupacion / manzana
curve_7 = Curve(curve)

# ----
max = Slider(30, range=0..30)
galapagos = Galapagos(fitness=expression_12, gene=[gene_pool04, number_slider_14, salida, alturaedificio, pointx, pointy])

# ---- group: ExcelWriter / ÁreaBruta
num = Number(area_5.Area)

# ---- group: ExcelWriter / ÁreaNetaUrbanizable
num_2 = Number(area.Area)

# ---- group: base / àrea_apto
numviviendas = Slider(616, range=0..1000)
number_slider_8 = Slider(65.5, range=60..70)
numviviendas_2 = Slider(572, range=0..1000)
number_slider_9 = Slider(60, range=60..70)
numviviendas_3 = Slider(660, range=0..1000)
number_slider_10 = Slider(60, range=60..70)
numviviendas_4 = Slider(616, range=0..1000)
number_slider_11 = Slider(60, range=60..70)
division_5 = Division(A=numviviendas_2, B=number_slider_9)
division_6 = Division(A=numviviendas, B=number_slider_8)
division_7 = Division(A=numviviendas_3, B=number_slider_10)
division_8 = Division(A=numviviendas_4, B=number_slider_11)
integer = Integer(division_6)
integer_2 = Integer(division_5)
integer_3 = Integer(division_7)
integer_4 = Integer(division_8)
panel_7 = Panel(integer_2)
panel_8 = Panel(integer_4)
panel_9 = Panel(integer_3)
numaptospiso = Panel(integer)

# ---- group: áreaTotalIdeal
multiplication_2 = Multiplication(A=numviviendas, B=number_slider_8)
panel_10 = Panel(multiplication_2)

# ----
multiplication_3 = Multiplication(A=number_slider_8, B=number_slider)
multiplication_4 = Multiplication(A=number_slider_9, B=number_slider)
multiplication_5 = Multiplication(A=number_slider_10, B=number_slider)
multiplication_6 = Multiplication(A=number_slider_11, B=number_slider)

# ---- group: base / àrea_apto (continued)
multiplication_7 = Multiplication(A=integer, B=multiplication_3)
multiplication_8 = Multiplication(A=integer_2, B=multiplication_4)
multiplication_9 = Multiplication(A=integer_4, B=multiplication_6)
multiplication_10 = Multiplication(A=integer_3, B=multiplication_5)
àrea_piso = Panel(multiplication_7)
panel_11 = Panel(multiplication_9)
panel_12 = Panel(multiplication_8)
panel_13 = Panel(multiplication_10)

# ---- group: manzana1
number_6 = Number(multiplication_7)

# ---- group: manzana2
number_7 = Number(multiplication_8)

# ---- group: manzana3
number_8 = Number(multiplication_10)

# ---- group: manzana4
number_9 = Number(multiplication_9)

# ---- group: definicionTorres
panel_14 = Panel(list_item_2)

# ---- group: towerNumber
construct_domain_2 = ConstructDomain(DomainStart=0, DomainEnd=1)
expression = Expression(area=number_9, Expression="sqrt(area/2)")
integer_5 = Integer(expression)
genepoolmodifier_2 = GenePoolModifier(
    GeneList="PointX",
    Count=number_slider_2,
    Domain=construct_domain_2,
    Randomize=Button(),
    PercentageOfRandomization=Slider(85, range=0..100))
genepoolmodifier_3 = GenePoolModifier(
    GeneList="PointY",
    Count=number_slider_2,
    Domain=construct_domain_2,
    Randomize=Button(),
    PercentageOfRandomization=Slider(85, range=0..100))
panel_15 = Panel(integer_5)
pointx = GenePool(Decimals=2, Maximum=1, Minimum=0, Value=[0.482195996, 0.5547416096, 0.2179368074])
pointy = GenePool(Decimals=2, Maximum=1, Minimum=0, Value=[0.2804855938, 0.827997419, 0.2993556956])
curve_8 = Curve(curve)
boundary_surfaces = BoundarySurfaces(Edges=curve_8)
construct_point = ConstructPoint(XCoordinate=pointx, YCoordinate=pointy, ZCoordinate=0)
custom_preview = CustomPreview(Geometry=boundary_surfaces, Material=ColourSwatch(SwatchColor=RGBA(241, 232, 210, 193)))

# ----
area_7 = Area(Geometry=boundary_surfaces)  # -> Area, Centroid
scale_2 = Scale(Geometry=boundary_surfaces, Center=area_7.Centroid, Factor=Slider(1, range=0..1))  # -> Geometry, Transform

# ---- group: towerNumber (continued)
evaluate_surface = EvaluateSurface(Surface=reparameterize(scale_2.Geometry), Point=construct_point)  # -> Point, Normal, UDirection, VDirection, Frame
surface_closest_point = SurfaceClosestPoint(Point=evaluate_surface.Point, Surface=scale_2.Geometry)  # -> Point, UVPoint, Distance
iso_curve = IsoCurve(Surface=boundary_surfaces, UVPoint=surface_closest_point.UVPoint)  # -> UIsocurve, VIsocurve

# ---- group: definicionTorres (continued)
multiplication_11 = Multiplication(A=integer_5, B=2)
division_9 = Division(A=integer_5, B=2)
division_10 = Division(A=multiplication_11, B=2)
multiplication_12 = Multiplication(A=division_9, B=-1)
multiplication_13 = Multiplication(A=division_10, B=-1)
construct_domain_3 = ConstructDomain(DomainStart=multiplication_12, DomainEnd=division_9)
construct_domain_4 = ConstructDomain(DomainStart=multiplication_13, DomainEnd=division_10)

# ----
domain = Domain(construct_domain_4)
domain_2 = Domain(construct_domain_3)

# ---- group: pisosAlturaMáxima / alturaTotal
mtstotal = Slider(80, range=0..80)

# ---- group: pisosAlturaMáxima
number_slider_12 = Slider(2.4, range=0..10)

# ---- group: definicionTorres / alturaEntrepiso
number_10 = Number(number_slider_12)

# ---- group: pisosAlturaMáxima / alturaTotal (continued)
division_11 = Division(A=mtstotal, B=number_slider_12)
integer_6 = Integer(division_11)
panel_16 = Panel(integer_6)

# ---- group: pisosAlturaMáxima (continued)
integer_7 = Integer(integer_6)
duplicate_data = DuplicateData(Data=number_slider_12, Number=integer_7, Order=True)
merge_2 = Merge(Data1=flatten(Slider(0, range=0..100)), Data2=flatten(duplicate_data))
mass_addition = MassAddition(Input=merge_2)  # -> Result, PartialResults
panel_17 = Panel(mass_addition.PartialResults)
panel_18 = Panel(mass_addition.Result)
construct_point_2 = ConstructPoint(XCoordinate=0, YCoordinate=0, ZCoordinate=mass_addition.PartialResults)
xy_plane = XYPlane(Origin=construct_point_2)  # -> graft(Plane)
panel_19 = Panel(xy_plane)

# ---- group: align / alignAllGeometry / orientacionPlanos
gene_pool04 = GenePool(Decimals=0, Maximum=3, Minimum=0, Value=[0, 0, 0])
construct_domain_5 = ConstructDomain(DomainStart=0, DomainEnd=3)

# ---- group: align / alignAllGeometry
line_pt = LinePt(Line=line, Point=list_item_7)
panel_20 = Panel("""0.0
0.5
1.0
1.5
2""")
expression_2 = Expression(x=panel_20, Expression="x*pi")
bounds = Bounds(Numbers=expression_2)
vector_2pt_3 = Vector2Pt(PointA=line_pt, PointB=point_2, Unitize=False)  # -> Vector, Length
circle = Circle(Plane=line_pt, Radius=Slider(47, range=0..100))
remap_numbers = RemapNumbers(Value=expression_2, Source=bounds, Target=Domain(0, 1))  # -> Mapped, Clipped
move_3 = Move(Geometry=circle, Motion=vector_2pt_3.Vector)  # -> Geometry, Transform
evaluate_curve = EvaluateCurve(Curve=reparameterize(move_3.Geometry), Parameter=remap_numbers.Mapped)  # -> Point, Tangent, Angle
panel_21 = Panel(remap_numbers.Mapped)
plane = Plane(surface_closest_point.Point)

# ----
vector_display_3 = VectorDisplay(Anchor=point_2, Vector=vector_2pt_3.Vector)
list_item_8 = ListItem(List=evaluate_curve.Point, Index=gene_pool04, Wrap=True)  # -> graft(Item)
list_length = ListLength(List=flatten(plane))

# ---- group: align / alignAllGeometry / orientacionPlanos (continued)
genepoolmodifier_4 = GenePoolModifier(
    GeneList="Gene Pool04",
    Count=list_length,
    Domain=construct_domain_5,
    Randomize=Button(),
    PercentageOfRandomization=Slider(80.059, range=0..100))
panel_22 = Panel(genepoolmodifier_4)

# ---- group: align / alignAllGeometry (continued)
vector_2pt_4 = Vector2Pt(PointA=point_2, PointB=list_item_8, Unitize=False)  # -> Vector, Length
align_plane = AlignPlane(Plane=plane, Direction=flatten(vector_2pt_4.Vector))  # -> Plane, Angle
vector_display_4 = VectorDisplay(Anchor=point_2, Vector=vector_2pt_4.Vector)
rotate = Rotate(Geometry=plane, Angle=align_plane.Angle, Plane=align_plane.Plane)  # -> simplify(Geometry), Transform
panel_23 = Panel(vector_2pt_4.Vector)

# ---- group: definicionTorres / planeIniciales
plane_2 = Plane(rotate.Geometry)

# ----
panel_24 = Panel(plane_2)
list_item_9 = ListItem(List=flatten(vector_2pt_4.Vector), Index=0, Wrap=True)  # -> Item, Item1, Item2
vector_display_5 = VectorDisplay(Anchor=point_2, Vector=list_item_9.Item)
vector_display_6 = VectorDisplay(Anchor=point_2, Vector=list_item_9.Item2)

# ---- group: definicionTorres (continued)
customgeoplacement = CSharpScript(diff=difstor, f=number_10, w=domain, h=domain_2, maxIter=list_item_2, areaTotal=multiplication, planes=flatten(plane_2))  # -> A, B; inputs diff: Int32, f: Double, maxIter: Int32, areaTotal: Double, planes: list of Plane
# ---------- customgeoplacement: C# ----------
    var listaRect = new DataTree<Rectangle3d>();
    double move = 0.0;
    var vectorList = new DataTree<Vector3d>();
    int size = planes.Count;
    Rectangle3d rectTemp = new Rectangle3d();
    double areaR = 0, temp = 0;

    for (int i = 0; i < size; ++i)
    {

      rectTemp = new Rectangle3d(planes[i], w, h);

      var path = new GH_Path(i);

      for (int j = 0; j <= maxIter; ++j)
      {

        if( j != 0 )

          temp += f;

        areaR += AreaMassProperties.Compute(rectTemp.ToNurbsCurve()).Area;

        //vector = new Vector3d(0, 0, temp);


        rectTemp.Transform(Rhino.Geometry.Transform.Translation(0, 0, temp));
        listaRect.Add(rectTemp, path);
        move += temp;
        vectorList.Add(new Vector3d(0, 0, move), path);
        temp = 0;

        if (areaR * 1.025 >= areaTotal && areaR * 0.975 <= areaTotal) break;

      }

      maxIter -= diff;

      move = 0;

      if (areaR * 1.025 >= areaTotal && areaR * 0.975 <= areaTotal) break;

    }

    A = listaRect;
    B = vectorList;
    //Print(areaR.ToString());
# ---------- end customgeoplacement ----------
area_8 = Area(Geometry=customgeoplacement.A)  # -> Area, Centroid
reverse_list = ReverseList(List=area_8.Centroid)
list_item_10 = ListItem(List=reverse_list, Index=0, Wrap=True)
deconstruct = Deconstruct(Point=list_item_10)  # -> XComponent, YComponent, ZComponent

# ---- group: definicionTorres / aislamiento
number_11 = Number(deconstruct.ZComponent)
division_12 = Division(A=number_11, B=Slider(5, range=0..5))

# ---- group: ExcelWriter / PisosXTorre
int = Integer(customgeoplacement.B)
lng = ListLength(List=int)

# ---- group: ExcelWriter / AislamientoMinimoEntreTorres
num_3 = Number(division_12)

# ---- group: outputBase
list_item_11 = ListItem(List=customgeoplacement.A, Index=0, Wrap=True)
geometry_6 = Geometry(customgeoplacement.A)

# ----
panel_26 = Panel(list_item_11)

# ---- group: definicionTorres (continued)
offset_curve = OffsetCurve(Curve=list_item_11, Distance=division_12, Plane=PlaneXY(0, 0, 0), Corners=1)
cross_reference = CrossReference(ListListA=flatten(offset_curve), ListListB=flatten(offset_curve), CrossMode=5)  # -> ListListA, ListListB
panel_27 = Panel(division_12)
geometry_7 = Geometry(graft(cross_reference.ListListA))
geometry_8 = Geometry(graft(cross_reference.ListListB))
geometry_9 = Geometry([geometry_7, geometry_8])
list_item_12 = ListItem(List=geometry_9, Index=0, Wrap=True)  # -> Item, Item1
region_intersection = RegionIntersection(CurvesA=list_item_12.Item, CurvesB=list_item_12.Item1)
curve_curve = CurveCurve(CurveA=list_item_12.Item, CurveB=list_item_12.Item1)  # -> Points, ParamsA, ParamsB

# ----
area_9 = Area(Geometry=list_item_11)  # -> Area, Centroid
offset_curve_2 = OffsetCurve(Curve=list_item_11, Distance=division_12, Plane=PlaneXY(0, 0, 0), Corners=1)

# ---- group: topology
cross_reference_2 = CrossReference(ListListA=flatten(list_item_11), ListListB=flatten(list_item_11), CrossMode=2)  # -> ListListA, ListListB
geometry_10 = Geometry(graft(cross_reference_2.ListListB))
geometry_11 = Geometry(graft(cross_reference_2.ListListA))
geometry_12 = Geometry([geometry_11, geometry_10])
area_10 = Area(Geometry=geometry_12)  # -> Area, Centroid
list_item_13 = ListItem(List=area_10.Centroid, Index=0, Wrap=True)  # -> Item, Item1
line_2 = Line(StartPoint=list_item_13.Item, EndPoint=list_item_13.Item1)

# ---- group: prueba2Perimetro
discontinuity_3 = Discontinuity(Curve=list_item_11, Level=1)  # -> Points, Parameters
edificios = Curve(list_item_11)
point_in_curve = PointInCurve(Point=discontinuity_3.Points, Curve=curve)  # -> Relationship, Point
collision_one_many = CollisionOneMany(Collider=curve, Obstacles=edificios)  # -> Collision, Index
expression_3 = Expression(x=point_in_curve.Relationship, Expression="If(x=2, True, False)")
dispatch = Dispatch(List=flatten(edificios), DispatchPattern=flatten(collision_one_many.Collision))  # -> ListA, ListB
dispatch_2 = Dispatch(List=point_in_curve.Point, DispatchPattern=expression_3)  # -> ListA, ListB
list_item_14 = ListItem(List=flatten(dispatch_2.ListB), Index=0, Wrap=True)
curve_closest_point = CurveClosestPoint(Point=list_item_14, Curve=curve)  # -> Point, Parameter, Distance
vector_2pt_5 = Vector2Pt(PointA=list_item_14, PointB=curve_closest_point.Point, Unitize=False)  # -> Vector, Length
move_4 = Move(Geometry=dispatch.ListA, Motion=vector_2pt_5.Vector)  # -> Geometry, Transform
merge_3 = Merge(Data1=move_4.Geometry, Data2=dispatch.ListB)  # -> graft(Result)

# ----
brep_edges = BrepEdges(Brep=list_item_11)  # -> Naked, Interior, NonManifold
brep_edges_2 = BrepEdges(Brep=offset_curve_2)  # -> Naked, Interior, NonManifold

# ---- group: areaTotalConstruida
move_5 = Move(Geometry=list_item_11, Motion=customgeoplacement.B)  # -> Geometry, Transform
list_length_2 = ListLength(List=move_5.Geometry)
subtraction = Subtraction(A=list_length_2, B=1)
cull_index = CullIndex(List=move_5.Geometry, Indices=subtraction, Wrap=True)
area_11 = Area(Geometry=cull_index)  # -> Area, Centroid
mass_addition_2 = MassAddition(Input=flatten(area_11.Area))  # -> Result, PartialResults
areatotalconstruida = Panel(mass_addition_2.Result)

# ---- group: outputBase (continued)
loft = Loft(Curves=move_5.Geometry, Options={Adjust=False, Closed=False, LoftEnds=0, LoftSimp=0, LoftType=0, Rebuild=10, Refit=0.01})

# ----
cap_holes = CapHoles(Brep=loft)
custom_preview_2 = CustomPreview(Geometry=cap_holes, Material=ColourSwatch(SwatchColor=RGBA(49, 101, 158, 103)))
point_on_curve = PointOnCurve(brep_edges.Naked, parameter=0.5)
point_on_curve_2 = PointOnCurve(brep_edges_2.Naked, parameter=0.5)
point_3 = Point(point_on_curve)
point_4 = Point(point_on_curve_2)

# ---- group: Heights
lng_2 = ListLength(List=move_5.Geometry)
subtraction_2 = Subtraction(A=lng_2, B=1)
item = ListItem(List=move_5.Geometry, Index=subtraction_2, Wrap=True)
area_12 = Area(Geometry=item, UseTasks=False)  # -> Area, Centroid
pdecon = Deconstruct(Point=area_12.Centroid)  # -> XComponent, YComponent, ZComponent
pt = ConstructPoint(XCoordinate=pdecon.XComponent, YCoordinate=pdecon.YComponent, ZCoordinate=0)
vec2pt = Vector2Pt(PointA=pt, PointB=area_12.Centroid, Unitize=False)  # -> Vector, Length
vdis = VectorDisplay(Anchor=pt, Vector=vec2pt.Vector)

# ----
list_item_15 = ListItem(List=point_3, Index=0, Wrap=True)  # -> Item, Item1, Item2, Item3
point_list_2 = PointList(Points=point_4, Size=Slider(1, range=0..1))
list_item_16 = ListItem(List=point_4, Index=0, Wrap=True)  # -> Item, Item1, Item2, Item3
line_3 = Line(StartPoint=list_item_15.Item1, EndPoint=list_item_15.Item3)
line_4 = Line(StartPoint=list_item_15.Item, EndPoint=list_item_15.Item2)
line_line = LineLine(LineA=line_3, LineB=line_4)
vector_2pt_6 = Vector2Pt(PointA=line_line, PointB=area_9.Centroid, Unitize=False)  # -> Vector, Length
move_6 = Move(Geometry=line_line, Motion=vector_2pt_6.Vector)  # -> Geometry, Transform
line_5 = Line(StartPoint=list_item_16.Item1, EndPoint=list_item_16.Item3)
line_6 = Line(StartPoint=list_item_16.Item, EndPoint=list_item_16.Item2)
length = Length(Curve=line_4)
length_2 = Length(Curve=line_3)
length_3 = Length(Curve=line_5)
length_4 = Length(Curve=line_6)
# ladosCortos porcentaje escala
expression_4 = Expression(a=length, b=length_4, Expression="((100*b)/a)*0.01")
# ladosLargos porcentaje escala
expression_5 = Expression(a=length_2, b=length_3, Expression="(1.5/b)+1")
scale_nu = ScaleNU(Geometry=list_item_11, Plane=move_6.Geometry, ScaleX=expression_5, ScaleY=expression_4, ScaleZ=1)  # -> Geometry, Transform
division_13 = Division(A=mass_addition_2.Result, B=Slider(1.2, range=1..2))
areatotalvendible = Panel(division_13)
panel_28 = Panel(expression_4)
panel_29 = Panel(expression_5)

# ---- group: calculoParqueaderos / numUnidades
number_12 = Number(mass_addition_2.Result)
number_13 = Number(number_slider_8)
division_14 = Division(A=number_12, B=number_13)
round = Round(Number=division_14)  # -> Nearest, Floor, Ceiling

# ----
panel_30 = Panel(brep_edges.Naked)

# ---- group: calculoParqueaderos
alturaedificio = Slider(7, range=4..8)
division_15 = Division(A=round.Nearest, B=Slider(2, range=0..10))
division_16 = Division(A=round.Nearest, B=Slider(30, range=0..30))
division_17 = Division(A=round.Nearest, B=Slider(10, range=0..10))
parqprivados = Panel(division_15)
parqvisitantes = Panel(division_17)
parqmovreducida = Panel(division_16)
division_18 = Division(A=parqprivados, B=alturaedificio)
division_19 = Division(A=parqvisitantes, B=alturaedificio)
division_20 = Division(A=parqmovreducida, B=alturaedificio)
mass_addition_3 = MassAddition(Input=[division_15, division_17, parqmovreducida])  # -> Result, PartialResults
round_2 = Round(Number=division_18)  # -> Nearest, Floor, Ceiling
round_3 = Round(Number=division_19)  # -> Nearest, Floor, Ceiling
round_4 = Round(Number=division_20)  # -> Nearest, Floor, Ceiling
always_even_odd = AlwaysEvenOdd(Integer=Slider(4, range=0..4), EvenOdd=Toggle(False))  # -> Integer, Corrected
panel_31 = Panel(round_3.Floor)
panel_32 = Panel(round_2.Floor)
panel_33 = Panel(round_4.Floor)
round_5 = Round(Number=mass_addition_3.Result)  # -> Nearest, Floor, Ceiling
anchoparqueo = Slider(2.3, range=0..2.5)
mass_addition_4 = MassAddition(Input=[round_2.Nearest, round_3.Nearest])  # -> Result, PartialResults
anchomovilidadreducida = Slider(3.1, range=0..3.1)
panel_34 = Panel(mass_addition_4.Result)
division_21 = Division(A=round_4.Nearest, B=always_even_odd.Integer)
division_22 = Division(A=mass_addition_4.Result, B=always_even_odd.Integer)
multiplication_14 = Multiplication(A=division_21, B=anchomovilidadreducida)
multiplication_15 = Multiplication(A=division_22, B=anchoparqueo)
multiplication_16 = Multiplication(A=Slider(4.3, range=0..10), B=always_even_odd.Integer)
multiplication_17 = Multiplication(A=Slider(5, range=0..10), B=always_even_odd.Integer)
addition_2 = Addition(A=multiplication_15, B=multiplication_14)
addition_3 = Addition(A=multiplication_16, B=multiplication_17)

# ---- group: bloqueParqueaderos
rectangle_2 = Rectangle(Plane=area.Centroid, XSize=addition_2, YSize=addition_3, Radius=0)  # -> Rectangle, Length

# ---- group: estudioParqueadero
vector_length = VectorLength(Vector=list_item_9.Item2)
discontinuity_4 = Discontinuity(Curve=rectangle.Rectangle, Level=1)  # -> Points, Parameters
multiplication_18 = Multiplication(A=vector_length, B=2)
division_23 = Division(A=multiplication_18, B=number_slider_7)
list_item_17 = ListItem(List=discontinuity_4.Points, Index=0, Wrap=True)  # -> Item, Item1, Item2, Item3
round_6 = Round(Number=division_23)  # -> Nearest, Floor, Ceiling
vector_2pt_7 = Vector2Pt(PointA=list_item_17.Item, PointB=list_item_17.Item3, Unitize=False)  # -> Vector, Length
moduloparqueos = Slider(60, range=0..100)
vector_display_7 = VectorDisplay(Anchor=list_item_17.Item, Vector=vector_2pt_7.Vector)
linear_array = LinearArray(Geometry=merge, Direction=vector_2pt_7.Vector, Count=round_6.Nearest)  # -> Geometry, Transform
division_24 = Division(A=round_5.Nearest, B=moduloparqueos)
bounding_box = BoundingBox(Content=flatten(linear_array.Geometry), Plane=PlaneXY(0, 0, 0), UnionBox=True)  # -> Box, Box_2
panel_35 = Panel(division_24)
brep_wireframe = BrepWireframe(Brep=bounding_box.Box, Density=-1)
curve_9 = Curve(brep_wireframe)

# ---- group: áreaConstruida
number_14 = Number(mass_addition_2.Result)

# ---- group: áreaVendible
number_15 = Number(division_13)

# ---- group: areaTotalOcupacion / edificios
curve_10 = Curve(merge_3)

# ----
# áreaVendible/áreaConstruida
number_slider_13 = Slider(100, range=0..100)
division_25 = Division(A=number_15, B=number_14)
multiplication_19 = Multiplication(A=division_25, B=number_slider_13)
round_7 = Round(Number=multiplication_19)  # -> Nearest, Floor, Ceiling
panel_36 = Panel(round_7.Nearest)
max_2 = Slider(10, range=0..30)
min = Slider(5, range=0..10)
subtraction_3 = Subtraction(A=max_2, B=min)
expression_6 = Expression(E=round_7.Nearest, max=max_2, min=min, x=subtraction_3, Expression="(E-90)/x")
panel_37 = Panel(expression_6)

# ---- group: fitnessFunction
# Índice de Construcción
mass_addition_5 = MassAddition(TotalÁreaConstruida=mass_addition_2.Result)  # -> Result, PartialResults
max_3 = Slider(5.32, range=0..6)
min_2 = Slider(5, range=0..10)
panel_38 = Panel(mass_addition_5.Result)
expression_7 = Expression(x=mass_addition_5.Result, y=area.Area, Expression="x/y")
expression_8 = Expression(A=expression_7, max=max_3, min=min_2, Expression="(A-5.30)/.35")
panel_39 = Panel(expression_7)
panel_40 = Panel(expression_8)

# ---- group: ExcelWriter / ParqueaderosVisitantes
round_8 = Round(Number=division_17)  # -> Nearest, Floor, Ceiling

# ---- group: ExcelWriter / ParqueaderosMovilidadReducida
round_9 = Round(Number=division_16)  # -> Nearest, Floor, Ceiling

# ---- group: ExcelWriter / I.C.
num_4 = Number(expression_7)

# ---- group: ExcelWriter / NúmeroPisosParqueadero
int_2 = Integer(always_even_odd.Integer)

# ---- group: ExcelWriter / ParqueaderosPrivados
int_3 = Integer(round_2.Nearest)

# ---- group: ExcelWriter / AptosXTorre
ma = MassAddition(Input=area_11.Area)  # -> Result, PartialResults
division_26 = Division(A=ma.Result, B=number_slider_8)
round_10 = Round(Number=division_26)  # -> Nearest, Floor, Ceiling

# ---- group: ExcelWriter / RelaciónParqueaderos/Aptos
ma_2 = MassAddition(Input=flatten(round_10.Nearest))  # -> Result, PartialResults
division_27 = Division(A=int_3, B=ma_2.Result)

# ---- group: ExcelWriter / RelaciónParqueaderos/Visitantes
ma_3 = MassAddition(Input=flatten(round_10.Nearest))  # -> Result, PartialResults
division_28 = Division(A=round_8.Nearest, B=ma_3.Result)

# ---- group: ExcelWriter / NúmeroTotalAptos
int_4 = Integer(ma_3.Result)

# ---- group: cnvexHull
discontinuity_5 = Discontinuity(Curve=merge_3, Level=1)  # -> flatten(Points), Parameters

# ---- group: equipamientoComunal
porcentaje = Slider(0.15, range=0..1)
radians_2 = Radians(Degrees=Slider(90, range=0..100))
multiplication_20 = Multiplication(A=mass_addition_2.Result, B=porcentaje)
m2 = Slider(80, range=0..150)
m2_2 = Slider(15, range=0..100)
division_29 = Division(A=multiplication_20, B=m2)
numpisos = Slider(2, range=0..2)
number_slider_14 = Slider(0, range=0..3)
multiplication_21 = Multiplication(A=division_29, B=m2_2)
division_30 = Division(A=multiplication_21, B=3)
division_31 = Division(A=division_30, B=numpisos)
square_root = SquareRoot(Value=division_31)
panel_41 = Panel(division_30)
multiplication_22 = Multiplication(A=numpisos, B=number_slider_12)
unit_z = UnitZ(Factor=multiplication_22)

# ---- group: bloqueParqueaderos
# input: módulo parqueaderos x piso, doble crujía, doble circulación paralela
salida = Slider(0.49, range=0..0.7)
curve_11 = Curve(rectangle_2.Rectangle)
evaluate_curve_2 = EvaluateCurve(Curve=reparameterize(curve_6), Parameter=salida)  # -> Point, Tangent, Angle
plane_3 = Plane(curve_11)
area_13 = Area(Geometry=curve)  # -> Area, Centroid

# ----
align_plane_2 = AlignPlane(Plane=plane_3, Direction=flatten(vector_2pt_4.Vector))  # -> Plane, Angle

# ---- group: bloqueParqueaderos (continued)
rotate_2 = Rotate(Geometry=curve_11, Angle=align_plane_2.Angle, Plane=align_plane_2.Plane)  # -> Geometry, Transform
area_14 = Area(Geometry=rotate_2.Geometry)  # -> Area, Centroid
subtraction_4 = Subtraction(A=area_13.Centroid, B=area_14.Centroid)
move_7 = Move(Geometry=rotate_2.Geometry, Motion=subtraction_4)  # -> Geometry, Transform
panel_42 = Panel(move_7.Geometry)
discontinuity_6 = Discontinuity(Curve=move_7.Geometry, Level=1)  # -> Points, Parameters
deconstruct_2 = Deconstruct(Point=discontinuity_6.Points)  # -> XComponent, YComponent, ZComponent
multiplication_23 = Multiplication(A=deconstruct_2.XComponent, B=10000)
addition_4 = Addition(A=deconstruct_2.YComponent, B=multiplication_23)
sort_list = SortList(Keys=addition_4, ValuesValuesA=discontinuity_6.Points)  # -> Keys, ValuesValuesA
list_item_18 = ListItem(List=sort_list.ValuesValuesA, Index=Slider(1, range=0..3), Wrap=True)
vector_2pt_8 = Vector2Pt(PointA=list_item_18, PointB=evaluate_curve_2.Point, Unitize=False)  # -> flatten(Vector), Length
multiplication_24 = Multiplication(A=vector_2pt_8.Vector, B=Slider(0.95, range=0..1))
move_8 = Move(Geometry=move_7.Geometry, Motion=multiplication_24)  # -> Geometry, Transform

# ---- group: selectorGeometríaParqueo
multiplication_25 = Multiplication(A=always_even_odd.Integer, B=number_slider_12)
unit_z_2 = UnitZ(Factor=multiplication_25)
item_selector = ItemSelector(move_8.Geometry, {"Polyline Curve", "Polyline Curve", "Polyline Curve"}, selected="Polyline Curve")
move_9 = Move(Geometry=item_selector, Motion=unit_z_2)  # -> Geometry, Transform
loft_2 = Loft(
    Curves=[move_9.Geometry, item_selector],
    Options={Adjust=False, Closed=False, LoftEnds=0, LoftSimp=0, LoftType=0, Rebuild=10, Refit=0.01})
cap_holes_2 = CapHoles(Brep=loft_2)
custom_preview_3 = CustomPreview(Geometry=cap_holes_2, Material=ColourSwatch(SwatchColor=RGBA(228, 95, 57, 154)))

# ---- group: equipamientoComunal (continued)
brep_edges_3 = BrepEdges(Brep=item_selector)  # -> graft(Naked), Interior, NonManifold
evaluate_curve_3 = EvaluateCurve(Curve=reparameterize(item_selector), Parameter=Slider(0.15, range=0..1))  # -> Point, Tangent, Angle
area_15 = Area(Geometry=item_selector)  # -> Area, Centroid
line_pt_2 = LinePt(Line=brep_edges_3.Naked, Point=area_15.Centroid)
rotate_plane = RotatePlane(Plane=line_pt_2, Angle=radians_2)  # -> flatten(Plane)
rectangle_3 = Rectangle(Plane=rotate_plane, XSize=square_root, YSize=square_root, Radius=0)  # -> Rectangle, Length
curve_12 = Curve(rectangle_3.Rectangle)
list_item_19 = ListItem(List=curve_12, Index=number_slider_14, Wrap=True)
panel_43 = Panel(list_item_19)
move_10 = Move(Geometry=list_item_19, Motion=unit_z)  # -> Geometry, Transform
loft_3 = Loft(
    Curves=[list_item_19, move_10.Geometry],
    Options={Adjust=False, Closed=False, LoftEnds=0, LoftSimp=0, LoftType=0, Rebuild=10, Refit=0.01})
cap_holes_3 = CapHoles(Brep=loft_3)
custom_preview_4 = CustomPreview(Geometry=cap_holes_3, Material=ColourSwatch(SwatchColor=RGBA(107, 80, 162, 138)))

# ---- group: cnvexHull (continued)
discontinuity_7 = Discontinuity(Curve=item_selector, Level=1)  # -> flatten(Points), Parameters
discontinuity_8 = Discontinuity(Curve=list_item_19, Level=1)  # -> flatten(Points), Parameters
convex_hull = ConvexHull(Points=[discontinuity_5.Points, discontinuity_7.Points, discontinuity_8.Points], Plane=PlaneXY(0, 0, 0))  # -> Hull, HullZ, Indices
area_16 = Area(Geometry=convex_hull.Hull, UseTasks=False)  # -> Area, Centroid

# ----
region_union = RegionUnion(Curves=[item_selector, list_item_19])
multiplication_26 = Multiplication(A=multiplication_25, B=Slider(0.2, range=0..1))
offset = OffsetCurve(Curve=region_union, Distance=multiplication_26, Plane=PlaneXY(0, 0, 0), Corners=1)

# ---- group: areaTotalOcupacion / parqueaderos
curve_13 = Curve(item_selector)

# ---- group: areaTotalOcupacion / equipamientoComunal
curve_14 = Curve(list_item_19)

# ----
# colisiones
curve_15 = Curve(flatten([list_item_11, curve, region_union]))
curve_16 = Curve(flatten([scale_nu.Geometry, offset]))
region_union_2 = RegionUnion(Curves=curve_15)
cross_reference_3 = CrossReference(ListListA=curve_16, ListListB=curve_16, CrossMode=2)  # -> graft(ListListA), graft(ListListB)
area_17 = Area(Geometry=region_union_2)  # -> Area, Centroid
area_18 = Area(Geometry=curve)  # -> Area, Centroid
region_intersection_2 = RegionIntersection(CurvesA=cross_reference_3.ListListA, CurvesB=cross_reference_3.ListListB)
subtraction_5 = Subtraction(A=area_17.Area, B=area_18.Area)
area_19 = Area(Geometry=region_intersection_2)  # -> Area, Centroid
max_4 = Slider(10, range=0..30)
min_3 = Slider(5, range=0..10)
min_4 = Slider(10, range=0..10)
panel_44 = Panel(subtraction_5)
mass_addition_6 = MassAddition(Input=flatten(area_19.Area))  # -> Result, PartialResults
max_5 = Multiplication(A=area.Area, B=0.005)
subtraction_6 = Subtraction(A=max_4, B=min_3)
subtraction_7 = Subtraction(A=max, B=min_4)
panel_45 = Panel(mass_addition_6.Result)
expression_9 = Expression(D=subtraction_5, max=max_4, min=min_3, x=subtraction_6, Expression="(D-5)/x")
expression_10 = Expression(C=mass_addition_6.Result, max=max, min=min_4, x=subtraction_7, Expression="(C-12)/x")
panel_46 = Panel(expression_9)
panel_47 = Panel(expression_10)

# ---- group: ExcelWriter / ÁreaComunal
area_20 = Area(Geometry=list_item_19, UseTasks=False)  # -> Area, Centroid

# ---- group: areaTotalOcupacion
# índice de ocupación
area_21 = Area(Geometry=curve_10)  # -> Area, Centroid
area_22 = Area(Geometry=curve_14)  # -> Area, Centroid
area_23 = Area(Geometry=curve_13)  # -> Area, Centroid
area_24 = Area(Geometry=curve_7)  # -> Area, Centroid
merge_4 = Merge(Data1=area_23.Area, Data2=area_22.Area, Data3=flatten(area_21.Area))
panel_48 = Panel(area_24.Area)
replace_nulls = ReplaceNulls(Items=merge_4, Replacements=Slider(0, range=0..100))  # -> Items, Count
mass_addition_7 = MassAddition(Input=replace_nulls.Items)  # -> Result, PartialResults
i_o_norma = Slider(0.7, range=0..1)
i_o_norma_2 = Slider(0.5, range=0..1)
panel_49 = Panel(mass_addition_7.Result)

# ----
division_32 = Division(A=mass_addition_7.Result, B=area_24.Area)
subtraction_8 = Subtraction(A=i_o_norma, B=i_o_norma_2)

# ---- group: areaTotalOcupacion (continued)
i_o = Panel(division_32)
expression_11 = Expression(B=division_32, max=i_o_norma, min=i_o_norma_2, x=subtraction_8, Expression="(B-.70)/x")
panel_50 = Panel(expression_11)

# ---- group: fitnessFunction
expression_12 = Expression(A=expression_8, B=expression_11, C=expression_10, D=expression_9, Expression="-A+B-C-D+E")

# ----
panel_51 = Panel(expression_12)

# ---- group: ExcelWriter / I.O.
num_5 = Number(division_32)

# ---- group: ExcelWriter
merge_5 = Merge(
    Data1=num,
    Data2=num_2,
    Data3=num_4,
    Data4=num_5,
    Data5=int_4,
    Data6=int_3,
    Data7=round_8.Nearest,
    Data8=round_9.Nearest,
    Data9=int_2,
    Data10=division_27,
    Data11=division_28,
    Data12=area_20.Area,
    Data13=multiplication_26)
panel_52 = Panel("""Área bruta m2
Área neta urbanizable m2
I.C.
I.O.
Número total aptos.
Parqueaderos privados
Parqueaderos visitantes
Parqueaderos movilidad reducida
Número pisos parqueadero
Relación parqueadero/aptos.
Relación parqueadero/visitantes
Área equipamiento comunal m2
Aislamientos comunal m""")
anchoslargos = CSharpScript(plantas=list_item_11)  # -> ancho, largo; inputs plantas: tree of Rectangle3d
# ---------- anchoslargos: C# ----------
    DataTree<double> anchosOut = new DataTree<double>(), largosOut = new DataTree<double>();

    Rectangle3d temp = new Rectangle3d();

    GH_Path path = new GH_Path();

    for( int i = 0; i < plantas.BranchCount; ++i )
    {

      path = plantas.Path(i);

      for( int j = 0; j < plantas.Branch(i).Count; ++j )
      {

        temp = plantas.Branch(i)[j];
        
        anchosOut.Add(temp.Width, path);
        largosOut.Add(temp.Height, path);

      }

    }

    ancho = anchosOut;
    largo = largosOut;
# ---------- end anchoslargos ----------
panel_54 = Panel(anchoslargos.largo)
data = Data(merge_5)
panel_55 = Panel("""Ancho m
Largo m
Pisos
Aislamientos m
Aptos
Altura m""")
button = Button()
c_script = CSharpScript(
    x=data,
    y=flatten(anchoslargos.ancho),
    z=flatten(anchoslargos.largo),
    u=flatten(lng),
    v=flatten(num_3),
    w=flatten(round_10.Nearest),
    xx=flatten(vec2pt.Length))  # -> out, A; inputs x: list, y: list, z: list, u: list, v: list, w: list, xx: list
# ---------- c_script: C# ----------
    var treeOut = new DataTree<object>();

    treeOut.AddRange(x, new GH_Path(0));

    for( int i = 0; i < x.Count; ++i )
    {

      treeOut.Add(null, new GH_Path(1));
      treeOut.Add(null, new GH_Path(2));
      treeOut.Add(null, new GH_Path(3));
      treeOut.Add(null, new GH_Path(4));
      treeOut.Add(null, new GH_Path(5));
      treeOut.Add(null, new GH_Path(6));

    }

    treeOut.AddRange(y, new GH_Path(1));
    treeOut.AddRange(z, new GH_Path(2));
    treeOut.AddRange(u, new GH_Path(3));
    treeOut.AddRange(v, new GH_Path(4));
    treeOut.AddRange(w, new GH_Path(5));
    treeOut.AddRange(xx, new GH_Path(6));

    A = treeOut;
# ---------- end c_script ----------
lng_3 = ListLength(List=flatten(num_3))
c_script_2 = CSharpScript(x=panel_52, y=lng_3)  # -> out, A; inputs x: list, y: Int32
# ---------- c_script_2: C# ----------
    for( int i = 1; i <= y; ++i )
    {

      string str = "Torre " + i.ToString();

      x.Add(str);

    }

    A = x;
# ---------- end c_script_2 ----------
writexl = WriteToExcel(
    Run=Toggle(False),
    ExcelWorksheet="1",
    ColumnNames=panel_55,
    RowNames=c_script_2.A,
    WriteOptions="None",
    ColumnnsOrRows=False,
    DataToWriteIntoColumns=c_script.A)
panel_56 = Panel(c_script_2.A)
panel_57 = Panel(c_script.A)
