# Grasshopper definition 19.07.06_Setting_001.gh (Grasshopper 1.0.7)
# plug-ins: SpacePartition, CORE.GH, Kangaroo2 Components, HAL [Data Utilities]

# ---- group: tipología
geometry = Geometry(<curve referenced from the Rhino model>)

area = Area(Geometry=geometry)  # -> Area, Centroid
discontinuity = Discontinuity(Curve=geometry, Level=1)  # -> Points, Parameters
brep_edges = BrepEdges(Brep=geometry)  # -> Naked, Interior, NonManifold
shift_list = ShiftList(List=discontinuity.Points, Shift=1, Wrap=True)
point_on_curve = PointOnCurve(brep_edges.Naked, parameter=0.5)
line = Line(StartPoint=discontinuity.Points, EndPoint=shift_list)
list_item = ListItem(List=line, Index=Slider(68, range=0..100), Wrap=True)
list_item_2 = ListItem(List=point_on_curve, Index=Slider(53, range=0..100), Wrap=True)
point_on_curve_2 = PointOnCurve(list_item, parameter=0.5)
vector_2pt = Vector2Pt(PointA=area.Centroid, PointB=list_item_2, Unitize=False)  # -> Vector, Length
vector_2pt_2 = Vector2Pt(PointA=area.Centroid, PointB=point_on_curve_2, Unitize=False)  # -> Vector, Length
vector_display = VectorDisplay(Anchor=area.Centroid, Vector=vector_2pt.Vector)
vector_display_2 = VectorDisplay(Anchor=area.Centroid, Vector=vector_2pt_2.Vector)
construct_plane = ConstructPlane(Origin=Point(0, 0, 0), XAxis=vector_2pt_2.Vector, YAxis=vector_2pt.Vector)
bounding_box = BoundingBox(Content=geometry, Plane=construct_plane, UnionBox=False)  # -> Box, Box_2
deconstruct_brep = DeconstructBrep(Brep=bounding_box.Box)  # -> Faces, Edges, Vertices
list_item_3 = ListItem(List=deconstruct_brep.Edges, Index=1, Wrap=True)
list_item_4 = ListItem(List=deconstruct_brep.Edges, Index=0, Wrap=True)
length = Length(Curve=list_item_3)
length_2 = Length(Curve=list_item_4)
panel = Panel(length)
panel_2 = Panel(length_2)
division = Division(A=length_2, B=2)
division_2 = Division(A=length, B=2)

# ---- group: áreas / áreaNeta
geometry_2 = Geometry(<curve referenced from the Rhino model>)

# ---- group: áreas
i_o = Panel("0.30")
i_c = Panel("2.40")
area_2 = Area(Geometry=geometry_2)  # -> Area, Centroid
àreamanzana = Panel(area_2.Area)
multiplication = Multiplication(A=area_2.Area, B=i_o)
multiplication_2 = Multiplication(A=area_2.Area, B=i_c)
áreavendiblevivienda = Panel(multiplication_2)
áreaocupaciòn = Panel(multiplication)

# ---- group: loteUtil
curve = Curve(geometry_2)

# ----
numtorres = Slider(5, range=0..10)
numpisos_torre = Slider(8, range=0..10)
numaptos_piso = Slider(8, range=0..10)
áreaapto = Slider(55.8, range=50..70)

# ---- group: áreaTotalIdeal
multiplication_3 = Multiplication(A=numaptos_piso, B=áreaapto)
panel_3 = Panel(multiplication_3)

# ----
multiplication_4 = Multiplication(A=numpisos_torre, B=numaptos_piso)
panel_4 = Panel(multiplication_4)
multiplication_5 = Multiplication(A=numtorres, B=multiplication_4)

# ---- group: planosPlantas
minpisos = Slider(5, range=0..100)
gene_pool03 = GenePool(Decimals=0, Maximum=8, Minimum=5, Value=8)
construct_domain = ConstructDomain(DomainStart=minpisos, DomainEnd=numpisos_torre)
genepoolmodifier = GenePoolModifier(
    GeneList="Gene Pool03",
    Count=Slider(1, range=0..6),
    Domain=construct_domain,
    Randomize=Button(),
    PercentageOfRandomization=Slider(87.936, range=0..100))
panel_5 = Panel(genepoolmodifier)

# ---- group: definicionTorres / altura1eraTorre
list_item_5 = ListItem(List=gene_pool03, Index=0, Wrap=True)

# ----
panel_6 = Panel(multiplication_5)

# ---- group: pisosAlturaMáxima
number_slider = Slider(2.4, range=0..10)
integer = Integer(numpisos_torre)
duplicate_data = DuplicateData(Data=number_slider, Number=integer, Order=True)
merge = Merge(Data1=flatten(Slider(0, range=0..100)), Data2=flatten(duplicate_data))
mass_addition = MassAddition(Input=merge)  # -> Result, PartialResults
panel_7 = Panel(mass_addition.Result)
panel_8 = Panel(mass_addition.PartialResults)

# ---- group: definicionTorres / alturaEntrepiso
number = Number(number_slider)

# ---- group: towerNumber
construct_domain_2 = ConstructDomain(DomainStart=0, DomainEnd=1)
genepoolmodifier_2 = GenePoolModifier(
    GeneList="PointX",
    Count=numtorres,
    Domain=construct_domain_2,
    Randomize=Button(),
    PercentageOfRandomization=Slider(85, range=0..100))
genepoolmodifier_3 = GenePoolModifier(
    GeneList="PointY",
    Count=numtorres,
    Domain=construct_domain_2,
    Randomize=Button(),
    PercentageOfRandomization=Slider(85, range=0..100))
pointx = GenePool(Decimals=2, Maximum=1, Minimum=0, Value=[0.22, 0.26, 0.52, 0.26, 0.44])
pointy = GenePool(Decimals=2, Maximum=1, Minimum=0, Value=[0.08, 0.78, 0.76, 0.36, 0.35])
curve_2 = Curve(curve)
boundary_surfaces = BoundarySurfaces(Edges=curve_2)
construct_point = ConstructPoint(XCoordinate=pointx, YCoordinate=pointy, ZCoordinate=0)
area_3 = Area(Geometry=boundary_surfaces)  # -> Area, Centroid
custom_preview = CustomPreview(Geometry=boundary_surfaces, Material=ColourSwatch(SwatchColor=RGBA(241, 232, 210, 193)))
scale = Scale(Geometry=boundary_surfaces, Center=area_3.Centroid, Factor=Slider(0.9, range=0..1))  # -> Geometry, Transform
evaluate_surface = EvaluateSurface(Surface=reparameterize(scale.Geometry), Point=construct_point)  # -> Point, Normal, UDirection, VDirection, Frame
surface_closest_point = SurfaceClosestPoint(Point=evaluate_surface.Point, Surface=scale.Geometry)  # -> Point, UVPoint, Distance
iso_curve = IsoCurve(Surface=boundary_surfaces, UVPoint=surface_closest_point.UVPoint)  # -> UIsocurve, VIsocurve

# ----
y = Slider(0.02, range=0..1)
x = Slider(0.66, range=0..1)
construct_point_2 = ConstructPoint(XCoordinate=x, YCoordinate=y, ZCoordinate=0)
evaluate_surface_2 = EvaluateSurface(Surface=reparameterize(scale.Geometry), Point=construct_point_2)  # -> Point, Normal, UDirection, VDirection, Frame
surface_closest_point_2 = SurfaceClosestPoint(Point=evaluate_surface_2.Point, Surface=scale.Geometry)  # -> Point, UVPoint, Distance
porcentajecirculaciòn = Slider(1.15, range=1..2)
radians = Radians(Degrees=Slider(83, range=0..360))

# ---- group: align / puntoReferenciaLote
number_slider_2 = Slider(8, range=0..20)

# ---- group: align
discontinuity_2 = Discontinuity(Curve=curve, Level=2)  # -> Points, Parameters
shift_list_2 = ShiftList(List=discontinuity_2.Points, Shift=number_slider_2, Wrap=True)
list_item_6 = ListItem(List=shift_list_2, Index=Slider(0, range=0..100), Wrap=True)
list_item_7 = ListItem(List=shift_list_2, Index=Slider(1, range=0..1), Wrap=True)
point_list = PointList(Points=discontinuity_2.Points, Size=Slider(10, range=0..10))
list_item_8 = ListItem(List=shift_list_2, Index=Slider(6, range=0..100), Wrap=True)
panel_9 = Panel(discontinuity_2.Points)
line_2 = Line(StartPoint=list_item_6, EndPoint=list_item_7)

# ---- group: align / northOrientation / centroid
point = Point(area_2.Centroid)

# ---- group: align / northOrientation
number_slider_3 = Slider(100, range=-100..100)
number_slider_4 = Slider(-100, range=-100..100)
unit_x = UnitX(Factor=[number_slider_3, number_slider_4])
unit_y = UnitY(Factor=[number_slider_3, number_slider_4])
move = Move(Geometry=point, Motion=unit_y)  # -> Geometry, Transform
move_2 = Move(Geometry=point, Motion=unit_x)  # -> Geometry, Transform
list_item_9 = ListItem(List=move_2.Geometry, Index=0, Wrap=True)
list_item_10 = ListItem(List=move.Geometry, Index=0, Wrap=True)
vector_2pt_3 = Vector2Pt(PointA=point, PointB=list_item_9, Unitize=False)  # -> Vector, Length
vector_2pt_4 = Vector2Pt(PointA=point, PointB=list_item_10, Unitize=False)  # -> Vector, Length
vector_display_3 = VectorDisplay(Anchor=point, Vector=vector_2pt_3.Vector)
vector_display_4 = VectorDisplay(Anchor=point, Vector=vector_2pt_4.Vector)

# ----
number_slider_5 = Slider(2.3, range=0..10)

# ---- group: referenciaViaAcceso
# curvaParqueadero
curve_3 = Curve(<curve referenced from the Rhino model>)

# ----
discontinuity_3 = Discontinuity(Curve=curve_3, Level=1)  # -> Points, Parameters
fit_line = FitLine(Points=discontinuity_3.Points)
number_slider_6 = Slider(33, range=0..100)
point_2 = Point(area_2.Centroid)
end_points = EndPoints(Curve=fit_line)  # -> Start, End
vector_2pt_5 = Vector2Pt(PointA=end_points.Start, PointB=end_points.End, Unitize=False)  # -> Vector, Length
amplitude = Amplitude(Vector=vector_2pt_5.Vector, Amplitude=number_slider_5)
line_pt = LinePt(Line=fit_line, Point=point_2)
rectangle = Rectangle(Plane=line_pt, XSize=number_slider_5, YSize=Slider(4.3, range=0..10), Radius=0)  # -> Rectangle, Length
offset_curve = OffsetCurve(Curve=fit_line, Distance=Slider(-5, range=-10..10), Plane=line_pt, Corners=1)
linear_array = LinearArray(Geometry=rectangle.Rectangle, Direction=amplitude, Count=number_slider_6)  # -> Geometry, Transform
gene_pool05 = GenePool(Decimals=0, Maximum=360, Minimum=0, Value=[38.44341602, 353.5000718, 205.9638429, 193.2548885, 249.6408944])
construct_domain_3 = ConstructDomain(DomainStart=0, DomainEnd=360)
number_slider_7 = Slider(247, range=0..360)
radians_2 = Radians(Degrees=gene_pool05)
unit_z = UnitZ(Factor=Slider(-1.5, range=-1.5..0))
number_slider_8 = Slider(3, range=0..10)

# ---- group: indicadores / áreaApto
number_2 = Number(áreaapto)

# ---- group: indicadores / áreaÚtilLote
number_3 = Number(area_2.Area)

# ---- group: ExcelWriter / ÁreaBruta
num = Number(area_2.Area)

# ---- group: ExcelWriter / ÁreaNetaUrbanizable
num_2 = Number(area_2.Area)

# ---- group: controlAmbiental
geometry_3 = Geometry(<curve referenced from the Rhino model>)

# ---- group: areaTotalOcupacion / manzana
curve_4 = Curve(curve)

# ----
max = Slider(0.6, range=0..0.6)
min = Slider(0.5, range=0.25..1)
subtraction = Subtraction(A=max, B=min)
panel_10 = Panel("maximize")
galapagos = Galapagos(fitness=expression_13, gene=[gene_pool04, number_slider_11, salida, pointx, pointy, x, y, number_slider_12])

# ---- group: definicionTorres
construct_domain_4 = ConstructDomain(DomainStart=expr("-x", division_2), DomainEnd=division_2)
construct_domain_5 = ConstructDomain(DomainStart=expr("-x", division), DomainEnd=division)
c_script = CSharpScript(x=multiplication_2, y=Slider(2, range=0..10))  # -> out, A; inputs x: Double, y: Int32
# ---------- c_script: C# ----------
    A = Math.Round(x, y);
# ---------- end c_script ----------
difstor = Slider(0, range=0..10)
domain = Domain(construct_domain_5)
domain_2 = Domain(construct_domain_4)
panel_11 = Panel(list_item_5)

# ---- group: definicionTorres / areaTotalVendible
number_4 = Number(c_script.A)

# ---- group: definicionTorres (continued)
multiplication_6 = Multiplication(A=number_4, B=1.5)

# ----
panel_12 = Panel(multiplication_6)

# ---- group: escalaOffsets
# ladosCortos porcentaje escala
# ladosLargos porcentaje escala
number_slider_9 = Slider(1, range=0..1)

# ---- group: align / alignAllGeometry / orientacionPlanos
gene_pool04 = GenePool(Decimals=0, Maximum=3, Minimum=0, Value=[1, 2, 0, 0, 0])
construct_domain_6 = ConstructDomain(DomainStart=0, DomainEnd=3)

# ---- group: align
point_list_2 = PointList(Points=shift_list_2, Size=Slider(10, range=0..10))

# ---- group: align / alignAllGeometry
line_pt_2 = LinePt(Line=line_2, Point=list_item_8)
panel_13 = Panel("""0.0
0.5
1.0
1.5
2""")
expression = Expression(x=panel_13, Expression="x*pi")
bounds = Bounds(Numbers=expression)
remap_numbers = RemapNumbers(Value=expression, Source=bounds, Target=Domain(0, 1))  # -> Mapped, Clipped
panel_14 = Panel(remap_numbers.Mapped)
plane = Plane(surface_closest_point.Point)
list_length = ListLength(List=flatten(plane))

# ----
rotate_plane = RotatePlane(Plane=line_pt_2, Angle=radians)

# ---- group: align / alignAllGeometry / orientacionPlanos (continued)
genepoolmodifier_4 = GenePoolModifier(
    GeneList="Gene Pool04",
    Count=list_length,
    Domain=construct_domain_6,
    Randomize=Button(),
    PercentageOfRandomization=Slider(80.059, range=0..100))
panel_15 = Panel(genepoolmodifier_4)

# ----
genepoolmodifier_5 = GenePoolModifier(
    GeneList="Gene Pool05",
    Count=list_length,
    Domain=construct_domain_3,
    Randomize=Button(),
    PercentageOfRandomization=Slider(80.059, range=0..100))
panel_16 = Panel(genepoolmodifier_5)

# ---- group: calculoParqueaderos / numUnidades
number_5 = Number(áreaapto)

# ---- group: align / alignAllGeometry (continued)
vector_2pt_6 = Vector2Pt(PointA=rotate_plane, PointB=point, Unitize=False)  # -> Vector, Length
vector_display_5 = VectorDisplay(Anchor=point, Vector=vector_2pt_6.Vector)

# ---- group: align (continued)
circle = Circle(Plane=rotate_plane, Radius=Slider(47, range=0..100))

# ---- group: align / alignAllGeometry (continued)
move_3 = Move(Geometry=circle, Motion=vector_2pt_6.Vector)  # -> Geometry, Transform

# ---- group: align (continued)
evaluate_curve = EvaluateCurve(Curve=reparameterize(move_3.Geometry), Parameter=remap_numbers.Mapped)  # -> Point, Tangent, Angle

# ---- group: align / alignAllGeometry (continued)
list_item_11 = ListItem(List=evaluate_curve.Point, Index=gene_pool04, Wrap=True)  # -> graft(Item)

# ---- group: align (continued)
vector_2pt_7 = Vector2Pt(PointA=point, PointB=list_item_11, Unitize=False)  # -> Vector, Length
vector_display_6 = VectorDisplay(Anchor=point, Vector=vector_2pt_7.Vector)
align_plane = AlignPlane(Plane=plane, Direction=flatten(vector_2pt_7.Vector))  # -> Plane, Angle

# ---- group: align / alignAllGeometry (continued)
panel_17 = Panel(vector_2pt_7.Vector)
list_item_12 = ListItem(List=flatten(vector_2pt_7.Vector), Index=0, Wrap=True)  # -> Item, Item1, Item2, Item3
rotate = Rotate(Geometry=plane, Angle=align_plane.Angle, Plane=align_plane.Plane)  # -> Geometry, Transform
vector_display_7 = VectorDisplay(Anchor=point, Vector=list_item_12.Item)
vector_display_8 = VectorDisplay(Anchor=point, Vector=list_item_12.Item2)

# ----
plane_2 = Plane(rotate.Geometry)

# ---- group: definicionTorres / planeIniciales
plane_3 = Plane(plane_2)

# ----
merge_2 = Merge(Data1=list_item_12.Item, Data2=list_item_12.Item2)
panel_19 = Panel(merge_2)
rotate_plane_2 = RotatePlane(Plane=plane_2, Angle=radians_2)
list_length_2 = ListLength(List=merge_2)

# ---- group: definicionTorres (continued)
customgeoplacement = CSharpScript(diff=difstor, f=number, w=domain, h=domain_2, maxIter=list_item_5, areaTotal=multiplication_6, planes=flatten(plane_3))  # -> A, B; inputs diff: Int32, f: Double, maxIter: Int32, areaTotal: Double, planes: list of Plane
# ---------- customgeoplacement: C# ----------
    var listaRect = new DataTree<Rectangle3d>();
    double move = 0.0;
    var vectorList = new DataTree<Vector3d>();
    int size = planes.Count;
    Rectangle3d rectTemp = new Rectangle3d();
    double areaR = 0, temp = 0;

    for (int i = 0; i < size; ++i)
    {

      rectTemp = new Rectangle3d(planes[i], w, h);

      var path = new GH_Path(i);

      for (int j = 0; j <= maxIter; ++j)
      {

        if( j != 0 )

          temp += f;

        areaR += AreaMassProperties.Compute(rectTemp.ToNurbsCurve()).Area;

        //vector = new Vector3d(0, 0, temp);


        rectTemp.Transform(Rhino.Geometry.Transform.Translation(0, 0, temp));
        listaRect.Add(rectTemp, path);
        move += temp;
        vectorList.Add(new Vector3d(0, 0, move), path);
        temp = 0;

        if (areaR * 1.025 >= areaTotal && areaR * 0.975 <= areaTotal) break;

      }

      maxIter -= diff;

      move = 0;

      if (areaR * 1.025 >= areaTotal && areaR * 0.975 <= areaTotal) break;

    }

    A = listaRect;
    B = vectorList;
    //Print(areaR.ToString());
# ---------- end customgeoplacement ----------
area_4 = Area(Geometry=customgeoplacement.A)  # -> Area, Centroid
reverse_list = ReverseList(List=area_4.Centroid)
list_item_13 = ListItem(List=reverse_list, Index=0, Wrap=True)
deconstruct = Deconstruct(Point=list_item_13)  # -> XComponent, YComponent, ZComponent

# ---- group: definicionTorres / aislamiento
number_6 = Number(deconstruct.ZComponent)
division_3 = Division(A=number_6, B=Slider(3, range=0..5))

# ----
division_4 = Division(A=division_3, B=2)

# ---- group: ExcelWriter / PisosXTorre
int = Integer(customgeoplacement.B)
lng = ListLength(List=int)

# ---- group: ExcelWriter / AislamientoMinimoEntreTorres
num_3 = Number(division_4)

# ---- group: definicionTorres / outputBase
list_item_14 = ListItem(List=customgeoplacement.A, Index=0, Wrap=True)
geometry_4 = Geometry(customgeoplacement.A)

# ----
area_5 = Area(Geometry=list_item_14)  # -> Area, flatten(Centroid)

# ---- group: escalaOffsets (continued)
area_6 = Area(Geometry=list_item_14)  # -> Area, Centroid
offset_curve_2 = OffsetCurve(Curve=list_item_14, Distance=division_4, Plane=PlaneXY(0, 0, 0), Corners=1)
brep_edges_2 = BrepEdges(Brep=list_item_14)  # -> Naked, Interior, NonManifold
brep_edges_3 = BrepEdges(Brep=offset_curve_2)  # -> Naked, Interior, NonManifold
point_on_curve_3 = PointOnCurve(brep_edges_2.Naked, parameter=0.5)
point_on_curve_4 = PointOnCurve(brep_edges_3.Naked, parameter=0.5)
point_3 = Point(point_on_curve_3)
point_4 = Point(point_on_curve_4)
list_item_15 = ListItem(List=point_3, Index=0, Wrap=True)  # -> Item, Item1, Item2, Item3
point_list_3 = PointList(Points=point_4, Size=number_slider_9)
list_item_16 = ListItem(List=point_4, Index=0, Wrap=True)  # -> Item, Item1, Item2, Item3
line_3 = Line(StartPoint=list_item_15.Item1, EndPoint=list_item_15.Item3)
line_4 = Line(StartPoint=list_item_15.Item, EndPoint=list_item_15.Item2)
line_5 = Line(StartPoint=list_item_16.Item1, EndPoint=list_item_16.Item3)
line_6 = Line(StartPoint=list_item_16.Item, EndPoint=list_item_16.Item2)
length_3 = Length(Curve=line_4)
length_4 = Length(Curve=line_3)
length_5 = Length(Curve=line_5)
length_6 = Length(Curve=line_6)
expression_2 = Expression(a=length_3, b=length_6, Expression="((100*b)/a)*0.01")
expression_3 = Expression(a=length_4, b=length_5, Expression="(1.5/b)+1")
panel_20 = Panel(expression_3)
panel_21 = Panel(expression_2)

# ----
panel_22 = Panel(area_5.Centroid)
mass_addition_2 = MassAddition(Input=flatten(area_5.Area))  # -> Result, PartialResults

# ---- group: topology
cross_reference = CrossReference(ListListA=flatten(list_item_14), ListListB=flatten(list_item_14), CrossMode=2)  # -> ListListA, ListListB
geometry_5 = Geometry(graft(cross_reference.ListListA))
geometry_6 = Geometry(graft(cross_reference.ListListB))
geometry_7 = Geometry([geometry_5, geometry_6])
area_7 = Area(Geometry=geometry_7)  # -> Area, Centroid
list_item_17 = ListItem(List=area_7.Centroid, Index=0, Wrap=True)  # -> Item, Item1
line_7 = Line(StartPoint=list_item_17.Item, EndPoint=list_item_17.Item1)

# ---- group: prueba2Perimetro
discontinuity_4 = Discontinuity(Curve=list_item_14, Level=1)  # -> Points, Parameters
edificios = Curve(list_item_14)
point_in_curve = PointInCurve(Point=discontinuity_4.Points, Curve=curve)  # -> Relationship, Point
collision_one_many = CollisionOneMany(Collider=curve, Obstacles=edificios)  # -> Collision, Index
expression_4 = Expression(x=point_in_curve.Relationship, Expression="If(x=2, True, False)")
dispatch = Dispatch(List=flatten(edificios), DispatchPattern=flatten(collision_one_many.Collision))  # -> ListA, ListB
dispatch_2 = Dispatch(List=point_in_curve.Point, DispatchPattern=expression_4)  # -> ListA, ListB
list_item_18 = ListItem(List=flatten(dispatch_2.ListB), Index=0, Wrap=True)
curve_closest_point = CurveClosestPoint(Point=list_item_18, Curve=curve)  # -> Point, Parameter, Distance
vector_2pt_8 = Vector2Pt(PointA=list_item_18, PointB=curve_closest_point.Point, Unitize=False)  # -> Vector, Length
move_4 = Move(Geometry=dispatch.ListA, Motion=vector_2pt_8.Vector)  # -> Geometry, Transform
merge_3 = Merge(Data1=move_4.Geometry, Data2=dispatch.ListB)  # -> graft(Result)

# ---- group: areaTotalConstruida
move_5 = Move(Geometry=list_item_14, Motion=customgeoplacement.B)  # -> Geometry, Transform
list_length_3 = ListLength(List=move_5.Geometry)
subtraction_2 = Subtraction(A=list_length_3, B=1)
cull_index = CullIndex(List=move_5.Geometry, Indices=subtraction_2, Wrap=True)
area_8 = Area(Geometry=cull_index)  # -> Area, Centroid
mass_addition_3 = MassAddition(Input=flatten(area_8.Area))  # -> Result, PartialResults
multiplication_7 = Multiplication(A=mass_addition_3.Result, B=Slider(0.15, range=0..1))
areatotalconstruida = Panel(mass_addition_3.Result)

# ---- group: definicionTorres / outputBase (continued)
loft = Loft(Curves=move_5.Geometry, Options={Adjust=False, Closed=False, LoftEnds=0, LoftSimp=0, LoftType=0, Rebuild=10, Refit=0.01})

# ---- group: definicionTorres (continued)
panel_23 = Panel(list_item_14)
cap_holes = CapHoles(Brep=loft)
custom_preview_2 = CustomPreview(Geometry=cap_holes, Material=ColourSwatch(SwatchColor=RGBA(49, 101, 158, 103)))
offset_curve_3 = OffsetCurve(Curve=list_item_14, Distance=division_4, Plane=PlaneXY(0, 0, 0), Corners=1)
cross_reference_2 = CrossReference(ListListA=flatten(offset_curve_3), ListListB=flatten(offset_curve_3), CrossMode=5)  # -> ListListA, ListListB
panel_24 = Panel(division_4)
geometry_8 = Geometry(graft(cross_reference_2.ListListA))
geometry_9 = Geometry(graft(cross_reference_2.ListListB))
geometry_10 = Geometry([geometry_8, geometry_9])
list_item_19 = ListItem(List=geometry_10, Index=0, Wrap=True)  # -> Item, Item1
region_intersection = RegionIntersection(CurvesA=list_item_19.Item, CurvesB=list_item_19.Item1)
curve_curve = CurveCurve(CurveA=list_item_19.Item, CurveB=list_item_19.Item1)  # -> Points, ParamsA, ParamsB

# ---- group: Heights
lng_2 = ListLength(List=move_5.Geometry)
subtraction_3 = Subtraction(A=lng_2, B=1)
item = ListItem(List=move_5.Geometry, Index=subtraction_3, Wrap=True)
area_9 = Area(Geometry=item, UseTasks=False)  # -> Area, Centroid
pdecon = Deconstruct(Point=area_9.Centroid)  # -> XComponent, YComponent, ZComponent
pt = ConstructPoint(XCoordinate=pdecon.XComponent, YCoordinate=pdecon.YComponent, ZCoordinate=0)
vec2pt = Vector2Pt(PointA=pt, PointB=area_9.Centroid, Unitize=False)  # -> Vector, Length
vdis = VectorDisplay(Anchor=pt, Vector=vec2pt.Vector)

# ---- group: scaleOffsets
line_line = LineLine(LineA=line_3, LineB=line_4)
vector_2pt_9 = Vector2Pt(PointA=line_line, PointB=area_6.Centroid, Unitize=False)  # -> Vector, Length
move_6 = Move(Geometry=line_line, Motion=vector_2pt_9.Vector)  # -> Geometry, Transform
scale_nu = ScaleNU(Geometry=list_item_14, Plane=move_6.Geometry, ScaleX=expression_3, ScaleY=expression_2, ScaleZ=1)  # -> Geometry, Transform

# ----
division_5 = Division(A=mass_addition_3.Result, B=porcentajecirculaciòn)
areatotalvendible = Panel(division_5)
multiplication_8 = Multiplication(A=multiplication_7, B=0.5)

# ---- group: calculoParqueaderos / numUnidades (continued)
number_7 = Number(division_5)
division_6 = Division(A=number_7, B=number_5)
round = Round(Number=division_6)  # -> Nearest, Floor, Ceiling

# ----
panel_25 = Panel(round.Nearest)

# ---- group: indicadores / totalUNViv
integer_2 = Integer(round.Nearest)

# ---- group: indicadores / áreaPrimerPiso
number_8 = Number(mass_addition_2.Result)

# ---- group: indicadores / áreaVendible
number_9 = Number(division_5)

# ---- group: indicadores / áreaTotalConstruida
number_10 = Number(mass_addition_3.Result)

# ---- group: indicadores / áreaCirculación
number_11 = Number(multiplication_7)

# ---- group: indicadores / áreaPuntoFijo
number_12 = Number(multiplication_8)

# ----
curve_5 = Curve(list_item_14)

# ---- group: fitnessFunction
# Índice de Construcción
number_13 = Number(division_5)
mass_addition_4 = MassAddition(TotalÁreaConstruida=number_13)  # -> Result, PartialResults
max_2 = Slider(2.8, range=0..6)
min_2 = Slider(2, range=0..10)
panel_26 = Panel(mass_addition_4.Result)
expression_5 = Expression(x=mass_addition_4.Result, y=area_2.Area, Expression="x/y")
subtraction_4 = Subtraction(A=max_2, B=min_2)
panel_27 = Panel(expression_5)
expression_6 = Expression(A=expression_5, max=max_2, min=min_2, x=subtraction_4, Expression="(A-2.4)/x")
panel_29 = Panel(expression_6)

# ---- group: ExcelWriter / I.C.
num_4 = Number(expression_5)

# ---- group: areaTotalOcupacion / edificios
curve_6 = Curve(merge_3)

# ---- group: áreaConstruida
number_14 = Number(mass_addition_3.Result)

# ---- group: áreaVendible
number_15 = Number(division_5)

# ----
# áreaVendible/áreaConstruida
number_slider_10 = Slider(100, range=0..100)
division_7 = Division(A=number_15, B=number_14)
multiplication_9 = Multiplication(A=division_7, B=number_slider_10)
round_2 = Round(Number=multiplication_9)  # -> Nearest, Floor, Ceiling
panel_30 = Panel(division_7)
max_3 = Slider(1, range=0..1)
min_3 = Slider(0, range=0..1)
subtraction_5 = Subtraction(A=max_3, B=min_3)
expression_7 = Expression(E=division_7, max=max_3, min=min_3, x=subtraction_5, Expression="(E-0.80)/x")
panel_32 = Panel(expression_7)

# ---- group: indicadores
# RELACION M2 VENDIBLES /M2 CONSTRUIDOS = (AREA TOTAL VENDIBLE/AREA CONSTRUIDA )	80%, 	76%, 	84%
division_8 = Division(A=number_9, B=number_10)
multiplication_10 = Multiplication(A=division_8, B=100)
panel_33 = Panel(multiplication_10)

# NUMERO DE VIV/Ha UTIL = (No. TOTAL DE APARTAMENTOS/AREA UTIL LOTE) 	257, 	170, 	344
division_9 = Division(A=number_3, B=10000)
round_3 = Round(Number=division_9)  # -> Nearest, Floor, Ceiling
division_10 = Division(A=integer_2, B=round_3.Nearest)
panel_34 = Panel(division_10)

# INDICE DE CONSTRUCCION (AREA CONSTRUIDA VENDIBLE/AREA UTIL)	1.58, 	1.08, 	2.08
division_11 = Division(A=number_9, B=number_3)
panel_35 = Panel(division_11)

# M2 PUNTO FIJO POR  UNIDAD DE VIVIENDA = (AREA PUNTOS FIJOS/No. TOTAL DE APARTAMENTOS)	5.41, 	4.69, 	6.13
division_12 = Division(A=number_12, B=integer_2)
panel_36 = Panel(division_12)

# RELACION M2 DE PUNTO FIJO/AREA VENDIBLE=(AREA PUNTOS FIJOS/AREA VENDIBLE)	9.2%, 	8.2%, 	10.2%
division_13 = Division(A=number_12, B=number_9)
multiplication_11 = Multiplication(A=division_13, B=100)
panel_37 = Panel(multiplication_11)

# INDICE DE OCUPACION (AREA CONSTRUIDA EN PRIMER PISO/AREA UTIL LOTE)	0.39, 	0.21, 	0.57
division_14 = Division(A=number_8, B=number_3)
panel_38 = Panel(division_14)

# ---- group: ExcelWriter / AptosXTorre
ma = MassAddition(Input=area_8.Area)  # -> Result, PartialResults
division_15 = Division(A=ma.Result, B=áreaapto)
round_4 = Round(Number=division_15)  # -> Nearest, Floor, Ceiling

# ---- group: calculoParqueaderos
parqprivados = Slider(2, range=0..10)
alturaedificio = Slider(2, range=1..3)
division_16 = Division(A=round.Nearest, B=parqprivados)
division_17 = Division(A=round.Nearest, B=Slider(30, range=0..30))
division_18 = Division(A=round.Nearest, B=Slider(10, range=0..10))
parqprivados_2 = Panel(division_16)
parqmovreducida = Panel(division_17)
parqvisitantes = Panel(division_18)
division_19 = Division(A=parqprivados_2, B=alturaedificio)
division_20 = Division(A=parqmovreducida, B=alturaedificio)
mass_addition_5 = MassAddition(Input=[division_16, division_18, parqmovreducida])  # -> Result, PartialResults
round_5 = Round(Number=division_19)  # -> Nearest, Floor, Ceiling
round_6 = Round(Number=division_20)  # -> Nearest, Floor, Ceiling
always_even_odd = AlwaysEvenOdd(Integer=Slider(4, range=1..4), EvenOdd=Toggle(False))  # -> Integer, Corrected
panel_39 = Panel(round_5.Floor)
round_7 = Round(Number=mass_addition_5.Result)  # -> Nearest, Floor, Ceiling
panel_40 = Panel(round_6.Floor)
anchoparqueo = Slider(2.3, range=0..2.5)
anchomovilidadreducida = Slider(3.1, range=0..3.1)
division_21 = Division(A=round_6.Nearest, B=always_even_odd.Integer)
multiplication_12 = Multiplication(A=division_21, B=anchomovilidadreducida)
multiplication_13 = Multiplication(A=Slider(4.3, range=0..10), B=always_even_odd.Integer)
multiplication_14 = Multiplication(A=Slider(5, range=0..10), B=always_even_odd.Integer)
addition = Addition(A=multiplication_13, B=multiplication_14)

# ----
subtraction_6 = Subtraction(A=parqvisitantes, B=number_slider_6)

# ---- group: calculoParqueaderos (continued)
division_22 = Division(A=subtraction_6, B=alturaedificio)
round_8 = Round(Number=division_22)  # -> Nearest, Floor, Ceiling
panel_41 = Panel(round_8.Floor)
mass_addition_6 = MassAddition(Input=[round_5.Nearest, round_8.Nearest])  # -> Result, PartialResults
panel_42 = Panel(mass_addition_6.Result)
division_23 = Division(A=mass_addition_6.Result, B=always_even_odd.Integer)
multiplication_15 = Multiplication(A=division_23, B=anchoparqueo)
addition_2 = Addition(A=multiplication_15, B=multiplication_12)

# ----
panel_43 = Panel(round_7.Nearest)

# ---- group: bloqueParqueaderos
rectangle_2 = Rectangle(Plane=area_2.Centroid, XSize=addition_2, YSize=addition, Radius=0)  # -> Rectangle, Length

# ----
area_10 = Area(Geometry=rectangle_2.Rectangle)  # -> Area, Centroid
multiplication_16 = Multiplication(A=area_10.Area, B=alturaedificio)
panel_44 = Panel(multiplication_16)

# ---- group: indicadores / totalParqueaderos
integer_3 = Integer(round_7.Nearest)

# ---- group: indicadores / áreaParqueable
number_16 = Number(multiplication_16)

# ---- group: ExcelWriter / ParqueaderosVisitantes
round_9 = Round(Number=division_18)  # -> Nearest, Floor, Ceiling

# ---- group: ExcelWriter / RelaciónParqueaderos/Visitantes
ma_2 = MassAddition(Input=flatten(round_4.Nearest))  # -> Result, PartialResults
division_24 = Division(A=round_9.Nearest, B=ma_2.Result)

# ---- group: ExcelWriter / ParqueaderosMovilidadReducida
round_10 = Round(Number=division_17)  # -> Nearest, Floor, Ceiling

# ---- group: ExcelWriter / NúmeroTotalAptos
int_2 = Integer(ma_2.Result)

# ---- group: ExcelWriter / ParqueaderosPrivados
int_3 = Integer(round_5.Nearest)

# ---- group: ExcelWriter / RelaciónParqueaderos/Aptos
ma_3 = MassAddition(Input=flatten(round_4.Nearest))  # -> Result, PartialResults
division_25 = Division(A=int_3, B=ma_3.Result)

# ---- group: ExcelWriter / NúmeroPisosParqueadero
int_4 = Integer(alturaedificio)

# ---- group: indicadores
# AREA PROMEDIO PARQUEADERO (AREA PARQUEABLE/TOTAL PARQUEADEROS)	23.53, 	20.18, 	26.88
division_26 = Division(A=number_16, B=integer_3)
panel_45 = Panel(division_26)

# RELACION PARQUEADEROS POR VIVIENDA=(TOTAL PARQUEADEROS / No. TOTAL DE VIVIENDAS, Incl visit)	0.43, 	0.36, 	0.50
division_27 = Division(A=integer_3, B=integer_2)
panel_46 = Panel(division_27)

# ---- group: equipamientoComunal
m2comunal = Slider(5, range=0..10)
division_28 = Division(A=division_5, B=áreaapto)
subtraction_7 = Subtraction(A=area_2.Area, B=multiplication)
areaequipcomunal = Slider(190, range=0..1000)
round_11 = Round(Number=division_28)  # -> Nearest, Floor, Ceiling
multiplication_17 = Multiplication(A=round_11.Nearest, B=m2comunal)
multiplication_18 = Multiplication(A=subtraction_7, B=Slider(0.465, range=0..1))
zonasverdes = Panel(multiplication_18)
equipcomunalexigido = Panel(multiplication_17)
radians_3 = Radians(Degrees=Slider(90, range=0..100))
numpisos = Slider(2, range=0..2)
number_slider_11 = Slider(0, range=0..3)
multiplication_19 = Multiplication(A=numpisos, B=number_slider)
division_29 = Division(A=areaequipcomunal, B=numpisos)
square_root = SquareRoot(Value=division_29)
unit_z_2 = UnitZ(Factor=multiplication_19)

# ---- group: bloqueParqueaderos
# input: módulo parqueaderos x piso, doble crujía, doble circulación paralela
panel_47 = Panel(curve_3)
curve_7 = Curve(rectangle_2.Rectangle)
plane_4 = Plane(curve_7)
align_plane_2 = AlignPlane(Plane=plane_4, Direction=flatten(merge_2))  # -> Plane, Angle
salida = Slider(0.08, range=0..0.7)
rotate_2 = Rotate(Geometry=curve_7, Angle=align_plane_2.Angle, Plane=align_plane_2.Plane)  # -> Geometry, Transform
area_11 = Area(Geometry=curve)  # -> Area, Centroid
area_12 = Area(Geometry=rotate_2.Geometry)  # -> Area, Centroid
evaluate_curve_2 = EvaluateCurve(Curve=reparameterize(curve_3), Parameter=salida)  # -> Point, Tangent, Angle
subtraction_8 = Subtraction(A=area_11.Centroid, B=area_12.Centroid)
move_7 = Move(Geometry=rotate_2.Geometry, Motion=subtraction_8)  # -> Geometry, Transform
curve_proximity = CurveProximity(CurveA=graft(move_7.Geometry), CurveB=curve_3)  # -> PointA, PointB, Distance
panel_48 = Panel(curve_proximity.PointB)
number_slider_12 = Slider(1, range=1..2)

# ----
duplicate_data_2 = DuplicateData(Data=evaluate_curve_2.Point, Number=list_length_2, Order=True)

# ---- group: bloqueParqueaderos (continued)
vector_2pt_10 = Vector2Pt(PointA=curve_proximity.PointA, PointB=graft(duplicate_data_2), Unitize=False)  # -> Vector, Length
vector_display_9 = VectorDisplay(Anchor=curve_proximity.PointA, Vector=vector_2pt_10.Vector)
move_8 = Move(Geometry=graft(move_7.Geometry), Motion=vector_2pt_10.Vector)  # -> Geometry, Transform
list_item_20 = ListItem(List=flatten(move_8.Geometry), Index=number_slider_12, Wrap=True)

# ----
move_9 = Move(Geometry=list_item_20, Motion=unit_z)  # -> Geometry, Transform

# ---- group: areaTotalOcupacion / parqueaderos
curve_8 = Curve(list_item_20)

# ---- group: equipamientoComunal (continued)
area_13 = Area(Geometry=list_item_20)  # -> Area, Centroid
brep_edges_4 = BrepEdges(Brep=list_item_20)  # -> graft(Naked), Interior, NonManifold
line_pt_3 = LinePt(Line=brep_edges_4.Naked, Point=area_13.Centroid)
rotate_plane_3 = RotatePlane(Plane=line_pt_3, Angle=radians_3)  # -> flatten(Plane)

# ----
plane_origin = PlaneOrigin(Base=rotate_plane_3, Origin=surface_closest_point_2.Point)
list_item_21 = ListItem(List=plane_origin, Index=0, Wrap=True)

# ---- group: equipamientoComunal (continued)
rectangle_3 = Rectangle(Plane=list_item_21, XSize=square_root, YSize=square_root, Radius=0)  # -> Rectangle, Length
curve_9 = Curve(rectangle_3.Rectangle)
list_item_22 = ListItem(List=curve_9, Index=number_slider_11, Wrap=True)
area_14 = Area(Geometry=list_item_22)  # -> Area, Centroid
panel_49 = Panel(list_item_22)
move_10 = Move(Geometry=list_item_22, Motion=unit_z_2)  # -> Geometry, Transform
multiplication_20 = Multiplication(A=numpisos, B=area_14.Area)
loft_2 = Loft(
    Curves=[list_item_22, move_10.Geometry],
    Options={Adjust=False, Closed=False, LoftEnds=0, LoftSimp=0, LoftType=0, Rebuild=10, Refit=0.01})
cap_holes_2 = CapHoles(Brep=loft_2)
custom_preview_3 = CustomPreview(Geometry=cap_holes_2, Material=ColourSwatch(SwatchColor=RGBA(107, 80, 162, 138)))

# ---- group: selectorGeometríaParqueo
unit_z_3 = UnitZ(Factor=number_slider)
move_11 = Move(Geometry=move_9.Geometry, Motion=unit_z_3)  # -> Geometry, Transform
loft_3 = Loft(
    Curves=[move_11.Geometry, list_item_20],
    Options={Adjust=False, Closed=False, LoftEnds=0, LoftSimp=0, LoftType=0, Rebuild=10, Refit=0.01})
cap_holes_3 = CapHoles(Brep=loft_3)
custom_preview_4 = CustomPreview(Geometry=cap_holes_3, Material=ColourSwatch(SwatchColor=RGBA(228, 95, 57, 154)))
region_union = RegionUnion(Curves=[list_item_20, list_item_22])
offset = OffsetCurve(Curve=region_union, Distance=number_slider_8, Plane=PlaneXY(0, 0, 0), Corners=1)

# ----
area_15 = Area(Geometry=region_union)  # -> Area, Centroid
mass_addition_7 = MassAddition(Input=flatten([mass_addition_2.Result, area_15.Area]))  # -> Result, PartialResults

# ---- group: indicadores / ocupaciónTotal
number_17 = Number(mass_addition_7.Result)

# ---- group: indicadores / áreaEquipComunal
number_18 = Number(multiplication_20)

# ---- group: ExcelWriter / ÁreaComunal
area_16 = Area(Geometry=list_item_22, UseTasks=False)  # -> Area, Centroid

# ----
curve_10 = Curve(region_union)
curve_11 = Curve(list_item_22)
path_mapper = PathMapper(curve_10, source="{A;B}", target="{6}")
path_mapper_2 = PathMapper(curve_11, source="{A}", target="{7}")

# ---- group: areaTotalOcupacion / equipamientoComunal
curve_12 = Curve(list_item_22)

# ----
# distanciaCentroides
area_17 = Area(Geometry=list_item_20)  # -> Area, Centroid
area_18 = Area(Geometry=move_10.Geometry)  # -> Area, Centroid
merge_4 = Merge(Data1=area_5.Centroid, Data2=area_17.Centroid, Data3=area_18.Centroid)
interconnectpoints = InterconnectPoints(Pts=merge_4)
length_7 = Length(Curve=interconnectpoints)
mass_addition_8 = MassAddition(Input=length_7)  # -> Result, PartialResults
panel_50 = Panel(mass_addition_8.Result)
max_4 = Slider(1000, range=0..1000)
min_4 = Slider(0, range=0..400.01)
subtraction_9 = Subtraction(A=max_4, B=min_4)
expression_8 = Expression(F=mass_addition_8.Result, max=max_4, min=min_4, x=subtraction_9, Expression="(F-550)/x")
panel_51 = Panel("minimize")
panel_52 = Panel(expression_8)

merge_5 = Merge(Data1=curve_5, Data2=path_mapper, Data3=path_mapper_2)  # -> flatten(Result)
curve_13 = Curve(merge_5)
panel_53 = Panel(curve_13)
region_union_2 = RegionUnion(Curves=curve_13)

# ---- group: indicadores
# M2 DOTACION COMUNAL POR UNIDAD DE VIVIENDA (No Incluye Espacios Tecnicos)	2.09, 	1.36, 	2.82
addition_3 = Addition(A=multiplication_18, B=number_18)
division_30 = Division(A=number_18, B=integer_2)
panel_54 = Panel(division_30)

# ---- group: areaTotalOcupacion
# índice de ocupación
area_19 = Area(Geometry=curve_6)  # -> Area, Centroid
area_20 = Area(Geometry=curve_12)  # -> Area, Centroid
area_21 = Area(Geometry=curve_8)  # -> Area, Centroid
area_22 = Area(Geometry=curve_4)  # -> Area, Centroid
merge_6 = Merge(Data2=area_20.Area, Data3=flatten(area_19.Area))
panel_55 = Panel(area_22.Area)
replace_nulls = ReplaceNulls(Items=merge_6, Replacements=Slider(0, range=0..100))  # -> Items, Count
mass_addition_9 = MassAddition(Input=replace_nulls.Items)  # -> Result, PartialResults
max_5 = Slider(0.35, range=0..1)
min_5 = Slider(0.28, range=0..1)
panel_56 = Panel(mass_addition_9.Result)
division_31 = Division(A=mass_addition_9.Result, B=area_22.Area)
subtraction_10 = Subtraction(A=max_5, B=min_5)
i_o_2 = Panel(division_31)
expression_9 = Expression(B=division_31, max=max_5, min=min_5, x=subtraction_10, Expression="(B-0.3)/x")
panel_58 = Panel(expression_9)

# ---- group: ExcelWriter / I.O.
num_5 = Number(division_31)

# ---- group: ExcelWriter
panel_59 = Panel(num_4)
merge_7 = Merge(
    Data1=num,
    Data2=num_2,
    Data3=num_4,
    Data4=num_5,
    Data5=int_2,
    Data6=int_3,
    Data7=round_9.Nearest,
    Data8=round_10.Nearest,
    Data9=int_4,
    Data10=division_25,
    Data11=division_24,
    Data12=area_16.Area,
    Data13=number_slider_8)
panel_60 = Panel("""Área bruta m2
Área neta urbanizable m2
I.C.
I.O.
Número total aptos.
Parqueaderos privados
Parqueaderos visitantes
Parqueaderos movilidad reducida
Número pisos parqueadero
Relación parqueadero/aptos.
Relación parqueadero/visitantes
Área equipamiento comunal m2
Aislamientos comunal m""")
anchoslargos = CSharpScript(plantas=list_item_14)  # -> ancho, largo; inputs plantas: tree of Rectangle3d
# ---------- anchoslargos: C# ----------
    DataTree<double> anchosOut = new DataTree<double>(), largosOut = new DataTree<double>();

    Rectangle3d temp = new Rectangle3d();

    GH_Path path = new GH_Path();

    for( int i = 0; i < plantas.BranchCount; ++i )
    {

      path = plantas.Path(i);

      for( int j = 0; j < plantas.Branch(i).Count; ++j )
      {

        temp = plantas.Branch(i)[j];
        
        anchosOut.Add(temp.Width, path);
        largosOut.Add(temp.Height, path);

      }

    }

    ancho = anchosOut;
    largo = largosOut;
# ---------- end anchoslargos ----------
panel_62 = Panel(anchoslargos.largo)
data = Data(merge_7)
panel_63 = Panel("""Ancho m
Largo m
Pisos
Aislamientos m
Aptos
Altura m""")
button = Button()
c_script_2 = CSharpScript(
    x=data,
    y=flatten(anchoslargos.ancho),
    z=flatten(anchoslargos.largo),
    u=flatten(lng),
    v=flatten(num_3),
    w=flatten(round_4.Nearest),
    xx=flatten(vec2pt.Length))  # -> out, A; inputs x: list, y: list, z: list, u: list, v: list, w: list, xx: list
# ---------- c_script_2: C# ----------
    var treeOut = new DataTree<object>();

    treeOut.AddRange(x, new GH_Path(0));

    for( int i = 0; i < x.Count; ++i )
    {

      treeOut.Add(null, new GH_Path(1));
      treeOut.Add(null, new GH_Path(2));
      treeOut.Add(null, new GH_Path(3));
      treeOut.Add(null, new GH_Path(4));
      treeOut.Add(null, new GH_Path(5));
      treeOut.Add(null, new GH_Path(6));

    }

    treeOut.AddRange(y, new GH_Path(1));
    treeOut.AddRange(z, new GH_Path(2));
    treeOut.AddRange(u, new GH_Path(3));
    treeOut.AddRange(v, new GH_Path(4));
    treeOut.AddRange(w, new GH_Path(5));
    treeOut.AddRange(xx, new GH_Path(6));

    A = treeOut;
# ---------- end c_script_2 ----------
lng_3 = ListLength(List=flatten(num_3))
c_script_3 = CSharpScript(x=panel_60, y=lng_3)  # -> out, A; inputs x: list, y: Int32
# ---------- c_script_3: C# ----------
    for( int i = 1; i <= y; ++i )
    {

      string str = "Torre " + i.ToString();

      x.Add(str);

    }

    A = x;
# ---------- end c_script_3 ----------
writexl = WriteToExcel(
    Run=Toggle(False),
    ExcelWorksheet="1",
    ColumnNames=panel_63,
    RowNames=c_script_3.A,
    WriteOptions="None",
    ColumnnsOrRows=False,
    DataToWriteIntoColumns=c_script_2.A)
panel_64 = Panel(c_script_3.A)
panel_65 = Panel(c_script_2.A)

# ---- group: indicadores
# % DE OCUPACION TOTAL (AREA TOTAL OCUPADA/AREA UTIL LOTE)	53.7%, 	38.7%, 	68.7%
division_32 = Division(A=number_17, B=number_3)
panel_66 = Panel(division_32)

# % DE AREA LIBRE = (AREA UTIL LOTE - AREA DE OCUPACION TOTAL / AREA UTIL LOTE)	46.3%, 	31.3%, 	61.3%
subtraction_11 = Subtraction(A=number_3, B=number_17)
division_33 = Division(A=subtraction_11, B=number_3)
multiplication_21 = Multiplication(A=division_33, B=100)
panel_67 = Panel(multiplication_21)

# ----
region_difference = RegionDifference(CurvesA=geometry_3, CurvesB=region_union_2)
area_23 = Area(Geometry=flatten(merge_5))  # -> Area, Centroid
region_union_3 = RegionUnion(Curves=flatten(merge_5))
area_24 = Area(Geometry=region_difference)  # -> Area, Centroid
panel_68 = Panel(merge_5)
mass_addition_10 = MassAddition(Input=area_24.Area)  # -> Result, PartialResults
area_25 = Area(Geometry=flatten(region_union_3))  # -> Area, Centroid
mass_addition_11 = MassAddition(Input=area_23.Area)  # -> Result, PartialResults
mass_addition_12 = MassAddition(Input=area_25.Area)  # -> Result, PartialResults
division_34 = Division(A=mass_addition_12.Result, B=mass_addition_11.Result)

# ----
# colisiones
curve_14 = Curve(flatten([list_item_14, region_union, list_item_22, geometry_3]))
area_26 = Area(Geometry=geometry_3)  # -> Area, Centroid
region_union_4 = RegionUnion(Curves=curve_14)
curve_15 = Curve(flatten([scale_nu.Geometry, offset, geometry_3]))
mass_addition_13 = MassAddition(Input=flatten(area_26.Area))  # -> Result, PartialResults
area_27 = Area(Geometry=region_union_4)  # -> Area, Centroid
division_35 = Division(A=mass_addition_13.Result, B=area_27.Area)
max_6 = Slider(1, range=0..1)
min_6 = Slider(0.25, range=0.25..1)
max_7 = Slider(12, range=0..80)
min_7 = Slider(0, range=0..10)
subtraction_12 = Subtraction(A=max_6, B=min_6)
subtraction_13 = Subtraction(A=max_7, B=min_7)
expression_10 = Expression(D=division_35, max=max_6, min=min_6, x=subtraction_12, Expression="(D - 0.25)/x")
panel_69 = Panel(division_34)
panel_72 = Panel(expression_10)

collision_many_many = CollisionManyMany(Colliders=curve_15)  # -> Collision, Indices
list_length_4 = ListLength(List=collision_many_many.Collision)
panel_73 = Panel(division_35)

panel_74 = Panel(list_length_4)
expression_11 = Expression(C=list_length_4, max=max_7, min=min_7, x=subtraction_13, Expression="(C-5)/x")
panel_75 = Panel(expression_11)

division_36 = Division(A=mass_addition_10.Result, B=mass_addition_13.Result)
panel_76 = Panel(division_36)
expression_12 = Expression(G=division_36, max=max, min=min, x=subtraction, Expression="((G*2) - 0.5)/x")
panel_77 = Panel(expression_12)

# ---- group: fitnessFunction
expression_13 = Expression(
    A=expression_6,
    B=expression_9,
    C=expression_11,
    D=expression_10,
    E=expression_7,
    F=expression_8,
    G=expression_12,
    Expression="A-B-C+D+E+F-G")

# ----
panel_78 = Panel(expression_13)
