# Grasshopper definition 19.07.06_Setting_002.gh (Grasshopper 1.0.7)
# plug-ins: SpacePartition, CORE.GH, Kangaroo2 Components, HAL [Data Utilities]

# ---- group: tipología
geometry = Geometry(<curve referenced from the Rhino model>)

# ---- group: áreas / áreaNeta
geometry_2 = Geometry(<curve referenced from the Rhino model>)

# ---- group: áreas
# Base Proyecto-Tipología
i_o = Panel("0.30")
i_c = Panel("2.40")
area = Area(Geometry=geometry_2)  # -> Area, Centroid
àreamanzana = Panel(area.Area)
multiplication = Multiplication(A=area.Area, B=i_o)
multiplication_2 = Multiplication(A=area.Area, B=i_c)
áreavendiblevivienda = Panel(multiplication_2)
áreaocupaciòn = Panel(multiplication)

# ---- group: áreas / loteUtil
curve = Curve(geometry_2)

# ---- group: tipología
area_2 = Area(Geometry=geometry)  # -> Area, Centroid
discontinuity = Discontinuity(Curve=geometry, Level=1)  # -> Points, Parameters
brep_edges = BrepEdges(Brep=geometry)  # -> Naked, Interior, NonManifold
shift_list = ShiftList(List=discontinuity.Points, Shift=1, Wrap=True)
point_on_curve = PointOnCurve(brep_edges.Naked, parameter=0.5)
line = Line(StartPoint=discontinuity.Points, EndPoint=shift_list)
list_item = ListItem(List=line, Index=Slider(68, range=0..100), Wrap=True)
list_item_2 = ListItem(List=point_on_curve, Index=Slider(53, range=0..100), Wrap=True)
point_on_curve_2 = PointOnCurve(list_item, parameter=0.5)
vector_2pt = Vector2Pt(PointA=area_2.Centroid, PointB=list_item_2, Unitize=False)  # -> Vector, Length
vector_2pt_2 = Vector2Pt(PointA=area_2.Centroid, PointB=point_on_curve_2, Unitize=False)  # -> Vector, Length
vector_display = VectorDisplay(Anchor=area_2.Centroid, Vector=vector_2pt.Vector)
vector_display_2 = VectorDisplay(Anchor=area_2.Centroid, Vector=vector_2pt_2.Vector)
construct_plane = ConstructPlane(Origin=Point(0, 0, 0), XAxis=vector_2pt_2.Vector, YAxis=vector_2pt.Vector)
bounding_box = BoundingBox(Content=geometry, Plane=construct_plane, UnionBox=False)  # -> Box, Box_2
deconstruct_brep = DeconstructBrep(Brep=bounding_box.Box)  # -> Faces, Edges, Vertices
number_slider = Slider(2.02, range=2..2.2)
list_item_3 = ListItem(List=deconstruct_brep.Edges, Index=1, Wrap=True)
list_item_4 = ListItem(List=deconstruct_brep.Edges, Index=0, Wrap=True)
length = Length(Curve=list_item_3)
length_2 = Length(Curve=list_item_4)
panel = Panel(length_2)
panel_2 = Panel(length)
division = Division(A=length, B=number_slider)
division_2 = Division(A=length_2, B=number_slider)

# ---- group: áreaPlanta
number_slider_2 = Slider(0.23, range=0.15..0.3)
area_3 = Area(Geometry=bounding_box.Box)  # -> Area, Centroid
expression = Expression(y=number_slider_2, Expression="1+y")
division_3 = Division(A=area_2.Area, B=expression)
division_4 = Division(A=division_3, B=8)
tipologíabox = Panel(area_3.Area)
tipologíaoriginal = Panel(area_2.Area)
panel_3 = Panel(division_3)
panel_4 = Panel(division_4)

# ---- group: referenciaViaAcceso
# curvaParqueadero
curve_2 = Curve(<curve referenced from the Rhino model>)

# ---- group: determinantesTorres
# Base Determinantes Proyecto
numtorres = Slider(5, range=0..10)
numpisos_torre = Slider(8, range=0..10)
numaptos_piso = Slider(8, range=0..10)
áreaapto = Slider(55.8, range=55..65)
multiplication_3 = Multiplication(A=numpisos_torre, B=numaptos_piso)
totalaptostorre = Panel(multiplication_3)
multiplication_4 = Multiplication(A=numtorres, B=multiplication_3)
totalaptos = Panel(multiplication_4)

# ---- group: maxPisos
# Torres + Aislamientos
minpisos = Slider(5, range=0..100)
gene_pool03 = GenePool(Decimals=0, Maximum=8, Minimum=5, Value=8)
construct_domain = ConstructDomain(DomainStart=minpisos, DomainEnd=numpisos_torre)
genepoolmodifier = GenePoolModifier(
    GeneList="Gene Pool03",
    Count=Slider(1, range=0..6),
    Domain=construct_domain,
    Randomize=Button(),
    PercentageOfRandomization=Slider(87.936, range=0..100))
panel_5 = Panel(genepoolmodifier)

# ---- group: determinantesTorres / áreaTotalIdeal
expression_2 = Expression(x=number_slider_2, Expression="1+x")
multiplication_5 = Multiplication(A=numaptos_piso, B=áreaapto)
multiplication_6 = Multiplication(A=multiplication_5, B=expression_2)
panel_6 = Panel(multiplication_5)
panel_7 = Panel(multiplication_6)

# ---- group: planesTorres / altura1eraTorre
list_item_5 = ListItem(List=gene_pool03, Index=0, Wrap=True)

# ---- group: towerNumber
construct_domain_2 = ConstructDomain(DomainStart=0, DomainEnd=1)
genepoolmodifier_2 = GenePoolModifier(
    GeneList="PointX",
    Count=numtorres,
    Domain=construct_domain_2,
    Randomize=Button(),
    PercentageOfRandomization=Slider(85, range=0..100))
genepoolmodifier_3 = GenePoolModifier(
    GeneList="PointY",
    Count=numtorres,
    Domain=construct_domain_2,
    Randomize=Button(),
    PercentageOfRandomization=Slider(85, range=0..100))
curve_3 = Curve(curve)
pointy = GenePool(Decimals=2, Maximum=1, Minimum=0, Value=[0.49, 0.75, 0.49, 0.72, 0.7])
pointx = GenePool(Decimals=2, Maximum=1, Minimum=0, Value=[0.18, 0.11, 0.79, 0.39, 0.83])
boundary_surfaces = BoundarySurfaces(Edges=curve_3)
construct_point = ConstructPoint(XCoordinate=pointx, YCoordinate=pointy, ZCoordinate=0)
area_4 = Area(Geometry=boundary_surfaces)  # -> Area, Centroid
custom_preview = CustomPreview(Geometry=boundary_surfaces, Material=ColourSwatch(SwatchColor=RGBA(241, 232, 210, 193)))
scale = Scale(Geometry=boundary_surfaces, Center=area_4.Centroid, Factor=Slider(1, range=0..1))  # -> Geometry, Transform
evaluate_surface = EvaluateSurface(Surface=reparameterize(scale.Geometry), Point=construct_point)  # -> Point, Normal, UDirection, VDirection, Frame
surface_closest_point = SurfaceClosestPoint(Point=evaluate_surface.Point, Surface=scale.Geometry)  # -> Point, UVPoint, Distance
iso_curve = IsoCurve(Surface=boundary_surfaces, UVPoint=surface_closest_point.UVPoint)  # -> UIsocurve, VIsocurve

# ---- group: pisosAlturaMáxima
number_slider_3 = Slider(2.4, range=0..10)
integer = Integer(numpisos_torre)
duplicate_data = DuplicateData(Data=number_slider_3, Number=integer, Order=True)
merge = Merge(Data1=flatten(Slider(0, range=0..100)), Data2=flatten(duplicate_data))
mass_addition = MassAddition(Input=merge)  # -> Result, PartialResults
panel_8 = Panel(mass_addition.Result)
panel_9 = Panel(mass_addition.PartialResults)

# ---- group: planesTorres / alturaEntrepiso
number = Number(number_slider_3)

# ----
# Parqueaderos Visitantes Andén
discontinuity_2 = Discontinuity(Curve=curve_2, Level=1)  # -> Points, Parameters
number_slider_4 = Slider(2.3, range=0..10)
fit_line = FitLine(Points=discontinuity_2.Points)
number_slider_5 = Slider(33, range=0..100)
point = Point(area.Centroid)
end_points = EndPoints(Curve=fit_line)  # -> Start, End
# Plataforma Parqueaderos P/V/MR
vector_2pt_3 = Vector2Pt(PointA=end_points.Start, PointB=end_points.End, Unitize=False)  # -> Vector, Length
amplitude = Amplitude(Vector=vector_2pt_3.Vector, Amplitude=number_slider_4)
line_pt = LinePt(Line=fit_line, Point=point)
rectangle = Rectangle(Plane=line_pt, XSize=number_slider_4, YSize=Slider(4.3, range=0..10), Radius=0)  # -> Rectangle, Length
offset_curve = OffsetCurve(Curve=fit_line, Distance=Slider(-5, range=-10..10), Plane=line_pt, Corners=1)
linear_array = LinearArray(Geometry=rectangle.Rectangle, Direction=amplitude, Count=number_slider_5)  # -> Geometry, Transform

# ---- group: equipComún
y = Slider(0.11, range=0..1)
x = Slider(0.2, range=0..1)
construct_point_2 = ConstructPoint(XCoordinate=x, YCoordinate=y, ZCoordinate=0)
evaluate_surface_2 = EvaluateSurface(Surface=reparameterize(scale.Geometry), Point=construct_point_2)  # -> Point, Normal, UDirection, VDirection, Frame
surface_closest_point_2 = SurfaceClosestPoint(Point=evaluate_surface_2.Point, Surface=scale.Geometry)  # -> Point, UVPoint, Distance

# ----
# Orientación Proyecto/Lote
number_slider_6 = Slider(6, range=0..100)
discontinuity_3 = Discontinuity(Curve=curve, Level=2)  # -> Points, Parameters
shift_list_2 = ShiftList(List=discontinuity_3.Points, Shift=Slider(8, range=0..20), Wrap=True)
list_item_6 = ListItem(List=shift_list_2, Index=Slider(0, range=0..100), Wrap=True)
list_item_7 = ListItem(List=shift_list_2, Index=Slider(1, range=0..1), Wrap=True)
point_list = PointList(Points=discontinuity_3.Points, Size=Slider(10, range=0..10))
point_list_2 = PointList(Points=shift_list_2, Size=Slider(10, range=0..10))
list_item_8 = ListItem(List=shift_list_2, Index=number_slider_6, Wrap=True)
panel_10 = Panel(discontinuity_3.Points)
line_2 = Line(StartPoint=list_item_6, EndPoint=list_item_7)
line_pt_2 = LinePt(Line=line_2, Point=list_item_8)

# ---- group: northOrientation / centroid
# Orientación Norte/Lote
point_2 = Point(area.Centroid)

# ---- group: northOrientation
number_slider_7 = Slider(100, range=-100..100)
# Orientación Volumetría/Lote
number_slider_8 = Slider(-100, range=-100..100)
unit_x = UnitX(Factor=[number_slider_7, number_slider_8])
unit_y = UnitY(Factor=[number_slider_7, number_slider_8])
move = Move(Geometry=point_2, Motion=unit_y)  # -> Geometry, Transform
move_2 = Move(Geometry=point_2, Motion=unit_x)  # -> Geometry, Transform
list_item_9 = ListItem(List=move_2.Geometry, Index=0, Wrap=True)
list_item_10 = ListItem(List=move.Geometry, Index=0, Wrap=True)
vector_2pt_4 = Vector2Pt(PointA=point_2, PointB=list_item_9, Unitize=False)  # -> Vector, Length
vector_2pt_5 = Vector2Pt(PointA=point_2, PointB=list_item_10, Unitize=False)  # -> Vector, Length
vector_display_3 = VectorDisplay(Anchor=point_2, Vector=vector_2pt_4.Vector)
vector_display_4 = VectorDisplay(Anchor=point_2, Vector=vector_2pt_5.Vector)

# ---- group: alignAllGeometry
radians = Radians(Degrees=Slider(83, range=0..360))
rotate_plane = RotatePlane(Plane=line_pt_2, Angle=radians)
panel_11 = Panel("""0.0
0.5
1.0
1.5
2""")
circle = Circle(Plane=rotate_plane, Radius=Slider(47, range=0..100))
vector_2pt_6 = Vector2Pt(PointA=rotate_plane, PointB=point_2, Unitize=False)  # -> Vector, Length
expression_3 = Expression(x=panel_11, Expression="x*pi")
vector_display_5 = VectorDisplay(Anchor=rotate_plane, Vector=vector_2pt_6.Vector)
bounds = Bounds(Numbers=expression_3)
move_3 = Move(Geometry=circle, Motion=vector_2pt_6.Vector)  # -> Geometry, Transform
gene_pool04 = GenePool(Decimals=0, Maximum=3, Minimum=0, Value=[0, 0, 0, 1, 0])
remap_numbers = RemapNumbers(Value=expression_3, Source=bounds, Target=Domain(0, 1))  # -> Mapped, Clipped
panel_12 = Panel(remap_numbers.Mapped)
construct_domain_3 = ConstructDomain(DomainStart=0, DomainEnd=3)
evaluate_curve = EvaluateCurve(Curve=reparameterize(move_3.Geometry), Parameter=remap_numbers.Mapped)  # -> Point, Tangent, Angle
plane = Plane(surface_closest_point.Point)
list_item_11 = ListItem(List=evaluate_curve.Point, Index=gene_pool04, Wrap=True)  # -> graft(Item)
vector_2pt_7 = Vector2Pt(PointA=point_2, PointB=list_item_11, Unitize=False)  # -> Vector, Length
vector_display_6 = VectorDisplay(Anchor=point_2, Vector=vector_2pt_7.Vector)
align_plane = AlignPlane(Plane=plane, Direction=flatten(vector_2pt_7.Vector))  # -> Plane, Angle
list_length = ListLength(List=flatten(plane))
genepoolmodifier_4 = GenePoolModifier(
    GeneList="Gene Pool04",
    Count=list_length,
    Domain=construct_domain_3,
    Randomize=Button(),
    PercentageOfRandomization=Slider(80.059, range=0..100))
panel_13 = Panel(genepoolmodifier_4)
rotate = Rotate(Geometry=plane, Angle=align_plane.Angle, Plane=align_plane.Plane)  # -> Geometry, Transform
list_item_12 = ListItem(List=flatten(vector_2pt_7.Vector), Index=0, Wrap=True)  # -> Item, Item1, Item2, Item3
vector_display_7 = VectorDisplay(Anchor=point_2, Vector=list_item_12.Item2)
vector_display_8 = VectorDisplay(Anchor=point_2, Vector=list_item_12.Item)

# ---- group: planesTorres
plane_2 = Plane(rotate.Geometry)

# ---- group: indicadores / áreaApto
number_2 = Number(áreaapto)

# ---- group: indicadores / áreaÚtilLote
number_3 = Number(area.Area)

# ---- group: areaTotalOcupacion / manzana
curve_4 = Curve(curve)

# ---- group: ExcelWriter / ÁreaBruta
num = Number(area.Area)

# ---- group: ExcelWriter / ÁreaNetaUrbanizable
num_2 = Number(area.Area)

# ---- group: controlAmbiental
geometry_3 = Geometry(<curve referenced from the Rhino model>)

# ----
area_5 = Area(Geometry=flatten(geometry_3))  # -> Area, Centroid
mass_addition_2 = MassAddition(Input=area_5.Area)  # -> Result, PartialResults
min = Slider(0.3, range=0.25..1)
max = Slider(0.6, range=0..0.6)
subtraction = Subtraction(A=max, B=min)
panel_14 = Panel("G minimize")
galapagos = Galapagos(fitness=expression_14, gene=[gene_pool04, salida, pointx, pointy, x, y, number_slider])

# ---- group: calculoParqueaderos / numUnidades
number_4 = Number(áreaapto)

# ---- group: planesTorres
construct_domain_4 = ConstructDomain(DomainStart=expr("-x", division), DomainEnd=division)
construct_domain_5 = ConstructDomain(DomainStart=expr("-x", division_2), DomainEnd=division_2)
c_script = CSharpScript(x=multiplication_2, y=Slider(2, range=0..10))  # -> out, A; inputs x: Double, y: Int32
# ---------- c_script: C# ----------
    A = Math.Round(x, y);
# ---------- end c_script ----------
difstor = Slider(0, range=0..10)
domain = Domain(construct_domain_4)
domain_2 = Domain(construct_domain_5)
panel_15 = Panel(list_item_5)

# ---- group: planesTorres / areaTotalConstruida
number_5 = Number(c_script.A)

# ---- group: calculoParqueaderos
parqprivados = Slider(2, range=0..10)
alturaedificio = Slider(2, range=1..3)
always_even_odd = AlwaysEvenOdd(Integer=Slider(4, range=1..4), EvenOdd=Toggle(False))  # -> Integer, Corrected
anchoparqueo = Slider(2.3, range=0..2.5)
anchomovilidadreducida = Slider(3.1, range=0..3.1)
multiplication_7 = Multiplication(A=Slider(4.3, range=0..10), B=always_even_odd.Integer)
multiplication_8 = Multiplication(A=Slider(5, range=0..10), B=always_even_odd.Integer)
addition = Addition(A=multiplication_7, B=multiplication_8)

# ---- group: ExcelWriter / NúmeroPisosParqueadero
int = Integer(alturaedificio)

# ---- group: planesTorres (continued)
multiplication_9 = Multiplication(A=number_5, B=1.5)
customgeoplacement = CSharpScript(diff=difstor, f=number, w=domain_2, h=domain, maxIter=list_item_5, areaTotal=multiplication_9, planes=flatten(plane_2))  # -> A, B; inputs diff: Int32, f: Double, maxIter: Int32, areaTotal: Double, planes: list of Plane
# ---------- customgeoplacement: C# ----------
    var listaRect = new DataTree<Rectangle3d>();
    double move = 0.0;
    var vectorList = new DataTree<Vector3d>();
    int size = planes.Count;
    Rectangle3d rectTemp = new Rectangle3d();
    double areaR = 0, temp = 0;

    for (int i = 0; i < size; ++i)
    {

      rectTemp = new Rectangle3d(planes[i], w, h);

      var path = new GH_Path(i);

      for (int j = 0; j <= maxIter; ++j)
      {

        if( j != 0 )

          temp += f;

        areaR += AreaMassProperties.Compute(rectTemp.ToNurbsCurve()).Area;

        //vector = new Vector3d(0, 0, temp);


        rectTemp.Transform(Rhino.Geometry.Transform.Translation(0, 0, temp));
        listaRect.Add(rectTemp, path);
        move += temp;
        vectorList.Add(new Vector3d(0, 0, move), path);
        temp = 0;

        if (areaR * 1.025 >= areaTotal && areaR * 0.975 <= areaTotal) break;

      }

      maxIter -= diff;

      move = 0;

      if (areaR * 1.025 >= areaTotal && areaR * 0.975 <= areaTotal) break;

    }

    A = listaRect;
    B = vectorList;
    //Print(areaR.ToString());
# ---------- end customgeoplacement ----------
panel_16 = Panel(multiplication_9)
area_6 = Area(Geometry=customgeoplacement.A)  # -> Area, Centroid
reverse_list = ReverseList(List=area_6.Centroid)
list_item_13 = ListItem(List=reverse_list, Index=0, Wrap=True)
deconstruct = Deconstruct(Point=list_item_13)  # -> XComponent, YComponent, ZComponent

# ---- group: planesTorres / aislamiento
number_6 = Number(deconstruct.ZComponent)
division_5 = Division(A=number_6, B=Slider(3, range=0..5))

# ---- group: ExcelWriter / PisosXTorre
int_2 = Integer(customgeoplacement.B)
lng = ListLength(List=int_2)

# ---- group: planesTorres / outputBase
list_item_14 = ListItem(List=customgeoplacement.A, Index=0, Wrap=True)
geometry_4 = Geometry(customgeoplacement.A)

# ---- group: areaTotalConstruida
move_4 = Move(Geometry=list_item_14, Motion=customgeoplacement.B)  # -> Geometry, Transform
# Área Construida / Vendible
panel_17 = Panel(move_4.Geometry)
list_length_2 = ListLength(List=move_4.Geometry)
subtraction_2 = Subtraction(A=list_length_2, B=1)
cull_index = CullIndex(List=move_4.Geometry, Indices=subtraction_2, Wrap=True)
area_7 = Area(Geometry=cull_index)  # -> Area, Centroid
porcentajecirculaciòn = Slider(1.15, range=1..2)
mass_addition_3 = MassAddition(Input=flatten(area_7.Area))  # -> Result, PartialResults
division_6 = Division(A=mass_addition_3.Result, B=porcentajecirculaciòn)
multiplication_10 = Multiplication(A=mass_addition_3.Result, B=Slider(0.15, range=0..1))
areatotalconstruida = Panel(mass_addition_3.Result)
areatotalvendible = Panel(division_6)
multiplication_11 = Multiplication(A=multiplication_10, B=0.5)

# ---- group: calculoParqueaderos / numUnidades (continued)
# Cálculo Parqueaderos
number_7 = Number(division_6)
division_7 = Division(A=number_7, B=number_4)
round = Round(Number=division_7)  # -> Nearest, Floor, Ceiling

# ---- group: calculoParqueaderos (continued)
panel_18 = Panel(round.Nearest)
division_8 = Division(A=round.Nearest, B=parqprivados)
division_9 = Division(A=round.Nearest, B=Slider(30, range=0..30))
division_10 = Division(A=round.Nearest, B=Slider(10, range=0..10))
parqprivados_2 = Panel(division_8)
parqmovreducida = Panel(division_9)
parqvisitantes = Panel(division_10)
subtraction_3 = Subtraction(A=parqvisitantes, B=number_slider_5)
division_11 = Division(A=parqprivados_2, B=alturaedificio)
division_12 = Division(A=subtraction_3, B=alturaedificio)
division_13 = Division(A=parqmovreducida, B=alturaedificio)
mass_addition_4 = MassAddition(Input=[division_8, division_10, parqmovreducida])  # -> Result, PartialResults
round_2 = Round(Number=division_11)  # -> Nearest, Floor, Ceiling
round_3 = Round(Number=division_12)  # -> Nearest, Floor, Ceiling
round_4 = Round(Number=division_13)  # -> Nearest, Floor, Ceiling
panel_19 = Panel(round_3.Floor)
panel_20 = Panel(round_2.Floor)
round_5 = Round(Number=mass_addition_4.Result)  # -> Nearest, Floor, Ceiling
panel_21 = Panel(round_4.Floor)
panel_22 = Panel(round_5.Nearest)
mass_addition_5 = MassAddition(Input=[round_2.Nearest, round_3.Nearest])  # -> Result, PartialResults
panel_23 = Panel(mass_addition_5.Result)
division_14 = Division(A=round_4.Nearest, B=always_even_odd.Integer)
division_15 = Division(A=mass_addition_5.Result, B=always_even_odd.Integer)
multiplication_12 = Multiplication(A=division_14, B=anchomovilidadreducida)
multiplication_13 = Multiplication(A=division_15, B=anchoparqueo)
addition_2 = Addition(A=multiplication_13, B=multiplication_12)

# ---- group: planesTorres / outputBase (continued)
loft = Loft(Curves=move_4.Geometry, Options={Adjust=False, Closed=False, LoftEnds=0, LoftSimp=0, LoftType=0, Rebuild=10, Refit=0.01})

# ---- group: planesTorres (continued)
panel_24 = Panel(list_item_14)
cap_holes = CapHoles(Brep=loft)
custom_preview_2 = CustomPreview(Geometry=cap_holes, Material=ColourSwatch(SwatchColor=RGBA(49, 101, 158, 103)))
division_16 = Division(A=division_5, B=2)
offset_curve_2 = OffsetCurve(Curve=list_item_14, Distance=division_16, Plane=PlaneXY(0, 0, 0), Corners=1)
cross_reference = CrossReference(ListListA=flatten(offset_curve_2), ListListB=flatten(offset_curve_2), CrossMode=5)  # -> ListListA, ListListB
panel_25 = Panel(division_16)
geometry_5 = Geometry(graft(cross_reference.ListListB))
geometry_6 = Geometry(graft(cross_reference.ListListA))
geometry_7 = Geometry([geometry_6, geometry_5])
list_item_15 = ListItem(List=geometry_7, Index=0, Wrap=True)  # -> Item, Item1
region_intersection = RegionIntersection(CurvesA=list_item_15.Item, CurvesB=list_item_15.Item1)
curve_curve = CurveCurve(CurveA=list_item_15.Item, CurveB=list_item_15.Item1)  # -> Points, ParamsA, ParamsB

# ---- group: escalaOffsets
# ladosCortos porcentaje escala
# ladosLargos porcentaje escala
offset_curve_3 = OffsetCurve(Curve=list_item_14, Distance=division_16, Plane=PlaneXY(0, 0, 0), Corners=1)
area_8 = Area(Geometry=list_item_14)  # -> Area, Centroid
brep_edges_2 = BrepEdges(Brep=list_item_14)  # -> Naked, Interior, NonManifold
brep_edges_3 = BrepEdges(Brep=offset_curve_3)  # -> Naked, Interior, NonManifold
point_on_curve_3 = PointOnCurve(brep_edges_2.Naked, parameter=0.5)
point_on_curve_4 = PointOnCurve(brep_edges_3.Naked, parameter=0.5)
point_3 = Point(point_on_curve_3)
point_4 = Point(point_on_curve_4)
list_item_16 = ListItem(List=point_3, Index=0, Wrap=True)  # -> Item, Item1, Item2, Item3
point_list_3 = PointList(Points=point_4, Size=Slider(1, range=0..1))
list_item_17 = ListItem(List=point_4, Index=0, Wrap=True)  # -> Item, Item1, Item2, Item3
line_3 = Line(StartPoint=list_item_16.Item1, EndPoint=list_item_16.Item3)
line_4 = Line(StartPoint=list_item_16.Item, EndPoint=list_item_16.Item2)
line_5 = Line(StartPoint=list_item_17.Item1, EndPoint=list_item_17.Item3)
line_6 = Line(StartPoint=list_item_17.Item, EndPoint=list_item_17.Item2)
length_3 = Length(Curve=line_4)
length_4 = Length(Curve=line_3)
length_5 = Length(Curve=line_5)
length_6 = Length(Curve=line_6)
expression_4 = Expression(a=length_3, b=length_6, Expression="((100*b)/a)*0.01")
expression_5 = Expression(a=length_4, b=length_5, Expression="(1.5/b)+1")
panel_26 = Panel(expression_4)
panel_27 = Panel(expression_5)

# ----
areatotalvendible_2 = Panel(multiplication_11)

# ---- group: Heights
# Altura Torres
# Ocupación Total Edificios / Equipamiento Cumunal / Parqueaderos
lng_2 = ListLength(List=move_4.Geometry)
subtraction_4 = Subtraction(A=lng_2, B=1)
item = ListItem(List=move_4.Geometry, Index=subtraction_4, Wrap=True)
area_9 = Area(Geometry=item, UseTasks=False)  # -> Area, Centroid
pdecon = Deconstruct(Point=area_9.Centroid)  # -> XComponent, YComponent, ZComponent
pt = ConstructPoint(XCoordinate=pdecon.XComponent, YCoordinate=pdecon.YComponent, ZCoordinate=0)
vec2pt = Vector2Pt(PointA=pt, PointB=area_9.Centroid, Unitize=False)  # -> Vector, Length
vdis = VectorDisplay(Anchor=pt, Vector=vec2pt.Vector)

# ---- group: scaleOffsets
line_line = LineLine(LineA=line_3, LineB=line_4)
vector_2pt_8 = Vector2Pt(PointA=line_line, PointB=area_8.Centroid, Unitize=False)  # -> Vector, Length
move_5 = Move(Geometry=line_line, Motion=vector_2pt_8.Vector)  # -> Geometry, Transform
scale_nu = ScaleNU(Geometry=list_item_14, Plane=move_5.Geometry, ScaleX=expression_5, ScaleY=expression_4, ScaleZ=1)  # -> Geometry, Transform

# ---- group: bloqueParqueaderos
rectangle_2 = Rectangle(Plane=area.Centroid, XSize=addition_2, YSize=addition, Radius=0)  # -> Rectangle, Length

# input: módulo parqueaderos x piso, doble crujía, doble circulación paralela
panel_28 = Panel(curve_2)
merge_2 = Merge(Data1=list_item_12.Item, Data2=list_item_12.Item2)
curve_5 = Curve(rectangle_2.Rectangle)
area_10 = Area(Geometry=rectangle_2.Rectangle)  # -> Area, Centroid
plane_3 = Plane(curve_5)
align_plane_2 = AlignPlane(Plane=plane_3, Direction=flatten(merge_2))  # -> Plane, Angle
panel_29 = Panel(merge_2)
multiplication_14 = Multiplication(A=area_10.Area, B=alturaedificio)
panel_30 = Panel(multiplication_14)
salida = Slider(0.43, range=0..0.7)
rotate_2 = Rotate(Geometry=curve_5, Angle=align_plane_2.Angle, Plane=align_plane_2.Plane)  # -> Geometry, Transform
area_11 = Area(Geometry=curve)  # -> Area, Centroid
area_12 = Area(Geometry=rotate_2.Geometry)  # -> Area, Centroid
evaluate_curve_2 = EvaluateCurve(Curve=reparameterize(curve_2), Parameter=salida)  # -> Point, Tangent, Angle
subtraction_5 = Subtraction(A=area_11.Centroid, B=area_12.Centroid)
move_6 = Move(Geometry=rotate_2.Geometry, Motion=subtraction_5)  # -> Geometry, Transform
list_length_3 = ListLength(List=merge_2)
duplicate_data_2 = DuplicateData(Data=evaluate_curve_2.Point, Number=list_length_3, Order=True)
curve_proximity = CurveProximity(CurveA=graft(move_6.Geometry), CurveB=curve_2)  # -> PointA, PointB, Distance
panel_31 = Panel(curve_proximity.PointB)
vector_2pt_9 = Vector2Pt(PointA=curve_proximity.PointA, PointB=graft(duplicate_data_2), Unitize=False)  # -> Vector, Length
unit_z = UnitZ(Factor=Slider(-1.5, range=-1.5..0))
vector_display_9 = VectorDisplay(Anchor=curve_proximity.PointA, Vector=vector_2pt_9.Vector)
move_7 = Move(Geometry=graft(move_6.Geometry), Motion=vector_2pt_9.Vector)  # -> Geometry, Transform
list_item_18 = ListItem(List=flatten(move_7.Geometry), Index=Slider(1, range=1..2), Wrap=True)
move_8 = Move(Geometry=list_item_18, Motion=unit_z)  # -> Geometry, Transform
number_slider_9 = Slider(3, range=0..10)

# ---- group: equipamientoComunal
m2comunal = Slider(5, range=0..10)
# Equipamiento Comunal
division_17 = Division(A=division_6, B=áreaapto)
subtraction_6 = Subtraction(A=area.Area, B=multiplication)
areaequipcomunal = Slider(190, range=0..1000)
round_6 = Round(Number=division_17)  # -> Nearest, Floor, Ceiling
multiplication_15 = Multiplication(A=round_6.Nearest, B=m2comunal)
multiplication_16 = Multiplication(A=subtraction_6, B=Slider(0.465, range=0..1))
zonasverdes = Panel(multiplication_16)
equipcomunalexigido = Panel(multiplication_15)
area_13 = Area(Geometry=list_item_18)  # -> Area, Centroid
brep_edges_4 = BrepEdges(Brep=list_item_18)  # -> graft(Naked), Interior, NonManifold
radians_2 = Radians(Degrees=Slider(90, range=0..100))
line_pt_3 = LinePt(Line=brep_edges_4.Naked, Point=area_13.Centroid)
rotate_plane_2 = RotatePlane(Plane=line_pt_3, Angle=radians_2)  # -> flatten(Plane)
plane_origin = PlaneOrigin(Base=rotate_plane_2, Origin=surface_closest_point_2.Point)
numpisos = Slider(2, range=0..2)
list_item_19 = ListItem(List=plane_origin, Index=0, Wrap=True)
multiplication_17 = Multiplication(A=numpisos, B=number_slider_3)
division_18 = Division(A=areaequipcomunal, B=numpisos)
square_root = SquareRoot(Value=division_18)
rectangle_3 = Rectangle(Plane=list_item_19, XSize=square_root, YSize=square_root, Radius=0)  # -> Rectangle, Length
curve_6 = Curve(rectangle_3.Rectangle)
unit_z_2 = UnitZ(Factor=multiplication_17)
list_item_20 = ListItem(List=curve_6, Index=Slider(3, range=0..3), Wrap=True)
area_14 = Area(Geometry=list_item_20)  # -> Area, Centroid
panel_32 = Panel(list_item_20)
move_9 = Move(Geometry=list_item_20, Motion=unit_z_2)  # -> Geometry, Transform
multiplication_18 = Multiplication(A=numpisos, B=area_14.Area)
loft_2 = Loft(
    Curves=[list_item_20, move_9.Geometry],
    Options={Adjust=False, Closed=False, LoftEnds=0, LoftSimp=0, LoftType=0, Rebuild=10, Refit=0.01})
cap_holes_2 = CapHoles(Brep=loft_2)
custom_preview_3 = CustomPreview(Geometry=cap_holes_2, Material=ColourSwatch(SwatchColor=RGBA(107, 80, 162, 138)))

# ---- group: bloqueParqueaderos / selectorGeometríaParqueo
unit_z_3 = UnitZ(Factor=number_slider_3)
move_10 = Move(Geometry=move_8.Geometry, Motion=unit_z_3)  # -> Geometry, Transform
loft_3 = Loft(
    Curves=[move_10.Geometry, list_item_18],
    Options={Adjust=False, Closed=False, LoftEnds=0, LoftSimp=0, LoftType=0, Rebuild=10, Refit=0.01})
cap_holes_3 = CapHoles(Brep=loft_3)
custom_preview_4 = CustomPreview(Geometry=cap_holes_3, Material=ColourSwatch(SwatchColor=RGBA(228, 95, 57, 154)))
region_union = RegionUnion(Curves=[list_item_18, list_item_20])
offset = OffsetCurve(Curve=region_union, Distance=number_slider_9, Plane=PlaneXY(0, 0, 0), Corners=1)

# ---- group: ocupaciónTotal
area_15 = Area(Geometry=region_union)  # -> Area, Centroid
area_16 = Area(Geometry=list_item_14)  # -> Area, flatten(Centroid)
panel_33 = Panel(area_16.Area)
mass_addition_6 = MassAddition(Input=flatten(area_16.Area))  # -> Result, PartialResults
mass_addition_7 = MassAddition(Input=flatten([mass_addition_6.Result, area_15.Area]))  # -> Result, PartialResults
ocupacióntotal = Panel(mass_addition_7.Result)

# ---- group: indicadores / totalParqueaderos
integer_2 = Integer(round_5.Nearest)

# ---- group: indicadores / totalUNViv
integer_3 = Integer(round.Nearest)

# ---- group: indicadores / áreaPrimerPiso
number_8 = Number(mass_addition_6.Result)

# ---- group: indicadores / ocupaciónTotal
number_9 = Number(mass_addition_7.Result)

# ---- group: fitnessFunction
# Índice de Construcción
number_10 = Number(division_6)
mass_addition_8 = MassAddition(TotalÁreaConstruida=number_10)  # -> Result, PartialResults
expression_6 = Expression(x=mass_addition_8.Result, y=area.Area, Expression="x/y")
panel_34 = Panel(mass_addition_8.Result)
max_2 = Slider(2.43, range=0..6)
min_2 = Slider(2.25, range=0..10)
subtraction_7 = Subtraction(A=max_2, B=min_2)
panel_35 = Panel(expression_6)
expression_7 = Expression(A=expression_6, max=max_2, min=min_2, x=subtraction_7, Expression="(A-2.4)/x")
panel_36 = Panel("A maximize")
panel_37 = Panel(expression_7)

# ---- group: indicadores / áreaVendible
number_11 = Number(division_6)

# ---- group: indicadores / áreaPuntoFijo
number_12 = Number(multiplication_11)

# ----
# distanciaCentroides
area_17 = Area(Geometry=list_item_18)  # -> Area, Centroid
area_18 = Area(Geometry=move_9.Geometry)  # -> Area, Centroid
merge_3 = Merge(Data1=area_16.Centroid, Data2=area_17.Centroid, Data3=area_18.Centroid)
interconnectpoints = InterconnectPoints(Pts=merge_3)
length_7 = Length(Curve=interconnectpoints)
mass_addition_9 = MassAddition(Input=length_7)  # -> Result, PartialResults
panel_38 = Panel(mass_addition_9.Result)
max_3 = Slider(1000, range=0..1000)
min_3 = Slider(0, range=0..1)
subtraction_8 = Subtraction(A=max_3, B=min_3)
expression_8 = Expression(F=mass_addition_9.Result, max=max_3, min=min_3, x=subtraction_8, Expression="(F-650)/x")
panel_39 = Panel("F maximize")
panel_40 = Panel(expression_8)

# ---- group: indicadores / áreaTotalConstruida
number_13 = Number(mass_addition_3.Result)

# ---- group: indicadores / áreaCirculación
number_14 = Number(multiplication_10)

# ---- group: indicadores / áreaParqueable
number_15 = Number(multiplication_14)

# ---- group: indicadores / áreaEquipComunal
number_16 = Number(multiplication_18)

# ---- group: áreaVendible
number_17 = Number(division_6)

# ---- group: áreaConstruida
number_18 = Number(mass_addition_3.Result)

# ---- group: ExcelWriter / ParqueaderosVisitantes
round_7 = Round(Number=division_10)  # -> Nearest, Floor, Ceiling

# ---- group: ExcelWriter / ParqueaderosMovilidadReducida
round_8 = Round(Number=division_9)  # -> Nearest, Floor, Ceiling

# ---- group: areaTotalOcupacion / parqueaderos
curve_7 = Curve(list_item_18)

# ---- group: areaTotalOcupacion / equipamientoComunal
curve_8 = Curve(list_item_20)

# ---- group: areaTotalOcupacion / edificios
curve_9 = Curve(list_item_14)

# ---- group: ExcelWriter / ÁreaComunal
area_19 = Area(Geometry=list_item_20, UseTasks=False)  # -> Area, Centroid

# ---- group: ExcelWriter / I.C.
num_3 = Number(expression_6)

# ---- group: ExcelWriter / ParqueaderosPrivados
int_3 = Integer(round_2.Nearest)

# ----
curve_10 = Curve(flatten(list_item_14))
curve_11 = Curve(region_union)
curve_12 = Curve(list_item_20)
path_mapper = PathMapper(curve_12, source="{A}", target="{7}")
path_mapper_2 = PathMapper(curve_11, source="{A;B}", target="{6}")
cross_reference_2 = CrossReference(ListA=curve_10, ListB=curve_10, CrossMode=2)  # -> ListA, ListB
merge_4 = Merge(Data1=curve_10, Data2=path_mapper_2, Data3=path_mapper)  # -> flatten(Result)

# ----
# áreaVendible/áreaConstruida
division_19 = Division(A=number_17, B=number_18)
panel_41 = Panel(division_19)
max_4 = Slider(1, range=0..1)
min_4 = Slider(0.8, range=0.8..1)
subtraction_9 = Subtraction(A=max_4, B=min_4)
expression_9 = Expression(E=division_19, max=max_4, min=min_4, x=subtraction_9, Expression="(E-0.85)/x")
panel_42 = Panel(expression_9)
panel_43 = Panel("E maximize")

# ---- group: indicadores
# AREA PROMEDIO PARQUEADERO (AREA PARQUEABLE/TOTAL PARQUEADEROS)	23.53, 	20.18, 	26.88
division_20 = Division(A=number_15, B=integer_2)
panel_44 = Panel(division_20)

# RELACION M2 VENDIBLES /M2 CONSTRUIDOS = (AREA TOTAL VENDIBLE/AREA CONSTRUIDA )	80%, 	76%, 	84%
division_21 = Division(A=number_11, B=number_13)
multiplication_19 = Multiplication(A=division_21, B=100)
panel_45 = Panel(multiplication_19)

# NUMERO DE VIV/Ha UTIL = (No. TOTAL DE APARTAMENTOS/AREA UTIL LOTE) 	257, 	170, 	344
division_22 = Division(A=number_3, B=10000)
round_9 = Round(Number=division_22)  # -> Nearest, Floor, Ceiling
division_23 = Division(A=integer_3, B=round_9.Nearest)
panel_46 = Panel(division_23)

# M2 DOTACION COMUNAL POR UNIDAD DE VIVIENDA (No Incluye Espacios Tecnicos)	2.09, 	1.36, 	2.82
addition_3 = Addition(A=multiplication_16, B=number_16)
division_24 = Division(A=number_16, B=integer_3)
panel_47 = Panel(division_24)

# INDICE DE CONSTRUCCION (AREA CONSTRUIDA VENDIBLE/AREA UTIL)	1.58, 	1.08, 	2.08
division_25 = Division(A=number_11, B=number_3)
panel_48 = Panel(division_25)

# M2 PUNTO FIJO POR  UNIDAD DE VIVIENDA = (AREA PUNTOS FIJOS/No. TOTAL DE APARTAMENTOS)	5.41, 	4.69, 	6.13
division_26 = Division(A=number_12, B=integer_3)
panel_49 = Panel(division_26)

# RELACION PARQUEADEROS POR VIVIENDA=(TOTAL PARQUEADEROS / No. TOTAL DE VIVIENDAS, Incl visit)	0.43, 	0.36, 	0.50
division_27 = Division(A=integer_2, B=integer_3)
panel_50 = Panel(division_27)

# RELACION M2 DE PUNTO FIJO/AREA VENDIBLE=(AREA PUNTOS FIJOS/AREA VENDIBLE)	9.2%, 	8.2%, 	10.2%
division_28 = Division(A=number_12, B=number_11)
multiplication_20 = Multiplication(A=division_28, B=100)
panel_51 = Panel(multiplication_20)

# INDICE DE OCUPACION (AREA CONSTRUIDA EN PRIMER PISO/AREA UTIL LOTE)	0.39, 	0.21, 	0.57
division_29 = Division(A=number_8, B=number_3)
panel_52 = Panel(division_29)

# ----
curve_13 = Curve(merge_4)
region_union_2 = RegionUnion(Curves=curve_13)

# ---- group: indicadores
# % DE OCUPACION TOTAL (AREA TOTAL OCUPADA/AREA UTIL LOTE)	53.7%, 	38.7%, 	68.7%
division_30 = Division(A=number_9, B=number_3)
panel_53 = Panel(division_30)

# % DE AREA LIBRE = (AREA UTIL LOTE - AREA DE OCUPACION TOTAL / AREA UTIL LOTE)	46.3%, 	31.3%, 	61.3%
subtraction_10 = Subtraction(A=number_3, B=number_9)
division_31 = Division(A=subtraction_10, B=number_3)
multiplication_21 = Multiplication(A=division_31, B=100)
panel_54 = Panel(multiplication_21)

# ----
# Área Libre 1er Piso
region_difference = RegionDifference(CurvesA=geometry_3, CurvesB=region_union_2)

# ---- group: areaTotalOcupacion
# índice de ocupación
area_20 = Area(Geometry=curve_9)  # -> Area, Centroid
area_21 = Area(Geometry=curve_8)  # -> Area, Centroid
area_22 = Area(Geometry=curve_7)  # -> Area, Centroid
area_23 = Area(Geometry=curve_4)  # -> Area, Centroid
merge_5 = Merge(Data2=area_21.Area, Data3=flatten(area_20.Area))
panel_55 = Panel(area_20.Area)
panel_56 = Panel(area_23.Area)
replace_nulls = ReplaceNulls(Items=merge_5, Replacements=Slider(0, range=0..100))  # -> Items, Count
mass_addition_10 = MassAddition(Input=replace_nulls.Items)  # -> Result, PartialResults
max_5 = Slider(0.35, range=0..1)
min_5 = Slider(0.28, range=0..1)
panel_57 = Panel(mass_addition_10.Result)
division_32 = Division(A=mass_addition_10.Result, B=area_23.Area)
subtraction_11 = Subtraction(A=max_5, B=min_5)
i_o_2 = Panel(division_32)
expression_10 = Expression(B=division_32, max=max_5, min=min_5, x=subtraction_11, Expression="(Sqrt(B)-0.3)/x")
panel_58 = Panel("B minimize")
panel_59 = Panel(expression_10)

# ---- group: ExcelWriter / I.O.
num_4 = Number(division_32)

# ----
area_24 = Area(Geometry=region_difference)  # -> Area, Centroid
mass_addition_11 = MassAddition(Input=area_24.Area)  # -> Result, PartialResults

# ---- group: ExcelWriter / AptosXTorre
ma = MassAddition(Input=area_7.Area)  # -> Result, PartialResults
division_33 = Division(A=ma.Result, B=áreaapto)
round_10 = Round(Number=division_33)  # -> Nearest, Floor, Ceiling

# ---- group: ExcelWriter / RelaciónParqueaderos/Aptos
ma_2 = MassAddition(Input=flatten(round_10.Nearest))  # -> Result, PartialResults
division_34 = Division(A=int_3, B=ma_2.Result)

# ---- group: ExcelWriter / RelaciónParqueaderos/Visitantes
ma_3 = MassAddition(Input=flatten(round_10.Nearest))  # -> Result, PartialResults
division_35 = Division(A=round_7.Nearest, B=ma_3.Result)

# ---- group: ExcelWriter / NúmeroTotalAptos
int_4 = Integer(ma_3.Result)

# ---- group: ExcelWriter / AislamientoMinimoEntreTorres
num_5 = Number(division_16)

# ---- group: ExcelWriter
panel_60 = Panel(num_3)
merge_6 = Merge(
    Data1=num,
    Data2=num_2,
    Data3=num_3,
    Data4=num_4,
    Data5=int_4,
    Data6=int_3,
    Data7=round_7.Nearest,
    Data8=round_8.Nearest,
    Data9=int,
    Data10=division_34,
    Data11=division_35,
    Data12=area_19.Area,
    Data13=number_slider_9)
panel_61 = Panel("""Área bruta m2
Área neta urbanizable m2
I.C.
I.O.
Número total aptos.
Parqueaderos privados
Parqueaderos visitantes
Parqueaderos movilidad reducida
Número pisos parqueadero
Relación parqueadero/aptos.
Relación parqueadero/visitantes
Área equipamiento comunal m2
Aislamientos comunal m""")
anchoslargos = CSharpScript(plantas=list_item_14)  # -> ancho, largo; inputs plantas: tree of Rectangle3d
# ---------- anchoslargos: C# ----------
    DataTree<double> anchosOut = new DataTree<double>(), largosOut = new DataTree<double>();

    Rectangle3d temp = new Rectangle3d();

    GH_Path path = new GH_Path();

    for( int i = 0; i < plantas.BranchCount; ++i )
    {

      path = plantas.Path(i);

      for( int j = 0; j < plantas.Branch(i).Count; ++j )
      {

        temp = plantas.Branch(i)[j];
        
        anchosOut.Add(temp.Width, path);
        largosOut.Add(temp.Height, path);

      }

    }

    ancho = anchosOut;
    largo = largosOut;
# ---------- end anchoslargos ----------
panel_63 = Panel(anchoslargos.largo)
data = Data(merge_6)
panel_64 = Panel("""Ancho m
Largo m
Pisos
Aislamientos m
Aptos
Altura m""")
button = Button()
c_script_2 = CSharpScript(
    x=data,
    y=flatten(anchoslargos.ancho),
    z=flatten(anchoslargos.largo),
    u=flatten(lng),
    v=flatten(num_5),
    w=flatten(round_10.Nearest),
    xx=flatten(vec2pt.Length))  # -> out, A; inputs x: list, y: list, z: list, u: list, v: list, w: list, xx: list
# ---------- c_script_2: C# ----------
    var treeOut = new DataTree<object>();

    treeOut.AddRange(x, new GH_Path(0));

    for( int i = 0; i < x.Count; ++i )
    {

      treeOut.Add(null, new GH_Path(1));
      treeOut.Add(null, new GH_Path(2));
      treeOut.Add(null, new GH_Path(3));
      treeOut.Add(null, new GH_Path(4));
      treeOut.Add(null, new GH_Path(5));
      treeOut.Add(null, new GH_Path(6));

    }

    treeOut.AddRange(y, new GH_Path(1));
    treeOut.AddRange(z, new GH_Path(2));
    treeOut.AddRange(u, new GH_Path(3));
    treeOut.AddRange(v, new GH_Path(4));
    treeOut.AddRange(w, new GH_Path(5));
    treeOut.AddRange(xx, new GH_Path(6));

    A = treeOut;
# ---------- end c_script_2 ----------
lng_3 = ListLength(List=flatten(num_5))
c_script_3 = CSharpScript(x=panel_61, y=lng_3)  # -> out, A; inputs x: list, y: Int32
# ---------- c_script_3: C# ----------
    for( int i = 1; i <= y; ++i )
    {

      string str = "Torre " + i.ToString();

      x.Add(str);

    }

    A = x;
# ---------- end c_script_3 ----------
writexl = WriteToExcel(
    Run=Toggle(False),
    ExcelWorksheet="1",
    ColumnNames=panel_64,
    RowNames=c_script_3.A,
    WriteOptions="None",
    ColumnnsOrRows=False,
    DataToWriteIntoColumns=c_script_2.A)
panel_65 = Panel(c_script_3.A)
panel_66 = Panel(c_script_2.A)

# ----
# colisiones
curve_14 = Curve(flatten([scale_nu.Geometry, offset, geometry_3]))
curve_15 = Curve(flatten([list_item_14, region_union, list_item_20, geometry_3]))
area_25 = Area(Geometry=geometry_3)  # -> Area, Centroid
max_6 = Slider(9, range=0..9)
min_6 = Slider(0, range=0..9)
max_7 = Slider(1, range=0..1)
min_7 = Slider(0, range=0..10)
subtraction_12 = Subtraction(A=max_6, B=min_6)
subtraction_13 = Subtraction(A=max_7, B=min_7)
panel_67 = Panel("D minmize")
panel_68 = Panel("C minimize")

region_union_3 = RegionUnion(Curves=flatten(curve_14))
collision_many_many = CollisionManyMany(Colliders=curve_15)  # -> Collision, Indices
area_26 = Area(Geometry=flatten(region_union_3))  # -> Area, Centroid
dispatch = Dispatch(List=curve_15, DispatchPattern=collision_many_many.Collision)  # -> ListA, ListB
mass_addition_12 = MassAddition(Input=area_26.Area)  # -> Result, PartialResults
division_36 = Division(A=mass_addition_11.Result, B=area_25.Area)
list_length_4 = ListLength(List=dispatch.ListB)
list_length_5 = ListLength(List=dispatch.ListA)
panel_69 = Panel(division_36)
division_37 = Division(A=mass_addition_12.Result, B=mass_addition_2.Result)
mass_addition_13 = MassAddition(Input=list_length_5)  # -> Result, PartialResults
expression_11 = Expression(G=division_36, max=max, min=min, x=subtraction, Expression="(Sqrt(G) - 0.5)/x")

expression_12 = Expression(D=mass_addition_13.Result, max=max_6, min=min_6, x=subtraction_12, Expression="(D - 0)/x")
expression_13 = Expression(C=division_37, max=max_7, min=min_7, x=subtraction_13, Expression="(C-0.15)/x")
panel_70 = Panel(division_37)
panel_71 = Panel(expression_12)
panel_72 = Panel(expression_13)

panel_73 = Panel(expression_11)

# ---- group: fitnessFunction
expression_14 = Expression(
    A=expression_7,
    B=expression_10,
    C=expression_13,
    D=expression_12,
    E=expression_9,
    F=expression_8,
    G=expression_11,
    Expression="A-B-D+E+F-G")

# ----
panel_74 = Panel(expression_14)
