# Grasshopper definition ResearchAndDevelopment.gh (Grasshopper 1.0.7)
# plug-ins: SpacePartition, Human

# ---- group: SeedPoints
number_slider = Slider(5, range=0..10)
dom = ConstructDomain(DomainStart=Slider(0, range=0..100), DomainEnd=Slider(1, range=0..1))
genemodifier = GenePoolModifier(
    GeneList="XOriginal",
    Count=number_slider,
    Domain=dom,
    Randomize=Button(),
    PercentageOfRandomization=Slider(1, range=0..1))
genemodifier_2 = GenePoolModifier(
    GeneList="YOriginal",
    Count=number_slider,
    Domain=dom,
    Randomize=Button(),
    PercentageOfRandomization=Slider(1, range=0..1))
xoriginal = GenePool(Decimals=4, Maximum=1, Minimum=0, Value=[0.3079448386, 0.0656032991, 0.3746236327, 0.5081871238, 0.7843364765])
yoriginal = GenePool(Decimals=4, Maximum=1, Minimum=0, Value=[0.3014191763, 0.4348362537, 0.1246702257, 0.681864234, 0.1002687677])
pt = ConstructPoint(XCoordinate=xoriginal, YCoordinate=yoriginal, ZCoordinate=0)
crv = Curve(<curve referenced from the Rhino model>)
evalsrf = EvaluateSurface(Surface=reparameterize(crv), Point=pt)  # -> Point, Normal, UDirection, VDirection, Frame
srf_cp = SurfaceClosestPoint(Point=evalsrf.Point, Surface=crv)  # -> Point, UVPoint, Distance
pln = Plane(srf_cp.Point)
num = Number(1.112732212)
rotate = Rotate(Geometry=pln, Angle=expr("x-0.5*pi", num), Plane=srf_cp.Point)  # -> Geometry, Transform

# ---- group: PorcentajeCirculacion
number_slider_2 = Slider(0.2, range=0..1)

# ---- group: SameAreaDifferentRatios
txt = Text("Percentage")
number_slider_3 = Slider(573, range=0..1000)
dom_2 = ConstructDomain(DomainStart=Slider(0.6, range=0..1), DomainEnd=Slider(1.572, range=0..10))
genemodifier_3 = GenePoolModifier(GeneList=txt, Count=number_slider, Domain=dom_2, Randomize=Button(), PercentageOfRandomization=Slider(1, range=0..1))
multiplication = Multiplication(A=number_slider_3, B=number_slider_2)
addition = Addition(A=number_slider_3, B=multiplication)
percentage = GenePool(Decimals=2, Maximum=1.572, Minimum=0.6, Value=[0.9277950508, 0.6642206046, 1.18483642, 0.7075372054, 1.083795771])
sqrt = SquareRoot(Value=addition)
multiplication_2 = Multiplication(A=sqrt, B=percentage)
division = Division(A=addition, B=multiplication_2)
multiplication_3 = Multiplication(A=division, B=0.5)
multiplication_4 = Multiplication(A=multiplication_2, B=0.5)
dom_3 = ConstructDomain(DomainStart=expr("-x", multiplication_4), DomainEnd=multiplication_4)
dom_4 = ConstructDomain(DomainStart=expr("-x", multiplication_3), DomainEnd=multiplication_3)
rectangle = Rectangle(Plane=rotate.Geometry, XSize=dom_3, YSize=dom_4, Radius=0)  # -> Rectangle, Length

# ----
rad = Radians(Degrees=Slider(30.728, range=0..360))

# ---- group: Rotations
dom_5 = ConstructDomain(DomainStart=0, DomainEnd=1)
rotations = GenePool(Decimals=0, Maximum=1, Minimum=0, Value=[0.3558625888, 0.2777851109, 0.9437249768, 0.3850133677, 0.05726511639])
genemodifier_4 = GenePoolModifier(
    GeneList="Rotations",
    Count=number_slider,
    Domain=dom_5,
    Randomize=Button(),
    PercentageOfRandomization=Slider(1, range=0..1))
rad_2 = Radians(Degrees=expr("x*90", rotations))
rotate_2 = Rotate(Geometry=rectangle.Rectangle, Angle=rad_2, Plane=rotate.Geometry)  # -> Geometry, Transform
crv_2 = Curve(<curve referenced from the Rhino model>)

# ----
drec = DeconstuctRectangle(Rectangle=crv_2)  # -> BasePlane, XInterval, YInterval
rotate_3 = Rotate(Geometry=drec.BasePlane, Angle=expr("x-0.5*pi", num), Plane=drec.BasePlane)  # -> Geometry, Transform
rectangle_2 = Rectangle(Plane=rotate_3.Geometry, XSize=drec.XInterval, YSize=drec.YInterval, Radius=0)  # -> Rectangle, Length
rotate_4 = Rotate(Geometry=rectangle_2.Rectangle, Angle=rad, Plane=drec.BasePlane)  # -> Geometry, Transform
scale_nu = ScaleNU(
    Geometry=rotate_4.Geometry,
    Plane=drec.BasePlane,
    ScaleX=Slider(0.899, range=0..1),
    ScaleY=Slider(0.873, range=0..1),
    ScaleZ=1)  # -> Geometry, Transform

# ---- group: Rotations (continued)
rint = RegionIntersection(CurvesA=rotate_2.Geometry, CurvesB=scale_nu.Geometry)

# ----
colmm = CollisionManyMany(Colliders=rint)  # -> Collision, Indices

# ---- group: DifferentialHeights
txt_2 = Text("Z")
dom_6 = ConstructDomain(DomainStart=Slider(5, range=0..10), DomainEnd=Slider(10, range=0..10))
genemodifier_5 = GenePoolModifier(GeneList=txt_2, Count=number_slider, Domain=dom_6, Randomize=Button(), PercentageOfRandomization=Slider(1, range=0..1))
Z = GenePool(Decimals=0, Maximum=10, Minimum=5, Value=[6.457290294, 9.164174443, 5.320175169, 8.657019482, 5.503441817])
number_slider_4 = Slider(2.4, range=0..10)
sort = SortList(Keys=Z, ValuesA=Z)  # -> Keys, ValuesA
series = Series(Start=0, Step=number_slider_4, Count=sort.ValuesA)
multiplication_5 = Multiplication(A=number_slider_4, B=sort.ValuesA)
Z_2 = UnitZ(Factor=series)
multiplication_6 = Multiplication(A=multiplication_5, B=Slider(0.2, range=0..1))
multiplication_7 = Multiplication(A=multiplication_5, B=Slider(0.3333, range=0..1))
move = Move(Geometry=graft(rint), Motion=Z_2)  # -> simplify(Geometry), Transform

# ----
shift = ShiftList(List=rint, Shift=1, Wrap=True)
panel = Panel(colmm.Indices)
ccx = CurveCurve(CurveA=rint, CurveB=shift, UseTasks=False)  # -> Points, ParamsA, ParamsB
crv_3 = Curve(move.Geometry)

# ---- group: CustomContour
c_script = CSharpScript(curveTree=crv_3)  # -> indexPattern; inputs curveTree: tree of Curve
# ---------- c_script: C# ----------
    double maxZ = 0.0, minZ = 0.0;

    List<int> indexes = new List<int>();

    int branches = curveTree.BranchCount;

    indexes.Add(0);

    for( int i = 0; i < branches - 1; ++i )
    {

      maxZ = AreaMassProperties.Compute(curveTree.Branch(i)[curveTree.Branch(i).Count - 1]).Centroid.Z;

      minZ = AreaMassProperties.Compute(curveTree.Branch(i + 1)[curveTree.Branch(i).Count - 1]).Centroid.Z;

      for( int j = 0; j < curveTree.Branch(i).Count; ++j )
      {

        double Z = AreaMassProperties.Compute(curveTree.Branch(i)[j]).Centroid.Z;

        if( Z <= maxZ && Z >= minZ || Z == maxZ || Z == minZ )
        {

          indexes.Add(j);

        }

      }

    }

    maxZ = AreaMassProperties.Compute(curveTree.Branch(branches - 1)[curveTree.Branch(branches - 1).Count - 1]).Centroid.Z;
    minZ = AreaMassProperties.Compute(curveTree.Branch(branches - 2)[curveTree.Branch(branches - 2).Count - 1]).Centroid.Z;

    for( int i = 0; i < curveTree.Branch(branches - 1).Count; ++i )
    {

      double Z = AreaMassProperties.Compute(curveTree.Branch(branches - 1)[i]).Centroid.Z;

      if( Z <= maxZ && Z >= minZ && i == curveTree.Branch(branches - 1).Count - 1 )
      {

        indexes.Add(i);

      }

    }

    int fromI = 0, toI = 1;

    DataTree<int> dataOut = new DataTree<int>();
    int pather = 0;

    int countIndexes = indexes.Count, tempoCount = 0;

    for( int i = 2; i < countIndexes; ++i )
    {

      tempoCount++;

    }


    countIndexes += tempoCount;

    indexPattern = countIndexes;

    for( int i = 0; i < countIndexes; ++i )
    {

      var path = new GH_Path(pather);

      if( i % 2 == 0 )
      {

        dataOut.Add(indexes[fromI], path);
        dataOut.Add(indexes[toI], path);
        fromI++;
        toI++;
        pather++;

      }

    }
/*
    for( int i = 0; i < dataOut.BranchCount; ++i )
    {

      for( int j = 0; j < 2; ++j )
      {

        if( i % 2 != 1 && j % 2 != 0 )
        {

          dataOut.Branch(i)[j]--;

        }

      }

    }
*/
    indexPattern = dataOut;

   /* var finalTree = new DataTree<int>(); int pathF = 0;

    for( int i = 0; i < dataOut.BranchCount; ++i )
    {

      //if( dataOut.Branch(i)[0] != dataOut.Branch(i)[1] )
      {

        if( i != 0 ) dataOut.Branch(i)[0]++;

        if( i != dataOut.BranchCount - 1 && i != 0  ) dataOut.Branch(i)[1]++;

        finalTree.AddRange(dataOut.Branch(i), new GH_Path(pathF));

        pathF++;

      }

    }

    indexPattern = finalTree;*/
# ---------- end c_script ----------
c_script_2 = CSharpScript(curveTree=crv_3, frameTree=crv_3, indexes=c_script)  # -> out, A, B; inputs curveTree: tree of Curve, frameTree: tree of Plane, indexes: tree of Int32
# ---------- c_script_2: C# ----------
    var curvesOut = new DataTree<Curve>();
    var planesOut = new DataTree<Plane>();
    int tracker = 0;

    GH_Path pathy = new GH_Path();
    int minIndex = 0, maxIndex = 0;

    for( int i = 0; i < curveTree.BranchCount; ++i )
    {

      for( int k = 0; k < curveTree.BranchCount; ++k )
      {

        pathy = new GH_Path(k);

        minIndex = indexes.Branch(k)[0];

        maxIndex = indexes.Branch(k)[1];

        if( minIndex != maxIndex )
        {

          for( int j = minIndex; j < maxIndex + 1; ++j )
          {

            if( k != 0 )
            {

              if( i > tracker )
              {

                curvesOut.Add(curveTree.Branch(i)[j], pathy);

              }

            }

            else
            {

              curvesOut.Add(curveTree.Branch(i)[j], pathy);

            }

            tracker = k - 1;

          }

        }

      }

    }

    int initialIndex = 0, finalIndex = 0;

    for( int i = 0; i < indexes.BranchCount; ++i )
    {

      initialIndex = indexes.Branch(i)[0];
      finalIndex = indexes.Branch(i)[1];
      
      //if( indexes.Branch(i)[0] != null ) indexes.Branch(i)[0]++;

      if( initialIndex != finalIndex )
      {

        for( int j = initialIndex; j < finalIndex + 1; ++j )
        {

          planesOut.Add(frameTree.Branch(i)[j], new GH_Path(i));

        }
        
      }

    }

    A = curvesOut;
    B = planesOut;
# ---------- end c_script_2 ----------
cull_i = CullIndex(List=c_script_2.B, Indices=0, Wrap=True)
area = Area(Geometry=c_script_2.A, UseTasks=False)  # -> Area, Centroid
pdecon = Deconstruct(Point=area.Centroid)  # -> XComponent, YComponent, ZComponent
item = ListItem(List=pdecon.ZComponent, Index=0, Wrap=True)
expression = Expression(x=item, y=pdecon.ZComponent, Expression="If( ( y - x ) < 0.01, False, True )")
cull = CullPattern(List=c_script_2.A, CullPattern=expression)
runion = RegionUnion(Curves=cull, Plane=cull_i)  # -> simplify(Result)
runion_2 = RegionUnion(Curves=rint)
area_2 = Area(Geometry=runion_2, UseTasks=False)  # -> Area, Centroid
c_script_3 = CSharpScript(x=runion_2, y=runion)  # -> A; inputs x: list of Curve, y: tree of Curve
# ---------- c_script_3: C# ----------
    var treeOut = new DataTree<Curve>();
    
    treeOut.AddRange( x, new GH_Path( 0 ) );
    
    for( int i = 0; i < y.BranchCount; ++i )
    {
    
      treeOut.AddRange( y.Branch(i), new GH_Path(i+1) );
    
    }
    
    A = treeOut;
# ---------- end c_script_3 ----------

# ----
multiplication_8 = Multiplication(A=sort.ValuesA, B=0.3333)
offset = OffsetCurve(Curve=rint, Distance=multiplication_7, Plane=PlaneXY(0, 0, 0), Corners=1)
item_2 = ListItem(List=runion_2, Index=Slider(1, range=0..5), Wrap=True)
shift_2 = ShiftList(List=runion_2, Shift=1, Wrap=True)
crvprox = CurveProximity(CurveA=runion_2, CurveB=shift_2)  # -> PointA, PointB, Distance
panel_2 = Panel(crvprox.Distance)
ln = Line(StartPoint=crvprox.PointA, EndPoint=crvprox.PointB)

# ---- group: Volumes
loft = Loft(Curves=crv_3, Options={Adjust=False, Closed=False, LoftEnds=0, LoftSimp=0, LoftType=0, Rebuild=10, Refit=0.01})
cap = CapHoles(Brep=loft)  # -> flatten(Brep)
frgb = ColourRGBF(Alpha=Slider(0.359, range=0..1), Red=Slider(1, range=0..1), Green=Slider(1, range=0..1), Blue=Slider(1, range=0..1))
sunion = SolidUnion(Breps=cap)
preview = CustomPreview(Geometry=sunion, Material=frgb)

# ---- group: Alturas
debrep = DeconstructBrep(Brep=sunion)  # -> Faces, Edges, Vertices
area_3 = Area(Geometry=debrep.Faces)  # -> Area, Centroid
pdecon_2 = Deconstruct(Point=area_3.Centroid)  # -> XComponent, YComponent, ZComponent
sort_2 = SortList(Keys=pdecon_2.ZComponent, ValuesA=area_3.Centroid)  # -> Keys, ValuesA
lng = ListLength(List=sort_2.Keys)
item_3 = ListItem(List=sort_2.ValuesA, Index=expr("0", lng), Wrap=True)
item_4 = ListItem(List=sort_2.ValuesA, Index=expr("x-1", lng), Wrap=True)
vec2pt = Vector2Pt(PointA=item_3, PointB=item_4, Unitize=False)  # -> Vector, Length
num_2 = Number(flatten(vec2pt.Length))
vdis = VectorDisplay(Anchor=item_3, Vector=vec2pt.Vector)

# ----
item_5 = ListItem(List=num_2, Index=Slider(1, range=0..5), Wrap=True)
multiplication_9 = Multiplication(A=num_2, B=0.3333)
panel_3 = Panel(multiplication_9)

# ---- group: Lote
crv_4 = Curve(<curve referenced from the Rhino model>)
crv_5 = Curve(<curve referenced from the Rhino model>)
area_4 = Area(Geometry=runion_2, UseTasks=False)  # -> Area, Centroid
area_5 = Area(Geometry=crv_4, UseTasks=False)  # -> Area, Centroid
area_6 = Area(Geometry=crv_5, UseTasks=False)  # -> Area, Centroid
ma = MassAddition(Input=flatten(area_4.Area))  # -> Result, PartialResults
panel_4 = Panel(area_5.Area)
panel_5 = Panel(area_6.Area)

# ---- group: I.O
ma_2 = MassAddition(Input=area_2.Area)  # -> Result, PartialResults
multiplication_10 = Multiplication(A=ma_2.Result, B=number_slider_2)
subtraction = Subtraction(A=ma_2.Result, B=multiplication_10)
ma_3 = MassAddition(Input=subtraction)  # -> Result, PartialResults
division_2 = Division(A=ma_3.Result, B=area_5.Area)
panel_6 = Panel(division_2)
expression_2 = Expression(
    x=division_2,
    y=Slider(0.31, range=0..10),
    z=Slider(0.24, range=0..1),
    Expression="If( ( x ≤ y ) and ( x ≥ z ), 0, 10000 )")

# ---- group: AreaPlanta
area_7 = Area(Geometry=runion_2, UseTasks=False)  # -> Area, Centroid
panel_7 = Panel(area_7.Area)

# ---- group: Floors
area_8 = Area(Geometry=c_script_3, UseTasks=False)  # -> Area, Centroid
flatten = FlattenTree(Tree=c_script_3, Path="{0}")
crv_6 = Curve(flatten)
frgb_2 = ColourRGBF(Alpha=Slider(1, range=0..1), Red=Slider(0, range=0..1), Green=Slider(0, range=0..1), Blue=Slider(0, range=0..1))
ma_4 = MassAddition(Input=flatten(area_8.Area))  # -> Result, PartialResults
previewlw = CustomPreviewLineweights(Geometry=crv_6, Shader=frgb_2, Thickness=Slider(5, range=0..10), Absolute=False)
panel_8 = Panel(ma_4.Result)
cull_i_2 = CullIndex(List=area_8.Area, Indices=Slider(0, range=0..100), Wrap=True)

# ---- group: Floors / ÁreaXTorre
ma_5 = MassAddition(Input=cull_i_2)  # -> simplify(flatten(Result)), PartialResults

# ---- group: Floors / ÁreaTotal
ma_6 = MassAddition(Input=flatten(cull_i_2))  # -> Result, PartialResults

# ---- group: Floors (continued)
panel_9 = Panel(ma_6.Result)

# ---- group: AreaVendible
multiplication_11 = Multiplication(A=ma_6.Result, B=number_slider_2)
subtraction_2 = Subtraction(A=ma_6.Result, B=multiplication_11)
panel_10 = Panel(subtraction_2)

# ---- group: I.C
division_3 = Division(A=subtraction_2, B=area_5.Area)
panel_11 = Panel(division_3)
expression_3 = Expression(
    x=division_3,
    y=Slider(2.4, range=0..10),
    z=Slider(1.7, range=0..10),
    Expression="If( ( x ≤ y ) and ( x ≥ z ), 0, 100000 )")
